# Grasshopper definition TestConnection.gh (Grasshopper 1.0.7)
# Copyright: 2021
# Copyright: 2022-28-21
# Copyright: 2022-06-43
# plug-ins: GrasshopperRadianceLinuxConnector, LadybugGrasshopper, Human, HDTTreeUtils, jSwan

# ----
# Setup globals
panel = Panel("""proj
projname
projfolder
cpus""")
panel_2 = Panel("""~/simulation/test_project2
test_project2
simulation/test_project2
7""")
globals = SetupGlobals(Keys=panel, Values=panel_2)
panel_3 = Panel(globals)

# ----
# Connect
panel_4 = Panel("mss")
connect_ssh = ConnectSSH(User=panel_4, Ip="127.0.0.1", Password="_prompt", _port=22, Connect=Toggle(True))  # -> Status, Run
panel_5 = Panel(connect_ssh.Status)

od_outdated = ColourSwatch(SwatchColor=RGBA(97, 97, 97, 150))
u_updated = ColourSwatch(SwatchColor=RGBA(208, 115, 230, 112))
g_general = ColourSwatch(SwatchColor=RGBA(245, 243, 237, 156))
o_outputs = ColourSwatch(SwatchColor=RGBA(160, 218, 242, 203))
s_settings = ColourSwatch(SwatchColor=RGBA(224, 145, 81, 154))
toggle = BooleanToggle(True)
y_yellow = ColourSwatch(SwatchColor=RGBA(247, 244, 64, 188))
i_inputs = ColourSwatch(SwatchColor=RGBA(125, 217, 98, 150))
c_core = ColourSwatch(SwatchColor=RGBA(235, 227, 206, 203))
r_red = ColourSwatch(SwatchColor=RGBA(242, 63, 63, 203))

# ----
# Test connection
testconnection = TestConnection()  # -> Status, Errors
panel_6 = Panel(testconnection.Status)
panel_7 = Panel(testconnection.Errors)

colorgroups = CSharpScript(
    Colors=[i_inputs, s_settings, g_general, c_core, o_outputs, r_red, y_yellow, u_updated, od_outdated],
    Enable=toggle,
    Rename=Toggle(False),
    RunOnce=Button(),
    Debug=Toggle(False))  # -> out; inputs Colors: list of Color, Enable: Boolean, Rename: Boolean, RunOnce: Boolean, Debug: Boolean
# ---------- colorgroups: C# usings ----------
using System.Linq;
using System.Text;
using System.Reflection;
# ---------- colorgroups: C# ----------
    msg.Clear();


    this.Component.Message = "id: " + id.ToString();

    _debug = Debug; //Set to true to have all events printed in rhino log
    _rename = Rename;

    if (Enable)
    {
      msg.AppendFormat("Set up events on ID {0}\n", id);
      SetupDict(); // Create a dictionary of the input swatches
      SetEventHandlers(); // This would do the job.


    }
    else
    {
      RemoveEventHandlers();
    }
    if (RunOnce)
    {
      foreach(Grasshopper.Kernel.Special.GH_Group grp in Grasshopper.Instances.ActiveCanvas.Document.Objects.OfType<Grasshopper.Kernel.Special.GH_Group>())
      {
        ColorGroup(grp, null); // You decide if it should run once on all existing groups

      }
    }

    Print(msg.ToString());


    // Component setup
    Component.Description = "Set up event handlers to color groups based on prefixes such as 'in_' and 'out_'.\n"
      + "Please insert only swatcheds directly into the Colors input\n\n"
      + "MIT License. Copyright Mathias Sønderskov Schaltz 2022";
    Component.Params.Input[0].Description = "Please insert only swatcheds directly into the Colors input.\nRemember to rename them";
    Component.Params.Input[1].Description = "Toggle to run...";
    Component.Params.Input[2].Description = "Set to true if you want to automatically rename the groups and remove prefix. Default is false.";
    Component.Params.Input[3].Description = "Set to true to run it once and color all existing groups.";
    Component.Params.Input[Component.Params.Input.Count - 1].Description = "Set debug to true to get all the events printed in the rhino log";
# ---------- colorgroups: C# additional code ----------
  public static Random rnd = new Random();
  public int id = rnd.Next(0, 1000);
  StringBuilder msg = new StringBuilder();
  Dictionary<string, System.Drawing.Color> colorDict = new Dictionary<string, System.Drawing.Color>();

  bool _debug = false;
  bool _rename = false;

  public bool IdExists(int id)
  {
    IList<IGH_DocumentObject> objs = Grasshopper.Instances.ActiveCanvas.Document.Objects;
    return objs
      .OfType<IGH_Component>()
      .Where(ob => ob.NickName == this.Component.NickName)
      .Where(ob => ob.GetType().ToString() == "ScriptComponents.Component_CSNET_Script")
      .Where(ob => ob.Message == "id: " + id.ToString()).Any();

  }


  public void SetupDict()
  {
    colorDict.Clear();
    // Get all inputs to "Colors"
    IList<IGH_Param> colorSources = this.Component.Params.Input[0].Sources;
    if (colorSources.Count == 0)
    {
      throw new Exception("You forgot to setup the colors. Please input swatch components and rename them");
    }
    foreach(IGH_Param source in colorSources)
    {
      //if (source.Type.ToString() == "Grasshopper.Kernel.Types.GH_Colour")
      if (source is Grasshopper.Kernel.Special.GH_ColourSwatch)
      {
        string nickName = source.NickName.Split('_')[0].Trim() + "_";
        if(!colorDict.ContainsKey(nickName))
        {
          Grasshopper.Kernel.Special.GH_ColourSwatch swatch = (Grasshopper.Kernel.Special.GH_ColourSwatch) source;
          colorDict.Add(nickName, swatch.SwatchColour);
        }
        else
        {
          throw new Exception("Multiple swatches using the same name detected. Please rename");
        }
      }
      else
      {
        throw new Exception("Whacko! Why did you input a non-swatch into the Colors? " + source.Type.ToString());
      }

    }

    msg.AppendFormat("Set up the dictionaries with {0} colors\n", colorDict.Count);
    foreach(var pairs in colorDict)
    {
      msg.AppendFormat("{0} -> {1}\n", ("\"" + pairs.Key + "\"").PadRight(5 + colorDict.Keys.Select(k => k.Length).Max()), pairs.Value);
    }
  }

  public void SetEventHandlers()
  {

    // Always remove events first to avoid duplicates
    GrasshopperDocument.ObjectsAdded -= OnObjectsAdded;
    GrasshopperDocument.ObjectsDeleted -= OnObjectsRemoved;
    GrasshopperDocument.ObjectsDeleted -= OnDeleteThisComponent;

    // Attach events
    GrasshopperDocument.ObjectsAdded += OnObjectsAdded;
    GrasshopperDocument.ObjectsDeleted += OnObjectsRemoved;
    GrasshopperDocument.ObjectsDeleted += OnDeleteThisComponent;


    foreach(Grasshopper.Kernel.Special.GH_Group grp in GrasshopperDocument.Objects.OfType<Grasshopper.Kernel.Special.GH_Group>())
    {
      grp.ObjectChanged -= ColorGroup;
      grp.ObjectChanged += ColorGroup;

      //ColorGroup(grp, null); // Make sure to run it once
    }
    msg.AppendFormat("Added the eventhandlers on {0} existing groups and on future created groups\n", GrasshopperDocument.Objects.OfType<Grasshopper.Kernel.Special.GH_Group>().Count());
  }

  public void OnObjectsAdded(object sender, GH_DocObjectEventArgs e)
  {
    bool any = false;
    foreach (Grasshopper.Kernel.Special.GH_Group grp in e.Objects.OfType<Grasshopper.Kernel.Special.GH_Group>())
    {
      grp.ObjectChanged -= ColorGroup;
      grp.ObjectChanged += ColorGroup;
      any = true;
    }

    DebugWrite(any ? "Group Objects Added: Attaching Events to ObjectChanged" : "Objects Added - but no groups");
  }

  //Same but reversed
  public void OnObjectsRemoved(object sender, GH_DocObjectEventArgs e)
  {
    bool any = false;
    foreach (Grasshopper.Kernel.Special.GH_Group grp in e.Objects.OfType<Grasshopper.Kernel.Special.GH_Group>())
    {
      grp.ObjectChanged -= ColorGroup;
      any = true;
    }

    DebugWrite(any ? "Group Objects Removed, removing event" : "Objects Removed - although not a group");

  }



  public void RemoveEventHandlers()
  {
    GrasshopperDocument.ObjectsAdded -= OnObjectsAdded;
    GrasshopperDocument.ObjectsDeleted -= OnObjectsRemoved;


    foreach(Grasshopper.Kernel.Special.GH_Group grp in GrasshopperDocument.Objects.OfType<Grasshopper.Kernel.Special.GH_Group>())
    {
      grp.ObjectChanged -= ColorGroup;

    }
    msg.AppendFormat("Removed event handlers on document and on {0} groups\n", GrasshopperDocument.Objects.OfType<Grasshopper.Kernel.Special.GH_Group>().Count());

  }

  public void ColorGroup(object sender, EventArgs e)
  {
    if (!IdExists(id))
    {
      DebugWrite("Component not relevant. Disabling old id + " + id.ToString());
      RemoveEventHandlers();
      return;
    }

    Grasshopper.Kernel.Special.GH_Group grp = sender as Grasshopper.Kernel.Special.GH_Group;
    if (grp == null) return; //not type GH_Group
    //if (!grp.NickName.EndsWith("_")) return;

    string[] nameParts = grp.NickName.Split('_');
    if (nameParts.Length <= 1)
      return;
    string prefix = grp.NickName.Split('_')[0].Trim() + '_';

    string prefixes = String.Join(", ", colorDict.Keys.Select(k => "\"" + k + "\""));

    msg.Append("prefix " + prefix + "\n");
    if (colorDict.ContainsKey(prefix))
    {
      //if (grp.NickName.EndsWith("_"))
      grp.Colour = colorDict[prefix];
      if (_rename)
      {
        grp.NickName = grp.NickName.Replace(prefix, "");
      }

      DebugWrite("Colored " + grp.NickName);

    }
    else
    {
      DebugWrite("Group changed but not relevant: prefix " + prefix + " is not among " + prefixes);
    }

  }
  public void DebugWrite(string msg)
  {
    if (_debug)
    {
      Rhino.RhinoApp.WriteLine(String.Format("[ColGrps {0}]: {1}", id, msg));
    }
  }

  public void OnDeleteThisComponent(object sender, GH_DocObjectEventArgs e)
  {

    if (e.Objects.OfType<Grasshopper.Kernel.GH_Component>().Where(o => o.NickName == this.Component.NickName).Any())
    {
      DebugWrite("Removed template component. Removing all the eventhandlers");
      RemoveEventHandlers();
    }

  }
# ---------- end colorgroups ----------

fixparams = CSharpScript(FixOnce=Button(), Enable=toggle, Debug=Toggle(False))  # -> out; inputs FixOnce: Boolean, Enable: Boolean, Debug: Boolean
# ---------- fixparams: C# usings ----------
using System.Text;
using System.Linq;
using Grasshopper.Kernel.Special;
# ---------- fixparams: C# ----------
    _debug = Debug;
    _enable = Enable;
    msg.Clear();
    this.Component.Message = "id: " + id.ToString();




    if (Enable)
    {
      SetEventHandlers();
    }
    else
    {
      RemoveEventHandlers();
    }


    if (FixOnce)
    {
      FixAll();
    }

    Print(msg.ToString());

    // Component setup
    Component.Description = "Set up event handlers to change params to show nickname and not icon"
      + "\n\n"
      + "MIT License. Copyright Mathias Sønderskov Schaltz 2022";
    Component.Params.Input[0].Description = "Run me once on the document";
    Component.Params.Input[1].Description = "Toggle to enable event listener";
    Component.Params.Input[Component.Params.Input.Count - 1].Description = "Set debug to true to get all the events printed in the rhino log";
# ---------- fixparams: C# additional code ----------
  public static Random rnd = new Random();
  public int id = rnd.Next(0, 1000);
  StringBuilder msg = new StringBuilder();
  bool _debug = false;
  bool _enable = false;

  public Dictionary<IGH_ActiveObject, HashSet<GH_Group>> groupsPerObject = new Dictionary<IGH_ActiveObject, HashSet<GH_Group>>();


  public void OnObjectsAdded(object sender, GH_DocObjectEventArgs e)
  {
    if (!IdExists(id))
    {
      DebugWrite("[FixParam] Component not relevant. Disabling old id " + id.ToString());
      RemoveEventHandlers();
      return;
    }


    if(_enable)
    {
      foreach(IGH_Param par in e.Objects.OfType<IGH_Param>())
      {
        FixInputs(par);
      }
    }


  }

  public void FixAll()
  {
    //DebugWrite("Fixing all?");
    foreach(IGH_Param par in GrasshopperDocument.Objects.OfType<IGH_Param>())
    {

      FixInputs(par);
    }
  }




  public void FixInputs(IGH_ActiveObject obj)
  {



    IGH_Param par = obj as IGH_Param;
    if (par != null)
    {

      par.IconDisplayMode = GH_IconDisplayMode.name;


    }

  }


  public void SetEventHandlers()
  {

    GrasshopperDocument.ObjectsAdded -= OnObjectsAdded;
    GrasshopperDocument.ObjectsAdded += OnObjectsAdded;
    GrasshopperDocument.ObjectsDeleted -= OnDeleteThisComponent;
    GrasshopperDocument.ObjectsDeleted += OnDeleteThisComponent;
    msg.AppendFormat("Added the eventhandlers to OnObjectsAdded\n", GrasshopperDocument.Objects.OfType<Grasshopper.Kernel.Special.GH_Group>().Count());
  }

  public void RemoveEventHandlers()
  {
    GrasshopperDocument.ObjectsAdded -= OnObjectsAdded;
    GrasshopperDocument.ObjectsDeleted -= OnDeleteThisComponent;

    msg.AppendFormat("Removed wire event handlers on document\n", GrasshopperDocument.Objects.OfType<Grasshopper.Kernel.Special.GH_Group>().Count());

  }

  public void OnDeleteThisComponent(object sender, GH_DocObjectEventArgs e)
  {

    if (e.Objects.OfType<Grasshopper.Kernel.GH_Component>().Where(o => o.NickName == this.Component.NickName).Any())
    {
      DebugWrite("Removed template component. Removing all the eventhandlers");
      RemoveEventHandlers();
    }

  }

  public bool IdExists(int id)
  {
    IList<IGH_DocumentObject> objs = Grasshopper.Instances.ActiveCanvas.Document.Objects;
    return objs
      .OfType<IGH_Component>()
      .Where(ob => ob.NickName == this.Component.NickName)
      .Where(ob => ob.GetType().ToString() == "ScriptComponents.Component_CSNET_Script")
      .Where(ob => ob.Message == "id: " + id.ToString()).Any();

  }

  public void DebugWrite(string msg)
  {
    if (_debug)
    {
      Rhino.RhinoApp.WriteLine(String.Format("[FixParams {0}]: {1}", id, msg));
    }
  }
# ---------- end fixparams ----------

fixwires = CSharpScript(FixOnce=Button(), Enable=toggle, Debug=Toggle(False))  # -> out; inputs FixOnce: Boolean, Enable: Boolean, Debug: Boolean
# ---------- fixwires: C# ----------
    _debug = Debug;
    _enable = Enable;
    msg.Clear();
    this.Component.Message = "id: " + id.ToString();


    SetDictionary();

    if (Enable)
    {
      SetEventHandlers();
    }
    else
    {
      RemoveEventHandlers();
    }


    if (FixOnce)
    {
      FixAll();
    }

    Print(msg.ToString());
    
    // Component setup
    Component.Description = "Set up event handlers to change all wire types across groups to faint"
      + "\n\n"
      + "MIT License. Copyright Mathias Sønderskov Schaltz 2022";
    Component.Params.Input[0].Description = "Run me once on the document";
    Component.Params.Input[1].Description = "Toggle to enable event listener";
    Component.Params.Input[Component.Params.Input.Count - 1].Description = "Set debug to true to get all the events printed in the rhino log";
# ---------- fixwires: C# additional code ----------
  public static Random rnd = new Random();
  public int id = rnd.Next(0, 1000);
  StringBuilder msg = new StringBuilder();
  bool _debug = false;
  bool _enable = false;

  public Dictionary<IGH_ActiveObject, HashSet<GH_Group>> groupsPerObject = new Dictionary<IGH_ActiveObject, HashSet<GH_Group>>();


  public void OnSolutionExpired(object sender, GH_DocUndoEventArgs e)
  {
    if(_enable)
      FixAll();
  }

  public void FixAll()
  {
    //DebugWrite("Fixing all?");
    foreach(IGH_ActiveObject key in groupsPerObject.Keys.Where(k => groupsPerObject[k].Count() > 0))
    {

      FixInputs(key);
    }
  }



  public bool HasGroup(IGH_ActiveObject obj)
  {
    return groupsPerObject[obj].Count > 0;
  }


  public void FixInputs(IGH_ActiveObject obj)
  {

    if (!IdExists(id))
    {
      DebugWrite("Component not relevant. Disabling old id " + id.ToString());
      RemoveEventHandlers();
      return;
    }

    //List<List<IGH_ActiveObject>> parents = new List<List<IGH_ActiveObject>>();
    IGH_Param par = obj as IGH_Param;
    if (par != null && par.Sources != null)
    {


      IEnumerable<IGH_ActiveObject> p = par.Sources.Select(s => s.Attributes.GetTopLevel.DocObject as IGH_ActiveObject);
      //parents.Add(p);
      if(HasGroup(obj) && p.All(o => !HasGroupsInCommon(o, obj)) && par.WireDisplay != GH_ParamWireDisplay.faint)
      {
        DebugWrite("Fixing " + par.Attributes.GetTopLevel.DocObject.NickName);
        par.WireDisplay = GH_ParamWireDisplay.faint;
      }

    }

    IGH_Component comp = obj as IGH_Component;
    if (comp != null)
    {
      foreach(IGH_Param inp in comp.Params.Input)
      {

        IEnumerable<IGH_ActiveObject> p = inp.Sources.Select(i => i.Attributes.GetTopLevel.DocObject as IGH_ActiveObject);

        if(HasGroup(obj) && p.All(o => !HasGroupsInCommon(o, obj)) && inp.WireDisplay != GH_ParamWireDisplay.faint)
        {
          DebugWrite("Fixing " + inp.Attributes.GetTopLevel.DocObject.NickName);
          inp.WireDisplay = GH_ParamWireDisplay.faint;
        }
      }

    }



  }





  public void SetDictionary()
  {
    IList<IGH_DocumentObject> objects = Grasshopper.Instances.ActiveCanvas.Document.Objects.ToList();
    //Print(String.Join(", ", objects.Select(o => o.NickName)));

    groupsPerObject = objects
      .Where(o => o.GetType() != typeof(GH_Group))
      .OfType<IGH_ActiveObject>()
      .ToDictionary(o => o, o => new HashSet<GH_Group>());

    foreach(GH_Group grp in objects.OfType<GH_Group>())
    {

      foreach(IGH_ActiveObject obj in grp.ObjectsRecursive().OfType<IGH_ActiveObject>())
      {
        groupsPerObject[obj].Add(grp);

      }
    }



  }

  public bool HasGroupsInCommon(IGH_ActiveObject obj1, IGH_ActiveObject obj2)
  {
    HashSet<GH_Group> set1 = groupsPerObject[obj1];
    HashSet<GH_Group> set2 = groupsPerObject[obj2];

    set1.IntersectWith(set2);

    return set1.Any();
  }

  public void SetEventHandlers()
  {

    GrasshopperDocument.UndoStateChanged -= OnSolutionExpired;
    GrasshopperDocument.UndoStateChanged += OnSolutionExpired;
    GrasshopperDocument.ObjectsDeleted -= OnDeleteThisComponent;
    GrasshopperDocument.ObjectsDeleted += OnDeleteThisComponent;
    msg.AppendFormat("Added the eventhandlers to UndoStateChanged\n", GrasshopperDocument.Objects.OfType<Grasshopper.Kernel.Special.GH_Group>().Count());
  }

  public void RemoveEventHandlers()
  {
    GrasshopperDocument.UndoStateChanged -= OnSolutionExpired;
    GrasshopperDocument.ObjectsDeleted -= OnDeleteThisComponent;

    msg.AppendFormat("Removed wire event handlers on document\n", GrasshopperDocument.Objects.OfType<Grasshopper.Kernel.Special.GH_Group>().Count());

  }

  public void OnDeleteThisComponent(object sender, GH_DocObjectEventArgs e)
  {

    if (e.Objects.OfType<Grasshopper.Kernel.GH_Component>().Where(o => o.NickName == this.Component.NickName).Any())
    {
      DebugWrite("Removed template component. Removing all the eventhandlers");
      RemoveEventHandlers();
    }

  }

  public bool IdExists(int id)
  {
    IList<IGH_DocumentObject> objs = Grasshopper.Instances.ActiveCanvas.Document.Objects;
    return objs
      .OfType<IGH_Component>()
      .Where(ob => ob.NickName == this.Component.NickName)
      .Where(ob => ob.GetType().ToString() == "ScriptComponents.Component_CSNET_Script")
      .Where(ob => ob.Message == "id: " + id.ToString()).Any();

  }

  public void DebugWrite(string msg)
  {
    if (_debug)
    {
      Rhino.RhinoApp.WriteLine(String.Format("[FixWire {0}]: {1}", id, msg));
    }
  }
# ---------- end fixwires ----------

# ----
# Template methods
# By Mathias Sønderskov Schaltz 2022
# Check for updates here https://github.com/Sonderwoods/GrasshopperScribbles
panel_8 = Panel(fixwires)
panel_9 = Panel(fixparams)
panel_10 = Panel(colorgroups)

panel_11 = Panel("""export PATH=$PATH.:/usr/local/radiance/bin
export RAYPATH=.:/usr/local/radiance/lib
objview <glowmat> ~/simulation/<name>.rad | meta2tga -x 1048 -y 1048 | ra_t8 -r > ~/simulation/<name>.hdr
normtiff ~/simulation/<name>.hdr ~/simulation/<name>.tif
convert ~/simulation/<name>.tif ~/simulation/<name>.png
echo "C:\Users\mm1013\simulation\<name>.png"
""")
panel_12 = Panel("kill -9 (ps aux | grep <instance> | fgrep -v grep | awk '{ print $1}')")

panel_13 = Panel("""Mesh
Polysurface
Surface
Extrusion""")

falsestart = LBFalseStartToggle(False)

vertical_offset = Panel("0.75m")
grid_size = Panel("0.5m")
docunits = ConvertToDocumentUnits(ValueString=vertical_offset)
docunits_2 = ConvertToDocumentUnits(ValueString=grid_size)

panel_14 = Panel("""echo $PATH
genbox""")  # disabled
falsestart_2 = LBFalseStartToggle(False)  # disabled
execute_ssh_async = ExecuteSSHAsync(SSHCommands=panel_14, Run=falsestart_2, addPrefix=True, addSuffix=True)  # -> Stdout, Stderr, Log, Pid, Ran; disabled
panel_15 = Panel(execute_ssh_async.Stderr)  # disabled
panel_16 = Panel(execute_ssh_async.Stdout)  # disabled

execute_ssh_async_2 = ExecuteSSHAsync(
    SSHCommands="ps aux",
    Run=falsestart,
    addPrefix=True,
    addSuffix=True,
    stdouts="""USER       PID %CPU %MEM    VSZ   RSS TTY      STAT START   TIME COMMAND
root         1  0.0  0.0    896     0 ?        Sl   11:35   0:00 /init
root         8  0.0  0.0    896     0 ?        S    11:35   0:00 /init
root        31  0.0  0.0  12176  2164 ?        Ss   11:35   0:00 sshd: /usr/sbin/sshd [listener] 0 of 10-100 startups
root      1255  0.0  0.0    896     8 ?        Ss   11:55   0:00 /init
root      1256  0.0  0.0    896    16 ?        S    11:55   0:00 /init
mss       1257  0.0  0.0  10168  3316 pts/0    Ss+  11:55   0:00 -bash
root      3849  0.0  0.0    896     0 ?        Ss   12:39   0:00 /init
root      3850  0.0  0.0    896     0 ?        S    12:39   0:00 /init
mss       3851  0.0  0.0  10036  2864 pts/1    Ss+  12:39   0:00 -bash
root      7404  0.0  0.0  13904  8640 ?        Ss   16:27   0:00 sshd: mss [priv]
root      7408  0.0  0.0  13904  8548 ?        Ss   16:27   0:00 sshd: mss [priv]
mss       7501  0.1  0.0  13904  5744 ?        S    16:27   0:02 sshd: mss@notty
mss       7521  0.0  0.0  13904  5744 ?        S    16:27   0:00 sshd: mss@notty
mss       7522  0.0  0.0   6604  5304 ?        Ss   16:27   0:00 /usr/lib/openssh/sftp-server
mss      11746  0.0  0.0  10616  3316 ?        R    17:01   0:00 ps aux""")  # -> Stdout, Stderr, Log, Pid, Ran

dpipeline = DynamicGeometryPipeline(
    LayerFilter="Daylight_Inputs::*",
    TypeFilter=panel_13,
    NameFilter="*",
    GroupByLayer=False,
    GroupByType=False,
    IncludeHidden=True,
    IncludeLocked=True,
    enableFullPath=True,
    listenToAttributes=True)
dam = DataDam(DataA=dpipeline, BufferDelay=10000000, BufferMode=0)
objatts = ObjectAttributes(ObjectOrAttributes=dam)  # -> Name, LayerName, LayerFullPath, Color, MaterialName, LinetypeName, GroupIndices, PlotWeight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
cset = CreateSet(List=objatts.LayerName)  # -> Set, Map
assign_paths = AssignPaths(InputData=flatten(dam), PathsToAssign=flatten(cset.Map))
python = GhPythonScript(layer_name=graft(cset.Set))  # -> is_opaque, is_transparent, is_grid, is_HB_Room, is_HB_Window
# ---------- python: Python ----------
__author__ = "mm1013"
__version__ = "2022.01.16"

import rhinoscriptsyntax as rs

is_grid = layer_name == "Grids"

if layer_name.startswith("HB_"):
    is_opaque = is_transparent = is_grid = False
    
    is_HB_Window = layer_name.endswith("%")
    is_HB_Room = layer_name == "HB_Rooms"
    
    
else:
    if is_grid:
        is_opaque = False
        is_transparent = False
    else:
        is_transparent = layer_name.endswith("%")
        if is_transparent:
            transmittance = layer_name.split("_")[-1].replace("%","")
        is_opaque = not is_transparent
# ---------- end python ----------
layer_name = Text(cset.Set)
geo = Geometry(assign_paths)

mesh = Mesh([<mesh referenced from the Rhino model> x2])
panel_17 = Panel("""dctimestep
rcontrib
rtrace
oconv""")
facen = FaceNormals(Mesh=mesh)  # -> Centers, Normals
demesh = DeconstructMesh(Mesh=mesh)  # -> Vertices, Faces, Colours, Normals

# ----
# you can remove last characters of a value
# 
# Here adding render instead of image
panel_18 = Panel("echo <proj>/<target-8>_render.gif")
applyglobals = ApplyGlobals(Input=panel_18, AdditionalKeys="target", AdditionalValues="myFiles/myImage.hdr")  # -> Output, Pairs
panel_19 = Panel(applyglobals.Output)

panel_20 = Panel(execute_ssh_async_2.Stdout)

# ----
# you can combine globals and locals
panel_21 = Panel("echo <proj>/<target-.>.gif")
applyglobals_2 = ApplyGlobals(Input=panel_21, AdditionalKeys="target", AdditionalValues="myFiles/myImage.hdr")  # -> Output, Pairs
panel_22 = Panel(applyglobals_2.Output)

# ----
# Applyglobals
# try <target-.>  to remove the file ending on <target>
# 
# Here we are changing from hdr to gif
panel_23 = Panel("echo <target-.>.gif")
applyglobals_3 = ApplyGlobals(Input=panel_23, AdditionalKeys="target", AdditionalValues="myFiles/myImage.hdr")  # -> Output, Pairs
panel_24 = Panel(applyglobals_3.Output)

panel_25 = Panel("""up_clock3
up_ccw3""")
panel_26 = Panel("""glowmat
glowmat""")
points = PointList(Points=demesh.Vertices, Size="50")
vdis = VectorDisplay(Anchor=facen.Centers, Vector=expr("x*500", facen.Normals))
panel_27 = Panel("""echo "void glow glowmat
0
0
4 12 12 12 1000" > <target>;echo <target>""")
falsestart_3 = LBFalseStartToggle(False)
overrides = ApplyOverrides(Input=panel_12, AdditionalKeys="instance", AdditionalValues=graft("dctimestep"))  # -> flatten(Output), Pairs
falsestart_4 = LBFalseStartToggle(False)
mesh2obj = MeshToObj(Mesh=graft(mesh), Name=graft(panel_25), ModifierName=graft(panel_26), Run=falsestart_3)  # -> ObjFiles, MapFile, Run
overrides_2 = ApplyOverrides(Input=panel_27, AdditionalKeys="target", AdditionalValues="~/simulation/testglow.rad")  # -> Output, Pairs
execute_ssh_async_3 = ExecuteSSHAsync(SSHCommands=overrides_2.Output, Run=falsestart_3, addPrefix=True, addSuffix=True)  # -> Stdout, Stderr, Log, Pid, Ran
overrides_3 = ApplyOverrides(Input=panel_11, AdditionalKeys="glowmat", AdditionalValues=execute_ssh_async_3.Stdout)  # -> Output, Pairs
overrides_4 = ApplyOverrides(Input=overrides_3.Output, AdditionalKeys="name", AdditionalValues=graft(panel_25))  # -> Output, Pairs
panel_28 = Panel("echo hi")
panel_29 = Panel(overrides.Output)
join = TextJoin(Text=overrides.Output, Join=";")
concat = Concatenate(FragmentA=join)
panel_30 = Panel(overrides_4.Output)

# ----
# 5 phase bash script from andy mcneil
panel_31 = Panel("""#!/bin/bash

procs=4

### First let me download and unpacking Axel\'s files for rtcontrib lesson

printf "\nDownloading Axels rtcontrib lesson files...\n"
curl -O http://www.jaloxa.eu/resources/radiance/documentation/docs/rtcontrib_lesson.tgz
tar -xf rtcontrib_lesson.tgz
mv rtcontrib_lesson 5p_tutorial_examples

cd 5p_tutorial_examples

mkdir bsdf hourlypics hourlypics_dir hourlypics_ds hourlyresult \
	matrices octs viewpics viewpics_dir viewpics_ds
	
### Let me download the weather data file for you
printf "\nDownloading weather data...\n"
curl -O http://apps1.eere.energy.gov/buildings/energyplus/weatherdata/4_north_and_central_america_wmo_region_4/1_usa/USA_CA_Oakland.Intl.AP.724930_TMY3.zip
tar -xf USA_CA_Oakland.Intl.AP.724930_TMY3.zip
rm USA_CA_Oakland.Intl.AP.724930_TMY3.ddy 
rm USA_CA_Oakland.Intl.AP.724930_TMY3.stat
rm USA_CA_Oakland.Intl.AP.724930_TMY3.zip 
mv USA_CA_Oakland.Intl.AP.724930_TMY3.epw skies/.

# grabbing reinsrc.cal from CVS
printf "\nDownloading reinsrc.cal...\n"
curl -O http://radiance-online.org/cgi-bin/viewcvs.cgi/ray/src/cal/cal/reinsrc.cal

### Section 6.1 - Model adjustments for five-phase simulation
printf "\nMaking model adjustments...\n"
cat <<EOF > objects/testroom_Swall.rad
!genbox wall_mat wall_s_bottom 4 .3 1 |xform -t 0 -.3 0
!genbox wall_mat wall_s_top 4 .3 .5 |xform -t 0 -.3 2
!genbox wall_mat wall_s_west .5 .3 1 |xform -t 0 -.3 1
!genbox wall_mat wall_s_west .5 .3 1 |xform -t 3.5 -.3 1
EOF

cat <<EOF > objects/testroom.rad
!genbox floor_mat floor 4.6 6.6 .3 |xform -t -.3 -.3 -.3
!genbox ceiling_mat ceiling 4.6 6.6 .3 |xform -t -.3 -.3 2.5

!genbox wall_mat wall_w .3 6.6 2.5 |xform -t -.3 -.3 0
!genbox wall_mat wall_e .3 6.6 2.5 |xform -t 4 -.3 0
!genbox wall_mat wall_n 4 .3 2.5 |xform -t 0 6 0
EOF

cat <<EOF > objects/glazing.rad
void glass glazing
0
0
3 0.73 0.73 0.73

glazing polygon glass
0
0
12    0.5  -0.25   1
        0.5  -0.25   2
        3.5  -0.25   2
        3.5  -0.25   1
EOF

cat <<EOF > objects/venetianblind.rad
void plastic blindslat
0
0
5 .65 .65 .65 .01 0 

!genblinds blindslat blinds .05 3 1 25 0 +r .15 | xform -rz -90 -t 0.5 -.15 1 
EOF

cat <<EOF > objects/viewmtxsurf.rad
void glow viewsurf
0
0
4 1 1 1 0

viewsurf polygon inside
0
0
12    0.5   0   1
        0.5   0   2
        3.5   0   2
        3.5   0   1
EOF

cat <<EOF > objects/daymtxsurf.rad
void plastic daymtxsurf
0
0
5 0 0 0 0 0

daymtxsurf polygon outside
0
0
12    0.5   -0.3   1
        0.5   -0.3   2
        3.5   -0.3   2
        3.5   -0.3  1
EOF

cat <<EOF > objects/glazing_bsdf.rad
void BSDF BSDFproxy
6 0.30 bsdf/fullwindow_t45.xml 0 0 1 .
0
0

BSDFproxy polygon inside
0
0
12    0.5   0   1
        0.5   0   2
        3.5   0   2
        3.5   0   1
EOF

cat <<EOF >> materials/testroom.mat
void plastic black
0
0
5 0 0 0 0 0
EOF


### Section 6.2 - Creating BSDFs
xform -rz 180 -rx -90 -t 4 0 0 objects/glazing.rad objects/venetianblind.rad materials/testroom.mat \
	objects/testroom_Swall.rad > bsdf/fullwindow.rad

### I am going to save you the trouble of generating the High-Res BSDF
#genBSDF -n $procs +f +b -geom meter -dim 0.5 3.5 1 2 -.3 0 -t4 5 \
#	bsdf/fullwindow.rad > bsdf/fullwindow_t45.xml
printf "\nDownloading tensor tree BSDF...\n"
curl -o bsdf/fullwindow_t45.xml http://www.radiance-online.org/learning/tutorials/fivephasetutorialfiles/fullwindow_t45.xml

### I will also save you the trouble with the low-res BSDF
#bsdf2klems bsdf/fullwindow_t45.xml > bsdf/fullwindow_klems.xml
#genBSDF -n $procs +f +b -geom meter -dim 0.5 3.5 1 2 -.3 0 \
#	bsdf/fullwindow.rad > bsdf/fullwindow_klems.xml
printf "\nDownloading klems BSDF...\n"
curl -o bsdf/fullwindow.xml http://www.radiance-online.org/learning/tutorials/fivephasetutorialfiles/fullwindow.xml


### Section 6.3 - View matrix (V)
printf "\nDoing 5-phase simulation for sensor points...\n"
oconv materials/testroom.mat objects/daymtxsurf.rad objects/ground.rad objects/testroom.rad \
	objects/testroom_Swall.rad objects/viewmtxsurf.rad skies/sky_white.rad \
	objects/viewmtxsurf.rad objects/daymtxsurf.rad > octs/model_3ph.oct
printf "\nView Matrix\n"
time rcontrib < data/photocells.pts -n $procs -f klems_int.cal -b kbinS -bn Nkbins -m viewsurf \
	-I+ -ab 10 -ad 65536 -lw 1.52e-5 octs/model_3ph.oct > matrices/viewmatrix.vmx


### Section 6.4 - Direct view matrix (Vd)
printf "\nDirect View Matrix\n"
time rcontrib < data/photocells.pts -n $procs -f klems_int.cal -b kbinS -bn Nkbins -m viewsurf \
	-I+ -ab 1 -ad 65536 -lw 1.52e-5 octs/model_3ph.oct > matrices/viewmatrix_direct.vmx

### Section 6.5 - Daylight matrix (D)
printf "\nDaylight Matrix\n"
time genklemsamp -c 1000 -vd 0 -1 0 objects/daymtxsurf.rad | \
	rcontrib -n $procs -c 1000 -ab 2 -ad 1024 -e MF:1 -f reinhart.cal -b rbin -bn Nrbins \
		-m sky_glow octs/model_3ph.oct > matrices/daylightmatrix.dmx

### Section 6.6 - Direct daylight matrix (Dd)
printf "\nDirect Daylight Matrix\n"
xform -m black objects/testroom_Swall.rad objects/testroom.rad objects/ground.rad \
	objects/venetianblind.rad | oconv materials/testroom.mat - objects/viewmtxsurf.rad \
	objects/daymtxsurf.rad skies/sky_white.rad > octs/model_allblack.oct

time genklemsamp -c 1000 -vd 0 -1 0 objects/daymtxsurf.rad | \
	rcontrib -n $procs -c 1000 -ab 0 -e MF:1 -f reinhart.cal -b rbin -bn Nrbins \
		-m sky_glow octs/model_allblack.oct > matrices/daylightmatrix_direct.dmx

### Section 6.7 - Direct sun coefficient matrix (Cds)
printf "\nDirect Sun Coefficient Matrix\n"
echo void light solar 0 0 3 1e6 1e6 1e6 > skies/suns.rad
cnt 5185  |  rcalc -e MF:6 -f reinsrc.cal -e Rbin=recno \
	-o 'solar source sun 0 0 4 ${ Dx } ${ Dy } ${ Dz } 0.533' >> skies/suns.rad

xform -m black objects/testroom_Swall.rad objects/testroom.rad objects/ground.rad \
	| oconv materials/testroom.mat - objects/glazing.rad objects/venetianblind.rad \
		objects/glazing_bsdf.rad skies/suns.rad > octs/model_suns.oct

time rcontrib < data/photocells.pts -n $procs -I -ab 1 -ad 65536 -lw 1.52e-5 -dc 1 -dt 0 -dj 0 -st 1 -ss 0 -faf  \
	-e MF:6 -f reinhart.cal -b rbin -bn Nrbins -m solar \
	octs/model_suns.oct > matrices/directsun.dsmx

### Section 6.8 - Putting it all together
printf "\nCombining it all\n"
epw2wea skies/USA_CA_Oakland.Intl.AP.724930_TMY3.epw skies/OakLand.wea
gendaymtx -of skies/OakLand.wea > matrices/OakLand.smx
gendaymtx -of -d skies/OakLand.wea > matrices/OakLand_direct.smx
gendaymtx -5 -d -m 6 -of skies/OakLand.wea > matrices/OakLand_direct_m6.smx

time dctimestep -n 8760 -if matrices/viewmatrix.vmx bsdf/fullwindow.xml  \
	matrices/daylightmatrix.dmx matrices/OakLand.smx | \
	rcollate -h -oc 1 > i_3ph.txt

time dctimestep -n 8760 -if  matrices/viewmatrix_direct.vmx bsdf/fullwindow.xml  \
	matrices/daylightmatrix_direct.dmx matrices/OakLand_direct.smx | \
	rcollate -h -oc 1 > i_ds3ph.txt

time dctimestep -n 8760 -if matrices/directsun.dsmx matrices/OakLand_direct_m6.smx | \
	rcollate -h -oc 1 > i_ds5ph.txt

rlam i_3ph.txt i_ds3ph.txt i_ds5ph.txt | \
	rcalc -e 'r=$1-$4+$7;g=$2-$5+$8;b=$3-$6+$9' \
	-e '$1=179*(.265*r+.670*g+.065*b)' | \
	rcollate -h -fa1 -ic 8760 -t > illum.txt

printf "\nAll done with example 1!  look at illum.txt for the result.\n"


printf "\n\n\nDoing 5-phase simulation for rendering...\n"
### 7.1	View matrix (V)
printf "\nView Matrix...\n"
time vwrays -vf views/back.vf  -ff -x 500 -y 500 \
	| rcontrib `vwrays -vf views/back.vf  -x 500 -y 500 -d` -n $procs -ffc -fo -o viewpics/back_%03d.hdr \
		-f klems_int.cal -b kbinS -bn Nkbins -m viewsurf \
		-ab 10 -ad 65536 -lw 1.52e-5 octs/model_3ph.oct

### 7.2	Direct view matrix (Vd)	
printf "\nDirect View Matrix...\n"	
time vwrays -vf views/back.vf  -ff -x 500 -y 500 \
	| rcontrib `vwrays -vf views/back.vf  -x 500 -y 500 -d` -n $procs -ffc -fo -o viewpics_dir/back_%03d.hdr \
		-f klems_int.cal -b kbinS -bn Nkbins -m viewsurf \
		-ab 1 -ad 65536 -lw 1.52e-5 octs/model_3ph.oct

### 7.5	Direct sun coefficient matrix (Cds)
printf "\nDirect Coefficient Matrix...\n"
ulimit -n 9999
xform -m black objects/testroom_Swall.rad objects/testroom.rad objects/ground.rad | \
	oconv materials/testroom.mat - objects/venetianblind.rad > octs/model_nosuns.oct
time vwrays -c 4 -pj 1 -fa -vf views/back.vf -x 500 -y 500 | \
	rtrace -h- -opn -faa -ab 0 octs/model_nosuns.oct | \
	rcontrib `vwrays -vf views/back.vf -x 500 -y 500 -d` -n $procs -fac -fo -o viewpics_ds/back_%04d.hdr \
	-e MF:6 -f reinhart.cal -b rbin -bn Nrbins -m solar -c 4 -I -ab 1 -ad 100 -dt 0 -dc 1 -lw 1e-2 octs/model_suns.oct

oconv materials/testroom.mat objects/testroom_Swall.rad objects/testroom.rad \
	objects/ground.rad objects/glazing.rad objects/venetianblind.rad \
	objects/daymtxsurf.rad > octs/model_material.oct
time rpict -x 1000 -y 1000 -vf views/back.vf -ps 1 -pj 1 -av 0.31831 0.31831 0.31831 -aa 0 \
	octs/model_material.oct | pfilt -x /2 -y /2 -1 -e 1 > materialmap.hdr  

### 7.6	Putting it all together
printf "\nPutting it together...\n"
time dctimestep -n 8760 -if -o hourlypics/back_%04d.hdr viewpics/back_%03d.hdr \
	bsdf/fullwindow.xml matrices/daylightmatrix.dmx matrices/OakLand.smx 

time dctimestep -n 8760 -if -o hourlypics_dir/back_%04d.hdr viewpics_dir/back_%03d.hdr \
	bsdf/fullwindow.xml matrices/daylightmatrix_direct.dmx matrices/OakLand_direct.smx 

time dctimestep -n 8760 -if -o hourlypics_ds/back_%04d.hdr viewpics_ds/back_%04d.hdr \
	matrices/OakLand_direct_m6.smx

time for t in {1..8760} 
do ts=`printf %04d $t `
pcomb -e 'lo=li(1)-li(2)+li(3)*li(4)' -o hourlypics/back_${ts}.hdr -o hourlypics_dir/back_${ts}.hdr \
	-o hourlypics_ds/back_${ts}.hdr -o materialmap.hdr > hourlyresult/back_${ts}.hdr 
done
printf "\nAll Done with 5-phase Rendering sim\n"
pcond hourlyresult/back_0015.hdr | ximage &""")  # disabled

cluster = Cluster(L=execute_ssh_async_3.Stdout)
obj2rad = ObjToRad(ObjFiles=mesh2obj.ObjFiles, MapFile=mesh2obj.MapFile, Run=mesh2obj.Run)  # -> Status, RadFiles, Run
execute_ssh_async_4 = ExecuteSSHAsync(SSHCommands=concat, Run=falsestart_4, addPrefix=True, addSuffix=True)  # -> Stdout, Stderr, Log, Pid, Ran
cluster_2 = Cluster(L=overrides_4.Output)
panel_32 = Panel(cluster)
execute_ssh_async_5 = ExecuteSSHAsync(SSHCommands=overrides_4.Output, Run=obj2rad.Run, addPrefix=True, addSuffix=True)  # -> Stdout, Stderr, Log, Pid, Ran
panel_33 = Panel(cluster_2)
cluster_3 = Cluster(L=execute_ssh_async_5.Stdout)
item = ListItem(List=flatten(execute_ssh_async_5.Stdout), Index=0, Wrap=True)  # -> Item, Item1
panel_34 = Panel(execute_ssh_async_4.Stderr)
panel_35 = Panel(cluster_3)

cull = CullPattern(List=graft(layer_name), CullPattern=graft(python.is_transparent))  # -> simplify(List)
cull_2 = CullPattern(List=geo, CullPattern=python.is_transparent)
python_2 = GhPythonScript(layer_name=cull)  # -> out, transmittance, name
# ---------- python_2: Python ----------
__author__ = "mm1013"
__version__ = "2022.01.16"

import rhinoscriptsyntax as rs

try:
    transmittance = layer_name.split("_")[-1].replace("%","")
    name = layer_name.replace("%","")
except:
    transmittance = None
    name = None
# ---------- end python_2 ----------
clean = CleanTree(
    RemoveNulls=True,
    RemoveInvalid=True,
    RemoveEmpty=True,
    Tree=simplify(cull_2),
    SynchronousTree1=simplify(python_2.name),
    SynchronousTree2=simplify(python_2.transmittance))  # -> Tree, SynchronousTree1, SynchronousTree2
mesh_2 = MeshBrep(
    Brep=clean.Tree,
    Settings={GridMaxCount=0, GridMinCount=16, JaggedSeams=False, MaxEdgeLength=0, MinEdgeLength=0.0001, MinTolerance=0, Refine=True, RefineAngle=0, RelativeTolerance=0.65, SimplePlanes=True, Tolerance=0})
transmittance = Number(expr("x/100", clean.SynchronousTree2))
name = Text(clean.SynchronousTree1)
geo_2 = Geometry(mesh_2)

imageviewer = LBImageViewer(ImagePath_=item.Item1, _scale_=1, DisableClickable=False, SaveImgWithCoords=False, scale=1)  # -> ImagePath, Values, GIF
panel_36 = Panel(execute_ssh_async_5.Stderr)
panel_37 = Panel(layer_name)

cull_3 = CullPattern(List=graft(layer_name), CullPattern=graft(python.is_grid))  # -> simplify(List)
cull_4 = CullPattern(List=geo, CullPattern=python.is_grid)
grid_size_2 = Number(docunits_2)
offset = Number(docunits)
clean_2 = CleanTree(RemoveNulls=True, RemoveInvalid=True, RemoveEmpty=True, Tree=cull_3, SynchronousTree1=simplify(cull_4))  # -> Tree, SynchronousTree1
geo_3 = Geometry(graft(clean_2.SynchronousTree1))
rectangle = Rectangle(Plane=PlaneXY(0, 0, 0), XSize=Domain(-1, 1), YSize=Domain(-2, 2), Radius=0)  # -> Rectangle, Length
flip = Flip(Surface=geo_3, Guide=rectangle.Rectangle)  # -> Surface, Result
custom_mesh_settings = SettingsCustom(
    StitchSeams=True,
    SimplePlanes=False,
    Refine=True,
    MinCount=16,
    MaxCount=400,
    AspectRatio=20,
    MaxDistance=0,
    MaxAngle=20,
    MinEdge=grid_size_2,
    MaxEdge=grid_size_2)
normals = Normals(geo=flip.Surface, amplitude=offset)  # -> center_2, norm_2, P
mesh_3 = MeshBrep(Brep=flip.Surface, Settings=custom_mesh_settings)
move = Move(Geometry=mesh_3, Motion=normals.norm_2)  # -> Geometry, Transform
facen_2 = FaceNormals(Mesh=move.Geometry)  # -> Centers, Normals

cull_5 = CullPattern(List=graft(layer_name), CullPattern=graft(python.is_opaque))  # -> simplify(List)
cull_6 = CullPattern(List=geo, CullPattern=graft(python.is_opaque))  # -> simplify(List)
panel_38 = Panel(cull_5)
python_3 = GhPythonScript(layer_name=panel_38)  # -> out, reflectance
# ---------- python_3: Python ----------
__author__ = "mm1013"
__version__ = "2022.01.16"

import rhinoscriptsyntax as rs
try:
    reflectance = layer_name.split("_")[-1]
    
except:
    reflectance = None
# ---------- end python_3 ----------
clean_3 = CleanTree(
    RemoveNulls=True,
    RemoveInvalid=True,
    RemoveEmpty=True,
    Tree=cull_5,
    SynchronousTree1=cull_6,
    SynchronousTree2=python_3.reflectance)  # -> Tree, SynchronousTree1, SynchronousTree2
geo_4 = Geometry(clean_3.SynchronousTree1)
refl = Number(clean_3.SynchronousTree2)
name_2 = Text(clean_3.Tree)

imageviewer_2 = LBImageViewer(ImagePath_=item.Item, _scale_=1, DisableClickable=False, SaveImgWithCoords=False, scale=1)  # -> ImagePath, Values, GIF
panel_39 = Panel(refl)
walls = Geometry(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)
floor = Geometry(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)
panel_40 = Panel("""Floors
Walls""")
panel_41 = Panel(name)
mesh_4 = Mesh(floor)
mesh_5 = Mesh(walls)
mesh_6 = Mesh(geo_2)
graft = GraftTree(Tree=panel_40, IncludeEmptyLists=True, IncludeNullItems=True)
entwine = Entwine(Branch00=mesh_4, Branch01=mesh_5, FlattenInputs=True)
concat_2 = Concatenate(FragmentA=panel_41, FragmentB="_mat")
# export PATH=$PATH.:/usr/local/radiance/bin
# export RAYPATH=.:/usr/local/radiance/lib
# obj2rad -m /home/mss/simulation/mapping.map -f /home/mss/simulation/twoMeshes4.obj 2>&1 1>/home/mss/simulation/x.rad
# head /home/mss/simulation/x.rad
panel_42 = Panel("""export PATH=$PATH.:/usr/local/radiance/bin
export RAYPATH=.:/usr/local/radiance/lib
objline ~/simulation/twoMeshes5.rad | meta2tga -x 1048 -y 1048 | ra_t8 -r > ~/simulation/test.hdr
normtiff ~/simulation/test.hdr ~/simulation/test.tif
convert ~/simulation/test.tif ~/simulation/test.png
echo "C:\Users\mm1013\simulation\test.png"
""")  # disabled

start_raytracing_2ph_dds = LBFalseStartToggle(False)
prep_octrees = LBFalseStartToggle(False)
raytrace_2ph = Boolean(start_raytracing_2ph_dds)

# ----
# Create working folder
panel_43 = Panel("mkdir -p <proj>;echo <proj>")
applyglobals_4 = ApplyGlobals(Input=panel_43)  # -> Output, Pairs
execute_ssh_async_6 = ExecuteSSHAsync(
    SSHCommands=applyglobals_4.Output,
    Run=prep_octrees,
    addPrefix=True,
    addSuffix=True,
    stdouts="/home/mss/simulation/test_project2")  # -> Stdout, Stderr, Log, Pid, Ran

falsestart_5 = LBFalseStartToggle(False)  # disabled
execute_ssh_async_7 = ExecuteSSHAsync(SSHCommands=panel_42, Run=falsestart_5, addPrefix=True, addSuffix=True)  # -> Stdout, Stderr, Log, Pid, Ran; disabled

overrides_5 = ApplyOverrides(Input="<projname>")  # -> Output, Pairs
overrides_6 = ApplyOverrides(Input="<projfolder>/radFiles")  # -> Output, Pairs

# ----
# Black Geometry
item_2 = ListItem(List=geo_4, Index=0, Wrap=True)
concat_3 = Concatenate(FragmentA=name_2, FragmentB="_black")
long = LongestList(ListA=item_2, ListB="blackMaterial", PaddingMode=2)  # -> ListA, ListB
mesh2obj_2 = MeshToObj(
    Mesh=geo_4,
    Name=graft(concat_3),
    MapFileName="mapping_black",
    ModifierName=graft(long.ListB),
    SubfolderOverride=overrides_5.Output,
    Run=execute_ssh_async_6.Ran)  # -> ObjFiles, MapFile, Run
obj2rad_2 = ObjToRad(ObjFiles=mesh2obj_2.ObjFiles, MapFile=mesh2obj_2.MapFile, SubfolderOverride=overrides_6.Output, Run=mesh2obj_2.Run)  # -> Status, RadFiles, Run

imageviewer_3 = LBImageViewer(ImagePath_=execute_ssh_async_7.Stdout, _scale_=1, DisableClickable=False, SaveImgWithCoords=False, scale=1)  # -> ImagePath, Values, GIF; disabled

# ----
# window geometry
panel_44 = Panel("mapping_windows")
# rad files
mesh2obj_3 = MeshToObj(
    Mesh=mesh_6,
    Name=graft(panel_41),
    MapFileName=panel_44,
    ModifierName=graft(concat_2),
    SubfolderOverride=overrides_5.Output,
    Run=execute_ssh_async_6.Ran)  # -> ObjFiles, MapFile, Run
obj2rad_3 = ObjToRad(ObjFiles=mesh2obj_3.ObjFiles, MapFile=mesh2obj_3.MapFile, SubfolderOverride=overrides_6.Output, Run=mesh2obj_3.Run)  # -> Status, RadFiles, Run

# ----
# grid points
geo_5 = Geometry(floor)
pt = Point(facen_2.Centers)
vec = Vector(facen_2.Normals)
area = Area(Geometry=geo_5)  # -> Area, Centroid
scale = Scale(Geometry=geo_5, Center=area.Centroid, Factor="1.3")  # -> Geometry, Transform
# Grid
sdivide = DivideSurface(Surface=scale.Geometry, UCount=10, VCount=20)  # -> Points, Normals, Parameters
panel_45 = Panel(sdivide.Parameters)
lng = ListLength(List=flatten(pt))
overrides_7 = ApplyOverrides(Input="<projfolder>")  # -> Output, Pairs
points2pts = PointsToPts(
    Points=flatten(pt),
    Vectors=flatten(vec),
    Name="points",
    SubfolderOverride=overrides_7.Output,
    Run=execute_ssh_async_6.Ran)  # -> PtsFile, Run
ptscount = Integer(lng)
points_2 = Text(points2pts.PtsFile)

# ----
# Geometry
panel_46 = Panel("_mat")
concat_4 = Concatenate(FragmentA=name_2, FragmentB=panel_46)
mesh2obj_4 = MeshToObj(
    Mesh=geo_4,
    Name=graft(name_2),
    MapFileName="mapping_opaque",
    ModifierName=graft(concat_4),
    SubfolderOverride=overrides_5.Output,
    Run=execute_ssh_async_6.Ran)  # -> ObjFiles, MapFile, Run
obj2rad_4 = ObjToRad(ObjFiles=mesh2obj_4.ObjFiles, MapFile=mesh2obj_4.MapFile, SubfolderOverride=overrides_6.Output, Run=mesh2obj_4.Run)  # -> Status, RadFiles, Run

panel_47 = Panel(execute_ssh_async_7.Stderr)  # disabled

# ----
# WEA file
# create WEA file
path = FilePath("C:\ladybug\NOR_OS_Alna.014870_TMYx.2004-2018\NOR_OS_Alna.014870_TMYx.2004-2018.epw")
upload = Upload(LocalFilePaths=path, SubfolderOverride="simulation/weatherData", Run=execute_ssh_async_6.Ran)  # -> Status, FilePaths, Run
rep = ReplaceText(Text=upload.FilePaths, Find=".epw", Replace=".wea", RecursiveReplace=False)
panel_48 = Panel("""in
out""")
applyglobals_5 = ApplyGlobals(Input="epw2wea <in> <out> 1>&2;echo <out>", AdditionalKeys=panel_48, AdditionalValues=[upload.FilePaths, rep])  # -> Output, Pairs
execute_ssh_async_8 = ExecuteSSHAsync(
    SSHCommands=applyglobals_5.Output,
    Run=upload.Run,
    addPrefix=True,
    addSuffix=True,
    stdouts="/home/mss/simulation/weatherData/NOR_OS_Alna.014870_TMYx.2004-2018.wea")  # -> Stdout, Stderr, Log, Pid, Ran
file_exists = Panel("[ -f <out> ] && echo \"1\" || echo \"0\"")
panel_49 = Panel(execute_ssh_async_8.Stderr)
panel_50 = Panel(execute_ssh_async_8.Stdout)
applyglobals_6 = ApplyGlobals(Input=file_exists, AdditionalKeys="out", AdditionalValues=execute_ssh_async_8.Stdout)  # -> Output, Pairs
execute_ssh_async_9 = ExecuteSSHAsync(SSHCommands=applyglobals_6.Output, Run=upload.Run, addPrefix=True, addSuffix=True, stdouts="1")  # -> Stdout, Stderr, Log, Pid, Ran
wea_file = Text(execute_ssh_async_8.Stdout)

# ----
# opaque materials
panel_51 = Panel("echo \"<mats>\" > <proj>/radFiles/<target>;echo \"<proj>/radFiles/<target>\"")
opaquegreymat = OpaqueGreyMat(Name=concat_4, Reflectance_0_1=refl, Specularity=0, Roughness=0)  # -> flatten(RadMaterials), RadMaterialList
join_2 = TextJoin(Text=opaquegreymat.RadMaterials)
entwine_2 = Entwine(Branch00=join_2, Branch01="opaque_materials.mat", FlattenInputs=True)  # -> flatten(Result)
panel_52 = Panel("""mats
target""")
applyglobals_7 = ApplyGlobals(Input=panel_51, AdditionalKeys=panel_52, AdditionalValues=entwine_2)  # -> Output, Pairs
execute_ssh_async_10 = ExecuteSSHAsync(
    SSHCommands=applyglobals_7.Output,
    Run=obj2rad_4.Run,
    addPrefix=False,
    addSuffix=True,
    stdouts="~/simulation/test_project2/radFiles/opaque_materials.mat")  # -> Stdout, Stderr, Log, Pid, Ran
opaque_mat = Text(execute_ssh_async_10.Stdout)
opaque_rad = Text(obj2rad_4.RadFiles)

# ----
# Setup glass materials
panel_53 = Panel("0.8")
glassmat = GlassMat(Name=concat_2, Transmittance_0_1=transmittance)  # -> RadMaterials, RadMaterialList
# 2phase DDS simulation
# materials
panel_54 = Panel("echo \"<mats>\" > <proj>/radFiles/<target>;echo \"<proj>/radFiles/<target>\"")
entwine_3 = Entwine(Branch00=glassmat.RadMaterials, Branch01="glass_materials.mat", FlattenInputs=True)  # -> flatten(Result)
panel_55 = Panel("""mats
target""")
applyglobals_8 = ApplyGlobals(Input=panel_54, AdditionalKeys=panel_55, AdditionalValues=entwine_3)  # -> Output, Pairs
execute_ssh_async_11 = ExecuteSSHAsync(
    SSHCommands=applyglobals_8.Output,
    Run=obj2rad_4.Run,
    addPrefix=True,
    addSuffix=True,
    stdouts="~/simulation/test_project2/radFiles/glass_materials.mat")  # -> Stdout, Stderr, Log, Pid, Ran
window_mat = Text(execute_ssh_async_11.Stdout)
window_rad = Text(obj2rad_3.RadFiles)

# ----
# blackmaterials
panel_56 = Panel("0.0")
opaquegreymat_2 = OpaqueGreyMat(Name=flatten("blackMaterial"), Reflectance_0_1=panel_56, Specularity=0, Roughness=0)  # -> RadMaterials, RadMaterialList
panel_57 = Panel("echo \"<mats>\" > <proj>/radFiles/<target>;echo \"<proj>/radFiles/<target>\"")
panel_58 = Panel("""mats
target""")
entwine_4 = Entwine(Branch00=opaquegreymat_2.RadMaterials, Branch01="black_material.mat", FlattenInputs=True)  # -> flatten(Result)
applyglobals_9 = ApplyGlobals(Input=panel_57, AdditionalKeys=panel_58, AdditionalValues=entwine_4)  # -> Output, Pairs
execute_ssh_async_12 = ExecuteSSHAsync(
    SSHCommands=applyglobals_9.Output,
    Run=obj2rad_2.Run,
    addPrefix=True,
    addSuffix=True,
    stdouts="~/simulation/test_project2/radFiles/black_material.mat")  # -> Stdout, Stderr, Log, Pid, Ran
black_rad_files = Text(obj2rad_2.RadFiles)
black_mat = Text(execute_ssh_async_12.Stdout)

# ----
# -f is frozen (all links embedded)
panel_59 = Panel("oconv -f <rads> > <proj>/<target>.oct;echo <proj>/<target>.oct")

# ----
# create black octree
black_rad_files_2 = Text(black_rad_files)
window_mat_2 = Text(window_mat)
window_rad_2 = Text(window_rad)
black_mat_2 = Text(black_mat)
and = GateAnd(A=execute_ssh_async_11.Ran, B=execute_ssh_async_12.Ran)
panel_60 = Panel("oconv -f <rads> > ~/simulation/myscene_black.oct;echo ~/simulation/myscene_black.oct")
entwine_5 = Entwine(Branch02=black_mat_2, Branch03=black_rad_files_2, FlattenInputs=True)  # -> flatten(Result)
join_3 = TextJoin(Text=flatten(entwine_5), Join=" ")
rep_2 = ReplaceText(Text=panel_60, Find="<rads>", Replace=join_3, RecursiveReplace=False)
execute_ssh_async_13 = ExecuteSSHAsync(SSHCommands=rep_2, Run=and, addPrefix=True, addSuffix=True, stdouts="/home/mss/simulation/myscene_black.oct")  # -> Stdout, Stderr, Log, Pid, Ran
panel_61 = Panel(execute_ssh_async_13.Stdout)
octree_black = Text(execute_ssh_async_13.Stdout)

# ----
# Create skyglow.rad
panel_62 = Panel("""#@rfluxmtx u=+Y h=u
void glow groundglow
0
0
4 1 1 1 0

groundglow source ground
0
0
4 0 0 -1 180

#@rfluxmtx u=+Y h=r1
void glow skyglow
0
0
4 1 1 1 0

skyglow source skydome
0
0
4 0 0 1 180""")
panel_63 = Panel("""mkdir -p <proj>/radFiles
echo "<skyglow>" > <proj>/radFiles/<target>; echo <proj>/radFiles/<target>""")
panel_64 = Panel("""skyglow
target""")
applyglobals_10 = ApplyGlobals(Input=panel_63, AdditionalKeys=panel_64, AdditionalValues=[panel_62, "skyglow.rad"])  # -> Output, Pairs
execute_ssh_async_14 = ExecuteSSHAsync(
    SSHCommands=applyglobals_10.Output,
    Run=execute_ssh_async_6.Ran,
    addPrefix=True,
    addSuffix=True,
    stdouts="/home/mss/simulation/test_project2/radFiles/skyglow.rad")  # -> Stdout, Stderr, Log, Pid, Ran
applyglobals_11 = ApplyGlobals(Input="head <proj>/radFiles/<target>", AdditionalKeys=panel_64, AdditionalValues=[panel_62, "skyglow.rad"])  # -> Output, Pairs
execute_ssh_async_15 = ExecuteSSHAsync(
    SSHCommands=applyglobals_11.Output,
    Run=execute_ssh_async_14.Ran,
    addPrefix=True,
    addSuffix=True,
    stdouts="""#@rfluxmtx u=+Y h=u
void glow groundglow
0
0
4 1 1 1 0

groundglow source ground
0
0
4 0 0 -1 180""")  # -> Stdout, Stderr, Log, Pid, Ran
panel_65 = Panel(execute_ssh_async_14.Stdout)
panel_66 = Panel(execute_ssh_async_15.Stdout)
skyglow = Text(execute_ssh_async_14.Stdout)

panel_67 = Panel("""mkdir -p <proj>/radFiles/
gensky -ang 45 0 -c -B 55.866 > <proj>/radFiles/<target>; echo <proj>/radFiles/<target>""")

# ----
# Create a dummy gensky for renders
# mkdir -p <proj>/radFiles/
# gensky 12 4 +12:00 -c -B 55.866 > <proj>/radFiles/<target>; echo <proj>/radFiles/<target>
panel_68 = Panel("sky_10klx.mat")
applyglobals_12 = ApplyGlobals(Input=panel_67, AdditionalKeys="target", AdditionalValues=panel_68)  # -> Output, Pairs
execute_ssh_async_16 = ExecuteSSHAsync(
    SSHCommands=applyglobals_12.Output,
    Run=execute_ssh_async_6.Ran,
    addPrefix=True,
    addSuffix=True,
    stdouts="/home/mss/simulation/test_project2/radFiles/sky_10klx.mat")  # -> Stdout, Stderr, Log, Pid, Ran
applyglobals_13 = ApplyGlobals(Input="head <proj>/radFiles/<target>", AdditionalKeys="target", AdditionalValues=panel_68)  # -> Output, Pairs
execute_ssh_async_17 = ExecuteSSHAsync(
    SSHCommands=applyglobals_13.Output,
    Run=execute_ssh_async_16.Ran,
    addPrefix=True,
    addSuffix=True,
    stdouts="""# gensky -ang 45 0 -c -B 55.866
# Ground ambient level: 17.8

void brightfunc skyfunc
2 skybr skybright.cal
0
3 2 2.29e+01 3.56e+00""")  # -> Stdout, Stderr, Log, Pid, Ran
panel_69 = Panel(execute_ssh_async_16.Stdout)
panel_70 = Panel(execute_ssh_async_17.Stdout)
sky10klx = Text(execute_ssh_async_16.Stdout)

_10000lux_overcast = Panel("gensky -ang 45 0 -c -B 55.866")

# ----
# Annual sky-matrix 145 patches
wea_file_2 = Text(wea_file)
# Skies and Skymatrices
panel_71 = Panel("gendaymtx -m 1 \"<wea>\" > <smx>;echo \"<smx>\"")
rep_3 = ReplaceText(Text=wea_file_2, Find=".wea", Replace=".smx", RecursiveReplace=False)
panel_72 = Panel("""wea
smx""")
applyglobals_14 = ApplyGlobals(Input=panel_71, AdditionalKeys=panel_72, AdditionalValues=[wea_file_2, rep_3])  # -> Output, Pairs
execute_ssh_async_18 = ExecuteSSHAsync(
    SSHCommands=applyglobals_14.Output,
    Run=execute_ssh_async_9.Ran,
    addPrefix=True,
    addSuffix=True,
    stdouts="/home/mss/simulation/weatherData/NOR_OS_Alna.014870_TMYx.2004-2018.smx")  # -> Stdout, Stderr, Log, Pid, Ran
panel_73 = Panel(execute_ssh_async_18.Stdout)

# ----
# Sun matrix with 5165 suns
wea_file_3 = Text(wea_file)
panel_74 = Panel("gendaymtx -5 0.533 -d -m 6 \"<wea>\" > <smx>;echo \"<smx>\"")
rep_4 = ReplaceText(Text=wea_file_3, Find=".wea", Replace="sunM6.smx", RecursiveReplace=False)
panel_75 = Panel("""wea
smx""")
applyglobals_15 = ApplyGlobals(Input=panel_74, AdditionalKeys=panel_75, AdditionalValues=[wea_file_3, rep_4])  # -> Output, Pairs
execute_ssh_async_19 = ExecuteSSHAsync(
    SSHCommands=applyglobals_15.Output,
    Run=execute_ssh_async_9.Ran,
    addPrefix=True,
    addSuffix=True,
    stdouts="/home/mss/simulation/weatherData/NOR_OS_Alna.014870_TMYx.2004-2018sunM6.smx")  # -> Stdout, Stderr, Log, Pid, Ran
panel_76 = Panel(execute_ssh_async_19.Stdout)

# ----
# Annual direct only daylight matrix with 145 patches
wea_file_4 = Text(wea_file)
rep_5 = ReplaceText(Text=wea_file_4, Find=".wea", Replace="d.smx", RecursiveReplace=False)
panel_77 = Panel("""wea
smx""")
applyglobals_16 = ApplyGlobals(
    Input="gendaymtx -m 1 -d \"<wea>\" > <smx>;echo \"<smx>\"",
    AdditionalKeys=panel_77,
    AdditionalValues=[wea_file_4, rep_5])  # -> Output, Pairs
execute_ssh_async_20 = ExecuteSSHAsync(
    SSHCommands=applyglobals_16.Output,
    Run=execute_ssh_async_9.Ran,
    addPrefix=True,
    addSuffix=True,
    stdouts="/home/mss/simulation/weatherData/NOR_OS_Alna.014870_TMYx.2004-2018d.smx")  # -> Stdout, Stderr, Log, Pid, Ran
panel_78 = Panel(execute_ssh_async_20.Stdout)

panel_79 = Panel("""target
rads""")
and_append_the_ground = Panel("""skyfunc glow ground_glow
0
0
4 1 1 1 0
ground_glow source ground
0
0
4 0 0 -1 180""")

# ----
# Preview a RAD file with objpict
# can also use ra_tiff/normtiff/pfilt
# gamma will vary
# 
# check axel jacobs radiance tutorial p26
panel_80 = Panel("""mkdir -p <proj>/images/
objpict <rad> > <proj>/images/<target-.>.hdr
normtiff <proj>/images/<target-.>.hdr <proj>/images/<target-.>.tif
convert <proj>/images/<target-.>.tif <proj>/images/<target>
echo <proj>/images/<target>""")  # disabled
radfile = Text(execute_ssh_async_16.Stdout)  # disabled
panel_81 = Panel("quickRender.png")  # disabled
panel_82 = Panel("""rad
target""")  # disabled
applyglobals_17 = ApplyGlobals(Input=panel_80, AdditionalKeys=panel_82, AdditionalValues=[radfile, panel_81])  # -> Output, Pairs; disabled
execute_ssh_async_21 = ExecuteSSHAsync(
    SSHCommands=applyglobals_17.Output,
    Run=execute_ssh_async_17.Ran,
    addPrefix=True,
    addSuffix=True,
    stdouts="/home/mss/simulation/test_project/images/quickRender.png")  # -> Stdout, Stderr, Log, Pid, Ran; disabled
convertpaths = ConvertPaths(I=execute_ssh_async_21.Stdout)  # -> Linux, Windows; disabled
imageviewer_4 = LBImageViewer(ImagePath_=convertpaths.Windows, _scale_=1, DisableClickable=False, SaveImgWithCoords=False, scale=1)  # -> ImagePath, Values, GIF; disabled

txt = Text(sky10klx)
ptscount_2 = Integer(ptscount)
ptscount_3 = Integer(ptscount)

button = Button()
view = CreateView(Viewport="Perspective", Update=button)  # -> ViewfileContent, ImageRatio
panel_83 = Panel(view.ViewfileContent)

m6_sky_mtx = Text(panel_76)
ladybug = Ladybug_Ladybug()  # -> Vviiiiiiiiiizzz; disabled; plug-in component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
geo_6 = Geometry(<brep referenced from the Rhino model>)  # disabled
path_2 = FilePath("C:\Users\mm1013\Documents\Rhino setup\DNK_Copenhagen.061800_IWEC.epw")  # disabled
panel_84 = Panel("5")  # disabled
panel_85 = Panel("14")  # disabled
panel_86 = Panel("14")  # disabled
debrep = DeconstructBrep(Brep=geo_6)  # -> Faces, Edges, Vertices; disabled
panel_87 = Panel("4")  # disabled
genstandardciesky = Honeybee_GenerateStandardCIESky(weatherFile=path_2, month=panel_84, day=panel_85, hour=panel_86, skyType=panel_87)  # -> skyFilePath; disabled; plug-in component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
panel_88 = Panel("Perspective")  # disabled
createhbsrfs = Honeybee_createHBSrfs(geometry=debrep.Faces)  # -> readMe, simplify(HBSurface); disabled; plug-in component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
panel_89 = Panel("700")  # disabled
panel_90 = Panel("152")  # disabled
# RENDER PARALLEL (RPIECE)
opt1 = Panel("""NCPU=<cpus>
COLS=<cpus>
ROWS=8
echo "-vf views/view.vf" > viewpoint
echo "-w -i -bv -ab 4 -ar 128 -ad 1024 -as 512 -aa 0.15 -av 0.0 0.0 0.0 -aw 0 -lr -10 -lw 0.004 -x 2048 -y 2048 -af ambfile -ps 1 -ds .1 -dj .6 -t 120" > options
echo "-o <proj>/<unf> <proj>/<octree>" > arguments
echo $COLS $ROWS > syncfile
rm -f pp
while [ "$NCPU" -gt 0 ]
do
	echo "running proc $NCPU"
	rpiece -v -PP pp -F syncfile @viewpoint @options @arguments &
	NCPU=`expr $NCPU - 1`
	sleep 2
done
wait""")
imagebasedsimulation = Honeybee_ImageBasedSimulation(
    skyFile=genstandardciesky,
    rhinoViewsName=panel_88,
    simulationType=2,
    imageWidth=panel_90,
    imageHeight=panel_89,
    backupImages=0)  # -> analysisRecipe; disabled; plug-in component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
toggle_2 = BooleanToggle(True)  # disabled
run = LBFalseStartToggle(False)
rundaylightanalysis = Honeybee_RunDaylightSimulation(
    HBObjects=flatten(createhbsrfs.HBSurface),
    analysisRecipe=imagebasedsimulation,
    writeRad=toggle_2,
    runRad=toggle_2,
    overwriteResults=True)  # -> readMe, analysisType, resultsUnit, results, testPts, luminance_files, radGeoFile, studyFolder, done; disabled; plug-in component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

overrides_8 = ApplyOverrides(Input="awd <<a3-1>>  22", A3=flatten("ff"))  # -> Output, Pairs

hdr_gif = Honeybee_ConvertHDRToGIF(HDRFilePath=rundaylightanalysis.luminance_files, adjustExposure=False)  # -> GIFFilePath; disabled; plug-in component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
default = DefaultMSS(data=flatten(overrides_8.Output), default_value_flattened=flatten("8"))
# opt2: NCPU=4
# COLS=8
# ROWS=8
# 
# echo "-vf 6.vf" > viewpoint
# echo "-w -i -bv -ab 4 -ar 128 -ad 1024 -as 512 -aa 0.15 -av 0.0 0.0 0.0 -aw 0 -lr -10 -lw 0.004 -x 2048 -y 2048 -af ambfile -ps 1 -ds .1 -dj .6 -t 120" > options
# echo "-o smp.unf model.oct" > arguments
# 
# #echo $COLS $ROWS > syncfile
# rm -f syncfile
# rm -f pp
# 
# while [ "$NCPU" -gt 0 ]
# do
# 	echo "running proc $NCPU"
# 	rpiece -X $COLS -Y $ROWS -v -PP pp -F syncfile @viewpoint @options @arguments &
# 	NCPU=`expr $NCPU - 1`
# 	sleep 2
# done
# wait
panel_91 = Panel("""echo "" > <proj>/run2.sh

tee -a <proj>/run2.sh > /dev/null <<EOF
<shell>EOF""")
ex = Ex(T=opt1)
rejson = SerializeJson(X="5", IncludeNullAndEmptyProperties=False)
imageviewer_5 = LBImageViewer(ImagePath_=hdr_gif, _scale_=1, DisableClickable=False, SaveImgWithCoords=False, scale=1)  # -> ImagePath, Values, GIF; disabled
panel_92 = Panel("""shell
EOT""")
rec = DataRecorder(default, DataLimit=-10, RecordData=True)
panel_93 = Panel("""unf
octree
EOT""")
overrides_9 = ApplyOverrides(Input=panel_91, AdditionalKeys=panel_92, AdditionalValues=["<EOT>", ex])  # -> Output, Pairs
panel_94 = Panel(rec)
panel_95 = Panel("pcompos -a <cpus> <unf> > <targethdr>")
panel_96 = Panel("""C:\Users\mm1013\simulation\NRH_J_Para_LT06_Lysning07_WWR055_Facades03\daylight_factor\model\scene\envelope.mat
C:\Users\mm1013\simulation\NRH_J_Para_LT06_Lysning07_WWR055_Facades03\daylight_factor\model\scene\envelope.rad""")  # disabled

view_2 = CreateView(Viewport="MyCamera")  # -> ViewfileContent, ImageRatio
panel_97 = Panel(view_2.ViewfileContent)

radviewer = RadViewer(RadFiles=panel_96, IsTwoSided=True, ShowEdges=True, Transparent=True)  # -> Meshes, Names, ModifierNames, Modifiers, FailedWireFrame; disabled
falsestart_6 = LBFalseStartToggle(False)
crv = Curve(radviewer.FailedWireFrame)  # disabled
panel_98 = Panel(radviewer.Modifiers)
points_3 = Text(points_2)
analysisperiod = LBAnalysisPeriod(start_month=1, start_day=1, start_hour="8", end_hour="18")  # -> period, hoys, dates; plug-in component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
pt_2 = Point(flatten(pt))
Z = UnitZ(Factor=1)
long_2 = LongestList(ListA=pt_2, ListB=Z, PaddingMode=2)  # -> ListA, ListB
honeybee = Honeybee_Honeybee()  # -> Vviiiiiiiiiizzz; plug-in component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
toggle_3 = BooleanToggle(False)
pt_3 = Point(pt_2)
falsestart_7 = LBFalseStartToggle(False)
applyglobals_18 = ApplyGlobals(Input="[ -f <file> ] && echo \"1\" || echo \"0\"", AdditionalKeys="file", AdditionalValues="~/simulation/points.pts2")  # -> Output, Pairs
execute_ssh_async_22 = ExecuteSSHAsync(SSHCommands=applyglobals_18.Output, Run=falsestart_7, addPrefix=True, addSuffix=True)  # -> Stdout, Stderr, Log, Pid, Ran
panel_99 = Panel(execute_ssh_async_22.Stdout)

panel_100 = Panel("cat ~/.bashrc")  # disabled
panel_101 = Panel("dwd | tee ~/simulation/log.txt")  # disabled
falsestart_8 = LBFalseStartToggle(False)  # disabled

execute_ssh_async_23 = ExecuteSSHAsync(SSHCommands=[panel_100, panel_101], Run=falsestart_8, addPrefix=True, addSuffix=True)  # -> Stdout, Stderr, Log, Pid, Ran; disabled

panel_102 = Panel(execute_ssh_async_23.Stdout)  # disabled
panel_103 = Panel(execute_ssh_async_23.Log)  # disabled
panel_104 = Panel(execute_ssh_async_23.Stderr)  # disabled

# ----
# Check if ximage and other x-commands work.
# Must have Xlaunch running on windows with disabled access control
# Otherwise it will crash!
panel_105 = Panel("""export "DISPLAY=$(ip route list default | awk '{print $3}'):0"
export "LIBGL_ALWAYS_INDIRECT=1"
xclock""")
falsestart_9 = LBFalseStartToggle(False)

execute_ssh_async_24 = ExecuteSSHAsync(SSHCommands=panel_105, Run=falsestart_9, addPrefix=True, addSuffix=True)  # -> Stdout, Stderr, Log, Pid, Ran
panel_106 = Panel(execute_ssh_async_24.Log)

panel_107 = Panel(execute_ssh_async_24.Stderr)

# ----
# Sun
# sun primitive
panel_108 = Panel("""export PATH=$PATH.:/usr/local/radiance/bin
export RAYPATH=.:/usr/local/radiance/lib
echo "void light solar 0 0 3 1e6 1e6 1e6" > <target>
echo "<target>"
""")

applyglobals_19 = ApplyGlobals(Input=panel_108, AdditionalKeys="target", AdditionalValues="~/simulation/suns.rad")  # -> Output, Pairs
panel_109 = Panel("""export PATH=$PATH.:/usr/local/radiance/bin
export RAYPATH=.:/usr/local/radiance/lib
cnt 5165 | rcalc -e MF:6 -f reinsrc.cal -e Rbin=recno -o 'solar source sun 0 0 4 ${Dx} ${Dy} ${Dz} 0.553' >> <target>
echo <target>""")

execute_ssh_async_25 = ExecuteSSHAsync(
    SSHCommands=applyglobals_19.Output,
    Run=execute_ssh_async_6.Ran,
    addPrefix=True,
    addSuffix=True,
    stdouts="~/simulation/suns.rad")  # -> Stdout, Stderr, Log, Pid, Ran

# ----
# solar discs and modifiers for 5165 suns (=MF:6)
panel_110 = Panel("target")
applyglobals_20 = ApplyGlobals(Input=panel_109, AdditionalKeys=panel_110, AdditionalValues=execute_ssh_async_25.Stdout)  # -> Output, Pairs
execute_ssh_async_26 = ExecuteSSHAsync(
    SSHCommands=applyglobals_20.Output,
    Run=execute_ssh_async_25.Ran,
    addPrefix=True,
    addSuffix=True,
    stdouts="/home/mss/simulation/suns.rad")  # -> Stdout, Stderr, Log, Pid, Ran

# ----
# Octrees
# STANDARD octree
window_mat_3 = Text(window_mat)
opaque_mat_2 = Text(opaque_mat)
opaque_rad_2 = Text(opaque_rad)
window_rad_3 = Text(window_rad)
and_2 = GateAnd(A=execute_ssh_async_11.Ran, B=execute_ssh_async_10.Ran)
entwine_6 = Entwine(Branch00=window_mat_3, Branch01=window_rad_3, Branch02=opaque_mat_2, Branch03=opaque_rad_2, FlattenInputs=True)  # -> flatten(Result)
join_4 = TextJoin(Text=flatten(entwine_6), Join=" ")
or = GateOr(A=and_2)

entwine_7 = Entwine(Branch00="myscene", Branch01=join_4, FlattenInputs=True)  # -> flatten(Result)
applyglobals_21 = ApplyGlobals(Input=panel_59, AdditionalKeys=panel_79, AdditionalValues=entwine_7)  # -> Output, Pairs
panel_111 = Panel(applyglobals_21.Output)

execute_ssh_async_27 = ExecuteSSHAsync(
    SSHCommands=applyglobals_21.Output,
    Run=Toggle(False),
    addPrefix=True,
    addSuffix=True,
    stdouts="/home/mss/simulation/test_project/myscene.oct")  # -> Stdout, Stderr, Log, Pid, Ran
panel_112 = Panel(execute_ssh_async_27.Stdout)
panel_113 = Panel(execute_ssh_async_27.Ran)
octree = Text(execute_ssh_async_27.Stdout)

# ----
# preview rad files
convertpaths_2 = ConvertPaths(I=entwine_6)  # -> Linux, Windows
radviewer_2 = RadViewer(RadFiles=convertpaths_2.Windows, IsTwoSided=True, ShowEdges=False, Transparent=False)  # -> Meshes, Names, ModifierNames, Modifiers, FailedWireFrame

# ----
# Generate daylight coefficients
panel_114 = Panel("/home/mss/simulation/dc_illum.mtx")
# NO GOOD METHOD (YET) OF MAKING SURE
# THESE 3 DONT RUN AT THE SAME TIME.
# 
# Unless we chain them (doing that as a temp fix)
# Raytracing (rfluxmtx)
panel_115 = Panel("""export PATH=$PATH.:/usr/local/radiance/bin
export RAYPATH=.:/usr/local/radiance/lib
mkdir -p <proj>/mtxs/
rfluxmtx -I+ -y <ptcount> -lw 0.0001 -ab 5 -ad 5000 -n <cpus> - <skyglow> -i <octree> < <points> > <target>;echo <target>""")
raytrace_2ph_2 = Boolean(raytrace_2ph)
skyglow_2 = Text(skyglow)
ptscount_4 = Integer(ptscount)
octree_2 = Text(octree)
points_4 = Text(points_2)
panel_116 = Panel("""points
octree
skyglow
ptcount
target""")
and_3 = GateAnd(
    octree_ok=execute_ssh_async_27.Ran,
    skyglow_ok=execute_ssh_async_14.Ran,
    points_ok=points2pts.Run,
    raytrace=raytrace_2ph_2)
entwine_8 = Entwine(Branch00=points_4, Branch01=octree_2, Branch02=skyglow_2, Branch03=ptscount_4, Branch04=panel_114, FlattenInputs=True)  # -> flatten(Result)
applyglobals_22 = ApplyGlobals(Input=panel_115, AdditionalKeys=panel_116, AdditionalValues=entwine_8)  # -> Output, Pairs
execute_ssh_async_28 = ExecuteSSHAsync(
    SSHCommands=applyglobals_22.Output,
    Run=and_3,
    addPrefix=True,
    addSuffix=True,
    stdouts="/home/mss/simulation/dc_illum.mtx")  # -> Stdout, Stderr, Log, Pid, Ran
panel_117 = Panel(applyglobals_22.Output)
panel_118 = Panel(execute_ssh_async_28.Stdout)

# ----
# Generate daylight coefficients black (direct only)
panel_119 = Panel("/home/mss/simulation/dcd_illum.mtx")
panel_120 = Panel("""export PATH=$PATH.:/usr/local/radiance/bin
export RAYPATH=.:/usr/local/radiance/lib
mkdir -p <proj>/mtxs/
rfluxmtx -I+ -y <ptcount> -lw 0.0002 -ab 1 -ad 5000 -n <cpus> - <skyglow> -i <octree> < <points> > <target>;echo <target>""")
octree_black_2 = Text(octree_black)
skyglow_3 = Text(skyglow)
points_5 = Text(points_2)
panel_121 = Panel("""points
octree
skyglow
ptcount
target""")
and_4 = GateAnd(
    octree_ok=execute_ssh_async_13.Ran,
    skyglow_ok=execute_ssh_async_13.Ran,
    points_ok=points2pts.Run,
    ran_above=execute_ssh_async_28.Ran)
entwine_9 = Entwine(
    Branch00=points_5,
    Branch01=octree_black_2,
    Branch02=skyglow_3,
    Branch03=ptscount_2,
    Branch04=panel_119,
    FlattenInputs=True)  # -> flatten(Result)
applyglobals_23 = ApplyGlobals(Input=panel_120, AdditionalKeys=panel_121, AdditionalValues=entwine_9)  # -> Output, Pairs
execute_ssh_async_29 = ExecuteSSHAsync(
    SSHCommands=applyglobals_23.Output,
    Run=and_4,
    addPrefix=True,
    addSuffix=True,
    stdouts="/home/mss/simulation/dcd_illum.mtx")  # -> Stdout, Stderr, Log, Pid, Ran
panel_122 = Panel(execute_ssh_async_29.Stdout)
panel_123 = Panel(applyglobals_23.Output)

# ----
# - Results of daylight coefficients (direct from 145 sample sky)
panel_124 = Panel("""export PATH=$PATH.:/usr/local/radiance/bin
export RAYPATH=.:/usr/local/radiance/lib
mkdir -p <proj>/results/
dctimestep <dcillum> <skymtx> | rmtxop -fa -t -c 47.4 119.9 11.6 - > <proj>/results/<target>;echo <proj>/results/<target>""")
panel_125 = Panel("""dcillum
skymtx
target""")
entwine_10 = Entwine(
    Branch00=execute_ssh_async_29.Stdout,
    Branch01=execute_ssh_async_20.Stdout,
    Branch02="annualR_DCD.ill",
    FlattenInputs=True)  # -> flatten(Result)
and_5 = GateAnd(A=execute_ssh_async_20.Ran, B=execute_ssh_async_29.Ran)
applyglobals_24 = ApplyGlobals(Input=panel_124, AdditionalKeys=panel_125, AdditionalValues=entwine_10)  # -> Output, Pairs
execute_ssh_async_30 = ExecuteSSHAsync(
    SSHCommands=applyglobals_24.Output,
    Run=and_5,
    addPrefix=True,
    addSuffix=True,
    stdouts="/home/mss/simulation/test_project/results/annualR_DCD.ill")  # -> Stdout, Stderr, Log, Pid, Ran
panel_126 = Panel(applyglobals_24.Output)
panel_127 = Panel(execute_ssh_async_30.Stdout)

panel_128 = Panel("head <ill> -n 13;echo \" \";echo \"Number of lines\";wc -l <ill>")
applyglobals_25 = ApplyGlobals(Input=panel_128, AdditionalKeys="ill", AdditionalValues=execute_ssh_async_30.Stdout)  # -> Output, Pairs
execute_ssh_async_31 = ExecuteSSHAsync(
    SSHCommands=applyglobals_25.Output,
    Run=execute_ssh_async_30.Ran,
    addPrefix=True,
    addSuffix=True,
    stdouts="""#?RADIANCE
rmtxop -fa -t -c 47.4 119.9 11.6 -
dctimestep /home/mss/simulation/dcd_illum.mtx /home/mss/simulation/weatherData/NOR_OS_Alna.014870_TMYx.2004-2018d.smx
CAPDATE= 2022:06:09 16:56:15
GMT= 2022:06:09 14:56:15
Applied 1x3 matrix transform
Transposed rows and columns
NROWS=8760
NCOLS=108
NCOMP=1
FORMAT=ascii

 0.000000000000000e+00	 0.000000000000000e+00	 0.000000000000000e+00	 0.000000000000000e+00	 0.000000000000000e+00	 0.000000000000000e+00	 0.000000000000000e+00	 0.000000000000000e+00	 0.000000000000000e+00	 0.000000000000000e+00	 0.000000000000000e+00	 0.000000000000000e+00	 0.000000000000000e+00	 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
 
Number of lines
8772 /home/mss/simulation/test_project/results/annualR_DCD.ill""")  # -> Stdout, Stderr, Log, Pid, Ran
panel_129 = Panel(execute_ssh_async_31.Stdout)

# ----
# create black octreeDDS
suns_material = Text(execute_ssh_async_25.Stdout)
black_rad_files_3 = Text(black_rad_files)
window_mat_4 = Text(window_mat)
window_rad_4 = Text(window_rad)
black_mat_3 = Text(black_mat)
mf6_suns = Text(execute_ssh_async_26.Stdout)
entwine_11 = Entwine(
    Branch00=window_mat_4,
    Branch01=window_rad_4,
    Branch02=black_mat_3,
    Branch03=black_rad_files_3,
    Branch04=suns_material,
    Branch05=mf6_suns,
    FlattenInputs=True)  # -> flatten(Result)
join_5 = TextJoin(Text=flatten(entwine_11), Join=" ")
panel_130 = Panel("""rads
target""")
applyglobals_26 = ApplyGlobals(
    Input="oconv -f <rads> > <target>;echo <target>",
    AdditionalKeys=panel_130,
    AdditionalValues=[join_5, "~/simulation/myscene_black_sunCoeffecientsDDS.oct"])  # -> Output, Pairs

execute_ssh_async_32 = ExecuteSSHAsync(
    SSHCommands=applyglobals_26.Output,
    Run=execute_ssh_async_26.Ran,
    addPrefix=True,
    addSuffix=True,
    stdouts="/home/mss/simulation/myscene_black_sunCoeffecientsDDS.oct")  # -> Stdout, Stderr, Log, Pid, Ran

panel_131 = Panel(execute_ssh_async_32.Stdout)
octree_blackdds = Text(panel_131)

# ----
# Calculate illuminance sun coefficients for illuminance calculations
panel_132 = Panel("cdsDDS_illum.mtx")
# Raytracing suns (rcontrib)
panel_133 = Panel("""export PATH=$PATH.:/usr/local/radiance/bin
export RAYPATH=.:/usr/local/radiance/lib
mkdir -p <proj>/mtxs/
rcontrib -I+ -ab 1 -y <ptcount> -n <cpus> -ad 256 -lw 1.0e-3 -dc 1 -dt 0 -dj 0 -faf -e MF:6 -f reinhart.cal -b rbin -bn Nrbins -m solar <octree> < <points> > <proj>/mtxs/<target>
echo <proj>/mtxs/<target>""")
octree_blackdds_2 = Text(octree_blackdds)
points_6 = Text(points_2)
panel_134 = Panel("""points
octree
ptcount
target""")
entwine_12 = Entwine(Branch00=points_6, Branch01=octree_blackdds_2, Branch02=ptscount_3, Branch03=panel_132, FlattenInputs=True)  # -> flatten(Result)
and_6 = GateAnd(octree_ok=execute_ssh_async_32.Ran, points_ok=points2pts.Run, ran_above=execute_ssh_async_29.Ran)
applyglobals_27 = ApplyGlobals(Input=panel_133, AdditionalKeys=panel_134, AdditionalValues=entwine_12)  # -> Output, Pairs
panel_135 = Panel(applyglobals_27.Output)
execute_ssh_async_33 = ExecuteSSHAsync(
    SSHCommands=applyglobals_27.Output,
    Run=and_6,
    addPrefix=True,
    addSuffix=True,
    stdouts="/home/mss/simulation/test_project/mtxs/cdsDDS_illum.mtx")  # -> Stdout, Stderr, Log, Pid, Ran
panel_136 = Panel(execute_ssh_async_33.Stdout)

# ----
# + Results of direct sun coefficients (5165 sample sky)
panel_137 = Panel("annualR_CDS.ill")
panel_138 = Panel("""export PATH=$PATH.:/usr/local/radiance/bin
export RAYPATH=.:/usr/local/radiance/lib
mkdir -p <proj>/results/
dctimestep <dcillum> <skymtx> | rmtxop -fa -t -c 47.4 119.9 11.6 - > <proj>/results/<target>;echo <proj>/results/<target>""")
panel_139 = Panel("""dcillum
skymtx
target""")
entwine_13 = Entwine(Branch00=panel_136, Branch01=m6_sky_mtx, Branch02=panel_137, FlattenInputs=True)  # -> flatten(Result)
and_7 = GateAnd(A=execute_ssh_async_33.Ran, B=execute_ssh_async_19.Ran)
applyglobals_28 = ApplyGlobals(Input=panel_138, AdditionalKeys=panel_139, AdditionalValues=entwine_13)  # -> Output, Pairs
execute_ssh_async_34 = ExecuteSSHAsync(
    SSHCommands=applyglobals_28.Output,
    Run=and_7,
    addPrefix=True,
    addSuffix=True,
    stdouts="/home/mss/simulation/test_project/results/annualR_CDS.ill")  # -> Stdout, Stderr, Log, Pid, Ran
panel_140 = Panel(applyglobals_28.Output)
panel_141 = Panel(execute_ssh_async_34.Stdout)

panel_142 = Panel("head <ill> -n 13;echo \" \";echo \"Number of lines\";wc -l <ill>")
applyglobals_29 = ApplyGlobals(Input=panel_142, AdditionalKeys="ill", AdditionalValues=execute_ssh_async_34.Stdout)  # -> Output, Pairs
execute_ssh_async_35 = ExecuteSSHAsync(
    SSHCommands=applyglobals_29.Output,
    Run=execute_ssh_async_34.Ran,
    addPrefix=True,
    addSuffix=True,
    stdouts="""#?RADIANCE
rmtxop -fa -t -c 47.4 119.9 11.6 -
dctimestep /home/mss/simulation/test_project/mtxs/cdsDDS_illum.mtx /home/mss/simulation/weatherData/NOR_OS_Alna.014870_TMYx.2004-2018sunM6.smx
CAPDATE= 2022:06:09 16:59:33
GMT= 2022:06:09 14:59:33
Applied 1x3 matrix transform
Transposed rows and columns
NROWS=8760
NCOLS=108
NCOMP=1
FORMAT=ascii

 0.000000000000000e+00	 0.000000000000000e+00	 0.000000000000000e+00	 0.000000000000000e+00	 0.000000000000000e+00	 0.000000000000000e+00	 0.000000000000000e+00	 0.000000000000000e+00	 0.000000000000000e+00	 0.000000000000000e+00	 0.000000000000000e+00	 0.000000000000000e+00	 0.000000000000000e+00	 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
 
Number of lines
8772 /home/mss/simulation/test_project/results/annualR_CDS.ill""")  # -> Stdout, Stderr, Log, Pid, Ran
panel_143 = Panel(execute_ssh_async_35.Stdout)

# ----
# 10klx overcast sky (RwR p357)
panel_144 = Panel("gensky -ang 45 0 -c -B 55.866")
execute_ssh_async_36 = ExecuteSSHAsync(
    SSHCommands=panel_144,
    Run=execute_ssh_async_17.Ran,
    addPrefix=True,
    addSuffix=True,
    stdouts="""# gensky -ang 45 0 -c -B 55.866
# Ground ambient level: 17.8

void brightfunc skyfunc
2 skybr skybright.cal
0
3 2 2.29e+01 3.56e+00""")  # -> Stdout, Stderr, Log, Pid, Ran
# # start of sky definition for daylighting studies
# # location name: COPENHAGEN_DNK LAT: 55.63
# !gensky 5 14 14.0 -c -a 55.63 -o -12.67 -m -15.0 | xform -rz 0.0
# skyfunc glow sky_mat
# 0
# 0
# 4
# 1 1 1 0
# sky_mat source sky
# 0
# 0
# 4
# 0 0 1 180
# skyfunc glow ground_glow
# 0
# 0
# 4
# 1 .8 .5 0
# ground_glow source ground
# 0
# 0
# 4
# 0 0 -1 180
# # end of sky definition for daylighting studies
panel_145 = Panel("overcast_sky.rad")
panel_146 = Panel("""mkdir -p <proj>/skies/
echo "<sky>" > <proj>/skies/<target>
echo "<proj>/skies/<target>"
""")
panel_147 = Panel("""sky
target""")

concat_5 = Concatenate(FragmentA=execute_ssh_async_36.Stdout, FragmentB=and_append_the_ground)

panel_148 = Panel(concat_5)
entwine_14 = Entwine(Branch00=panel_148, Branch01=panel_145, FlattenInputs=True)  # -> flatten(Result)
applyglobals_30 = ApplyGlobals(Input=panel_146, AdditionalKeys=panel_147, AdditionalValues=entwine_14)  # -> Output, Pairs
execute_ssh_async_37 = ExecuteSSHAsync(
    SSHCommands=applyglobals_30.Output,
    Run=execute_ssh_async_17.Ran,
    addPrefix=True,
    addSuffix=True,
    stdouts="~/simulation/test_project2/skies/overcast_sky.rad")  # -> Stdout, Stderr, Log, Pid, Ran
panel_149 = Panel(execute_ssh_async_37.Stdout)

applyglobals_31 = ApplyGlobals(Input="cat <target>", AdditionalKeys="target", AdditionalValues=execute_ssh_async_37.Stdout)  # -> Output, Pairs
execute_ssh_async_38 = ExecuteSSHAsync(
    SSHCommands=applyglobals_31.Output,
    Run=execute_ssh_async_37.Ran,
    addPrefix=True,
    addSuffix=True,
    stdouts="""# gensky -ang 45 0 -c -B 55.866
# Ground ambient level: 17.8

void brightfunc skyfunc
2 skybr skybright.cal
0
3 2 2.29e+01 3.56e+00
skyfunc glow ground_glow
0
0
4 1 1 1 0
ground_glow source ground
0
0
4 0 0 -1 180""")  # -> Stdout, Stderr, Log, Pid, Ran
panel_150 = Panel(execute_ssh_async_38.Stdout)

# ----
# OCTREE
panel_151 = Panel("my_test_scene.oct")
scene_rads = Text(entwine_6)
sky_ovc = Text(execute_ssh_async_37.Stdout)
entwine_15 = Entwine(Branch01=sky_ovc, Branch02=scene_rads, FlattenInputs=True)  # -> flatten(Radfiles)
panel_152 = Panel("""mkdir -p <proj>/octrees/
oconv -r 2048 -f <rads> > <proj>/octrees/<target>
echo <proj>/octrees/<target>""")
panel_153 = Panel("""rads
target""")
panel_154 = Panel(" ")
join_6 = TextJoin(Text=entwine_15, Join=" ")
entwine_16 = Entwine(Branch00=join_6, Branch01=panel_151, FlattenInputs=True)  # -> flatten(Result)
applyglobals_32 = ApplyGlobals(Input=panel_152, AdditionalKeys=panel_153, AdditionalValues=entwine_16)  # -> Output, Pairs

python_4 = GhPythonScript(x=flatten(scene_rads))  # -> a; inputs x: list
# ---------- python_4: Python ----------
__author__ = "mm1013"
__version__ = "2022.06.15"

import rhinoscriptsyntax as rs

a = None not in x
# ---------- end python_4 ----------
and_8 = GateAnd(A=python_4, B=execute_ssh_async_37.Ran)

execute_ssh_async_39 = ExecuteSSHAsync(
    SSHCommands=applyglobals_32.Output,
    Run=and_8,
    addPrefix=True,
    addSuffix=True,
    stdouts="/home/mss/simulation/test_project2/octrees/my_test_scene.oct")  # -> Stdout, Stderr, Log, Pid, Ran
panel_155 = Panel(execute_ssh_async_39.Stdout)

convertpaths_3 = ConvertPaths(I=execute_ssh_async_39.Stdout)  # -> Linux, Windows
panel_156 = Panel(convertpaths_3.Windows)
or_2 = GateOr(A=execute_ssh_async_39.Ran, B=Toggle(True))

# ----
# VIEW
panel_157 = Panel("""mkdir -p <proj>/views/
echo "<vf>" > <proj>/views/<target>
echo <proj>/views/<target>""")
panel_158 = Panel("""vf
target""")
vf = Text(view.ViewfileContent)
entwine_17 = Entwine(Branch00=vf, Branch01="view.vf", FlattenInputs=True)  # -> flatten(Result)
applyglobals_33 = ApplyGlobals(Input=panel_157, AdditionalKeys=panel_158, AdditionalValues=entwine_17)  # -> Output, Pairs
file_exists_2 = Panel("[ -f <out> ] && echo \"1\" || echo \"0\"")
execute_ssh_async_40 = ExecuteSSHAsync(
    SSHCommands=applyglobals_33.Output,
    Run=button,
    addPrefix=True,
    addSuffix=True,
    stdouts="/home/mss/simulation/test_project2/views/view.vf")  # -> Stdout, Stderr, Log, Pid, Ran
panel_159 = Panel(execute_ssh_async_40.Stdout)
applyglobals_34 = ApplyGlobals(Input=file_exists_2, AdditionalKeys="out", AdditionalValues=execute_ssh_async_40.Stdout)  # -> Output, Pairs
# rpiece render multithreaded
# 
# https://discourse.radiance-online.org/t/another-rpiece-question/308/5
execute_ssh_async_41 = ExecuteSSHAsync(SSHCommands=applyglobals_34.Output, Run=or_2, addPrefix=True, addSuffix=True)  # -> Stdout, Stderr, Log, Pid, Ran

# ----
# RENDER
panel_160 = Panel("-ps 8 -pt 0.15 -pj 0.6 -dj 0 -ds 0.5 -dt 0.5 -dc 0.25 -dr 0 -dp 64 -st 0.85 -ab 2 -ad 512 -as 128 -ar 16 -aa 0.250 -lr 4 -lw 0.050 -av 0 0 0")
panel_161 = Panel("""mkdir -p <proj>/images/
rpict -i -t 10 -vf <vf> -x 300 -y 300 <radPar> <octree> > <proj>/images/<target-.>.hdr
normtiff <proj>/images/<target-.>.hdr <proj>/images/<target-.>.tif
convert <proj>/images/<target-.>.tif <proj>/images/<target>
echo <proj>/images/<target>""")
octree_3 = Text(execute_ssh_async_39.Stdout)
entwine_18 = Entwine(Branch00=execute_ssh_async_40.Stdout, Branch01=octree_3, Branch02="myRender.png", Branch03=panel_160, FlattenInputs=True)  # -> flatten(Result)
panel_162 = Panel("""vf
octree
target
radPar""")
overrides_10 = ApplyOverrides(Input=panel_161, AdditionalKeys=panel_162, AdditionalValues=entwine_18)  # -> Output, Pairs
and_9 = GateAnd(A=execute_ssh_async_39.Ran, B=execute_ssh_async_41.Stdout)
execute_ssh_async_42 = ExecuteSSHAsync(
    SSHCommands=overrides_10.Output,
    Run=and_9,
    addPrefix=True,
    addSuffix=True,
    stdouts="/home/mss/simulation/test_project2/images/myRender.png")  # -> Stdout, Stderr, Log, Pid, Ran
convertpaths_4 = ConvertPaths(I=execute_ssh_async_42.Stdout)  # -> Linux, Windows
imageviewer_6 = LBImageViewer(ImagePath_=convertpaths_4.Windows, _scale_=1, DisableClickable=False, SaveImgWithCoords=False, scale=1)  # -> ImagePath, Values, GIF

# ----
# Parallel RTRACE render
panel_163 = Panel("""vwrays -ff -x <x> -y <y> -vf <vf> -pa 1 | rtrace -n <cpus> `vwrays -d -ff -x <x> -y <y> -vf <vf> -pa 1` -ffc <oct> > <proj>/<target-.>.hdr
ra_tiff <proj>/<target-.>.hdr <proj>/<target-.>.tif
convert <proj>/<target-.>.tif <proj>/<target>
echo <proj>/<target>""")
octree_4 = Text(execute_ssh_async_39.Stdout)
viewfile = Text(execute_ssh_async_40.Stdout)
y = Panel("150")
panel_164 = Panel("echo \"rvu -vtv -vp 0.5 4.5 1.6 -vd 0.830824 -1.13002 -0.181063 -vu 0 0 1 -vh 98.2132 -vv 79.2785 -vo 0 -va 0 -vs 0 -vl 0\" > <proj>/views/myview.vf;echo <proj>/views/myview.vf")
panel_165 = Panel("""x
y
vf
oct
target""")
entwine_19 = Entwine(Branch00="250", Branch01=y, Branch02=viewfile, Branch03=octree_4, Branch04="rtrace_rendering.png", FlattenInputs=True)  # -> flatten(Result)
overrides_11 = ApplyOverrides(Input=panel_163, AdditionalKeys=panel_165, AdditionalValues=entwine_19)  # -> Output, Pairs
execute_ssh_async_43 = ExecuteSSHAsync(
    SSHCommands=overrides_11.Output,
    Run=run,
    addPrefix=True,
    addSuffix=False,
    stdouts="/home/mss/simulation/test_project2/rtrace_rendering.png")  # -> Stdout, Stderr, Log, Pid, Ran
execute_ssh_async_44 = ExecuteSSHAsync(
    SSHCommands=panel_164,
    Run=run,
    addPrefix=True,
    addSuffix=True,
    stdouts="/home/mss/simulation/test_project2/views/myview.vf")  # -> Stdout, Stderr, Log, Pid, Ran
panel_166 = Panel(execute_ssh_async_43.Stdout)
convertpaths_5 = ConvertPaths(I=execute_ssh_async_43.Stdout)  # -> Linux, Windows
imageviewer_7 = LBImageViewer(ImagePath_=convertpaths_5.Windows, _scale_=1, DisableClickable=False, SaveImgWithCoords=False, scale=1)  # -> ImagePath, Values, GIF

octree_5 = Text(execute_ssh_async_39.Stdout)
entwine_20 = Entwine(Branch00="collectedRender.unf", Branch01=octree_5, Branch02="<EOT>", FlattenInputs=True)  # -> flatten(Result)
overrides_12 = ApplyOverrides(Input=overrides_9.Output, AdditionalKeys=panel_93, AdditionalValues=entwine_20)  # -> Output, Pairs
execute_ssh_async_45 = ExecuteSSHAsync(SSHCommands=overrides_12.Output, Run=Toggle(True), addPrefix=False, addSuffix=True)  # -> Stdout, Stderr, Log, Pid, Ran
panel_167 = Panel(overrides_12.Output)
panel_168 = Panel(execute_ssh_async_45.Stderr)

# ----
# Getting results (dctimestep)
# Results of daylight coefficients
panel_169 = Panel("""export PATH=$PATH.:/usr/local/radiance/bin
export RAYPATH=.:/usr/local/radiance/lib
mkdir -p <proj>/results/
dctimestep <dcillum> <skymtx> | rmtxop -fa -t -c 47.4 119.9 11.6 - > <proj>/results/<target>;echo <proj>/results/<target>""")
panel_170 = Panel("""dcillum
skymtx
target""")
entwine_21 = Entwine(
    Branch00=execute_ssh_async_28.Stdout,
    Branch01=execute_ssh_async_18.Stdout,
    Branch02="annualR_DC.ill",
    FlattenInputs=True)  # -> flatten(Result)
and_10 = GateAnd(A=execute_ssh_async_28.Ran, B=execute_ssh_async_18.Ran)
applyglobals_35 = ApplyGlobals(Input=panel_169, AdditionalKeys=panel_170, AdditionalValues=entwine_21)  # -> Output, Pairs

execute_ssh_async_46 = ExecuteSSHAsync(
    SSHCommands=applyglobals_35.Output,
    Run=and_10,
    addPrefix=True,
    addSuffix=True,
    stdouts="/home/mss/simulation/test_project/results/annualR_DC.ill")  # -> Stdout, Stderr, Log, Pid, Ran

panel_171 = Panel("head <ill> -n 13;echo \" \";echo \"Number of lines\";wc -l <ill>")
applyglobals_36 = ApplyGlobals(Input=panel_171, AdditionalKeys="ill", AdditionalValues=execute_ssh_async_46.Stdout)  # -> Output, Pairs
execute_ssh_async_47 = ExecuteSSHAsync(
    SSHCommands=applyglobals_36.Output,
    Run=execute_ssh_async_46.Ran,
    addPrefix=True,
    addSuffix=True,
    stdouts="""#?RADIANCE
rmtxop -fa -t -c 47.4 119.9 11.6 -
dctimestep /home/mss/simulation/dc_illum.mtx /home/mss/simulation/weatherData/NOR_OS_Alna.014870_TMYx.2004-2018.smx
CAPDATE= 2022:06:09 16:55:47
GMT= 2022:06:09 14:55:47
Applied 1x3 matrix transform
Transposed rows and columns
NROWS=8760
NCOLS=108
NCOMP=1
FORMAT=ascii

 0.000000000000000e+00	 0.000000000000000e+00	 0.000000000000000e+00	 0.000000000000000e+00	 0.000000000000000e+00	 0.000000000000000e+00	 0.000000000000000e+00	 0.000000000000000e+00	 0.000000000000000e+00	 0.000000000000000e+00	 0.000000000000000e+00	 0.000000000000000e+00	 0.000000000000000e+00	 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
 
Number of lines
8772 /home/mss/simulation/test_project/results/annualR_DC.ill""")  # -> Stdout, Stderr, Log, Pid, Ran
panel_172 = Panel(execute_ssh_async_47.Stdout)

panel_173 = Panel(execute_ssh_async_46.Stderr)

# ----
# final step: Combine results
panel_174 = Panel("""export PATH=$PATH.:/usr/local/radiance/bin
export RAYPATH=.:/usr/local/radiance/lib
rmtxop <DCannualR> + -s -1 <DCDannualR> + <CDSannualR> > <proj>/results/<target>;echo <proj>/results/<target>""")
panel_175 = Panel("""DCannualR
DCDannualR
CDSannualR
target""")
falsestart_10 = LBFalseStartToggle(False)
and_11 = GateAnd(A=execute_ssh_async_46.Ran, B=execute_ssh_async_30.Ran, C=execute_ssh_async_34.Ran)
entwine_22 = Entwine(
    Branch00=execute_ssh_async_46.Stdout,
    Branch01=execute_ssh_async_30.Stdout,
    Branch02=execute_ssh_async_34.Stdout,
    Branch03="DDS_Total.ill",
    FlattenInputs=True)  # -> flatten(Result)
or_3 = GateOr(A=and_11, B=falsestart_10)
applyglobals_37 = ApplyGlobals(Input=panel_174, AdditionalKeys=panel_175, AdditionalValues=entwine_22)  # -> Output, Pairs
panel_176 = Panel(applyglobals_37.Output)
execute_ssh_async_48 = ExecuteSSHAsync(
    SSHCommands=applyglobals_37.Output,
    Run=or_3,
    addPrefix=True,
    addSuffix=True,
    stdouts="/home/mss/simulation/test_project/results/DDS_Total.ill")  # -> Stdout, Stderr, Log, Pid, Ran
int = Integer("1")

overrides_13 = ApplyOverrides(Input="<proj>/results/<dds>", AdditionalKeys="dds", AdditionalValues="DDS_Total.ill")  # -> Output, Pairs
replace = ReplaceItems(List=entwine_22, Item=overrides_13.Output, Indices=-1, Wrap=True)
panel_177 = Panel(execute_ssh_async_48.Stdout)

panel_178 = Panel("C:\Users\mm1013\simulation\radTutorialFiles\room\points.txt")
panel_179 = Panel("C:\Users\mm1013\simulation\radTutorialFiles\room\results\dcDDS\annualR.ill")
file = ReadFile(File=panel_178, PerLineParse=True)
c_script = CSharpScript(x=file)  # -> out, A; inputs x: list of String
# ---------- c_script: C# ----------
    List<Point3d> pts = new List<Point3d>(x.Count);

    for (int i = 0; i < x.Count; i++)
    {
      string[] split = x[i].Split(' ');
      pts.Add(new Point3d(double.Parse(split[0]),
        double.Parse(split[1]),
        double.Parse(split[2]))
        );
    }

    A = pts;
# ---------- end c_script ----------
falsestart_11 = LBFalseStartToggle(False)
dup = DuplicateData(Data=int, Number="40", Order=True)
annualresults = AnnualResults(IllFile=panel_179, Schedule=dup, Min="300", Max="300000000", Run=falsestart_11)  # -> Headers, Results, Ran
gradient = Gradient(
    LowerLimit="1",
    UpperLimit="0",
    Parameter=annualresults.Results,
    stops=[0: RGB(234, 38, 0), 0.25: RGB(234, 126, 0), 0.5: RGB(254, 244, 84), 0.75: RGB(173, 203, 249), 1: RGB(75, 107, 169)])
preview = CustomPreview(Geometry=c_script.A, Material=gradient)

or_4 = GateOr(A=execute_ssh_async_48.Ran, B=falsestart_6)
list = ItemSelector(
    replace,
    {"/home/mss/simulation/test_project/results/annualR_DC.ill", "/home/mss/simulation/test_project/results/annualR_DCD.ill", "/home/mss/simulation/test_project/results/annualR_CDS.ill", "~/simulation/test_project2/results/DDS_Total.ill"}, selected="/home/mss/simulation/test_project/results/annualR_DC.ill")
download = Download(LinuxFilePaths=list, Run=or_4)  # -> Status, FilePaths, Run
panel_180 = Panel(download.FilePaths)
dup_2 = DuplicateData(Data=int, Number="8760", Order=True)
annualresults_2 = AnnualResults(IllFile=download.FilePaths, Schedule=dup_2, Min=300, Max=0, Run=download.Run)  # -> Headers, Results, Ran
bnd = Bounds(Numbers=annualresults_2.Results)
readannualresultsi = Honeybee_ReadAnnualResultI(
    illFilesAddress=panel_180,
    testPoints=simplify(long_2.ListA),
    ptsVectors=long_2.ListB,
    DLAIllumThresholds=300,
    runIt=download.Run)  # -> DLA, UDLI_Less_100, UDLI_100_2000, UDLI_More_2000, CDA, sDA, annualProfiles, htmReport; plug-in component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
panel_181 = Panel(bnd)
reload_analysisgrid = GhPythonScript(pts_file="C:\Users\mm1013\simulation\points.pts", ill_file=panel_180, hoys=analysisperiod.hoys, run=or_4)  # -> out, analysisGrid; inputs hoys: list
# ---------- reload_analysisgrid: Python ----------
"""
    Args:
        _pts_file: Path to a points (*.pts) file
        _ill_file: Path to an illuminance (*.ill) file
        _hoys: A list of hours of the year. This should be the same list as the
            one used to run the simulation earlier.
            
            If you ran an Annual Simulation (using the Annual Daylight, Annual
            Radiation, DC-Grid Based, 3P or 5P recipe), you should provide a
            list of integers from 0 to 8759. If you used smaller timesteps in
            your simulation (e.g. using 'hoys_' input in HoneybeePlus_SkyMatrix
            component), make sure you provide a list with appropriate matching
            timesteps.
            
            If you ran a Solar Access simulation, you could use the hoys output
            from LadybugPlus_SunPath component i.e. the same you provided for the
            Solar Access Recipe.
            
            If you ran a simulation using HoneybeePlus Grid Based Recipe, you
            should enter the same hoy as was used to create the sky.
            
            You can get this _hoys list from:
            (1) LadybugPlus_SunPath component
            (2) LadybugPlus_Analysis Period component
            (3) LadybugPlus_Calculate HOY component
            (4) Standard grasshopper components
        _gridMode_: 0 > load the values. (Default)
            1 > load values as binary. Any non-zero value will be 1. Useful for studies such as Solar Access a.k.a. Sunlight Hours.
            2 > load the values divided by mode number. Use this mode for daylight factor or radiation analysis
        _run: Set to True to load the AnalysisGrid
    Returns:
        analysisGrid: Outputs a analysis grid loaded with results. Connect this
             grid to standard honeybee[+] copmonents to get the values
"""

import rhinoscriptsyntax as rs
from honeybee_plus.radiance.analysisgrid import AnalysisGrid

if _run == True:


    if _gridMode_ == None:
        gmode = 0
    else:
        gmode = int(_gridMode_)

# first let's create an analysis grid from pts file
    analysisGrid = AnalysisGrid.from_file(_pts_file)

# now let's load the results
    analysisGrid.set_values_from_file(_ill_file, hoys=_hoys, mode=gmode)
# ---------- end reload_analysisgrid ----------
readannualresultsiii = ReadAnnualResultsIII(resultFilesAddress=panel_180, minThreshold=300, maxThreshold=0)  # -> out, lessThanRange, inTheRange, moreThanRange, CDA; inputs resultFilesAddress: list of String, minThreshold: Double, maxThreshold: Double
# ---------- readannualresultsiii: C# usings ----------
using System.IO;
using System.Linq;
using System.Data;
using System.Drawing;
using System.Reflection;
using System.Windows.Forms;
using System.Xml;
using System.Xml.Linq;
using System.Runtime.InteropServices;

using Rhino.DocObjects;
using Rhino.Collections;
using GH_IO;
using GH_IO.Serialization;
# ---------- readannualresultsiii: C# ----------
    List < string > lines = new List<string>{};
    int ptsNumbers = 0;
    double min = minThreshold;
    double max = maxThreshold;

    var underT = new List<int>{};
    var withinT = new List<int>{};
    var aboveT = new List<int>{};

    var underTPercent = new List<double>{};
    var withinTPercent = new List<double>{};
    var aboveTPercent = new List<double>{};
    var cda = new List<double>{};

    double oneHrToPercent = 1 / 36.50;


    double infinity = 1.0 / 0.0;
    if(max == 0)max = infinity;



    for(int f = 0; f < resultFilesAddress.Count; f++){
      lines = File.ReadAllLines(resultFilesAddress[f], System.Text.Encoding.GetEncoding(1252)).ToList();

      int catecount = lines[0].Split(' ').Length - 4;


      for(int i = 0; i < catecount; i++){
        //underT.Add(0);
        //withinT.Add(0);
        //aboveT.Add(0);
        underTPercent.Add(0);
        withinTPercent.Add(0);
        aboveTPercent.Add(0);
        cda.Add(0);
      }

      for(int i = 0; i < 8760; i++){
        string [] items = lines[i].Split(' ');
        //A = items;
        var hr = Convert.ToDouble(items[2]);

        if(hr >= 8 && hr < 18){

          for(int l = 0; l < catecount; l++){
            int item = Convert.ToInt32(items[l + 4]);
            int ptsIndex = l + ptsNumbers;

            if(item < min){
              //underT[ptsIndex] += 1;
              underTPercent[ptsIndex] += oneHrToPercent;
              double factor = item / min;
              cda[ptsIndex] += oneHrToPercent * factor;
            }else if(item > max){
              //aboveT[ptsIndex] += 1;
              aboveTPercent[ptsIndex] += oneHrToPercent;
            }else{
              //withinT[ptsIndex] += 1;
              withinTPercent[ptsIndex] += oneHrToPercent;
              cda[ptsIndex] += oneHrToPercent;
            }
          }

        }
      }

      ptsNumbers += catecount;


    }



    lessThanRange = underTPercent;
    inTheRange = withinTPercent;
    moreThanRange = aboveTPercent;
    CDA = cda;
# ---------- end readannualresultsiii ----------
readannualresultsiii_2 = ReadAnnualResultsIII(resultFilesAddress=panel_180, workingHours=[8, 9, 10, 11, 12, 13, 14, 15, 16, 17], minThreshold=300, maxThreshold=0)  # -> out, lessThanRange, inTheRange, moreThanRange, CDA; inputs resultFilesAddress: list of String, workingHours: list of Int32, minThreshold: Double, maxThreshold: Double
# ---------- readannualresultsiii_2: C# ----------
    Component.Message = "VER 0.0.61\nJUL_06_2017";
    List < string > lines = new List<string>{};
    //int ptsNumbers = 0;
    min = minThreshold;
    max = maxThreshold;
    hours = workingHours;
    oneHrToPercent = 1 / (3.65*hours.Count);

    var AllProcessedData = new List<List<List<double>>>();

    var underTPercent = new List<double>{};
    var withinTPercent = new List<double>{};
    var aboveTPercent = new List<double>{};
    var cda = new List<double>{};


    double infinity = 1.0 / 0.0;
    if(max == 0)max = infinity;

    var illResults = resultFilesAddress.AsParallel().AsOrdered().Select(file => readIllFile(file));
    foreach (var illResult in illResults)
    {
      underTPercent.AddRange(illResult[0]);
      withinTPercent.AddRange(illResult[1]);
      aboveTPercent.AddRange(illResult[2]);
      cda.AddRange(illResult[3]);
    }

    lessThanRange = underTPercent;
    inTheRange = withinTPercent;
    moreThanRange = aboveTPercent;
    CDA = cda;
# ---------- readannualresultsiii_2: C# additional code ----------
  static double min = 300;
  static double max = 0;
  static double oneHrToPercent= 1 / 36.50;
  static List<int> hours;

  static List < List < double >> readIllFile (object file)
  {

    var underTPercent = new List<double>(){};
    var withinTPercent = new List<double>(){};
    var aboveTPercent = new List<double>(){};
    var cda = new List<double>{};
    var lines = File.ReadAllLines((String) file, System.Text.Encoding.GetEncoding(1252)).ToList();

    int ptsCount = lines[0].Split(' ').Length - 4;

    for(int i = 0; i < ptsCount; i++){

      underTPercent.Add(0);
      withinTPercent.Add(0);
      aboveTPercent.Add(0);
      cda.Add(0);
    }

    for(int i = 0; i < 8760; i++){
      string [] items = lines[i].Split(' ');
      //A = items;
      var hr = (int) Convert.ToDouble(items[2]);
      
      //var hrs = new List<int>(){8,9,10};
      int pos = hours.IndexOf(hr);

      if(pos >= 0){

        for(int l = 0; l < ptsCount; l++){
          int item = Convert.ToInt32(items[l + 4]);
          int ptsIndex = l;

          //underTPercent
          if(item < min){
            underTPercent[ptsIndex] += oneHrToPercent;
            cda[ptsIndex] += oneHrToPercent * item / min;
          }
            //aboveTPercent
          else if(item > max)
          {
            aboveTPercent[ptsIndex] += oneHrToPercent;
          }
            //withinTPercent
          else
          {
            withinTPercent[ptsIndex] += oneHrToPercent;
            cda[ptsIndex] += oneHrToPercent;
          }
        }

      }else{
        //underTPercent[hr] = pos;
      }
    }

    //processedData for one ill file
    List < List < double >> processedData = new List<List<double>>(){};

    processedData.Add(underTPercent);
    processedData.Add(withinTPercent);
    processedData.Add(aboveTPercent);
    processedData.Add(cda);

    return processedData;


  }
# ---------- end readannualresultsiii_2 ----------
reload_analysisgrid_2 = GhPythonScript(pts_file="C:\Users\mm1013\simulation\points.pts", ill_file=panel_180, run=Toggle(True))  # -> out, analysisGrid; inputs hoys: list
# ---------- reload_analysisgrid_2: Python ----------
"""
    Args:
        _pts_file: Path to a points (*.pts) file
        _ill_file: Path to an illuminance (*.ill) file
        _hoys: A list of hours of the year. This should be the same list as the
            one used to run the simulation earlier.
            
            If you ran an Annual Simulation (using the Annual Daylight, Annual
            Radiation, DC-Grid Based, 3P or 5P recipe), you should provide a
            list of integers from 0 to 8759. If you used smaller timesteps in
            your simulation (e.g. using 'hoys_' input in HoneybeePlus_SkyMatrix
            component), make sure you provide a list with appropriate matching
            timesteps.
            
            If you ran a Solar Access simulation, you could use the hoys output
            from LadybugPlus_SunPath component i.e. the same you provided for the
            Solar Access Recipe.
            
            If you ran a simulation using HoneybeePlus Grid Based Recipe, you
            should enter the same hoy as was used to create the sky.
            
            You can get this _hoys list from:
            (1) LadybugPlus_SunPath component
            (2) LadybugPlus_Analysis Period component
            (3) LadybugPlus_Calculate HOY component
            (4) Standard grasshopper components
        _gridMode_: 0 > load the values. (Default)
            1 > load values as binary. Any non-zero value will be 1. Useful for studies such as Solar Access a.k.a. Sunlight Hours.
            2 > load the values divided by mode number. Use this mode for daylight factor or radiation analysis
        _run: Set to True to load the AnalysisGrid
    Returns:
        analysisGrid: Outputs a analysis grid loaded with results. Connect this
             grid to standard honeybee[+] copmonents to get the values
"""

import rhinoscriptsyntax as rs
from honeybee_radiance.sensorgrid import SensorGrid
#from honeybee.radiance.analysisgrid import AnalysisGrid

if _run == True:


    if _gridMode_ == None:
        gmode = 0
    else:
        gmode = int(_gridMode_)

# first let's create an analysis grid from pts file
    analysisGrid = SensorGrid.from_file(_pts_file)
    

# now let's load the results
    #analysisGrid.set_values_from_file(_ill_file, hoys=_hoys, mode=gmode)
# ---------- end reload_analysisgrid_2 ----------
readannualresultsii = Honeybee_ReadAnnualResultII(resultFilesAddress=panel_180, testPts=long_2.ListA, timeStep=1, runIt=download.Run)  # -> readMe, lessThanRange, inTheRange, moreThanRange; plug-in component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
python_5 = GhPythonScript(x=reload_analysisgrid_2.analysisGrid)  # -> out, a
# ---------- python_5: Python ----------
__author__ = "mm1013"
__version__ = "2022.05.02"

import rhinoscriptsyntax as rs

a = x.sensors
# ---------- end python_5 ----------
gradient_2 = Gradient(
    LowerLimit="1",
    UpperLimit="0",
    Parameter=annualresults_2.Results,
    stops=[0: RGB(234, 38, 0), 0.25: RGB(234, 126, 0), 0.5: RGB(254, 244, 84), 0.75: RGB(173, 203, 249), 1: RGB(75, 107, 169)])
bnd_2 = Bounds(Numbers=readannualresultsii.inTheRange)
preview_2 = CustomPreview(Geometry=pt_3, Material=gradient_2)

# ==== cluster Cluster
L = ClusterInput()
item = ListItem(List=flatten(L), Index=0, Wrap=True)
rec = DataRecorder(item, DataLimit=-10, RecordData=True)
lng = ListLength(List=rec)
L_2 = ClusterOutput(lng)

# ==== cluster Normals
amplitude = ClusterInput()
amplitude_2 = Data(amplitude)
geo = ClusterInput()
merge = Merge(Data1=flatten(amplitude_2), Data2=flatten("1m"))
geo_2 = Geometry(geo)
item = ListItem(List=merge, Index=0, Wrap=True)
facen = FaceNormals(Mesh=geo_2)  # -> Centers, Normals
U = Units(ValueString=item)
avr = Average(Input=facen.Centers)
avr_2 = Average(Input=facen.Normals)
unflatten = UnflattenTree(Tree=avr, Guide=geo_2)
unflatten_2 = UnflattenTree(Tree=avr_2, Guide=geo_2)
amp = Amplitude(Vector=unflatten_2, Amplitude=U)
pl = PlaneNormal(Origin=unflatten, ZAxis=unflatten_2)
norm = Vector(amp)
center = Point(unflatten)
P = ClusterOutput(pl)
norm_2 = ClusterOutput(norm)
center_2 = ClusterOutput(center)

# ==== cluster Ex
T = ClusterInput()
rep = ReplaceText(Text=T, Find="\", Replace="\\", RecursiveReplace=False)
rep_2 = ReplaceText(Text=rep, Find="$", Replace="\$", RecursiveReplace=False)
rep_3 = ReplaceText(Text=rep_2, Find="`", Replace="\`", RecursiveReplace=False)
R = ClusterOutput(rep_3)

# ==== cluster DefaultMSS
default_value_flattened = ClusterInput()
data = ClusterInput()
data_2 = Data(data)
merge = Merge(Data1=flatten(data_2), Data2="0")  # -> flatten(Result)
default_value_flattened_2 = Data(flatten(default_value_flattened))
lng = ListLength(List=merge)
equals = Equality(FirstNumber=lng, SecondNumber="1")  # -> Equality, Inequality
cull = CullPattern(List=data_2, CullPattern=invert(equals.Equality))
panel = Panel(equals.Equality)
cull_2 = CullPattern(List=default_value_flattened_2, CullPattern=equals.Equality)
data_3 = Data([cull, cull_2])
data_4 = ClusterOutput(data_3)
