# Grasshopper definition TestRenders.gh (Grasshopper 1.0.7)
# Copyright: 2021
# Copyright: 2022-29-14
# Copyright: 2022-22-28
# plug-ins: MantaRay, LadybugGrasshopper, Human, Telepathy

# ----
# Setup globals
panel = Panel("""<LinuxHome>
simulation""")
panel_2 = Panel("""proj
projname""")
global_overrides = GlobalOverrides(Keys=panel_2, Values=panel)
panel_3 = Panel(global_overrides)

panel_4 = Panel("C:\MantaRayLinux")

# ----
# Create working folder
panel_5 = Panel("""mkdir -p <LinuxHome>
mkdir -p <LinuxHome>/radFiles
mkdir -p <LinuxHome>/objFiles
echo <LinuxHome>""")
prep_octrees = LBFalseStartToggle(False)
overrides = ApplyOverrides(Input=panel_5)  # -> Output, DynamicOutput
executessh = ExecuteSSH(
    _SSHCommands_=overrides.DynamicOutput,
    Run=prep_octrees,
    addPrefix=True,
    description="""mkdir -p ~/MantaRay/Andrei
mkdir -p ~/MantaRay/Andrei/radFiles
mkdir -p ~/MantaRay/Andrei/objFiles
echo ~/MantaRay/Andrei""",
    fireLogs=False,
    lastRunTime=21,
    name="Create working dir",
    suppressWarnings=False,
    results="/home/lio/MantaRay/Andrei",
    commands="""mkdir -p ~/MantaRay/Andrei
mkdir -p ~/MantaRay/Andrei/radFiles
mkdir -p ~/MantaRay/Andrei/objFiles
echo ~/MantaRay/Andrei""")  # -> Stdout, Stderr_, Ran
panel_6 = Panel(executessh.Stdout)

# ----
# Local Connect
python = GhPythonScript()  # -> username; disabled
# ---------- python: Python ----------
__author__ = "mm1013"
__version__ = "2022.09.25"

import rhinoscriptsyntax as rs

import System

username = System.Environment.UserName

if username == "mm1013":
    username = "mss"
# ---------- end python ----------
toggle = BooleanToggle(True)  # disabled
panel_7 = Panel("127.0.0.1")  # disabled
panel_8 = Panel(python)  # disabled
connect = ConnectSSHFTP(User=panel_8, Ip="127.0.0.1", Password="_prompt", _port=22, Connect=toggle)  # -> Status, Prefixes, Run; disabled
panel_9 = Panel(connect.Status)  # disabled

od_outdated = ColourSwatch(SwatchColor=RGBA(97, 97, 97, 150))
u_updated = ColourSwatch(SwatchColor=RGBA(208, 115, 230, 112))
toggle_2 = BooleanToggle(False)
g_general = ColourSwatch(SwatchColor=RGBA(245, 243, 237, 156))
o_outputs = ColourSwatch(SwatchColor=RGBA(160, 218, 242, 203))
s_settings = ColourSwatch(SwatchColor=RGBA(224, 145, 81, 154))
cc_core2 = ColourSwatch(SwatchColor=RGBA(230, 216, 186, 208))
y_yellow = ColourSwatch(SwatchColor=RGBA(247, 244, 64, 188))
i_inputs = ColourSwatch(SwatchColor=RGBA(125, 217, 98, 150))
c_core = ColourSwatch(SwatchColor=RGBA(235, 227, 206, 203))
r_red = ColourSwatch(SwatchColor=RGBA(242, 63, 63, 203))

# ----
# Test connection
testconnection = TestConnection()  # -> Status, Errors
panel_10 = Panel(testconnection.Status)
panel_11 = Panel(testconnection.Errors)

# ----
# Read rhino file and prepare simple geometry
parserhinofile = ParseRhinoFile(LayerPrefix="Daylight_Inputs::_", Grids="_Grids")  # -> GlassGeometries, GlassModifiers, port, OpaqueGeometries, OpaqueModifiers, port_2, CustomGeometries, ModifierNames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
falsestart = LBFalseStartToggle(False)
panel_12 = Panel(parserhinofile.SkippedLayers)

# ----
# Log of latest(10) SSH Commands
logviewer = LogViewer(Number=10)  # -> CurrentTasks, Logs
panel_13 = Panel(logviewer.Logs)
panel_14 = Panel(logviewer.CurrentTasks)

colorgroups = CSharpScript(
    Colors=[i_inputs, s_settings, g_general, c_core, o_outputs, r_red, y_yellow, u_updated, od_outdated, cc_core2],
    Enable=toggle_2,
    Rename=Toggle(False),
    RunOnce=Button(),
    Debug=Toggle(False))  # -> out; inputs Colors: list of Color, Enable: Boolean, Rename: Boolean, RunOnce: Boolean, Debug: Boolean
# ---------- colorgroups: C# usings ----------
using System.Linq;
using System.Text;
using System.Reflection;
# ---------- colorgroups: C# ----------
    msg.Clear();


    this.Component.Message = "id: " + id.ToString();

    _debug = Debug; //Set to true to have all events printed in rhino log
    _rename = Rename;

    if (Enable)
    {
      msg.AppendFormat("Set up events on ID {0}\n", id);
      SetupDict(); // Create a dictionary of the input swatches
      SetEventHandlers(); // This would do the job.


    }
    else
    {
      RemoveEventHandlers();
    }
    if (RunOnce)
    {
      foreach(Grasshopper.Kernel.Special.GH_Group grp in Grasshopper.Instances.ActiveCanvas.Document.Objects.OfType<Grasshopper.Kernel.Special.GH_Group>())
      {
        ColorGroup(grp, null); // You decide if it should run once on all existing groups

      }
    }

    Print(msg.ToString());


    // Component setup
    Component.Description = "Set up event handlers to color groups based on prefixes such as 'in_' and 'out_'.\n"
      + "Please insert only swatcheds directly into the Colors input\n\n"
      + "MIT License. Copyright Mathias Sønderskov Schaltz 2022";
    Component.Params.Input[0].Description = "Please insert only swatcheds directly into the Colors input.\nRemember to rename them";
    Component.Params.Input[1].Description = "Toggle to run...";
    Component.Params.Input[2].Description = "Set to true if you want to automatically rename the groups and remove prefix. Default is false.";
    Component.Params.Input[3].Description = "Set to true to run it once and color all existing groups.";
    Component.Params.Input[Component.Params.Input.Count - 1].Description = "Set debug to true to get all the events printed in the rhino log";
# ---------- colorgroups: C# additional code ----------
  public static Random rnd = new Random();
  public int id = rnd.Next(0, 1000);
  StringBuilder msg = new StringBuilder();
  Dictionary<string, System.Drawing.Color> colorDict = new Dictionary<string, System.Drawing.Color>();

  bool _debug = false;
  bool _rename = false;

  public bool IdExists(int id)
  {
    IList<IGH_DocumentObject> objs = Grasshopper.Instances.ActiveCanvas.Document.Objects;
    return objs
      .OfType<IGH_Component>()
      .Where(ob => ob.NickName == this.Component.NickName)
      .Where(ob => ob.GetType().ToString() == "ScriptComponents.Component_CSNET_Script")
      .Where(ob => ob.Message == "id: " + id.ToString()).Any();

  }


  public void SetupDict()
  {
    colorDict.Clear();
    // Get all inputs to "Colors"
    IList<IGH_Param> colorSources = this.Component.Params.Input[0].Sources;
    if (colorSources.Count == 0)
    {
      throw new Exception("You forgot to setup the colors. Please input swatch components and rename them");
    }
    foreach(IGH_Param source in colorSources)
    {
      //if (source.Type.ToString() == "Grasshopper.Kernel.Types.GH_Colour")
      if (source is Grasshopper.Kernel.Special.GH_ColourSwatch)
      {
        string nickName = source.NickName.Split('_')[0].Trim() + "_";
        if(!colorDict.ContainsKey(nickName))
        {
          Grasshopper.Kernel.Special.GH_ColourSwatch swatch = (Grasshopper.Kernel.Special.GH_ColourSwatch) source;
          colorDict.Add(nickName, swatch.SwatchColour);
        }
        else
        {
          throw new Exception("Multiple swatches using the same name detected. Please rename");
        }
      }
      else
      {
        throw new Exception("Whacko! Why did you input a non-swatch into the Colors? " + source.Type.ToString());
      }

    }

    msg.AppendFormat("Set up the dictionaries with {0} colors\n", colorDict.Count);
    foreach(var pairs in colorDict)
    {
      msg.AppendFormat("{0} -> {1}\n", ("\"" + pairs.Key + "\"").PadRight(5 + colorDict.Keys.Select(k => k.Length).Max()), pairs.Value);
    }
  }

  public void SetEventHandlers()
  {

    // Always remove events first to avoid duplicates
    GrasshopperDocument.ObjectsAdded -= OnObjectsAdded;
    GrasshopperDocument.ObjectsDeleted -= OnObjectsRemoved;
    GrasshopperDocument.ObjectsDeleted -= OnDeleteThisComponent;

    // Attach events
    GrasshopperDocument.ObjectsAdded += OnObjectsAdded;
    GrasshopperDocument.ObjectsDeleted += OnObjectsRemoved;
    GrasshopperDocument.ObjectsDeleted += OnDeleteThisComponent;


    foreach(Grasshopper.Kernel.Special.GH_Group grp in GrasshopperDocument.Objects.OfType<Grasshopper.Kernel.Special.GH_Group>())
    {
      grp.ObjectChanged -= ColorGroup;
      grp.ObjectChanged += ColorGroup;

      //ColorGroup(grp, null); // Make sure to run it once
    }
    msg.AppendFormat("Added the eventhandlers on {0} existing groups and on future created groups\n", GrasshopperDocument.Objects.OfType<Grasshopper.Kernel.Special.GH_Group>().Count());
  }

  public void OnObjectsAdded(object sender, GH_DocObjectEventArgs e)
  {
    bool any = false;
    foreach (Grasshopper.Kernel.Special.GH_Group grp in e.Objects.OfType<Grasshopper.Kernel.Special.GH_Group>())
    {
      grp.ObjectChanged -= ColorGroup;
      grp.ObjectChanged += ColorGroup;
      any = true;
    }

    DebugWrite(any ? "Group Objects Added: Attaching Events to ObjectChanged" : "Objects Added - but no groups");
  }

  //Same but reversed
  public void OnObjectsRemoved(object sender, GH_DocObjectEventArgs e)
  {
    bool any = false;
    foreach (Grasshopper.Kernel.Special.GH_Group grp in e.Objects.OfType<Grasshopper.Kernel.Special.GH_Group>())
    {
      grp.ObjectChanged -= ColorGroup;
      any = true;
    }

    DebugWrite(any ? "Group Objects Removed, removing event" : "Objects Removed - although not a group");

  }



  public void RemoveEventHandlers()
  {
    GrasshopperDocument.ObjectsAdded -= OnObjectsAdded;
    GrasshopperDocument.ObjectsDeleted -= OnObjectsRemoved;


    foreach(Grasshopper.Kernel.Special.GH_Group grp in GrasshopperDocument.Objects.OfType<Grasshopper.Kernel.Special.GH_Group>())
    {
      grp.ObjectChanged -= ColorGroup;

    }
    msg.AppendFormat("Removed event handlers on document and on {0} groups\n", GrasshopperDocument.Objects.OfType<Grasshopper.Kernel.Special.GH_Group>().Count());

  }

  public void ColorGroup(object sender, EventArgs e)
  {
    if (!IdExists(id))
    {
      DebugWrite("Component not relevant. Disabling old id + " + id.ToString());
      RemoveEventHandlers();
      return;
    }

    Grasshopper.Kernel.Special.GH_Group grp = sender as Grasshopper.Kernel.Special.GH_Group;
    if (grp == null) return; //not type GH_Group
    //if (!grp.NickName.EndsWith("_")) return;

    string[] nameParts = grp.NickName.Split('_');
    if (nameParts.Length <= 1)
      return;
    string prefix = grp.NickName.Split('_')[0].Trim() + '_';

    string prefixes = String.Join(", ", colorDict.Keys.Select(k => "\"" + k + "\""));

    msg.Append("prefix " + prefix + "\n");
    if (colorDict.ContainsKey(prefix))
    {
      //if (grp.NickName.EndsWith("_"))
      grp.Colour = colorDict[prefix];
      if (_rename)
      {
        grp.NickName = grp.NickName.Replace(prefix, "");
      }

      DebugWrite("Colored " + grp.NickName);

    }
    else
    {
      DebugWrite("Group changed but not relevant: prefix " + prefix + " is not among " + prefixes);
    }

  }
  public void DebugWrite(string msg)
  {
    if (_debug)
    {
      Rhino.RhinoApp.WriteLine(String.Format("[ColGrps {0}]: {1}", id, msg));
    }
  }

  public void OnDeleteThisComponent(object sender, GH_DocObjectEventArgs e)
  {

    if (e.Objects.OfType<Grasshopper.Kernel.GH_Component>().Where(o => o.NickName == this.Component.NickName).Any())
    {
      DebugWrite("Removed template component. Removing all the eventhandlers");
      RemoveEventHandlers();
    }

  }
# ---------- end colorgroups ----------

fixparams = CSharpScript(FixOnce=Button(), Enable=toggle_2, Debug=Toggle(False))  # -> out; inputs FixOnce: Boolean, Enable: Boolean, Debug: Boolean
# ---------- fixparams: C# usings ----------
using System.Text;
using System.Linq;
using Grasshopper.Kernel.Special;
# ---------- fixparams: C# ----------
    _debug = Debug;
    _enable = Enable;
    msg.Clear();
    this.Component.Message = "id: " + id.ToString();




    if (Enable)
    {
      SetEventHandlers();
    }
    else
    {
      RemoveEventHandlers();
    }


    if (FixOnce)
    {
      FixAll();
    }

    Print(msg.ToString());

    // Component setup
    Component.Description = "Set up event handlers to change params to show nickname and not icon"
      + "\n\n"
      + "MIT License. Copyright Mathias Sønderskov Schaltz 2022";
    Component.Params.Input[0].Description = "Run me once on the document";
    Component.Params.Input[1].Description = "Toggle to enable event listener";
    Component.Params.Input[Component.Params.Input.Count - 1].Description = "Set debug to true to get all the events printed in the rhino log";
# ---------- fixparams: C# additional code ----------
  public static Random rnd = new Random();
  public int id = rnd.Next(0, 1000);
  StringBuilder msg = new StringBuilder();
  bool _debug = false;
  bool _enable = false;

  public Dictionary<IGH_ActiveObject, HashSet<GH_Group>> groupsPerObject = new Dictionary<IGH_ActiveObject, HashSet<GH_Group>>();


  public void OnObjectsAdded(object sender, GH_DocObjectEventArgs e)
  {
    if (!IdExists(id))
    {
      DebugWrite("[FixParam] Component not relevant. Disabling old id " + id.ToString());
      RemoveEventHandlers();
      return;
    }


    if(_enable)
    {
      foreach(IGH_Param par in e.Objects.OfType<IGH_Param>())
      {
        FixInputs(par);
      }
    }


  }

  public void FixAll()
  {
    //DebugWrite("Fixing all?");
    foreach(IGH_Param par in GrasshopperDocument.Objects.OfType<IGH_Param>())
    {

      FixInputs(par);
    }
  }




  public void FixInputs(IGH_ActiveObject obj)
  {



    IGH_Param par = obj as IGH_Param;
    if (par != null)
    {

      par.IconDisplayMode = GH_IconDisplayMode.name;


    }

  }


  public void SetEventHandlers()
  {

    GrasshopperDocument.ObjectsAdded -= OnObjectsAdded;
    GrasshopperDocument.ObjectsAdded += OnObjectsAdded;
    GrasshopperDocument.ObjectsDeleted -= OnDeleteThisComponent;
    GrasshopperDocument.ObjectsDeleted += OnDeleteThisComponent;
    msg.AppendFormat("Added the eventhandlers to OnObjectsAdded\n", GrasshopperDocument.Objects.OfType<Grasshopper.Kernel.Special.GH_Group>().Count());
  }

  public void RemoveEventHandlers()
  {
    GrasshopperDocument.ObjectsAdded -= OnObjectsAdded;
    GrasshopperDocument.ObjectsDeleted -= OnDeleteThisComponent;

    msg.AppendFormat("Removed wire event handlers on document\n", GrasshopperDocument.Objects.OfType<Grasshopper.Kernel.Special.GH_Group>().Count());

  }

  public void OnDeleteThisComponent(object sender, GH_DocObjectEventArgs e)
  {

    if (e.Objects.OfType<Grasshopper.Kernel.GH_Component>().Where(o => o.NickName == this.Component.NickName).Any())
    {
      DebugWrite("Removed template component. Removing all the eventhandlers");
      RemoveEventHandlers();
    }

  }

  public bool IdExists(int id)
  {
    IList<IGH_DocumentObject> objs = Grasshopper.Instances.ActiveCanvas.Document.Objects;
    return objs
      .OfType<IGH_Component>()
      .Where(ob => ob.NickName == this.Component.NickName)
      .Where(ob => ob.GetType().ToString() == "ScriptComponents.Component_CSNET_Script")
      .Where(ob => ob.Message == "id: " + id.ToString()).Any();

  }

  public void DebugWrite(string msg)
  {
    if (_debug)
    {
      Rhino.RhinoApp.WriteLine(String.Format("[FixParams {0}]: {1}", id, msg));
    }
  }
# ---------- end fixparams ----------

fixwires = CSharpScript(FixOnce=Button(), Enable=toggle_2, Debug=Toggle(False))  # -> out; inputs FixOnce: Boolean, Enable: Boolean, Debug: Boolean
# ---------- fixwires: C# ----------
    _debug = Debug;
    _enable = Enable;
    msg.Clear();
    this.Component.Message = "id: " + id.ToString();


    SetDictionary();

    if (Enable)
    {
      SetEventHandlers();
    }
    else
    {
      RemoveEventHandlers();
    }


    if (FixOnce)
    {
      FixAll();
    }

    Print(msg.ToString());
    
    // Component setup
    Component.Description = "Set up event handlers to change all wire types across groups to faint"
      + "\n\n"
      + "MIT License. Copyright Mathias Sønderskov Schaltz 2022";
    Component.Params.Input[0].Description = "Run me once on the document";
    Component.Params.Input[1].Description = "Toggle to enable event listener";
    Component.Params.Input[Component.Params.Input.Count - 1].Description = "Set debug to true to get all the events printed in the rhino log";
# ---------- fixwires: C# additional code ----------
  public static Random rnd = new Random();
  public int id = rnd.Next(0, 1000);
  StringBuilder msg = new StringBuilder();
  bool _debug = false;
  bool _enable = false;

  public Dictionary<IGH_ActiveObject, HashSet<GH_Group>> groupsPerObject = new Dictionary<IGH_ActiveObject, HashSet<GH_Group>>();


  public void OnSolutionExpired(object sender, GH_DocUndoEventArgs e)
  {
    if(_enable)
      FixAll();
  }

  public void FixAll()
  {
    //DebugWrite("Fixing all?");
    foreach(IGH_ActiveObject key in groupsPerObject.Keys.Where(k => groupsPerObject[k].Count() > 0))
    {

      FixInputs(key);
    }
  }



  public bool HasGroup(IGH_ActiveObject obj)
  {
    return groupsPerObject[obj].Count > 0;
  }


  public void FixInputs(IGH_ActiveObject obj)
  {

    if (!IdExists(id))
    {
      DebugWrite("Component not relevant. Disabling old id " + id.ToString());
      RemoveEventHandlers();
      return;
    }

    //List<List<IGH_ActiveObject>> parents = new List<List<IGH_ActiveObject>>();
    IGH_Param par = obj as IGH_Param;
    if (par != null && par.Sources != null)
    {


      IEnumerable<IGH_ActiveObject> p = par.Sources.Select(s => s.Attributes.GetTopLevel.DocObject as IGH_ActiveObject);
      //parents.Add(p);
      if(HasGroup(obj) && p.All(o => !HasGroupsInCommon(o, obj)) && par.WireDisplay != GH_ParamWireDisplay.faint)
      {
        DebugWrite("Fixing " + par.Attributes.GetTopLevel.DocObject.NickName);
        par.WireDisplay = GH_ParamWireDisplay.faint;
      }

    }

    IGH_Component comp = obj as IGH_Component;
    if (comp != null)
    {
      foreach(IGH_Param inp in comp.Params.Input)
      {

        IEnumerable<IGH_ActiveObject> p = inp.Sources.Select(i => i.Attributes.GetTopLevel.DocObject as IGH_ActiveObject);

        if(HasGroup(obj) && p.All(o => !HasGroupsInCommon(o, obj)) && inp.WireDisplay != GH_ParamWireDisplay.faint)
        {
          DebugWrite("Fixing " + inp.Attributes.GetTopLevel.DocObject.NickName);
          inp.WireDisplay = GH_ParamWireDisplay.faint;
        }
      }

    }



  }





  public void SetDictionary()
  {
    IList<IGH_DocumentObject> objects = Grasshopper.Instances.ActiveCanvas.Document.Objects.ToList();
    //Print(String.Join(", ", objects.Select(o => o.NickName)));

    groupsPerObject = objects
      .Where(o => o.GetType() != typeof(GH_Group))
      .OfType<IGH_ActiveObject>()
      .ToDictionary(o => o, o => new HashSet<GH_Group>());

    foreach(GH_Group grp in objects.OfType<GH_Group>())
    {

      foreach(IGH_ActiveObject obj in grp.ObjectsRecursive().OfType<IGH_ActiveObject>())
      {
        groupsPerObject[obj].Add(grp);

      }
    }



  }

  public bool HasGroupsInCommon(IGH_ActiveObject obj1, IGH_ActiveObject obj2)
  {
    HashSet<GH_Group> set1 = groupsPerObject[obj1];
    HashSet<GH_Group> set2 = groupsPerObject[obj2];

    set1.IntersectWith(set2);

    return set1.Any();
  }

  public void SetEventHandlers()
  {

    GrasshopperDocument.UndoStateChanged -= OnSolutionExpired;
    GrasshopperDocument.UndoStateChanged += OnSolutionExpired;
    GrasshopperDocument.ObjectsDeleted -= OnDeleteThisComponent;
    GrasshopperDocument.ObjectsDeleted += OnDeleteThisComponent;
    msg.AppendFormat("Added the eventhandlers to UndoStateChanged\n", GrasshopperDocument.Objects.OfType<Grasshopper.Kernel.Special.GH_Group>().Count());
  }

  public void RemoveEventHandlers()
  {
    GrasshopperDocument.UndoStateChanged -= OnSolutionExpired;
    GrasshopperDocument.ObjectsDeleted -= OnDeleteThisComponent;

    msg.AppendFormat("Removed wire event handlers on document\n", GrasshopperDocument.Objects.OfType<Grasshopper.Kernel.Special.GH_Group>().Count());

  }

  public void OnDeleteThisComponent(object sender, GH_DocObjectEventArgs e)
  {

    if (e.Objects.OfType<Grasshopper.Kernel.GH_Component>().Where(o => o.NickName == this.Component.NickName).Any())
    {
      DebugWrite("Removed template component. Removing all the eventhandlers");
      RemoveEventHandlers();
    }

  }

  public bool IdExists(int id)
  {
    IList<IGH_DocumentObject> objs = Grasshopper.Instances.ActiveCanvas.Document.Objects;
    return objs
      .OfType<IGH_Component>()
      .Where(ob => ob.NickName == this.Component.NickName)
      .Where(ob => ob.GetType().ToString() == "ScriptComponents.Component_CSNET_Script")
      .Where(ob => ob.Message == "id: " + id.ToString()).Any();

  }

  public void DebugWrite(string msg)
  {
    if (_debug)
    {
      Rhino.RhinoApp.WriteLine(String.Format("[FixWire {0}]: {1}", id, msg));
    }
  }
# ---------- end fixwires ----------

# ----
# processes to kill
panel_15 = Panel("""dctimestep
rcontrib
rtrace
oconv
rvu
rmtxop""")
kill = LBFalseStartToggle(False)

# ----
# Kill processes running on linux
panel_16 = Panel("pkill -f <instance>")
overrides_2 = ApplyOverrides(Input=panel_16, Instance=graft(panel_15))  # -> Output, DynamicOutput
join = TextJoin(Text=flatten(overrides_2.Output), Join=";")
executessh_2 = ExecuteSSH(_SSHCommands_=join, Run=kill, addPrefix=True, fireLogs=False, lastRunTime=0, suppressWarnings=False)  # -> Stdout, Stderr_, Ran
panel_17 = Panel(executessh_2.Stderr_)

# ----
# Keep biggest srf
# Colored skies! Why not?
# from https://discourse.radiance-online.org/t/new-tool-for-generating-colored-sky/5891
largest_brep = LargestBREP(window_breps=[<geometry referenced from the Rhino model> x224])

# ----
# Template methods
# By Mathias Sønderskov Schaltz 2022
# Check for updates here https://github.com/Sonderwoods/GrasshopperScribbles
panel_18 = Panel(colorgroups)
panel_19 = Panel(fixwires)
panel_20 = Panel(fixparams)

bool = Boolean(falsestart)
cluster = Cluster(mod=parserhinofile.OpaqueModifiers)  # -> name_geo, name_mod
geo = Geometry(parserhinofile.OpaqueGeometries)
overrides_3 = ApplyOverrides(Input="<Project>\objFiles")  # -> Output, DynamicOutput
mesh2obj = MeshToObj(
    Mesh=graft(geo),
    Name=graft(cluster.name_geo),
    MapFileName="mapping_opaque",
    ModifierName=graft(cluster.name_mod),
    TargetFolder=overrides_3.Output,
    Run=bool)  # -> ObjFiles, MapFile, Run
entwine = Entwine(Branch00=mesh2obj.ObjFiles, Branch01=mesh2obj.MapFile, FlattenInputs=True)
overrides_4 = ApplyOverrides(Input="<SftpHome>/objFiles")
upload = Upload(
    LocalFilePaths=flatten(entwine),
    TargetFolder=overrides_4,
    Run=mesh2obj.Run,
    stdouts="/home/lio/MantaRay/Andrei/objFiles/FloorMat_0.7_geo.obj>JOIN</home/lio/MantaRay/Andrei/objFiles/Cladding_0.5_geo.obj>JOIN</home/lio/MantaRay/Andrei/objFiles/ConcreteWhite_0.8_geo.obj>JOIN</home/lio/MantaRay/Andrei/objFiles/ConcreteStructure_0.3_geo.obj>JOIN</home/lio/MantaRay/Andrei/objFiles/ConcreteGrey_0.5_geo.obj>JOIN</home/lio/MantaRay/Andrei/objFiles/IntWalls_0.9_geo.obj>JOIN</home/lio/MantaRay/Andrei/objFiles/Pipes_0.03_geo.obj>JOIN</home/lio/MantaRay/Andrei/objFiles/ConcreteDarker_0.1_geo.obj>JOIN</home/lio/MantaRay/Andrei/objFiles/Frames_0.6_geo.obj>JOIN</home/lio/MantaRay/Andrei/objFiles/Black_0.01_geo.obj>JOIN</home/lio/MantaRay/Andrei/objFiles/CurvedCeiling_0.8_geo.obj>JOIN</home/lio/MantaRay/Andrei/objFiles/IntWalls_0.8_geo.obj>JOIN</home/lio/MantaRay/Andrei/objFiles/FloorBox_0.75_geo.obj>JOIN</home/lio/MantaRay/Andrei/objFiles/mapping_opaque.map")  # -> Status, FilePaths, Ran
panel_21 = Panel("""obj2rad -m <mapfile> -f <objFile> > <LinuxHome>/radFiles/<name>.rad
echo <LinuxHome>/radFiles/<name>.rad""")
python_2 = GhPythonScript(f=upload.FilePaths)  # -> m, o; inputs f: list
# ---------- python_2: Python ----------
__author__ = "mm1013"
__version__ = "2023.03.11"

import rhinoscriptsyntax as rs

m = f[-1]
o = f[:-1]
# ---------- end python_2 ----------
overrides_5 = ApplyOverrides(Input=panel_21, Mapfile=graft(python_2.m), ObjFile=graft(python_2.o), Name=graft(cluster.name_geo))  # -> Output, flatten(DynamicOutput)
executessh_3 = ExecuteSSH(
    _SSHCommands_=graft(overrides_5.DynamicOutput),
    Run=upload.Ran,
    addPrefix=True,
    description="""obj2rad -m /home/lio/MantaRay/Andrei/objFiles/mapping_opaque.map -f /home/lio/MantaRay/Andrei/objFiles/FloorMat_0.7_geo.obj > ~/MantaRay/Andrei/radFiles/FloorMat_0.7_geo.rad
echo ~/MantaRay/Andrei/radFiles/FloorMat_0.7_geo.rad


- - -

obj2rad -m /home/lio/MantaRay/Andrei/objFiles/mapping_opaque.map -f /home/lio/MantaRay/Andrei/objFiles/Cladding_0.5_geo.obj > ~/MantaRay/Andrei/radFiles/Cladding_0.5_geo.rad
echo ~/MantaRay/Andrei/radFiles/Cladding_0.5_geo.rad


- - -

obj2rad -m /home/lio/MantaRay/Andrei/objFiles/mapping_opaque.map -f /home/lio/MantaRay/Andrei/objFiles/ConcreteWhite_0.8_geo.obj > ~/MantaRay/Andrei/radFiles/ConcreteWhite_0.8_geo.rad
echo ~/MantaRay/Andrei/radFiles/ConcreteWhite_0.8_geo.rad


- - -

obj2rad -m /home/lio/MantaRay/Andrei/objFiles/mapping_opaque.map -f /home/lio/MantaRay/Andrei/objFiles/ConcreteStructure_0.3_geo.obj > ~/MantaRay/Andrei/radFiles/ConcreteStructure_0.3_geo.rad
echo ~/MantaRay/Andrei/radFiles/ConcreteStructure_0.3_geo.rad


- - -

obj2rad -m /home/lio/MantaRay/Andrei/objFiles/mapping_opaque.map -f /home/lio/MantaRay/Andrei/objFiles/ConcreteGrey_0.5_geo.obj > ~/MantaRay/Andrei/radFiles/ConcreteGrey_0.5_geo.rad
echo ~/MantaRay/Andrei/radFiles/ConcreteGrey_0.5_geo.rad


- - -

obj2rad -m /home/lio/MantaRay/Andrei/objFiles/mapping_opaque.map -f /home/lio/MantaRay/Andrei/objFiles/IntWalls_0.9_geo.obj > ~/MantaRay/Andrei/radFiles/IntWalls_0.9_geo.rad
echo ~/MantaRay/Andrei/radFiles/IntWalls_0.9_geo.rad


- - -

obj2rad -m /home/lio/MantaRay/Andrei/objFiles/mapping_opaque.map -f /home/lio/MantaRay/Andrei/objFiles/Pipes_0.03_geo.obj > ~/MantaRay/Andrei/radFiles/Pipes_0.03_geo.rad
echo ~/MantaRay/Andrei/radFiles/Pipes_0.03_geo.rad


- - -

obj2rad -m /home/lio/MantaRay/Andrei/objFiles/mapping_opaque.map -f /home/lio/MantaRay/Andrei/objFiles/ConcreteDarker_0.1_geo.obj > ~/MantaRay/Andrei/radFiles/ConcreteDarker_0.1_geo.rad
echo ~/MantaRay/Andrei/radFiles/ConcreteDarker_0.1_geo.rad


- - -

obj2rad -m /home/lio/MantaRay/Andrei/objFiles/mapping_opaque.map -f /home/lio/MantaRay/Andrei/objFiles/Frames_0.6_geo.obj > ~/MantaRay/Andrei/radFiles/Frames_0.6_geo.rad
echo ~/MantaRay/Andrei/radFiles/Frames_0.6_geo.rad


- - -

obj2rad -m /home/lio/MantaRay/Andrei/objFiles/mapping_opaque.map -f /home/lio/MantaRay/Andrei/objFiles/Black_0.01_geo.obj > ~/MantaRay/Andrei/radFiles/Black_0.01_geo.rad
echo ~/MantaRay/Andrei/radFiles/Black_0.01_geo.rad


- - -

obj2rad -m /home/lio/MantaRay/Andrei/objFiles/mapping_opaque.map -f /home/lio/MantaRay/Andrei/objFiles/CurvedCeiling_0.8_geo.obj > ~/MantaRay/Andrei/radFiles/CurvedCeiling_0.8_geo.rad
echo ~/MantaRay/Andrei/radFiles/CurvedCeiling_0.8_geo.rad


- - -

obj2rad -m /home/lio/MantaRay/Andrei/objFiles/mapping_opaque.map -f /home/lio/MantaRay/Andrei/objFiles/IntWalls_0.8_geo.obj > ~/MantaRay/Andrei/radFiles/IntWalls_0.8_geo.rad
echo ~/MantaRay/Andrei/radFiles/IntWalls_0.8_geo.rad


- - -

obj2rad -m /home/lio/MantaRay/Andrei/objFiles/mapping_opaque.map -f /home/lio/MantaRay/Andrei/objFiles/FloorBox_0.75_geo.obj > ~/MantaRay/Andrei/radFiles/FloorBox_0.75_geo.rad
echo ~/MantaRay/Andrei/radFiles/FloorBox_0.75_geo.rad""",
    fireLogs=True,
    lastRunTime=245,
    name="obj2map - opaque",
    suppressWarnings=False,
    results=["/home/lio/MantaRay/Andrei/radFiles/FloorMat_0.7_geo.rad", "/home/lio/MantaRay/Andrei/radFiles/Cladding_0.5_geo.rad", "/home/lio/MantaRay/Andrei/radFiles/ConcreteWhite_0.8_geo.rad", "/home/lio/MantaRay/Andrei/radFiles/ConcreteStructure_0.3_geo.rad", "/home/lio/MantaRay/Andrei/radFiles/ConcreteGrey_0.5_geo.rad", "/home/lio/MantaRay/Andrei/radFiles/IntWalls_0.9_geo.rad", "/home/lio/MantaRay/Andrei/radFiles/Pipes_0.03_geo.rad", "/home/lio/MantaRay/Andrei/radFiles/ConcreteDarker_0.1_geo.rad", "/home/lio/MantaRay/Andrei/radFiles/Frames_0.6_geo.rad", "/home/lio/MantaRay/Andrei/radFiles/Black_0.01_geo.rad", "/home/lio/MantaRay/Andrei/radFiles/CurvedCeiling_0.8_geo.rad", "/home/lio/MantaRay/Andrei/radFiles/IntWalls_0.8_geo.rad", "/home/lio/MantaRay/Andrei/radFiles/FloorBox_0.75_geo.rad"],
    commands=["""obj2rad -m /home/lio/MantaRay/Andrei/objFiles/mapping_opaque.map -f /home/lio/MantaRay/Andrei/objFiles/FloorMat_0.7_geo.obj > ~/MantaRay/Andrei/radFiles/FloorMat_0.7_geo.rad
echo ~/MantaRay/Andrei/radFiles/FloorMat_0.7_geo.rad""", """obj2rad -m /home/lio/MantaRay/Andrei/objFiles/mapping_opaque.map -f /home/lio/MantaRay/Andrei/objFiles/Cladding_0.5_geo.obj > ~/MantaRay/Andrei/radFiles/Cladding_0.5_geo.rad
echo ~/MantaRay/Andrei/radFiles/Cladding_0.5_geo.rad""", """obj2rad -m /home/lio/MantaRay/Andrei/objFiles/mapping_opaque.map -f /home/lio/MantaRay/Andrei/objFiles/Pipes_0.03_geo.obj > ~/MantaRay/Andrei/radFiles/Pipes_0.03_geo.rad
echo ~/MantaRay/Andrei/radFiles/Pipes_0.03_geo.rad""", """obj2rad -m /home/lio/MantaRay/Andrei/objFiles/mapping_opaque.map -f /home/lio/MantaRay/Andrei/objFiles/ConcreteGrey_0.5_geo.obj > ~/MantaRay/Andrei/radFiles/ConcreteGrey_0.5_geo.rad
echo ~/MantaRay/Andrei/radFiles/ConcreteGrey_0.5_geo.rad""", """obj2rad -m /home/lio/MantaRay/Andrei/objFiles/mapping_opaque.map -f /home/lio/MantaRay/Andrei/objFiles/ConcreteWhite_0.8_geo.obj > ~/MantaRay/Andrei/radFiles/ConcreteWhite_0.8_geo.rad
echo ~/MantaRay/Andrei/radFiles/ConcreteWhite_0.8_geo.rad""", """obj2rad -m /home/lio/MantaRay/Andrei/objFiles/mapping_opaque.map -f /home/lio/MantaRay/Andrei/objFiles/ConcreteStructure_0.3_geo.obj > ~/MantaRay/Andrei/radFiles/ConcreteStructure_0.3_geo.rad
echo ~/MantaRay/Andrei/radFiles/ConcreteStructure_0.3_geo.rad""", """obj2rad -m /home/lio/MantaRay/Andrei/objFiles/mapping_opaque.map -f /home/lio/MantaRay/Andrei/objFiles/Frames_0.6_geo.obj > ~/MantaRay/Andrei/radFiles/Frames_0.6_geo.rad
echo ~/MantaRay/Andrei/radFiles/Frames_0.6_geo.rad""", """obj2rad -m /home/lio/MantaRay/Andrei/objFiles/mapping_opaque.map -f /home/lio/MantaRay/Andrei/objFiles/ConcreteDarker_0.1_geo.obj > ~/MantaRay/Andrei/radFiles/ConcreteDarker_0.1_geo.rad
echo ~/MantaRay/Andrei/radFiles/ConcreteDarker_0.1_geo.rad""", """obj2rad -m /home/lio/MantaRay/Andrei/objFiles/mapping_opaque.map -f /home/lio/MantaRay/Andrei/objFiles/Black_0.01_geo.obj > ~/MantaRay/Andrei/radFiles/Black_0.01_geo.rad
echo ~/MantaRay/Andrei/radFiles/Black_0.01_geo.rad""", """obj2rad -m /home/lio/MantaRay/Andrei/objFiles/mapping_opaque.map -f /home/lio/MantaRay/Andrei/objFiles/IntWalls_0.8_geo.obj > ~/MantaRay/Andrei/radFiles/IntWalls_0.8_geo.rad
echo ~/MantaRay/Andrei/radFiles/IntWalls_0.8_geo.rad""", """obj2rad -m /home/lio/MantaRay/Andrei/objFiles/mapping_opaque.map -f /home/lio/MantaRay/Andrei/objFiles/FloorBox_0.75_geo.obj > ~/MantaRay/Andrei/radFiles/FloorBox_0.75_geo.rad
echo ~/MantaRay/Andrei/radFiles/FloorBox_0.75_geo.rad"""])  # -> flatten(Stdout), Stderr_, Ran
opaque_rad = Text(executessh_3.Stdout)

bool_2 = Boolean(falsestart)
cluster_2 = Cluster(mod=parserhinofile.GlassModifiers)  # -> name_geo, name_mod
geo_2 = Geometry(parserhinofile.GlassGeometries)
overrides_6 = ApplyOverrides(Input="<Project>\objFiles")  # -> Output, DynamicOutput
mesh2obj_2 = MeshToObj(
    Mesh=graft(geo_2),
    Name=graft(cluster_2.name_geo),
    MapFileName="mapping_glass",
    ModifierName=graft(cluster_2.name_mod),
    TargetFolder=overrides_6.Output,
    Run=bool_2)  # -> ObjFiles, MapFile, Run
entwine_2 = Entwine(Branch00=mesh2obj_2.ObjFiles, Branch01=mesh2obj_2.MapFile, FlattenInputs=True)
overrides_7 = ApplyOverrides(Input="<SftpHome>/objFiles")
upload_2 = Upload(
    LocalFilePaths=flatten(entwine_2),
    TargetFolder=overrides_7,
    Run=mesh2obj_2.Run,
    stdouts="/home/lio/MantaRay/Andrei/objFiles/Glass_70_geo.obj>JOIN</home/lio/MantaRay/Andrei/objFiles/mapping_glass.map")  # -> Status, FilePaths, Ran
panel_22 = Panel("""obj2rad -m <mapfile> -f <objFile> > <LinuxHome>/radFiles/<name>.rad
echo <LinuxHome>/radFiles/<name>.rad""")
python_3 = GhPythonScript(f=upload_2.FilePaths)  # -> m, o; inputs f: list; same code as python_2
overrides_8 = ApplyOverrides(Input=panel_22, Mapfile=graft(python_3.m), ObjFile=graft(python_3.o), Name=graft(cluster_2.name_geo))  # -> Output, flatten(DynamicOutput)
executessh_4 = ExecuteSSH(
    _SSHCommands_=graft(overrides_8.DynamicOutput),
    Run=upload_2.Ran,
    addPrefix=True,
    description="""obj2rad -m /home/lio/MantaRay/Andrei/objFiles/mapping_glass.map -f /home/lio/MantaRay/Andrei/objFiles/Glass_70_geo.obj > ~/MantaRay/Andrei/radFiles/Glass_70_geo.rad
echo ~/MantaRay/Andrei/radFiles/Glass_70_geo.rad""",
    fireLogs=True,
    lastRunTime=68,
    name="obj2map - glass",
    suppressWarnings=False,
    results="/home/lio/MantaRay/Andrei/radFiles/Glass_70_geo.rad",
    commands="""obj2rad -m /home/lio/MantaRay/Andrei/objFiles/mapping_glass.map -f /home/lio/MantaRay/Andrei/objFiles/Glass_70_geo.obj > ~/MantaRay/Andrei/radFiles/Glass_70_geo.rad
echo ~/MantaRay/Andrei/radFiles/Glass_70_geo.rad""")  # -> flatten(Stdout), Stderr_, Ran
window_rad = Text(executessh_4.Stdout)

# ----
# Vertex order (and normal)
# 
# source : https://www.radiance-online.org/learning/tutorials/Tutorial-ThreePhaseMethod.pdf
image = ImageSampler(Filter="Colour", Interpolate=True, Umax=1, Umin=0, Vmax=1, Vmin=0, Wrap=1)  # disabled

# ----
# Check radiance
# Radiacnce versino
# check ssh login
panel_23 = Panel("head /usr/local/radiance/bin/rtpict -n 2")
falsestart_2 = LBFalseStartToggle(False)
# Read more
# 
# 
# Ambient cache
# https://discourse.radiance-online.org/t/what-data-does-ambfile-store/4785/2
toggle_3 = BooleanToggle(True)
executessh_5 = ExecuteSSH(
    _SSHCommands_="genbox",
    Run=falsestart_2,
    addPrefix=True,
    fireLogs=False,
    lastRunTime=57,
    suppressWarnings=False,
    stderr="Usage: genbox material name xsize ysize zsize [-i] [-b bevel | -r round [-n nsegs][-s]] [-o]",
    commands="genbox")  # -> Stdout, Stderr_, Ran
# FILE NAMES: *.vmx - view matrix (data)
# *.hdr - view matrix (renderings)
# *.dmx - daylight matrix
# *.skv - sky vector
# *.smx – sky matrix
# *.xml - transmission matrix (the file is xml format)
# 
# *.rad - radiance scene data
# *.oct - octree file
# *.vf - view file
# *.dat - data
# 
# source : https://www.radiance-online.org/learning/tutorials/Tutorial-ThreePhaseMethod.pdf
executessh_6 = ExecuteSSH(
    _SSHCommands_="whoami",
    Run=toggle_3,
    addPrefix=True,
    fireLogs=False,
    lastRunTime=102.6171,
    suppressWarnings=False,
    results="lio",
    commands="whoami")  # -> Stdout, Stderr_, Ran
executessh_7 = ExecuteSSH(
    _SSHCommands_=panel_23,
    Run=Toggle(True),
    addPrefix=True,
    fireLogs=False,
    lastRunTime=97.8392,
    suppressWarnings=False,
    results="""#!/usr/bin/perl -w
# RCSid $Id: rtpict.pl,v 2.25 2022/04/12 00:30:58 greg Exp $""",
    commands="head /usr/local/radiance/bin/rtpict -n 2")  # -> Stdout, Stderr_, Ran
panel_24 = Panel(executessh_5.Stdout)
panel_25 = Panel(executessh_5.Stderr_)
panel_26 = Panel(executessh_6.Stdout)
panel_27 = Panel(executessh_7.Stdout)

# ----
# Dummy
swatch = ColourSwatch(SwatchColor=RGB(188, 118, 194))
nickname = GH_TestComponentColor(Color=swatch, SelColor=ColourSwatch(SwatchColor=RGB(191, 128, 128)))

# ----
# materials
run = Boolean(falsestart)

# ----
# Setup glass materials
glass_mat = Data(parserhinofile.GlassModifiers)
panel_28 = Panel("echo \"<mats>\" > <LinuxHome>/radFiles/<target>;echo \"<LinuxHome>/radFiles/<target>\"")
overrides_9 = ApplyOverrides(Input="<mat>.mat", Mat=graft(cluster_2.name_mod))
overrides_10 = ApplyOverrides(Input=panel_28, Mats=graft(glass_mat), Target=graft(overrides_9))  # -> Output, DynamicOutput
cluster_3 = Cluster_2(L=glass_mat)
executessh_8 = ExecuteSSH(
    _SSHCommands_=overrides_10.DynamicOutput,
    Run=run,
    addPrefix=True,
    description="""echo "void glass Glass_70
0
0
3 0.763 0.763 0.763" > ~/MantaRay/Andrei/radFiles/Glass_70.mat;echo "~/MantaRay/Andrei/radFiles/Glass_70.mat"
""",
    fireLogs=False,
    lastRunTime=99,
    name="glassMats",
    suppressWarnings=False,
    results="~/MantaRay/Andrei/radFiles/Glass_70.mat",
    commands="""echo "void glass Glass_70
0
0
3 0.763 0.763 0.763" > ~/MantaRay/Andrei/radFiles/Glass_70.mat;echo "~/MantaRay/Andrei/radFiles/Glass_70.mat"
""")  # -> Stdout, Stderr_, Ran
cull = CullPattern(List=executessh_8.Stdout, CullPattern=cluster_3)
window_mat = Text(flatten(cull))

# ----
# opaque materials
opaque_mats = Data(parserhinofile.OpaqueModifiers)
panel_29 = Panel("echo \"<mats>\" > <LinuxHome>/radFiles/<target>;echo \"<LinuxHome>/radFiles/<target>\"")
join_2 = TextJoin(Text=opaque_mats)
overrides_11 = ApplyOverrides(Input=panel_29, Mats=graft(join_2), Target=graft("opaque_materials.mat"))  # -> Output, DynamicOutput
executessh_9 = ExecuteSSH(
    _SSHCommands_=overrides_11.DynamicOutput,
    Run=run,
    addPrefix=True,
    description="""echo "void plastic FloorMat_0.7
0
0
5 70.000 70.000 70.000 0.000 0.000
void plastic Cladding_0.5
0
0
5 50.000 50.000 50.000 0.000 0.000
void plastic ConcreteWhite_0.8
0
0
5 80.000 80.000 80.000 0.000 0.000
void plastic ConcreteStructure_0.3
0
0
5 30.000 30.000 30.000 0.000 0.000
void plastic ConcreteGrey_0.5
0
0
5 50.000 50.000 50.000 0.000 0.000
void plastic IntWalls_0.9
0
0
5 90.000 90.000 90.000 0.000 0.000
void plastic Pipes_0.03
0
0
5 3.000 3.000 3.000 0.000 0.000
void plastic ConcreteDarker_0.1
0
0
5 10.000 10.000 10.000 0.000 0.000
void plastic Frames_0.6
0
0
5 60.000 60.000 60.000 0.000 0.000
void plastic Black_0.01
0
0
5 1.000 1.000 1.000 0.000 0.000
void plastic CurvedCeiling_0.8
0
0
5 80.000 80.000 80.000 0.000 0.000
void plastic IntWalls_0.8
0
0
5 80.000 80.000 80.000 0.000 0.000
void plastic FloorBox_0.75
0
0
5 75.000 75.000 75.000 0.000 0.000" > ~/MantaRay/Andrei/radFiles/opaque_materials.mat;echo "~/MantaRay/Andrei/radFiles/opaque_materials.mat"
""",
    fireLogs=False,
    lastRunTime=106,
    name="opaqueMats",
    suppressWarnings=False,
    results="~/MantaRay/Andrei/radFiles/opaque_materials.mat",
    commands="""echo "void plastic FloorMat_0.7
0
0
5 70.000 70.000 70.000 0.000 0.000
void plastic Cladding_0.5
0
0
5 50.000 50.000 50.000 0.000 0.000
void plastic ConcreteWhite_0.8
0
0
5 80.000 80.000 80.000 0.000 0.000
void plastic ConcreteStructure_0.3
0
0
5 30.000 30.000 30.000 0.000 0.000
void plastic ConcreteGrey_0.5
0
0
5 50.000 50.000 50.000 0.000 0.000
void plastic IntWalls_0.9
0
0
5 90.000 90.000 90.000 0.000 0.000
void plastic Pipes_0.03
0
0
5 3.000 3.000 3.000 0.000 0.000
void plastic ConcreteDarker_0.1
0
0
5 10.000 10.000 10.000 0.000 0.000
void plastic Frames_0.6
0
0
5 60.000 60.000 60.000 0.000 0.000
void plastic Black_0.01
0
0
5 1.000 1.000 1.000 0.000 0.000
void plastic CurvedCeiling_0.8
0
0
5 80.000 80.000 80.000 0.000 0.000
void plastic IntWalls_0.8
0
0
5 80.000 80.000 80.000 0.000 0.000
void plastic FloorBox_0.75
0
0
5 75.000 75.000 75.000 0.000 0.000" > ~/MantaRay/Andrei/radFiles/opaque_materials.mat;echo "~/MantaRay/Andrei/radFiles/opaque_materials.mat"
""")  # -> Stdout, Stderr_, Ran
opaque_mat = Text(executessh_9.Stdout)

# ----
# Octrees
# STANDARD octree
window_mat_2 = Text(window_mat)
opaque_mat_2 = Text(opaque_mat)
window_rad_2 = Text(window_rad)
opaque_rad_2 = Text(opaque_rad)
entwine_3 = Entwine(Branch00=window_mat_2, Branch01=window_rad_2, Branch02=opaque_mat_2, Branch03=opaque_rad_2, FlattenInputs=True)  # -> flatten(Result)

# ----
# Download and preview rad files
entwine_4 = Entwine(Branch00=window_mat_2, Branch01=window_rad_2, FlattenInputs=True)
entwine_5 = Entwine(Branch00=opaque_mat_2, Branch01=opaque_rad_2, FlattenInputs=True)
falsestart_3 = LBFalseStartToggle(False)
overrides_12 = ApplyOverrides(Input="<WinHome>\Downloads")
falsestart_4 = LBFalseStartToggle(False)
download = Download(
    LinuxFilePaths=flatten(entwine_4),
    TargetLocalFolder=overrides_12,
    Run=falsestart_4,
    stdouts="C:\Users\mm1013\MantaRay\TestingRemote\Downloads\Glass_70_mat.mat>JOIN<C:\Users\mm1013\MantaRay\TestingRemote\Downloads\Glass_70.rad")  # -> FilePaths, Status, Ran
download_2 = Download(LinuxFilePaths=entwine_5, TargetLocalFolder=overrides_12, Run=falsestart_3, stdouts="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")  # -> FilePaths, Status, Ran
cull_2 = CullPattern(List=download.FilePaths, CullPattern=falsestart_4)
cull_3 = CullPattern(List=download_2.FilePaths, CullPattern=falsestart_3)
radviewer = RadViewer(
    RadFiles=flatten(cull_2),
    IsTwoSided=False,
    Polychromatic=True,
    ShowEdges=True,
    Transparent=True,
    ColorNames=["GlassTak_70_mat", "GlassInt_74_mat", "GlassFacade_74_mat", "GlassBSDF_70_mat", "SkylightWall_70_mat", "SlabCeiling_80_mat", "SlabFloor_30_mat", "SlabWall_50_mat", "SlabJ_50_mat", "WallExterior_50_mat", "Roofs_50_mat", "Doors_50_mat", "FramesCW_50_mat", "FacadeBright_70_mat", "ContextBright_70_mat", "WallInterior_70_mat", "FacadeDark_30_mat", "Frames_50_mat", "Terrain_20_mat", "Buildings_50_mat", "Glass_70_mat"],
    Colors=[RGB(177, 203, 218), RGB(149, 243, 118), RGB(218, 247, 105), RGB(165, 199, 252), RGB(100, 251, 165), RGB(203, 230, 172), RGB(169, 243, 224), RGB(238, 176, 232), RGB(242, 222, 239), RGB(146, 222, 239), RGB(144, 119, 233), RGB(174, 245, 124), RGB(120, 214, 159), RGB(156, 153, 225), RGB(117, 221, 150), RGB(184, 150, 138), RGB(158, 205, 172), RGB(189, 132, 143), RGB(106, 135, 236), RGB(102, 168, 232), RGB(245, 194, 251)])  # -> Geo, ModifierNames, Modifiers, FailedWireFrame
radviewer_2 = RadViewer(
    RadFiles=flatten(cull_3),
    IsTwoSided=False,
    Polychromatic=True,
    ShowEdges=True,
    Transparent=True,
    ColorNames=["GlassTak_70_mat", "GlassInt_74_mat", "GlassFacade_74_mat", "GlassBSDF_70_mat", "SkylightWall_70_mat", "SlabCeiling_80_mat", "SlabFloor_30_mat", "SlabWall_50_mat", "SlabJ_50_mat", "WallExterior_50_mat"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],
    Colors=[RGB(177, 203, 218), RGB(149, 243, 118), RGB(218, 247, 105), RGB(165, 199, 252), RGB(100, 251, 165), RGB(203, 230, 172)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])  # -> Geo, ModifierNames, Modifiers, FailedWireFrame
panel_30 = Panel(entwine_5)

# ----
# Preview a RAD file with objpict
# can also use ra_tiff/normtiff/pfilt
# gamma will vary
# 
# check axel jacobs radiance tutorial p26
panel_31 = Panel("""mkdir -p <proj>/images/
objpict <rad> > <proj>/images/<target-.>.hdr
normtiff <proj>/images/<target-.>.hdr <proj>/images/<target-.>.tif
convert <proj>/images/<target-.>.tif <proj>/images/<target>
echo <proj>/images/<target>""")
falsestart_5 = LBFalseStartToggle(False)
radfile = Text(flatten(entwine_3))
list = ItemSelector(
    radfile,
    {"~/MantaRay/Andrei/radFiles/Glass_70.mat", "/home/lio/MantaRay/Andrei/radFiles/Glass_70_geo.rad", "~/MantaRay/Andrei/radFiles/opaque_materials.mat", "/home/lio/MantaRay/Andrei/radFiles/FloorMat_0.7_geo.rad", "/home/lio/MantaRay/Andrei/radFiles/Cladding_0.5_geo.rad", "/home/lio/MantaRay/Andrei/radFiles/ConcreteWhite_0.8_geo.rad", "/home/lio/MantaRay/Andrei/radFiles/ConcreteStructure_0.3_geo.rad", "/home/lio/MantaRay/Andrei/radFiles/ConcreteGrey_0.5_geo.rad", "/home/lio/MantaRay/Andrei/radFiles/IntWalls_0.9_geo.rad", "/home/lio/MantaRay/Andrei/radFiles/Pipes_0.03_geo.rad", "/home/lio/MantaRay/Andrei/radFiles/ConcreteDarker_0.1_geo.rad", "/home/lio/MantaRay/Andrei/radFiles/Frames_0.6_geo.rad", "/home/lio/MantaRay/Andrei/radFiles/Black_0.01_geo.rad", "/home/lio/MantaRay/Andrei/radFiles/CurvedCeiling_0.8_geo.rad", "/home/lio/MantaRay/Andrei/radFiles/IntWalls_0.8_geo.rad", "/home/lio/MantaRay/Andrei/radFiles/FloorBox_0.75_geo.rad"}, selected="/home/lio/MantaRay/Andrei/radFiles/CurvedCeiling_0.8_geo.rad")
panel_32 = Panel("""rad
target""")
entwine_6 = Entwine(Branch00=window_mat_2, Branch01=opaque_mat_2, Branch02=list, FlattenInputs=True)  # -> flatten(Result)
join_3 = TextJoin(Text=entwine_6, Join=" ")
overrides_13 = ApplyOverrides(Input=panel_31, Rad=graft(join_3), Target=graft("quickRender.png"))  # -> Output, DynamicOutput
executessh_10 = ExecuteSSH(
    _SSHCommands_=overrides_13.DynamicOutput,
    Run=falsestart_5,
    addPrefix=True,
    description="""mkdir -p ~/MantaRay/Andrei/images/
objpict ~/MantaRay/Andrei/radFiles/Glass_70.mat ~/MantaRay/Andrei/radFiles/opaque_materials.mat /home/lio/MantaRay/Andrei/radFiles/CurvedCeiling_0.8_geo.rad > ~/MantaRay/Andrei/images/quickRender.hdr
normtiff ~/MantaRay/Andrei/images/quickRender.hdr ~/MantaRay/Andrei/images/quickRender.tif
convert ~/MantaRay/Andrei/images/quickRender.tif ~/MantaRay/Andrei/images/quickRender.png
echo ~/MantaRay/Andrei/images/quickRender.png""",
    fireLogs=False,
    lastRunTime=2180,
    suppressWarnings=False,
    results="""_JOIN_
_JOIN_
_JOIN_
_JOIN_
/home/lio/MantaRay/Andrei/images/quickRender.png""",
    commands="""mkdir -p ~/MantaRay/Andrei/images/
_JOIN_
objpict ~/MantaRay/Andrei/radFiles/Glass_70.mat ~/MantaRay/Andrei/radFiles/opaque_materials.mat /home/lio/MantaRay/Andrei/radFiles/CurvedCeiling_0.8_geo.rad > ~/MantaRay/Andrei/images/quickRender.hdr
_JOIN_
normtiff ~/MantaRay/Andrei/images/quickRender.hdr ~/MantaRay/Andrei/images/quickRender.tif
_JOIN_
convert ~/MantaRay/Andrei/images/quickRender.tif ~/MantaRay/Andrei/images/quickRender.png
_JOIN_
echo ~/MantaRay/Andrei/images/quickRender.png""")  # -> Stdout, Stderr_, Ran
download_3 = Download(SftpPaths=executessh_10.Stdout, Run=executessh_10.Ran, stdouts="C:\Users\mm1013\MantaRay\Andrei\quickRender.png")  # -> FilePaths, Status, Ran
imageviewer = LBImageViewer(ImagePath_=download_3.FilePaths, _scale_=1, DisableClickable=False, SaveImgWithCoords=False, scale=1)  # -> ImagePath, Values, GIF

# ----
# 10klx overcast sky (RwR p357)
# # start of sky definition for daylighting studies
# # location name: COPENHAGEN_DNK LAT: 55.63
# !gensky 5 14 14.0 -c -a 55.63 -o -12.67 -m -15.0 | xform -rz 0.0
# skyfunc glow sky_mat
# 0
# 0
# 4
# 1 1 1 0
# sky_mat source sky
# 0
# 0
# 4
# 0 0 1 180
# skyfunc glow ground_glow
# 0
# 0
# 4
# 1 .8 .5 0
# ground_glow source ground
# 0
# 0
# 4
# 0 0 -1 180
# # end of sky definition for daylighting studies
falsestart_6 = LBFalseStartToggle(True)
# Skies
bool_3 = Boolean(falsestart_6)
and_append_the_ground = Panel("""##The 1 will be multiplie with brightfunc
skyfunc glow sky_glow
0
0
4 1 1 1 0

##Set to 1 as it will be multiplied with the gensky result
sky_glow source sky
0
0
4 0 0 1 180

##Set to 1 as it will be multiplied with the gensky result
skyfunc glow ground_glow
0
0
4 1 1 1 0

##The ground pane
ground_glow source ground
0
0
4 0 0 -1 180""")
executessh_11 = ExecuteSSH(
    _SSHCommands_="gensky -ang 45 0 -c -B 55.866",
    Run=bool_3,
    addPrefix=True,
    fireLogs=False,
    lastRunTime=54.5714,
    suppressWarnings=False,
    results="""# gensky -ang 45 0 -c -B 55.866
# Ground ambient level: 17.8

void brightfunc skyfunc
2 skybr skybright.cal
0
3 2 2.29e+01 3.56e+00""",
    commands="gensky -ang 45 0 -c -B 55.866")  # -> Stdout, Stderr_, Ran
concat = Concatenate(FragmentC="##Will control the gradient of the sky", FragmentA=executessh_11.Stdout, FragmentB=and_append_the_ground)
panel_33 = Panel("""mkdir -p <proj>/skies/
echo "<sky>" > <proj>/skies/<target>
echo "<proj>/skies/<target>"
""")
panel_34 = Panel(concat)
overrides_14 = ApplyOverrides(Input=panel_33, Sky=graft(panel_34), Target=graft("overcast_sky.rad"))  # -> Output, DynamicOutput
executessh_12 = ExecuteSSH(
    _SSHCommands_=overrides_14.DynamicOutput,
    Run=executessh_11.Ran,
    addPrefix=True,
    description="""mkdir -p ~/MantaRay/Andrei/skies/
echo "##Will control the gradient of the sky
# gensky -ang 45 0 -c -B 55.866
# Ground ambient level: 17.8

void brightfunc skyfunc
2 skybr skybright.cal
0
3 2 2.29e+01 3.56e+00

##The 1 will be multiplie with brightfunc
skyfunc glow sky_glow
0
0
4 1 1 1 0

##Set to 1 as it will be multiplied with the gensky result
sky_glow source sky
0
0
4 0 0 1 180

##Set to 1 as it will be multiplied with the gensky result
skyfunc glow ground_glow
0
0
4 1 1 1 0

##The ground pane
ground_glow source ground
0
0
4 0 0 -1 180" > ~/MantaRay/Andrei/skies/overcast_sky.rad
echo "~/MantaRay/Andrei/skies/overcast_sky.rad"
""",
    fireLogs=False,
    lastRunTime=54.47,
    suppressWarnings=False,
    results="""_JOIN_
_JOIN_
~/MantaRay/Andrei/skies/overcast_sky.rad""",
    commands="""mkdir -p ~/MantaRay/Andrei/skies/
_JOIN_
echo "##Will control the gradient of the sky
# gensky -ang 45 0 -c -B 55.866
# Ground ambient level: 17.8

void brightfunc skyfunc
2 skybr skybright.cal
0
3 2 2.29e+01 3.56e+00

##The 1 will be multiplie with brightfunc
skyfunc glow sky_glow
0
0
4 1 1 1 0

##Set to 1 as it will be multiplied with the gensky result
sky_glow source sky
0
0
4 0 0 1 180

##Set to 1 as it will be multiplied with the gensky result
skyfunc glow ground_glow
0
0
4 1 1 1 0

##The ground pane
ground_glow source ground
0
0
4 0 0 -1 180" > ~/MantaRay/Andrei/skies/overcast_sky.rad
_JOIN_
echo "~/MantaRay/Andrei/skies/overcast_sky.rad"
""")  # -> Stdout, Stderr_, Ran
panel_35 = Panel(overrides_14.DynamicOutput)
panel_36 = Panel(executessh_12.Stderr_)
sky_ovc = Text(executessh_12.Stdout)

# ----
# 10 sunny skies (SET LAT AND LON)
panel_37 = Panel("gensky 7 4 <h>:00CEST +s -a <lat> -o <lon>")
falsestart_7 = LBFalseStartToggle(False)
series = Series(Start=8, Step=1, Count=10)
overrides_15 = ApplyOverrides(Input=panel_37, H=graft(series), Lat=graft("59.9"), Lon=graft("10.7"))  # -> Output, DynamicOutput
and_append_the_ground_2 = Panel("""##The 1 will be multiplie with brightfunc
skyfunc glow sky_glow
0
0
4 1 1 1 0

##Set to 1 as it will be multiplied with the gensky result
sky_glow source sky
0
0
4 0 0 1 180

##Set to 1 as it will be multiplied with the gensky result
skyfunc glow ground_glow
0
0
4 1 1 1 0

##The ground pane
ground_glow source ground
0
0
4 0 0 -1 180""")
bool_4 = Boolean(falsestart_7)
executessh_13 = ExecuteSSH(
    _SSHCommands_=overrides_15.DynamicOutput,
    Run=bool_4,
    addPrefix=True,
    description="""gensky 7 4 8:00CEST +s -a 59.9 -o 10.7


- - -

gensky 7 4 9:00CEST +s -a 59.9 -o 10.7


- - -

gensky 7 4 10:00CEST +s -a 59.9 -o 10.7


- - -

gensky 7 4 11:00CEST +s -a 59.9 -o 10.7


- - -

gensky 7 4 12:00CEST +s -a 59.9 -o 10.7


- - -

gensky 7 4 13:00CEST +s -a 59.9 -o 10.7


- - -

gensky 7 4 14:00CEST +s -a 59.9 -o 10.7


- - -

gensky 7 4 15:00CEST +s -a 59.9 -o 10.7


- - -

gensky 7 4 16:00CEST +s -a 59.9 -o 10.7


- - -

gensky 7 4 17:00CEST +s -a 59.9 -o 10.7""",
    fireLogs=False,
    lastRunTime=39,
    suppressWarnings=False,
    results=["""# gensky 7 4 8:00CEST +s -a 59.9 -o 10.7
# Local solar time: 5.22
# Solar altitude and azimuth: 14.1 -111.6
# Ground ambient level: 8.8

void light solar
0
0
3 3.92e+06 3.92e+06 3.92e+06

solar source sun
0
0
4 0.901641 0.357186 0.243849 0.5

void brightfunc skyfunc
2 skybr skybright.cal
0
7 1 3.81e+00 5.41e+00 3.08e-01 0.901641 0.357186 0.243849""", """# gensky 7 4 9:00CEST +s -a 59.9 -o 10.7
# Local solar time: 6.22
# Solar altitude and azimuth: 21.4 -99.3
# Ground ambient level: 10.8

void light solar
0
0
3 5.36e+06 5.36e+06 5.36e+06

solar source sun
0
0
4 0.919246 0.149788 0.364073 0.5

void brightfunc skyfunc
2 skybr skybright.cal
0
7 1 4.88e+00 9.62e+00 3.41e-01 0.919246 0.149788 0.364073""", """# gensky 7 4 10:00CEST +s -a 59.9 -o 10.7
# Local solar time: 7.22
# Solar altitude and azimuth: 28.8 -86.4
# Ground ambient level: 12.6

void light solar
0
0
3 6.07e+06 6.07e+06 6.07e+06

solar source sun
0
0
4 0.874207 -0.054485 0.482486 0.5

void brightfunc skyfunc
2 skybr skybright.cal
0
7 1 6.11e+00 1.37e+01 3.90e-01 0.874207 -0.054485 0.482486""", """# gensky 7 4 11:00CEST +s -a 59.9 -o 10.7
# Local solar time: 8.22
# Solar altitude and azimuth: 36.2 -72.6
# Ground ambient level: 13.8

void light solar
0
0
3 6.48e+06 6.48e+06 6.48e+06

solar source sun
0
0
4 0.769592 -0.241712 0.591018 0.5

void brightfunc skyfunc
2 skybr skybright.cal
0
7 1 7.51e+00 1.74e+01 4.56e-01 0.769592 -0.241712 0.591018""", """# gensky 7 4 12:00CEST +s -a 59.9 -o 10.7
# Local solar time: 9.22
# Solar altitude and azimuth: 43.0 -56.9
# Ground ambient level: 14.6

void light solar
0
0
3 6.72e+06 6.72e+06 6.72e+06

solar source sun
0
0
4 0.612531 -0.399135 0.682273 0.5

void brightfunc skyfunc
2 skybr skybright.cal
0
7 1 9.05e+00 2.04e+01 5.41e-01 0.612531 -0.399135 0.682273""", """# gensky 7 4 13:00CEST +s -a 59.9 -o 10.7
# Local solar time: 10.22
# Solar altitude and azimuth: 48.6 -38.7
# Ground ambient level: 15.0

void light solar
0
0
3 6.86e+06 6.86e+06 6.86e+06

solar source sun
0
0
4 0.413727 -0.516025 0.750032 0.5

void brightfunc skyfunc
2 skybr skybright.cal
0
7 1 1.06e+01 2.26e+01 6.32e-01 0.413727 -0.516025 0.750032"""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],
    commands=["gensky 7 4 12:00CEST +s -a 59.9 -o 10.7", "gensky 7 4 8:00CEST +s -a 59.9 -o 10.7", "gensky 7 4 9:00CEST +s -a 59.9 -o 10.7", "gensky 7 4 13:00CEST +s -a 59.9 -o 10.7", "gensky 7 4 15:00CEST +s -a 59.9 -o 10.7", "gensky 7 4 16:00CEST +s -a 59.9 -o 10.7", "gensky 7 4 17:00CEST +s -a 59.9 -o 10.7"])  # -> Stdout, Stderr_, Ran
panel_38 = Panel(executessh_13.Stdout)
concat_2 = Concatenate(FragmentC="##Will control the gradient of the sky", FragmentA=executessh_13.Stdout, FragmentB=and_append_the_ground_2)
panel_39 = Panel("""mkdir -p <proj>/skies/
echo "<sky>" > <proj>/skies/<target>
echo "<proj>/skies/<target>"
""")
overrides_16 = ApplyOverrides(Input=panel_39, Sky=graft(concat_2), Target=graft("sunny_sky_<h>.rad"), H=graft(series))  # -> Output, DynamicOutput
executessh_14 = ExecuteSSH(
    _SSHCommands_=overrides_16.DynamicOutput,
    Run=executessh_13.Ran,
    addPrefix=True,
    description="""mkdir -p ~/MantaRay/Andrei/skies/
echo "##Will control the gradient of the sky
# gensky 7 4 8:00CEST +s -a 59.9 -o 10.7
# Local solar time: 5.22
# Solar altitude and azimuth: 14.1 -111.6
# Ground ambient level: 8.8

void light solar
0
0
3 3.92e+06 3.92e+06 3.92e+06

solar source sun
0
0
4 0.901641 0.357186 0.243849 0.5

void brightfunc skyfunc
2 skybr skybright.cal
0
7 1 3.81e+00 5.41e+00 3.08e-01 0.901641 0.357186 0.243849

##The 1 will be multiplie with brightfunc
skyfunc glow sky_glow
0
0
4 1 1 1 0

##Set to 1 as it will be multiplied with the gensky result
sky_glow source sky
0
0
4 0 0 1 180

##Set to 1 as it will be multiplied with the gensky result
skyfunc glow ground_glow
0
0
4 1 1 1 0

##The ground pane
ground_glow source ground
0
0
4 0 0 -1 180" > ~/MantaRay/Andrei/skies/sunny_sky_8.rad
echo "~/MantaRay/Andrei/skies/sunny_sky_8.rad"


- - -

mkdir -p ~/MantaRay/Andrei/skies/
echo "##Will control the gradient of the sky
# gensky 7 4 9:00CEST +s -a 59.9 -o 10.7
# Local solar time: 6.22
# Solar altitude and azimuth: 21.4 -99.3
# Ground ambient level: 10.8

void light solar
0
0
3 5.36e+06 5.36e+06 5.36e+06

solar source sun
0
0
4 0.919246 0.149788 0.364073 0.5

void brightfunc skyfunc
2 skybr skybright.cal
0
7 1 4.88e+00 9.62e+00 3.41e-01 0.919246 0.149788 0.364073

##The 1 will be multiplie with brightfunc
skyfunc glow sky_glow
0
0
4 1 1 1 0

##Set to 1 as it will be multiplied with the gensky result
sky_glow source sky
0
0
4 0 0 1 180

##Set to 1 as it will be multiplied with the gensky result
skyfunc glow ground_glow
0
0
4 1 1 1 0

##The ground pane
ground_glow source ground
0
0
4 0 0 -1 180" > ~/MantaRay/Andrei/skies/sunny_sky_9.rad
echo "~/MantaRay/Andrei/skies/sunny_sky_9.rad"


- - -

mkdir -p ~/MantaRay/Andrei/skies/
echo "##Will control the gradient of the sky
# gensky 7 4 10:00CEST +s -a 59.9 -o 10.7
# Local solar time: 7.22
# Solar altitude and azimuth: 28.8 -86.4
# Ground ambient level: 12.6

void light solar
0
0
3 6.07e+06 6.07e+06 6.07e+06

solar source sun
0
0
4 0.874207 -0.054485 0.482486 0.5

void brightfunc skyfunc
2 skybr skybright.cal
0
7 1 6.11e+00 1.37e+01 3.90e-01 0.874207 -0.054485 0.482486

##The 1 will be multiplie with brightfunc
skyfunc glow sky_glow
0
0
4 1 1 1 0

##Set to 1 as it will be multiplied with the gensky result
sky_glow source sky
0
0
4 0 0 1 180

##Set to 1 as it will be multiplied with the gensky result
skyfunc glow ground_glow
0
0
4 1 1 1 0

##The ground pane
ground_glow source ground
0
0
4 0 0 -1 180" > ~/MantaRay/Andrei/skies/sunny_sky_10.rad
echo "~/MantaRay/Andrei/skies/sunny_sky_10.rad"


- - -

mkdir -p ~/MantaRay/Andrei/skies/
echo "##Will control the gradient of the sky
# gensky 7 4 11:00CEST +s -a 59.9 -o 10.7
# Local solar time: 8.22
# Solar altitude and azimuth: 36.2 -72.6
# Ground ambient level: 13.8

void light solar
0
0
3 6.48e+06 6.48e+06 6.48e+06

solar source sun
0
0
4 0.769592 -0.241712 0.591018 0.5

void brightfunc skyfunc
2 skybr skybright.cal
0
7 1 7.51e+00 1.74e+01 4.56e-01 0.769592 -0.241712 0.591018

##The 1 will be multiplie with brightfunc
skyfunc glow sky_glow
0
0
4 1 1 1 0

##Set to 1 as it will be multiplied with the gensky result
sky_glow source sky
0
0
4 0 0 1 180

##Set to 1 as it will be multiplied with the gensky result
skyfunc glow ground_glow
0
0
4 1 1 1 0

##The ground pane
ground_glow source ground
0
0
4 0 0 -1 180" > ~/MantaRay/Andrei/skies/sunny_sky_11.rad
echo "~/MantaRay/Andrei/skies/sunny_sky_11.rad"


- - -

mkdir -p ~/MantaRay/Andrei/skies/
echo "##Will control the gradient of the sky
# gensky 7 4 12:00CEST +s -a 59.9 -o 10.7
# Local solar time: 9.22
# Solar altitude and azimuth: 43.0 -56.9
# Ground ambient level: 14.6

void light solar
0
0
3 6.72e+06 6.72e+06 6.72e+06

solar source sun
0
0
4 0.612531 -0.399135 0.682273 0.5

void brightfunc skyfunc
2 skybr skybright.cal
0
7 1 9.05e+00 2.04e+01 5.41e-01 0.612531 -0.399135 0.682273

##The 1 will be multiplie with brightfunc
skyfunc glow sky_glow
0
0
4 1 1 1 0

##Set to 1 as it will be multiplied with the gensky result
sky_glow source sky
0
0
4 0 0 1 180

##Set to 1 as it will be multiplied with the gensky result
skyfunc glow ground_glow
0
0
4 1 1 1 0

##The ground pane
ground_glow source ground
0
0
4 0 0 -1 180" > ~/MantaRay/Andrei/skies/sunny_sky_12.rad
echo "~/MantaRay/Andrei/skies/sunny_sky_12.rad"


- - -

mkdir -p ~/MantaRay/Andrei/skies/
echo "##Will control the gradient of the sky
# gensky 7 4 13:00CEST +s -a 59.9 -o 10.7
# Local solar time: 10.22
# Solar altitude and azimuth: 48.6 -38.7
# Ground ambient level: 15.0

void light solar
0
0
3 6.86e+06 6.86e+06 6.86e+06

solar source sun
0
0
4 0.413727 -0.516025 0.750032 0.5

void brightfunc skyfunc
2 skybr skybright.cal
0
7 1 1.06e+01 2.26e+01 6.32e-01 0.413727 -0.516025 0.750032

##The 1 will be multiplie with brightfunc
skyfunc glow sky_glow
0
0
4 1 1 1 0

##Set to 1 as it will be multiplied with the gensky result
sky_glow source sky
0
0
4 0 0 1 180

##Set to 1 as it will be multiplied with the gensky result
skyfunc glow ground_glow
0
0
4 1 1 1 0

##The ground pane
ground_glow source ground
0
0
4 0 0 -1 180" > ~/MantaRay/Andrei/skies/sunny_sky_13.rad
echo "~/MantaRay/Andrei/skies/sunny_sky_13.rad"


- - -

mkdir -p ~/MantaRay/Andrei/skies/
echo "##Will control the gradient of the sky
# gensky 7 4 14:00CEST +s -a 59.9 -o 10.7
# Local solar time: 11.22
# Solar altitude and azimuth: 52.2 -17.7
# Ground ambient level: 15.1

void light solar
0
0
3 6.93e+06 6.93e+06 6.93e+06

solar source sun
0
0
4 0.186727 -0.584417 0.789677 0.5

void brightfunc skyfunc
2 skybr skybright.cal
0
7 1 1.18e+01 2.39e+01 7.04e-01 0.186727 -0.584417 0.789677

##The 1 will be multiplie with brightfunc
skyfunc glow sky_glow
0
0
4 1 1 1 0

##Set to 1 as it will be multiplied with the gensky result
sky_glow source sky
0
0
4 0 0 1 180

##Set to 1 as it will be multiplied with the gensky result
skyfunc glow ground_glow
0
0
4 1 1 1 0

##The ground pane
ground_glow source ground
0
0
4 0 0 -1 180" > ~/MantaRay/Andrei/skies/sunny_sky_14.rad
echo "~/MantaRay/Andrei/skies/sunny_sky_14.rad"


- - -

mkdir -p ~/MantaRay/Andrei/skies/
echo "##Will control the gradient of the sky
# gensky 7 4 15:00CEST +s -a 59.9 -o 10.7
# Local solar time: 12.22
# Solar altitude and azimuth: 53.0 5.1
# Ground ambient level: 15.2

void light solar
0
0
3 6.94e+06 6.94e+06 6.94e+06

solar source sun
0
0
4 -0.052997 -0.599649 0.798507 0.5

void brightfunc skyfunc
2 skybr skybright.cal
0
7 1 1.21e+01 2.42e+01 7.23e-01 -0.052997 -0.599649 0.798507

##The 1 will be multiplie with brightfunc
skyfunc glow sky_glow
0
0
4 1 1 1 0

##Set to 1 as it will be multiplied with the gensky result
sky_glow source sky
0
0
4 0 0 1 180

##Set to 1 as it will be multiplied with the gensky result
skyfunc glow ground_glow
0
0
4 1 1 1 0

##The ground pane
ground_glow source ground
0
0
4 0 0 -1 180" > ~/MantaRay/Andrei/skies/sunny_sky_15.rad
echo "~/MantaRay/Andrei/skies/sunny_sky_15.rad"


- - -

mkdir -p ~/MantaRay/Andrei/skies/
echo "##Will control the gradient of the sky
# gensky 7 4 16:00CEST +s -a 59.9 -o 10.7
# Local solar time: 13.22
# Solar altitude and azimuth: 50.9 27.3
# Ground ambient level: 15.1

void light solar
0
0
3 6.91e+06 6.91e+06 6.91e+06

solar source sun
0
0
4 -0.289110 -0.560683 0.775919 0.5

void brightfunc skyfunc
2 skybr skybright.cal
0
7 1 1.13e+01 2.35e+01 6.77e-01 -0.289110 -0.560683 0.775919

##The 1 will be multiplie with brightfunc
skyfunc glow sky_glow
0
0
4 1 1 1 0

##Set to 1 as it will be multiplied with the gensky result
sky_glow source sky
0
0
4 0 0 1 180

##Set to 1 as it will be multiplied with the gensky result
skyfunc glow ground_glow
0
0
4 1 1 1 0

##The ground pane
ground_glow source ground
0
0
4 0 0 -1 180" > ~/MantaRay/Andrei/skies/sunny_sky_16.rad
echo "~/MantaRay/Andrei/skies/sunny_sky_16.rad"


- - -

mkdir -p ~/MantaRay/Andrei/skies/
echo "##Will control the gradient of the sky
# gensky 7 4 17:00CEST +s -a 59.9 -o 10.7
# Local solar time: 14.22
# Solar altitude and azimuth: 46.3 47.1
# Ground ambient level: 14.8

void light solar
0
0
3 6.81e+06 6.81e+06 6.81e+06

solar source sun
0
0
4 -0.505520 -0.470175 0.723454 0.5

void brightfunc skyfunc
2 skybr skybright.cal
0
7 1 9.93e+00 2.18e+01 5.92e-01 -0.505520 -0.470175 0.723454

##The 1 will be multiplie with brightfunc
skyfunc glow sky_glow
0
0
4 1 1 1 0

##Set to 1 as it will be multiplied with the gensky result
sky_glow source sky
0
0
4 0 0 1 180

##Set to 1 as it will be multiplied with the gensky result
skyfunc glow ground_glow
0
0
4 1 1 1 0

##The ground pane
ground_glow source ground
0
0
4 0 0 -1 180" > ~/MantaRay/Andrei/skies/sunny_sky_17.rad
echo "~/MantaRay/Andrei/skies/sunny_sky_17.rad"
""",
    fireLogs=False,
    lastRunTime=45,
    suppressWarnings=False,
    results=["""_JOIN_
_JOIN_
~/MantaRay/TestingRemote/skies/sunny_sky_8.rad""", """_JOIN_
_JOIN_
~/MantaRay/TestingRemote/skies/sunny_sky_9.rad""", """_JOIN_
_JOIN_
~/MantaRay/TestingRemote/skies/sunny_sky_10.rad""", """_JOIN_
_JOIN_
~/MantaRay/TestingRemote/skies/sunny_sky_11.rad""", """_JOIN_
_JOIN_
~/MantaRay/TestingRemote/skies/sunny_sky_12.rad""", """_JOIN_
_JOIN_
~/MantaRay/TestingRemote/skies/sunny_sky_13.rad""", """_JOIN_
_JOIN_
~/MantaRay/TestingRemote/skies/sunny_sky_14.rad""", """_JOIN_
_JOIN_
~/MantaRay/TestingRemote/skies/sunny_sky_15.rad""", """_JOIN_
_JOIN_
~/MantaRay/TestingRemote/skies/sunny_sky_16.rad""", """_JOIN_
_JOIN_
~/MantaRay/TestingRemote/skies/sunny_sky_17.rad"""],
    commands=["""mkdir -p ~/MantaRay/TestingRemote/skies/
_JOIN_
echo "##Will control the gradient of the sky
# gensky 7 4 10:00CEST +s -a 59.9 -o 10.7
# Local solar time: 7.22
# Solar altitude and azimuth: 28.8 -86.4
# Ground ambient level: 12.6

void light solar
0
0
3 6.07e+06 6.07e+06 6.07e+06

solar source sun
0
0
4 0.874207 -0.054485 0.482486 0.5

void brightfunc skyfunc
2 skybr skybright.cal
0
7 1 6.11e+00 1.37e+01 3.90e-01 0.874207 -0.054485 0.482486

##The 1 will be multiplie with brightfunc
skyfunc glow sky_glow
0
0
4 1 1 1 0

##Set to 1 as it will be multiplied with the gensky result
sky_glow source sky
0
0
4 0 0 1 180

##Set to 1 as it will be multiplied with the gensky result
skyfunc glow ground_glow
0
0
4 1 1 1 0

##The ground pane
ground_glow source ground
0
0
4 0 0 -1 180" > ~/MantaRay/TestingRemote/skies/sunny_sky_10.rad
_JOIN_
echo "~/MantaRay/TestingRemote/skies/sunny_sky_10.rad"
""", """mkdir -p ~/MantaRay/TestingRemote/skies/
_JOIN_
echo "##Will control the gradient of the sky
# gensky 7 4 9:00CEST +s -a 59.9 -o 10.7
# Local solar time: 6.22
# Solar altitude and azimuth: 21.4 -99.3
# Ground ambient level: 10.8

void light solar
0
0
3 5.36e+06 5.36e+06 5.36e+06

solar source sun
0
0
4 0.919246 0.149788 0.364073 0.5

void brightfunc skyfunc
2 skybr skybright.cal
0
7 1 4.88e+00 9.62e+00 3.41e-01 0.919246 0.149788 0.364073

##The 1 will be multiplie with brightfunc
skyfunc glow sky_glow
0
0
4 1 1 1 0

##Set to 1 as it will be multiplied with the gensky result
sky_glow source sky
0
0
4 0 0 1 180

##Set to 1 as it will be multiplied with the gensky result
skyfunc glow ground_glow
0
0
4 1 1 1 0

##The ground pane
ground_glow source ground
0
0
4 0 0 -1 180" > ~/MantaRay/TestingRemote/skies/sunny_sky_9.rad
_JOIN_
echo "~/MantaRay/TestingRemote/skies/sunny_sky_9.rad"
""", """mkdir -p ~/MantaRay/TestingRemote/skies/
_JOIN_
echo "##Will control the gradient of the sky
# gensky 7 4 14:00CEST +s -a 59.9 -o 10.7
# Local solar time: 11.22
# Solar altitude and azimuth: 52.2 -17.7
# Ground ambient level: 15.1

void light solar
0
0
3 6.93e+06 6.93e+06 6.93e+06

solar source sun
0
0
4 0.186727 -0.584417 0.789677 0.5

void brightfunc skyfunc
2 skybr skybright.cal
0
7 1 1.18e+01 2.39e+01 7.04e-01 0.186727 -0.584417 0.789677

##The 1 will be multiplie with brightfunc
skyfunc glow sky_glow
0
0
4 1 1 1 0

##Set to 1 as it will be multiplied with the gensky result
sky_glow source sky
0
0
4 0 0 1 180

##Set to 1 as it will be multiplied with the gensky result
skyfunc glow ground_glow
0
0
4 1 1 1 0

##The ground pane
ground_glow source ground
0
0
4 0 0 -1 180" > ~/MantaRay/TestingRemote/skies/sunny_sky_14.rad
_JOIN_
echo "~/MantaRay/TestingRemote/skies/sunny_sky_14.rad"
""", """mkdir -p ~/MantaRay/TestingRemote/skies/
_JOIN_
echo "##Will control the gradient of the sky
# gensky 7 4 12:00CEST +s -a 59.9 -o 10.7
# Local solar time: 9.22
# Solar altitude and azimuth: 43.0 -56.9
# Ground ambient level: 14.6

void light solar
0
0
3 6.72e+06 6.72e+06 6.72e+06

solar source sun
0
0
4 0.612531 -0.399135 0.682273 0.5

void brightfunc skyfunc
2 skybr skybright.cal
0
7 1 9.05e+00 2.04e+01 5.41e-01 0.612531 -0.399135 0.682273

##The 1 will be multiplie with brightfunc
skyfunc glow sky_glow
0
0
4 1 1 1 0

##Set to 1 as it will be multiplied with the gensky result
sky_glow source sky
0
0
4 0 0 1 180

##Set to 1 as it will be multiplied with the gensky result
skyfunc glow ground_glow
0
0
4 1 1 1 0

##The ground pane
ground_glow source ground
0
0
4 0 0 -1 180" > ~/MantaRay/TestingRemote/skies/sunny_sky_12.rad
_JOIN_
echo "~/MantaRay/TestingRemote/skies/sunny_sky_12.rad"
""", """mkdir -p ~/MantaRay/TestingRemote/skies/
_JOIN_
echo "##Will control the gradient of the sky
# gensky 7 4 8:00CEST +s -a 59.9 -o 10.7
# Local solar time: 5.22
# Solar altitude and azimuth: 14.1 -111.6
# Ground ambient level: 8.8

void light solar
0
0
3 3.92e+06 3.92e+06 3.92e+06

solar source sun
0
0
4 0.901641 0.357186 0.243849 0.5

void brightfunc skyfunc
2 skybr skybright.cal
0
7 1 3.81e+00 5.41e+00 3.08e-01 0.901641 0.357186 0.243849

##The 1 will be multiplie with brightfunc
skyfunc glow sky_glow
0
0
4 1 1 1 0

##Set to 1 as it will be multiplied with the gensky result
sky_glow source sky
0
0
4 0 0 1 180

##Set to 1 as it will be multiplied with the gensky result
skyfunc glow ground_glow
0
0
4 1 1 1 0

##The ground pane
ground_glow source ground
0
0
4 0 0 -1 180" > ~/MantaRay/TestingRemote/skies/sunny_sky_8.rad
_JOIN_
echo "~/MantaRay/TestingRemote/skies/sunny_sky_8.rad"
""", """mkdir -p ~/MantaRay/TestingRemote/skies/
_JOIN_
echo "##Will control the gradient of the sky
# gensky 7 4 16:00CEST +s -a 59.9 -o 10.7
# Local solar time: 13.22
# Solar altitude and azimuth: 50.9 27.3
# Ground ambient level: 15.1

void light solar
0
0
3 6.91e+06 6.91e+06 6.91e+06

solar source sun
0
0
4 -0.289110 -0.560683 0.775919 0.5

void brightfunc skyfunc
2 skybr skybright.cal
0
7 1 1.13e+01 2.35e+01 6.77e-01 -0.289110 -0.560683 0.775919

##The 1 will be multiplie with brightfunc
skyfunc glow sky_glow
0
0
4 1 1 1 0

##Set to 1 as it will be multiplied with the gensky result
sky_glow source sky
0
0
4 0 0 1 180

##Set to 1 as it will be multiplied with the gensky result
skyfunc glow ground_glow
0
0
4 1 1 1 0

##The ground pane
ground_glow source ground
0
0
4 0 0 -1 180" > ~/MantaRay/TestingRemote/skies/sunny_sky_16.rad
_JOIN_
echo "~/MantaRay/TestingRemote/skies/sunny_sky_16.rad"
"""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])  # -> Stdout, Stderr_, Ran
item = ListItem(List=executessh_14.Stdout, Index=0, Wrap=True)  # -> Item1, Item
python_4 = GhPythonScript(x=series)  # -> a; inputs x: Int32
# ---------- python_4: Python ----------
__author__ = "mm1013"
__version__ = "2022.08.30"

import rhinoscriptsyntax as rs

a = "%02d00" % x
# ---------- end python_4 ----------
hours = Number(python_4)
hours_2 = Text(python_4)

overrides_17 = ApplyOverrides(Input="cat <target>", Target=graft(executessh_12.Stdout))  # -> Output, DynamicOutput
executessh_15 = ExecuteSSH(
    _SSHCommands_=overrides_17.Output,
    Run=False,
    addPrefix=True,
    fireLogs=False,
    lastRunTime=0,
    suppressWarnings=False,
    results="""##Will control the gradient of the sky
# gensky -ang 45 0 -c -B 55.866
# Ground ambient level: 17.8

void brightfunc skyfunc
2 skybr skybright.cal
0
3 2 2.29e+01 3.56e+00

##The 1 will be multiplie with brightfunc
skyfunc glow sky_glow
0
0
4 1 1 1 0

##Set to 1 as it will be multiplied with the gensky result
sky_glow source sky
0
0
4 0 0 1 180

##Set to 1 as it will be multiplied with the gensky result
skyfunc glow ground_glow
0
0
4 1 1 1 0

##The ground pane
ground_glow source ground
0
0
4 0 0 -1 180""",
    commands="cat ~/MantaRay/UnnamedProject/skies/overcast_sky.rad")  # -> Stdout, Stderr_, Ran
panel_40 = Panel(executessh_15.Stdout)

overrides_18 = ApplyOverrides(Input="head <target>", Target=graft(item.Item1))  # -> Output, DynamicOutput
executessh_16 = ExecuteSSH(
    _SSHCommands_=overrides_18.DynamicOutput,
    Run=executessh_14.Ran,
    addPrefix=True,
    description="""head ~/MantaRay/TestingRemote/skies/sunny_sky_8.rad


- - -

head ~/MantaRay/TestingRemote/skies/sunny_sky_9.rad


- - -

head ~/MantaRay/TestingRemote/skies/sunny_sky_10.rad


- - -

head ~/MantaRay/TestingRemote/skies/sunny_sky_11.rad


- - -

head ~/MantaRay/TestingRemote/skies/sunny_sky_12.rad


- - -

head ~/MantaRay/TestingRemote/skies/sunny_sky_13.rad


- - -

head ~/MantaRay/TestingRemote/skies/sunny_sky_14.rad


- - -

head ~/MantaRay/TestingRemote/skies/sunny_sky_15.rad


- - -

head ~/MantaRay/TestingRemote/skies/sunny_sky_16.rad


- - -

head ~/MantaRay/TestingRemote/skies/sunny_sky_17.rad""",
    fireLogs=False,
    lastRunTime=40,
    suppressWarnings=False,
    results=["""##Will control the gradient of the sky
# gensky 7 4 8:00CEST +s -a 59.9 -o 10.7
# Local solar time: 5.22
# Solar altitude and azimuth: 14.1 -111.6
# Ground ambient level: 8.8

void light solar
0
0
3 3.92e+06 3.92e+06 3.92e+06""", """##Will control the gradient of the sky
# gensky 7 4 9:00CEST +s -a 59.9 -o 10.7
# Local solar time: 6.22
# Solar altitude and azimuth: 21.4 -99.3
# Ground ambient level: 10.8

void light solar
0
0
3 5.36e+06 5.36e+06 5.36e+06""", """##Will control the gradient of the sky
# gensky 7 4 10:00CEST +s -a 59.9 -o 10.7
# Local solar time: 7.22
# Solar altitude and azimuth: 28.8 -86.4
# Ground ambient level: 12.6

void light solar
0
0
3 6.07e+06 6.07e+06 6.07e+06""", """##Will control the gradient of the sky
# gensky 7 4 11:00CEST +s -a 59.9 -o 10.7
# Local solar time: 8.22
# Solar altitude and azimuth: 36.2 -72.6
# Ground ambient level: 13.8

void light solar
0
0
3 6.48e+06 6.48e+06 6.48e+06""", """##Will control the gradient of the sky
# gensky 7 4 12:00CEST +s -a 59.9 -o 10.7
# Local solar time: 9.22
# Solar altitude and azimuth: 43.0 -56.9
# Ground ambient level: 14.6

void light solar
0
0
3 6.72e+06 6.72e+06 6.72e+06""", """##Will control the gradient of the sky
# gensky 7 4 13:00CEST +s -a 59.9 -o 10.7
# Local solar time: 10.22
# Solar altitude and azimuth: 48.6 -38.7
# Ground ambient level: 15.0

void light solar
0
0
3 6.86e+06 6.86e+06 6.86e+06""", """##Will control the gradient of the sky
# gensky 7 4 14:00CEST +s -a 59.9 -o 10.7
# Local solar time: 11.22
# Solar altitude and azimuth: 52.2 -17.7
# Ground ambient level: 15.1

void light solar
0
0
3 6.93e+06 6.93e+06 6.93e+06""", """##Will control the gradient of the sky
# gensky 7 4 15:00CEST +s -a 59.9 -o 10.7
# Local solar time: 12.22
# Solar altitude and azimuth: 53.0 5.1
# Ground ambient level: 15.2

void light solar
0
0
3 6.94e+06 6.94e+06 6.94e+06""", """##Will control the gradient of the sky
# gensky 7 4 16:00CEST +s -a 59.9 -o 10.7
# Local solar time: 13.22
# Solar altitude and azimuth: 50.9 27.3
# Ground ambient level: 15.1

void light solar
0
0
3 6.91e+06 6.91e+06 6.91e+06""", """##Will control the gradient of the sky
# gensky 7 4 17:00CEST +s -a 59.9 -o 10.7
# Local solar time: 14.22
# Solar altitude and azimuth: 46.3 47.1
# Ground ambient level: 14.8

void light solar
0
0
3 6.81e+06 6.81e+06 6.81e+06"""],
    commands=["head ~/MantaRay/TestingRemote/skies/sunny_sky_8.rad", "head ~/MantaRay/TestingRemote/skies/sunny_sky_9.rad", "head ~/MantaRay/TestingRemote/skies/sunny_sky_11.rad", "head ~/MantaRay/TestingRemote/skies/sunny_sky_10.rad", "head ~/MantaRay/TestingRemote/skies/sunny_sky_12.rad", "head ~/MantaRay/TestingRemote/skies/sunny_sky_13.rad", "head ~/MantaRay/TestingRemote/skies/sunny_sky_15.rad", "head ~/MantaRay/TestingRemote/skies/sunny_sky_14.rad", "head ~/MantaRay/TestingRemote/skies/sunny_sky_17.rad"])  # -> Stdout, Stderr_, Ran
panel_41 = Panel(executessh_16.Stdout)

falsestart_8 = LBFalseStartToggle(True)

resolution = ValueList({"750x330": 750, "1500x750": 1500, "3000x1500": 3000, "5000x2500": 5000, "7000x3500": 7000, "8000x4000": 8000, "16000x8000": 16000, "20000x12000": 20000}, selected="5000x2500")
x = Number(resolution)

# ----
# OCTREE (overcast)
scene_rads = Text(entwine_3)
sky_ovc_2 = Text(sky_ovc)
python_5 = GhPythonScript(x=flatten(scene_rads))  # -> a; inputs x: list
# ---------- python_5: Python ----------
__author__ = "mm1013"
__version__ = "2022.06.15"

import rhinoscriptsyntax as rs

a = None not in x
# ---------- end python_5 ----------
entwine_7 = Entwine(Branch01=sky_ovc_2, Branch02=scene_rads, FlattenInputs=True)  # -> flatten(Radfiles)
panel_42 = Panel("""mkdir -p <proj>/octrees/
oconv -r 2048 -w -f <rads> > <proj>/octrees/<target>
echo <proj>/octrees/<target>""")
and = GateAnd(A=python_5, B=falsestart_8)
join_4 = TextJoin(Text=entwine_7, Join=" ")
overrides_19 = ApplyOverrides(Input=panel_42, Rads=graft(join_4), Target=graft("Scene_Overcast10klux.oct"))  # -> Output, DynamicOutput
executessh_17 = ExecuteSSH(
    _SSHCommands=overrides_19.DynamicOutput,
    Run=and,
    addPrefix=True,
    description="""mkdir -p ~/MantaRay/Andrei/octrees/
oconv -r 2048 -w -f ~/MantaRay/Andrei/skies/overcast_sky.rad ~/MantaRay/Andrei/radFiles/Glass_70.mat /home/lio/MantaRay/Andrei/radFiles/Glass_70_geo.rad ~/MantaRay/Andrei/radFiles/opaque_materials.mat /home/lio/MantaRay/Andrei/radFiles/FloorMat_0.7_geo.rad /home/lio/MantaRay/Andrei/radFiles/Cladding_0.5_geo.rad /home/lio/MantaRay/Andrei/radFiles/ConcreteWhite_0.8_geo.rad /home/lio/MantaRay/Andrei/radFiles/ConcreteStructure_0.3_geo.rad /home/lio/MantaRay/Andrei/radFiles/ConcreteGrey_0.5_geo.rad /home/lio/MantaRay/Andrei/radFiles/IntWalls_0.9_geo.rad /home/lio/MantaRay/Andrei/radFiles/Pipes_0.03_geo.rad /home/lio/MantaRay/Andrei/radFiles/ConcreteDarker_0.1_geo.rad /home/lio/MantaRay/Andrei/radFiles/Frames_0.6_geo.rad /home/lio/MantaRay/Andrei/radFiles/Black_0.01_geo.rad /home/lio/MantaRay/Andrei/radFiles/CurvedCeiling_0.8_geo.rad /home/lio/MantaRay/Andrei/radFiles/IntWalls_0.8_geo.rad /home/lio/MantaRay/Andrei/radFiles/FloorBox_0.75_geo.rad > ~/MantaRay/Andrei/octrees/Scene_Overcast10klux.oct
echo ~/MantaRay/Andrei/octrees/Scene_Overcast10klux.oct""",
    fireLogs=True,
    lastRunTime=1120.0897,
    name="oconv Scene_Overcast10klux.oct",
    suppressWarnings=False,
    results="/home/lio/MantaRay/Andrei/octrees/Scene_Overcast10klux.oct",
    commands="""mkdir -p ~/MantaRay/Andrei/octrees/
oconv -r 2048 -w -f ~/MantaRay/Andrei/skies/overcast_sky.rad ~/MantaRay/Andrei/radFiles/Glass_70.mat /home/lio/MantaRay/Andrei/radFiles/Glass_70_geo.rad ~/MantaRay/Andrei/radFiles/opaque_materials.mat /home/lio/MantaRay/Andrei/radFiles/FloorMat_0.7_geo.rad /home/lio/MantaRay/Andrei/radFiles/Cladding_0.5_geo.rad /home/lio/MantaRay/Andrei/radFiles/ConcreteWhite_0.8_geo.rad /home/lio/MantaRay/Andrei/radFiles/ConcreteStructure_0.3_geo.rad /home/lio/MantaRay/Andrei/radFiles/ConcreteGrey_0.5_geo.rad /home/lio/MantaRay/Andrei/radFiles/IntWalls_0.9_geo.rad /home/lio/MantaRay/Andrei/radFiles/Pipes_0.03_geo.rad /home/lio/MantaRay/Andrei/radFiles/ConcreteDarker_0.1_geo.rad /home/lio/MantaRay/Andrei/radFiles/Frames_0.6_geo.rad /home/lio/MantaRay/Andrei/radFiles/Black_0.01_geo.rad /home/lio/MantaRay/Andrei/radFiles/CurvedCeiling_0.8_geo.rad /home/lio/MantaRay/Andrei/radFiles/IntWalls_0.8_geo.rad /home/lio/MantaRay/Andrei/radFiles/FloorBox_0.75_geo.rad > ~/MantaRay/Andrei/octrees/Scene_Overcast10klux.oct
echo ~/MantaRay/Andrei/octrees/Scene_Overcast10klux.oct""")  # -> Stdout, Stderr_, Ran
panel_43 = Panel(overrides_19.Output)
panel_44 = Panel(executessh_17.Stderr_)
octree_overcast = Text(executessh_17.Stdout)

# ----
# OCTREE (Sunny - 10 hourly skies!)
scene_rads_2 = Text(entwine_3)
falsestart_9 = LBFalseStartToggle(True)
python_6 = GhPythonScript(x=flatten(scene_rads_2))  # -> a; inputs x: list; same code as python_5
entwine_8 = Entwine(Branch02=scene_rads_2, FlattenInputs=True)  # -> flatten(Radfiles)
panel_45 = Panel("""mkdir -p <proj>/octrees/
oconv -r 2048 -f -w <rads> > <proj>/octrees/<target>
echo <proj>/octrees/<target>""")
join_5 = TextJoin(Text=entwine_8, Join=" ")
overrides_20 = ApplyOverrides(Input=panel_45, Rads=graft(join_5), Target=graft("my_test_scene_NOSKY.oct"))  # -> Output, DynamicOutput
panel_46 = Panel("oconv -r 2048 -i <oldOct> -f <newRads> > <proj>/octrees/<target>_<h>.oct;echo <proj>/octrees/<target>_<h>.oct")
executessh_18 = ExecuteSSH(
    _SSHCommands_=overrides_20.DynamicOutput,
    Run=[python_6, falsestart_9],
    addPrefix=True,
    description="""mkdir -p ~/MantaRay/Andrei/octrees/
oconv -r 2048 -f -w ~/MantaRay/Andrei/radFiles/Glass_70.mat /home/lio/MantaRay/Andrei/radFiles/Glass_70_geo.rad ~/MantaRay/Andrei/radFiles/opaque_materials.mat /home/lio/MantaRay/Andrei/radFiles/FloorMat_0.7_geo.rad /home/lio/MantaRay/Andrei/radFiles/Cladding_0.5_geo.rad /home/lio/MantaRay/Andrei/radFiles/ConcreteWhite_0.8_geo.rad /home/lio/MantaRay/Andrei/radFiles/ConcreteStructure_0.3_geo.rad /home/lio/MantaRay/Andrei/radFiles/ConcreteGrey_0.5_geo.rad /home/lio/MantaRay/Andrei/radFiles/IntWalls_0.9_geo.rad /home/lio/MantaRay/Andrei/radFiles/Pipes_0.03_geo.rad /home/lio/MantaRay/Andrei/radFiles/ConcreteDarker_0.1_geo.rad /home/lio/MantaRay/Andrei/radFiles/Frames_0.6_geo.rad /home/lio/MantaRay/Andrei/radFiles/Black_0.01_geo.rad /home/lio/MantaRay/Andrei/radFiles/CurvedCeiling_0.8_geo.rad /home/lio/MantaRay/Andrei/radFiles/IntWalls_0.8_geo.rad /home/lio/MantaRay/Andrei/radFiles/FloorBox_0.75_geo.rad > ~/MantaRay/Andrei/octrees/my_test_scene_NOSKY.oct
echo ~/MantaRay/Andrei/octrees/my_test_scene_NOSKY.oct""",
    fireLogs=False,
    lastRunTime=1124.8347,
    suppressWarnings=False,
    results="/home/lio/MantaRay/Andrei/octrees/my_test_scene_NOSKY.oct",
    commands="""mkdir -p ~/MantaRay/Andrei/octrees/
oconv -r 2048 -f -w ~/MantaRay/Andrei/radFiles/Glass_70.mat /home/lio/MantaRay/Andrei/radFiles/Glass_70_geo.rad ~/MantaRay/Andrei/radFiles/opaque_materials.mat /home/lio/MantaRay/Andrei/radFiles/FloorMat_0.7_geo.rad /home/lio/MantaRay/Andrei/radFiles/Cladding_0.5_geo.rad /home/lio/MantaRay/Andrei/radFiles/ConcreteWhite_0.8_geo.rad /home/lio/MantaRay/Andrei/radFiles/ConcreteStructure_0.3_geo.rad /home/lio/MantaRay/Andrei/radFiles/ConcreteGrey_0.5_geo.rad /home/lio/MantaRay/Andrei/radFiles/IntWalls_0.9_geo.rad /home/lio/MantaRay/Andrei/radFiles/Pipes_0.03_geo.rad /home/lio/MantaRay/Andrei/radFiles/ConcreteDarker_0.1_geo.rad /home/lio/MantaRay/Andrei/radFiles/Frames_0.6_geo.rad /home/lio/MantaRay/Andrei/radFiles/Black_0.01_geo.rad /home/lio/MantaRay/Andrei/radFiles/CurvedCeiling_0.8_geo.rad /home/lio/MantaRay/Andrei/radFiles/IntWalls_0.8_geo.rad /home/lio/MantaRay/Andrei/radFiles/FloorBox_0.75_geo.rad > ~/MantaRay/Andrei/octrees/my_test_scene_NOSKY.oct
echo ~/MantaRay/Andrei/octrees/my_test_scene_NOSKY.oct""")  # -> Stdout, Stderr_, Ran
hours_3 = Text(hours_2)
sky_sunny = Text(graft(item.Item1))
panel_47 = Panel(executessh_18.Stdout)
overrides_21 = ApplyOverrides(
    Input=panel_46,
    OldOct=graft(executessh_18.Stdout),
    NewRads=graft(sky_sunny),
    Target=graft("my_test_scene"),
    H=graft(hours_3))  # -> Output, DynamicOutput
executessh_19 = ExecuteSSH(
    _SSHCommands_=overrides_21.DynamicOutput,
    Run=executessh_18.Ran,
    addPrefix=True,
    description="""oconv -r 2048 -i /home/lio/MantaRay/Andrei/octrees/my_test_scene_NOSKY.oct -f ~/MantaRay/TestingRemote/skies/sunny_sky_8.rad > ~/MantaRay/Andrei/octrees/my_test_scene_0800.oct;echo ~/MantaRay/Andrei/octrees/my_test_scene_0800.oct


- - -

oconv -r 2048 -i /home/lio/MantaRay/Andrei/octrees/my_test_scene_NOSKY.oct -f ~/MantaRay/TestingRemote/skies/sunny_sky_9.rad > ~/MantaRay/Andrei/octrees/my_test_scene_0900.oct;echo ~/MantaRay/Andrei/octrees/my_test_scene_0900.oct


- - -

oconv -r 2048 -i /home/lio/MantaRay/Andrei/octrees/my_test_scene_NOSKY.oct -f ~/MantaRay/TestingRemote/skies/sunny_sky_10.rad > ~/MantaRay/Andrei/octrees/my_test_scene_1000.oct;echo ~/MantaRay/Andrei/octrees/my_test_scene_1000.oct


- - -

oconv -r 2048 -i /home/lio/MantaRay/Andrei/octrees/my_test_scene_NOSKY.oct -f ~/MantaRay/TestingRemote/skies/sunny_sky_11.rad > ~/MantaRay/Andrei/octrees/my_test_scene_1100.oct;echo ~/MantaRay/Andrei/octrees/my_test_scene_1100.oct


- - -

oconv -r 2048 -i /home/lio/MantaRay/Andrei/octrees/my_test_scene_NOSKY.oct -f ~/MantaRay/TestingRemote/skies/sunny_sky_12.rad > ~/MantaRay/Andrei/octrees/my_test_scene_1200.oct;echo ~/MantaRay/Andrei/octrees/my_test_scene_1200.oct


- - -

oconv -r 2048 -i /home/lio/MantaRay/Andrei/octrees/my_test_scene_NOSKY.oct -f ~/MantaRay/TestingRemote/skies/sunny_sky_13.rad > ~/MantaRay/Andrei/octrees/my_test_scene_1300.oct;echo ~/MantaRay/Andrei/octrees/my_test_scene_1300.oct


- - -

oconv -r 2048 -i /home/lio/MantaRay/Andrei/octrees/my_test_scene_NOSKY.oct -f ~/MantaRay/TestingRemote/skies/sunny_sky_14.rad > ~/MantaRay/Andrei/octrees/my_test_scene_1400.oct;echo ~/MantaRay/Andrei/octrees/my_test_scene_1400.oct


- - -

oconv -r 2048 -i /home/lio/MantaRay/Andrei/octrees/my_test_scene_NOSKY.oct -f ~/MantaRay/TestingRemote/skies/sunny_sky_15.rad > ~/MantaRay/Andrei/octrees/my_test_scene_1500.oct;echo ~/MantaRay/Andrei/octrees/my_test_scene_1500.oct


- - -

oconv -r 2048 -i /home/lio/MantaRay/Andrei/octrees/my_test_scene_NOSKY.oct -f ~/MantaRay/TestingRemote/skies/sunny_sky_16.rad > ~/MantaRay/Andrei/octrees/my_test_scene_1600.oct;echo ~/MantaRay/Andrei/octrees/my_test_scene_1600.oct


- - -

oconv -r 2048 -i /home/lio/MantaRay/Andrei/octrees/my_test_scene_NOSKY.oct -f ~/MantaRay/TestingRemote/skies/sunny_sky_17.rad > ~/MantaRay/Andrei/octrees/my_test_scene_1700.oct;echo ~/MantaRay/Andrei/octrees/my_test_scene_1700.oct""",
    fireLogs=False,
    lastRunTime=126.9465,
    suppressWarnings=False,
    results=["/home/lio/MantaRay/Andrei/octrees/my_test_scene_0800.oct", "/home/lio/MantaRay/Andrei/octrees/my_test_scene_0900.oct", "/home/lio/MantaRay/Andrei/octrees/my_test_scene_1000.oct", "/home/lio/MantaRay/Andrei/octrees/my_test_scene_1100.oct", "/home/lio/MantaRay/Andrei/octrees/my_test_scene_1200.oct", "/home/lio/MantaRay/Andrei/octrees/my_test_scene_1300.oct", "/home/lio/MantaRay/Andrei/octrees/my_test_scene_1400.oct", "/home/lio/MantaRay/Andrei/octrees/my_test_scene_1500.oct", "/home/lio/MantaRay/Andrei/octrees/my_test_scene_1600.oct", "/home/lio/MantaRay/Andrei/octrees/my_test_scene_1700.oct"],
    commands=["oconv -r 2048 -i /home/lio/MantaRay/Andrei/octrees/my_test_scene_NOSKY.oct -f ~/MantaRay/TestingRemote/skies/sunny_sky_8.rad > ~/MantaRay/Andrei/octrees/my_test_scene_0800.oct;echo ~/MantaRay/Andrei/octrees/my_test_scene_0800.oct", "oconv -r 2048 -i /home/lio/MantaRay/Andrei/octrees/my_test_scene_NOSKY.oct -f ~/MantaRay/TestingRemote/skies/sunny_sky_10.rad > ~/MantaRay/Andrei/octrees/my_test_scene_1000.oct;echo ~/MantaRay/Andrei/octrees/my_test_scene_1000.oct", "oconv -r 2048 -i /home/lio/MantaRay/Andrei/octrees/my_test_scene_NOSKY.oct -f ~/MantaRay/TestingRemote/skies/sunny_sky_11.rad > ~/MantaRay/Andrei/octrees/my_test_scene_1100.oct;echo ~/MantaRay/Andrei/octrees/my_test_scene_1100.oct", "oconv -r 2048 -i /home/lio/MantaRay/Andrei/octrees/my_test_scene_NOSKY.oct -f ~/MantaRay/TestingRemote/skies/sunny_sky_9.rad > ~/MantaRay/Andrei/octrees/my_test_scene_0900.oct;echo ~/MantaRay/Andrei/octrees/my_test_scene_0900.oct", "oconv -r 2048 -i /home/lio/MantaRay/Andrei/octrees/my_test_scene_NOSKY.oct -f ~/MantaRay/TestingRemote/skies/sunny_sky_13.rad > ~/MantaRay/Andrei/octrees/my_test_scene_1300.oct;echo ~/MantaRay/Andrei/octrees/my_test_scene_1300.oct", "oconv -r 2048 -i /home/lio/MantaRay/Andrei/octrees/my_test_scene_NOSKY.oct -f ~/MantaRay/TestingRemote/skies/sunny_sky_15.rad > ~/MantaRay/Andrei/octrees/my_test_scene_1500.oct;echo ~/MantaRay/Andrei/octrees/my_test_scene_1500.oct", "oconv -r 2048 -i /home/lio/MantaRay/Andrei/octrees/my_test_scene_NOSKY.oct -f ~/MantaRay/TestingRemote/skies/sunny_sky_17.rad > ~/MantaRay/Andrei/octrees/my_test_scene_1700.oct;echo ~/MantaRay/Andrei/octrees/my_test_scene_1700.oct"])  # -> Stdout, Stderr_, Ran

# ----
# img size
target_res = ValueList({"750x330": 750, "1500x750": 1500, "3000x1500": 3000, "5000x2500": 5000, "7000x3500": 7000, "8000x4000": 8000}, selected="5000x2500")
division = Division(A=target_res, B=2)
x_2 = RemoteSender(target_res)
y = RemoteSender(division)

view = CreateView(Viewport="Perspective")  # -> ViewfileContent, ImageRatio
panel_48 = Panel("""mkdir -p <proj>/views/
echo "<vf>" > <proj>/views/<target>.vf
echo <proj>/views/<target>.vf""")
concat_3 = Concatenate(FragmentA="Perspective", FragmentB="3")
vf = Text(view.ViewfileContent)
panel_49 = Panel(view.ViewfileContent)
overrides_22 = ApplyOverrides(Input=panel_48, Vf=graft(vf), Target=graft(concat_3))  # -> Output, DynamicOutput
executessh_20 = ExecuteSSH(
    _SSHCommands_=overrides_22.DynamicOutput,
    Run=Toggle(True),
    addPrefix=True,
    description="""mkdir -p ~/MantaRay/Andrei/views/
echo "rvu -vtv -vp 76.210958985352 16.4300937305602 1.83584927923156 -vd -0.349680913647465 0.927360836447747 0.133135786524922 -vu 0.0469732080515546 -0.124573895254805 0.991097806649975 -vh 103.466 -vv 50.000" > ~/MantaRay/Andrei/views/Perspective3.vf
echo ~/MantaRay/Andrei/views/Perspective3.vf""",
    fireLogs=False,
    lastRunTime=80.1308,
    suppressWarnings=False,
    results="/home/lio/MantaRay/Andrei/views/Perspective3.vf",
    commands="""mkdir -p ~/MantaRay/Andrei/views/
echo "rvu -vtv -vp 76.210958985352 16.4300937305602 1.83584927923156 -vd -0.349680913647465 0.927360836447747 0.133135786524922 -vu 0.0469732080515546 -0.124573895254805 0.991097806649975 -vh 103.466 -vv 50.000" > ~/MantaRay/Andrei/views/Perspective3.vf
echo ~/MantaRay/Andrei/views/Perspective3.vf""")  # -> Stdout, Stderr_, Ran
viewname = Text(concat_3)

view_2 = CreateView(Viewport="Perspective")  # -> ViewfileContent, ImageRatio
panel_50 = Panel("""mkdir -p <proj>/views/
echo "<vf>" > <proj>/views/<target>.vf
echo <proj>/views/<target>.vf""")
concat_4 = Concatenate(FragmentA="Perspective", FragmentB="2")
vf_2 = Text(view_2.ViewfileContent)
panel_51 = Panel(view_2.ViewfileContent)
overrides_23 = ApplyOverrides(Input=panel_50, Vf=graft(vf_2), Target=graft(concat_4))  # -> Output, DynamicOutput
executessh_21 = ExecuteSSH(
    _SSHCommands_=overrides_23.DynamicOutput,
    Run=Toggle(True),
    addPrefix=True,
    description="""mkdir -p ~/MantaRay/Andrei/views/
echo "rvu -vtv -vp 76.210958985352 16.4300937305602 1.83584927923156 -vd -0.349680913647465 0.927360836447747 0.133135786524922 -vu 0.0469732080515546 -0.124573895254805 0.991097806649975 -vh 103.466 -vv 50.000" > ~/MantaRay/Andrei/views/Perspective2.vf
echo ~/MantaRay/Andrei/views/Perspective2.vf""",
    fireLogs=False,
    lastRunTime=99.6741,
    suppressWarnings=False,
    results="/home/lio/MantaRay/Andrei/views/Perspective2.vf",
    commands="""mkdir -p ~/MantaRay/Andrei/views/
echo "rvu -vtv -vp 76.210958985352 16.4300937305602 1.83584927923156 -vd -0.349680913647465 0.927360836447747 0.133135786524922 -vu 0.0469732080515546 -0.124573895254805 0.991097806649975 -vh 103.466 -vv 50.000" > ~/MantaRay/Andrei/views/Perspective2.vf
echo ~/MantaRay/Andrei/views/Perspective2.vf""")  # -> Stdout, Stderr_, Ran
viewname_2 = Text(concat_4)

# ----
# Set focus zone to RAD
# to calculate parameters
type = ValueList({"Interior": "I", "Exterior": "E"}, selected="Interior")
zone = Box({Plane=PlaneXY(67.34687306, 14.8177948, 0), X=Domain(0, 14.49025655), Y=Domain(0, 18.20965901), Z=Domain(0, 13.53214381)})
zone_2 = GhPythonScript(zoneBox=zone, type=type)  # -> out, zone; inputs zoneBox: Box
# ---------- zone_2: Python ----------
__author__ = "mm1013"
__version__ = "2022.10.06"

import rhinoscriptsyntax as rs
import Rhino.Geometry as rg

import Grasshopper.Kernel as gh

#e = gh.GH_RuntimeMessageLevel.Error
w = gh.GH_RuntimeMessageLevel.Warning

zone =""

testPlane = rg.Plane(rg.Point3d(0,0,0), zoneBox.Plane.XAxis, zoneBox.Plane.YAxis)
if testPlane != rg.Plane.WorldXY:
    ghenv.Component.AddRuntimeMessage(w, "Bounding box must have XY as base plane")
else:
    zone = "ZONE={type} {Xmin:.2f} {Xmax:.2f} {Ymin:.2f} {Ymax:.2f} {Zmin:.2f} {Zmax:.2f}\n".format( \
    type=type, Xmin = zoneBox.X.Min, Xmax = zoneBox.X.Max, Ymin = zoneBox.Y.Min, Ymax = zoneBox.Y.Max, Zmin = zoneBox.Z.Min, Zmax = zoneBox.Z.Max)
# ---------- end zone_2 ----------

# ----
# Parallel RTRACE render
# with ambient cache
panel_52 = Panel("ambfile2_<time>.af")
octree = Text(executessh_17.Stdout)
viewfile = Text(executessh_21.Stdout)
panel_53 = Panel("""mkdir -p <LinuxHome>/images/
mkdir -p <LinuxHome>/ambientFiles/
vwrays -ff -x <x> -y <y> -vf <vf> -pa 1 | rtrace <radOptions> -af <LinuxHome>/ambientFiles/<af> -w -n <cpus> `vwrays -d -ff -x <x> -y <y> -vf <vf> -pa 1` -ffc -e <LinuxHome>/ambientFiles/<target-.>.err <oct> > <LinuxHome>/images/<target-.>.hdr
echo <LinuxHome>/images/<target-.>.hdr""")
run_2 = LBFalseStartToggle(False)
python_7 = GhPythonScript(x=viewfile)  # -> a
# ---------- python_7: Python ----------
__author__ = "mm1013"
__version__ = "2022.09.13"

import rhinoscriptsyntax as rs

a = x.split("/")[-1].split(".")[0]
# ---------- end python_7 ----------
panel_54 = Panel("<time>_<view>_render.hdr")
panel_55 = Panel("-as 0 -ab 2 -aa 0.0 -ad 16")
x_3 = RemoteReceiver(x_2)
y_2 = RemoteReceiver(y)
overrides_24 = ApplyOverrides(
    Input=panel_53,
    X=graft(x_3),
    Y=graft(y_2),
    Vf=graft("<vf>"),
    RadOptions=graft(panel_55),
    Oct=graft(octree),
    Target=graft(panel_54),
    Af=graft("<af>"),
    Time=graft("<time>"),
    View=graft("<view>"))  # -> Output, DynamicOutput
python_8 = GhPythonScript(update=overrides_24.Output)  # -> time; inputs update: tree
# ---------- python_8: Python ----------
#if not update:
#    return self.time
"""Provides a scripting component.
    Inputs:
        x: The x script variable
        y: The y script variable
    Output:
        a: The a output variable"""
        
__author__ = "mm1013"
__version__ = "2022.08.30"
        
import rhinoscriptsyntax as rs
        
from datetime import datetime
dt = datetime.now()
        
time = "%02d_%02d_%02d_%02d%02d_%02d" % (dt.year, dt.month, dt.day, dt.hour, dt.minute, dt.second)
# ---------- end python_8 ----------
overrides_25 = ApplyOverrides(
    Input=overrides_24.DynamicOutput,
    Time=graft(python_8),
    View=graft(viewname_2),
    Vf=graft(executessh_21.Stdout),
    Af=graft(panel_52))  # -> Output, DynamicOutput
falsestart_10 = LBFalseStartToggle(False)
executessh_22 = ExecuteSSH(
    _SSHCommands_=overrides_25.Output,
    Run=run_2,
    addPrefix=True,
    fireLogs=False,
    lastRunTime=130752,
    suppressWarnings=False,
    results="/home/lio/MantaRay/Andrei/images/2023_01_18_1002_49_Perspective_render.hdr",
    commands="""mkdir -p ~/MantaRay/Andrei/images/
mkdir -p ~/MantaRay/Andrei/ambientFiles/
vwrays -ff -x 2500 -y 2000 -vf /home/lio/MantaRay/Andrei/views/Perspective2.vf -pa 1 | rtrace -as 0 -ab 2 -aa 0.0 -ad 32 -af ~/MantaRay/Andrei/ambientFiles/ambfile2_2023_01_18_1002_49.af -w -n 63 `vwrays -d -ff -x 2500 -y 2000 -vf /home/lio/MantaRay/Andrei/views/Perspective2.vf -pa 1` -ffc -e ~/MantaRay/Andrei/ambientFiles/2023_01_18_1002_49_Perspective_render.err /home/lio/MantaRay/Andrei/octrees/my_test_scene.oct > ~/MantaRay/Andrei/images/2023_01_18_1002_49_Perspective_render.hdr
echo ~/MantaRay/Andrei/images/2023_01_18_1002_49_Perspective_render.hdr""")  # -> Stdout, Stderr_, Ran
or = GateOr(A=falsestart_10, B=executessh_22.Ran)

# ----
# Parallel RTRACE render (illuminance)
# with ambient cache (reusing file from above!)
# -ab 2 -aa 0.2 -ad 512
run_3 = LBFalseStartToggle(False)
panel_56 = Panel("""mkdir -p <proj>/images/
vwrays -ff -x <x> -y <y> -vf <vf> -pa 1 | rtrace -i <radOptions> -af <af> -w -n 11 `vwrays -d -ff -x <x> -y <y> -vf <vf> -pa 1` -ffc <oct> > <proj>/images/<target-.>.hdr
echo <proj>/images/<target-.>.hdr""")
octree_2 = Text(executessh_17.Stdout)
viewfile_2 = Text(executessh_21.Stdout)
python_9 = GhPythonScript(x=viewfile_2)  # -> a; same code as python_7
x_4 = RemoteReceiver(x_2)
y_3 = RemoteReceiver(y)
overrides_26 = ApplyOverrides(
    Input=panel_56,
    X=graft(x_4),
    Y=graft(y_3),
    Vf=graft(viewfile_2),
    RadOptions=graft(panel_55),
    Oct=graft(octree_2),
    Target=graft("<time>_<view>_render_illum.hdr"),
    Af=graft("<af>"),
    View=graft(python_9),
    Time=graft("<time>"))  # -> Output, DynamicOutput
overrides_27 = ApplyOverrides(
    Input=overrides_26.DynamicOutput,
    Time=graft(python_8),
    View=graft(viewname_2),
    Vf=graft(executessh_21.Stdout),
    Af=graft(panel_52))  # -> Output, DynamicOutput
executessh_23 = ExecuteSSH(
    _SSHCommands_=overrides_26.DynamicOutput,
    Run=run_3,
    addPrefix=True,
    description="""mkdir -p ~/MantaRay/Andrei/images/
vwrays -ff -x 5000 -y 2500 -vf /home/lio/MantaRay/Andrei/views/Perspective2.vf -pa 1 | rtrace -i -as 0 -ab 2 -aa 0.0 -ad 16 -af <af> -w -n 11 `vwrays -d -ff -x 5000 -y 2500 -vf /home/lio/MantaRay/Andrei/views/Perspective2.vf -pa 1` -ffc /home/lio/MantaRay/Andrei/octrees/Scene_Overcast10klux.oct > ~/MantaRay/Andrei/images/<time>_Perspective2_render_illum.hdr
echo ~/MantaRay/Andrei/images/<time>_Perspective2_render_illum.hdr""",
    fireLogs=False,
    lastRunTime=86167,
    suppressWarnings=False,
    results="/home/lio/MantaRay/Andrei/images/2023_01_18_1002_49_Perspective1_render_illum.hdr",
    commands="""mkdir -p ~/MantaRay/Andrei/images/
vwrays -ff -x 2500 -y 2000 -vf /home/lio/MantaRay/Andrei/views/Perspective1.vf -pa 1 | rtrace -i -as 0 -ab 2 -aa 0.0 -ad 32 -af ambfile2_2023_01_18_1002_49.af -w -n 11 `vwrays -d -ff -x 2500 -y 2000 -vf /home/lio/MantaRay/Andrei/views/Perspective1.vf -pa 1` -ffc /home/lio/MantaRay/Andrei/octrees/my_test_scene.oct > ~/MantaRay/Andrei/images/2023_01_18_1002_49_Perspective1_render_illum.hdr
echo ~/MantaRay/Andrei/images/2023_01_18_1002_49_Perspective1_render_illum.hdr""")  # -> Stdout, Stderr_, Ran

# ----
# attempt to do overcast discretized sky (rtcontrib tutorial p20)
panel_57 = Panel("gensky 3 21 10 -c -a 51 -o 0 -m 0 -b 22.86")
falsestart_11 = LBFalseStartToggle(False)
panel_58 = Panel("""gensky 3 21 10 -c -a 51 -o 0 -m 0 -b 22.86 \
|rcalc -i '3 2 <zenithbr> <groundbr>' \
-e '$1=<groundbr>'""")
executessh_24 = ExecuteSSH(
    _SSHCommands_=panel_57,
    Run=falsestart_11,
    addPrefix=True,
    fireLogs=False,
    lastRunTime=5,
    suppressWarnings=False,
    results="""# gensky 3 21 10 -c -a 51 -o 0 -m 0 -b 22.86
# Local solar time: 9.88
# Solar altitude and azimuth: 31.9 -38.5
# Ground ambient level: 17.8

void brightfunc skyfunc
2 skybr skybright.cal
0
3 2 2.29e+01 3.56e+00""",
    commands="gensky 3 21 10 -c -a 51 -o 0 -m 0 -b 22.86")  # -> Stdout, Stderr_, Ran
python_10 = GhPythonScript(x=executessh_24.Stdout)  # -> a
# ---------- python_10: Python ----------
__author__ = "mm1013"
__version__ = "2022.09.27"

import rhinoscriptsyntax as rs

a = float(x.split("\n")[3].split(" ")[-1])
# ---------- end python_10 ----------
python_11 = GhPythonScript(x=executessh_24.Stdout)  # -> a
# ---------- python_11: Python ----------
__author__ = "mm1013"
__version__ = "2022.09.27"

import rhinoscriptsyntax as rs

a = float(x.split(" ")[-2])
# ---------- end python_11 ----------
panel_59 = Panel(executessh_24.Stdout)
overrides_28 = ApplyOverrides(Input=panel_58, Zenithbr=graft(python_11), Groundbr=graft(python_10))  # -> Output, DynamicOutput
executessh_25 = ExecuteSSH(
    _SSHCommands_=overrides_28.Output,
    Run=executessh_24.Ran,
    addPrefix=True,
    fireLogs=False,
    lastRunTime=6,
    suppressWarnings=False,
    stderr="3 2 22.9 17.8: cannot open",
    commands="""gensky 3 21 10 -c -a 51 -o 0 -m 0 -b 22.86 \
|rcalc -i '3 2 22.9 17.8' \
-e '$1=17.8'""")  # -> Stdout, Stderr_, Ran
panel_60 = Panel(executessh_25.Stderr_)

supersampling = Panel("4")
y_4 = RemoteReceiver(y)
x_5 = RemoteReceiver(x_2)
multiplication = Multiplication(A=x_5, B=supersampling)
multiplication_2 = Multiplication(A=y_4, B=supersampling)
falsestart_12 = LBFalseStartToggle(False)

panel_61 = Panel("""pkill rtpict
pkill rtrace
pkill rpict""")
executessh_26 = ExecuteSSH(
    _SSHCommands_=panel_61,
    Run=Button(),
    addPrefix=True,
    fireLogs=False,
    lastRunTime=57.7614,
    suppressWarnings=False,
    commands="""pkill rtpict
pkill rtrace
pkill rpict""")  # -> Stdout, Stderr_, Ran

# ----
# killl the task
panel_62 = Panel("cat <LinuxHome>/ambientFiles/<target-.>.err")
overrides_29 = ApplyOverrides(Input=panel_62, Target=graft(panel_54), Time=graft(python_8), View=graft(viewname_2))  # -> Output, DynamicOutput
executessh_27 = ExecuteSSH(
    _SSHCommands_=overrides_29.DynamicOutput,
    Run=executessh_22.Ran,
    addPrefix=True,
    description="cat ~/MantaRay/Andrei/ambientFiles/2023_03_12_2232_04_Perspective2_render.err",
    fireLogs=False,
    lastRunTime=12,
    suppressWarnings=False,
    results="""**************
*** PID 12526: rtrace -as 0 -ab 2 -aa 0.0 -ad 32 -af /home/lio/MantaRay/Andrei/ambientFiles/ambfile2_2023_01_18_1002_49.af -w -n 63 -x 2500 -y 1240 -ffc -e /home/lio/MantaRay/Andrei/ambientFiles/2023_01_18_1002_49_Perspective_render.err /home/lio/MantaRay/Andrei/octrees/my_test_scene.oct""",
    commands="cat ~/MantaRay/Andrei/ambientFiles/2023_01_18_1002_49_Perspective_render.err")  # -> Stdout, Stderr_, Ran
panel_63 = Panel(executessh_27.Stdout)
python_12 = GhPythonScript(errIn=executessh_27.Stdout)  # -> pid, run
# ---------- python_12: Python ----------
__author__ = "mm1013"
__version__ = "2022.10.06"

import rhinoscriptsyntax as rs

start = errIn.split(":")[0].split(" ")[-1]
print(start)
try:
    pid = int(start)
    run = True
except:
    run = False
# ---------- end python_12 ----------
falsestart_13 = LBFalseStartToggle(False)
overrides_30 = ApplyOverrides(Input="kill <pid>", Pid=graft(python_12.pid))  # -> Output, DynamicOutput
executessh_28 = ExecuteSSH(
    _SSHCommands_=overrides_30.Output,
    Run=flatten([python_12.run, falsestart_13]),
    addPrefix=True,
    fireLogs=False,
    lastRunTime=0,
    suppressWarnings=False)  # -> Stdout, Stderr_, Ran

# ----
# Using PCOND to set automatic exposure
# and convert to PNG
panel_64 = Panel("""pcond -h <hdr> <hdr-.>_exposed.hdr
ra_tiff <hdr-.>_exposed.hdr <hdr-.>_exposed.tif
convert <hdr-.>_exposed.tif <hdr-.>_exposed.png
echo <hdr-.>_exposed.png""")
overrides_31 = ApplyOverrides(Input=panel_64, Hdr=graft(executessh_22.Stdout))  # -> Output, DynamicOutput
executessh_29 = ExecuteSSH(
    _SSHCommands_=overrides_31.DynamicOutput,
    Run=or,
    addPrefix=True,
    description="""pcond -h /home/lio/MantaRay/Andrei/images/2023_01_18_1002_49_Perspective_render.hdr /home/lio/MantaRay/Andrei/images/2023_01_18_1002_49_Perspective_render_exposed.hdr
ra_tiff /home/lio/MantaRay/Andrei/images/2023_01_18_1002_49_Perspective_render_exposed.hdr /home/lio/MantaRay/Andrei/images/2023_01_18_1002_49_Perspective_render_exposed.tif
convert /home/lio/MantaRay/Andrei/images/2023_01_18_1002_49_Perspective_render_exposed.tif /home/lio/MantaRay/Andrei/images/2023_01_18_1002_49_Perspective_render_exposed.png
echo /home/lio/MantaRay/Andrei/images/2023_01_18_1002_49_Perspective_render_exposed.png""",
    fireLogs=False,
    lastRunTime=2688,
    suppressWarnings=False,
    results="/home/lio/MantaRay/Andrei/images/2023_01_18_1002_49_Perspective_render_exposed.png",
    commands="""pcond -h /home/lio/MantaRay/Andrei/images/2023_01_18_1002_49_Perspective_render.hdr /home/lio/MantaRay/Andrei/images/2023_01_18_1002_49_Perspective_render_exposed.hdr
ra_tiff /home/lio/MantaRay/Andrei/images/2023_01_18_1002_49_Perspective_render_exposed.hdr /home/lio/MantaRay/Andrei/images/2023_01_18_1002_49_Perspective_render_exposed.tif
convert /home/lio/MantaRay/Andrei/images/2023_01_18_1002_49_Perspective_render_exposed.tif /home/lio/MantaRay/Andrei/images/2023_01_18_1002_49_Perspective_render_exposed.png
echo /home/lio/MantaRay/Andrei/images/2023_01_18_1002_49_Perspective_render_exposed.png""")  # -> Stdout, Stderr_, Ran
download_4 = Download(
    LinuxFilePaths=executessh_29.Stdout,
    Run=executessh_29.Ran,
    stdouts="C:\Users\mm1013\MantaRay\Andrei\2023_01_18_1002_49_Perspective_render_exposed.png")  # -> FilePaths, Status, Ran
denoiser = DenoiseImage(InputImage=download_4.FilePaths, PathToDenoisr="C:\Denoiser_v1.6\Denoiser.exe")  # disabled
imageviewer_2 = LBImageViewer(ImagePath_=download_4.FilePaths, _scale_="1", DisableClickable=False, SaveImgWithCoords=False, scale=1)  # -> ImagePath, Values, GIF

# ----
# Using PCOND to set automatic exposure
# and convert to PNG
panel_65 = Panel("""pcond -h <hdr> <hdr-.>_exposed.hdr
ra_tiff <hdr-.>_exposed.hdr <hdr-.>_exposed.tif
convert <hdr-.>_exposed.tif <hdr-.>_exposed.png
echo <hdr-.>_exposed.png""")
overrides_32 = ApplyOverrides(Input=panel_65, Hdr=graft(executessh_23.Stdout))  # -> Output, DynamicOutput
executessh_30 = ExecuteSSH(
    _SSHCommands_=overrides_32.DynamicOutput,
    Run=executessh_23.Ran,
    addPrefix=True,
    description="""pcond -h /home/lio/MantaRay/Andrei/images/2023_01_18_1002_49_Perspective1_render_illum.hdr /home/lio/MantaRay/Andrei/images/2023_01_18_1002_49_Perspective1_render_illum_exposed.hdr
ra_tiff /home/lio/MantaRay/Andrei/images/2023_01_18_1002_49_Perspective1_render_illum_exposed.hdr /home/lio/MantaRay/Andrei/images/2023_01_18_1002_49_Perspective1_render_illum_exposed.tif
convert /home/lio/MantaRay/Andrei/images/2023_01_18_1002_49_Perspective1_render_illum_exposed.tif /home/lio/MantaRay/Andrei/images/2023_01_18_1002_49_Perspective1_render_illum_exposed.png
echo /home/lio/MantaRay/Andrei/images/2023_01_18_1002_49_Perspective1_render_illum_exposed.png""",
    fireLogs=False,
    lastRunTime=2124,
    suppressWarnings=False,
    results="/home/lio/MantaRay/Andrei/images/2023_01_18_1002_49_Perspective1_render_illum_exposed.png",
    commands="""pcond -h /home/lio/MantaRay/Andrei/images/2023_01_18_1002_49_Perspective1_render_illum.hdr /home/lio/MantaRay/Andrei/images/2023_01_18_1002_49_Perspective1_render_illum_exposed.hdr
ra_tiff /home/lio/MantaRay/Andrei/images/2023_01_18_1002_49_Perspective1_render_illum_exposed.hdr /home/lio/MantaRay/Andrei/images/2023_01_18_1002_49_Perspective1_render_illum_exposed.tif
convert /home/lio/MantaRay/Andrei/images/2023_01_18_1002_49_Perspective1_render_illum_exposed.tif /home/lio/MantaRay/Andrei/images/2023_01_18_1002_49_Perspective1_render_illum_exposed.png
echo /home/lio/MantaRay/Andrei/images/2023_01_18_1002_49_Perspective1_render_illum_exposed.png""")  # -> Stdout, Stderr_, Ran
download_5 = Download(LinuxFilePaths=executessh_30.Stdout, Run=executessh_30.Ran)  # -> FilePaths, Status, Ran
imageviewer_3 = LBImageViewer(ImagePath_=download_5.FilePaths, _scale_="1", DisableClickable=False, SaveImgWithCoords=False, scale=1)  # -> ImagePath, Values, GIF

# ----
# False color with illuminance curves
# on top of luminance picture
panel_66 = Panel("""pcond -h <irrad> <irrad-.>_exposed.hdr
falsecolor -s 9000 -d 0 -l lux -p <irrad-.>_exposed.hdr -i <irrad> -cl -log 2 > <rad-.>_fc.hdr;echo <rad-.>_fc.hdr""")
bool_5 = Boolean([or, executessh_23.Ran])
rad = Text(executessh_22.Stdout)
irrad = Text(executessh_23.Stdout)
overrides_33 = ApplyOverrides(Input=panel_66, Rad=graft(rad), Irrad=graft(irrad))  # -> Output, DynamicOutput
executessh_31 = ExecuteSSH(
    _SSHCommands_=overrides_33.DynamicOutput,
    Run=bool_5,
    addPrefix=True,
    description="""pcond -h /home/lio/MantaRay/Andrei/images/2023_01_18_1002_49_Perspective1_render_illum.hdr /home/lio/MantaRay/Andrei/images/2023_01_18_1002_49_Perspective1_render_illum_exposed.hdr
falsecolor -s 9000 -d 0 -l lux -p /home/lio/MantaRay/Andrei/images/2023_01_18_1002_49_Perspective1_render_illum_exposed.hdr -i /home/lio/MantaRay/Andrei/images/2023_01_18_1002_49_Perspective1_render_illum.hdr -cl -log 2 > /home/lio/MantaRay/Andrei/images/2023_01_18_1002_49_Perspective_render_fc.hdr;echo /home/lio/MantaRay/Andrei/images/2023_01_18_1002_49_Perspective_render_fc.hdr""",
    fireLogs=False,
    lastRunTime=5852,
    suppressWarnings=False,
    results="/home/lio/MantaRay/Andrei/images/2023_01_18_1002_49_Perspective_render_fc.hdr",
    commands="""pcond -h /home/lio/MantaRay/Andrei/images/2023_01_18_1002_49_Perspective1_render_illum.hdr /home/lio/MantaRay/Andrei/images/2023_01_18_1002_49_Perspective1_render_illum_exposed.hdr
falsecolor -s 9000 -d 0 -l lux -p /home/lio/MantaRay/Andrei/images/2023_01_18_1002_49_Perspective1_render_illum_exposed.hdr -i /home/lio/MantaRay/Andrei/images/2023_01_18_1002_49_Perspective1_render_illum.hdr -cl -log 2 > /home/lio/MantaRay/Andrei/images/2023_01_18_1002_49_Perspective_render_fc.hdr;echo /home/lio/MantaRay/Andrei/images/2023_01_18_1002_49_Perspective_render_fc.hdr""")  # -> Stdout, Stderr_, Ran
download_6 = Download(LinuxFilePaths=executessh_31.Stdout, Run=executessh_31.Ran)  # -> FilePaths, Status, Ran
imageviewer_4 = LBImageViewer(ImagePath_=download_6.FilePaths, _scale_="1", DisableClickable=False, SaveImgWithCoords=False, scale=1)  # -> ImagePath, Values, GIF

# ----
# False color with illuminance curves
# on top of luminance picture
panel_67 = Panel("falsecolor -s 50 -n 10 -m 1.79 -l DF -p <rad-.>_exposed.hdr -i <irrad> -cp > <rad-.>_fc4.hdr;echo <rad-.>_fc4.hdr")
overrides_34 = ApplyOverrides(Input=panel_67, Rad=graft(executessh_22.Stdout), Irrad=graft(executessh_23.Stdout))  # -> Output, DynamicOutput
executessh_32 = ExecuteSSH(
    _SSHCommands_=overrides_34.DynamicOutput,
    Run=[or, executessh_23.Ran],
    addPrefix=True,
    description="falsecolor -s 50 -n 10 -m 1.79 -l DF -p /home/lio/MantaRay/Andrei/images/2023_01_18_1002_49_Perspective_render_exposed.hdr -i /home/lio/MantaRay/Andrei/images/2023_01_18_1002_49_Perspective1_render_illum.hdr -cp > /home/lio/MantaRay/Andrei/images/2023_01_18_1002_49_Perspective_render_fc4.hdr;echo /home/lio/MantaRay/Andrei/images/2023_01_18_1002_49_Perspective_render_fc4.hdr",
    fireLogs=False,
    lastRunTime=37,
    suppressWarnings=False,
    results="/home/lio/MantaRay/Andrei/images/2023_01_18_1002_49_Perspective_render_fc4.hdr",
    stderr="""/home/lio/MantaRay/Andrei/images/2023_01_18_1002_49_Perspective_render_exposed.hdr: bad picture size
<stdin>: bad picture size
Bad header!""",
    commands="falsecolor -s 50 -n 10 -m 1.79 -l DF -p /home/lio/MantaRay/Andrei/images/2023_01_18_1002_49_Perspective_render_exposed.hdr -i /home/lio/MantaRay/Andrei/images/2023_01_18_1002_49_Perspective1_render_illum.hdr -cp > /home/lio/MantaRay/Andrei/images/2023_01_18_1002_49_Perspective_render_fc4.hdr;echo /home/lio/MantaRay/Andrei/images/2023_01_18_1002_49_Perspective_render_fc4.hdr")  # -> Stdout, Stderr_, Ran
download_7 = Download(
    LinuxFilePaths=executessh_32.Stdout,
    Run=executessh_32.Ran,
    stdouts="C:\Users\mm1013\MantaRay\UnnamedProject\2022_09_28_1341_29_Perspective1_render_fc4.hdr")  # -> FilePaths, Status, Ran
imageviewer_5 = LBImageViewer(ImagePath_=download_7.FilePaths, _scale_="1", DisableClickable=False, SaveImgWithCoords=False, scale=1)  # -> ImagePath, Values, GIF

x_6 = RemoteReceiver(x_2)

# ---- group: Extracted Coordinates
pt = Point([Point(811, 630, 0), Point(812, 668, 0), Point(814, 715, 0), Point(816, 753, 0), Point(816, 798, 0), Point(1312, 468, 0), Point(1308, 506, 0), Point(1305, 547, 0), Point(1305, 574, 0), Point(1299, 606, 0), Point(1627, 410, 0), Point(1619, 440, 0), Point(1614, 468, 0), Point(1608, 500, 0), Point(132, 21, 0)])

# ----
# attempt to probe values from pixels
panel_68 = Panel("pcomb -o <hdr> | pcompos -x 2 -y 2 - -<x> -<y> | pvalue -h -H -df | total -if3 -m | sed -r 's/[\t]+/1/g'")
pdecon = Deconstruct(Point=pt)  # -> XComponent, YComponent, ZComponent
subtraction = Subtraction(A=y_2, B=pdecon.YComponent)
overrides_35 = ApplyOverrides(Input=panel_68, Hdr=graft(executessh_23.Stdout), X=graft(pdecon.XComponent), Y=graft(subtraction))  # -> Output, DynamicOutput
item_2 = ListItem(List=flatten(overrides_35.Output), Index=0, Wrap=True)
panel_69 = Panel(item_2)
executessh_33 = ExecuteSSH(
    _SSHCommands_=overrides_35.DynamicOutput,
    Run=executessh_23.Ran,
    addPrefix=True,
    description="""pcomb -o /home/lio/MantaRay/Andrei/images/2023_01_18_1002_49_Perspective1_render_illum.hdr | pcompos -x 2 -y 2 - -811 -1870 | pvalue -h -H -df | total -if3 -m | sed -r 's/[\t]+/1/g'


- - -

pcomb -o /home/lio/MantaRay/Andrei/images/2023_01_18_1002_49_Perspective1_render_illum.hdr | pcompos -x 2 -y 2 - -812 -1832 | pvalue -h -H -df | total -if3 -m | sed -r 's/[\t]+/1/g'


- - -

pcomb -o /home/lio/MantaRay/Andrei/images/2023_01_18_1002_49_Perspective1_render_illum.hdr | pcompos -x 2 -y 2 - -814 -1785 | pvalue -h -H -df | total -if3 -m | sed -r 's/[\t]+/1/g'


- - -

pcomb -o /home/lio/MantaRay/Andrei/images/2023_01_18_1002_49_Perspective1_render_illum.hdr | pcompos -x 2 -y 2 - -816 -1747 | pvalue -h -H -df | total -if3 -m | sed -r 's/[\t]+/1/g'


- - -

pcomb -o /home/lio/MantaRay/Andrei/images/2023_01_18_1002_49_Perspective1_render_illum.hdr | pcompos -x 2 -y 2 - -816 -1702 | pvalue -h -H -df | total -if3 -m | sed -r 's/[\t]+/1/g'


- - -

pcomb -o /home/lio/MantaRay/Andrei/images/2023_01_18_1002_49_Perspective1_render_illum.hdr | pcompos -x 2 -y 2 - -1312 -2032 | pvalue -h -H -df | total -if3 -m | sed -r 's/[\t]+/1/g'


- - -

pcomb -o /home/lio/MantaRay/Andrei/images/2023_01_18_1002_49_Perspective1_render_illum.hdr | pcompos -x 2 -y 2 - -1308 -1994 | pvalue -h -H -df | total -if3 -m | sed -r 's/[\t]+/1/g'


- - -

pcomb -o /home/lio/MantaRay/Andrei/images/2023_01_18_1002_49_Perspective1_render_illum.hdr | pcompos -x 2 -y 2 - -1305 -1953 | pvalue -h -H -df | total -if3 -m | sed -r 's/[\t]+/1/g'


- - -

pcomb -o /home/lio/MantaRay/Andrei/images/2023_01_18_1002_49_Perspective1_render_illum.hdr | pcompos -x 2 -y 2 - -1305 -1926 | pvalue -h -H -df | total -if3 -m | sed -r 's/[\t]+/1/g'


- - -

pcomb -o /home/lio/MantaRay/Andrei/images/2023_01_18_1002_49_Perspective1_render_illum.hdr | pcompos -x 2 -y 2 - -1299 -1894 | pvalue -h -H -df | total -if3 -m | sed -r 's/[\t]+/1/g'


- - -

pcomb -o /home/lio/MantaRay/Andrei/images/2023_01_18_1002_49_Perspective1_render_illum.hdr | pcompos -x 2 -y 2 - -1627 -2090 | pvalue -h -H -df | total -if3 -m | sed -r 's/[\t]+/1/g'


- - -

pcomb -o /home/lio/MantaRay/Andrei/images/2023_01_18_1002_49_Perspective1_render_illum.hdr | pcompos -x 2 -y 2 - -1619 -2060 | pvalue -h -H -df | total -if3 -m | sed -r 's/[\t]+/1/g'


- - -

pcomb -o /home/lio/MantaRay/Andrei/images/2023_01_18_1002_49_Perspective1_render_illum.hdr | pcompos -x 2 -y 2 - -1614 -2032 | pvalue -h -H -df | total -if3 -m | sed -r 's/[\t]+/1/g'


- - -

pcomb -o /home/lio/MantaRay/Andrei/images/2023_01_18_1002_49_Perspective1_render_illum.hdr | pcompos -x 2 -y 2 - -1608 -2000 | pvalue -h -H -df | total -if3 -m | sed -r 's/[\t]+/1/g'


- - -

pcomb -o /home/lio/MantaRay/Andrei/images/2023_01_18_1002_49_Perspective1_render_illum.hdr | pcompos -x 2 -y 2 - -132 -2479 | pvalue -h -H -df | total -if3 -m | sed -r 's/[\t]+/1/g'""",
    fireLogs=False,
    lastRunTime=1755,
    suppressWarnings=False,
    results=["24.125124.125124.125", "21.5625121.5625121.5625", "17.875117.875117.875", "14.953125114.953125114.953125", "54.625154.625154.625", "23123123", "19.625119.625119.625", "16.5116.5116.5", "24.7578125124.7578125124.7578125", "55.625155.625155.625", "21.15625121.15625121.15625", "20.1875120.1875120.1875", "19119119", "17.59375117.59375117.59375", "55.625155.625155.625"],
    commands=["pcomb -o /home/mss/MantaRay/UnnamedProject/images/2022_09_28_1341_29_Perspective1_render_illum.hdr | pcompos -x 2 -y 2 - -811 -470 | pvalue -h -H -df | total -if3 -m | sed -r 's/[\t]+/1/g'", "pcomb -o /home/mss/MantaRay/UnnamedProject/images/2022_09_28_1341_29_Perspective1_render_illum.hdr | pcompos -x 2 -y 2 - -812 -432 | pvalue -h -H -df | total -if3 -m | sed -r 's/[\t]+/1/g'", "pcomb -o /home/mss/MantaRay/UnnamedProject/images/2022_09_28_1341_29_Perspective1_render_illum.hdr | pcompos -x 2 -y 2 - -1627 -690 | pvalue -h -H -df | total -if3 -m | sed -r 's/[\t]+/1/g'", "pcomb -o /home/mss/MantaRay/UnnamedProject/images/2022_09_28_1341_29_Perspective1_render_illum.hdr | pcompos -x 2 -y 2 - -1308 -594 | pvalue -h -H -df | total -if3 -m | sed -r 's/[\t]+/1/g'", "pcomb -o /home/mss/MantaRay/UnnamedProject/images/2022_09_28_1341_29_Perspective1_render_illum.hdr | pcompos -x 2 -y 2 - -1614 -632 | pvalue -h -H -df | total -if3 -m | sed -r 's/[\t]+/1/g'", "pcomb -o /home/mss/MantaRay/UnnamedProject/images/2022_09_28_1341_29_Perspective1_render_illum.hdr | pcompos -x 2 -y 2 - -132 -1079 | pvalue -h -H -df | total -if3 -m | sed -r 's/[\t]+/1/g'", "pcomb -o /home/mss/MantaRay/UnnamedProject/images/2022_09_28_1341_29_Perspective1_render_illum.hdr | pcompos -x 2 -y 2 - -1305 -553 | pvalue -h -H -df | total -if3 -m | sed -r 's/[\t]+/1/g'", "pcomb -o /home/mss/MantaRay/UnnamedProject/images/2022_09_28_1341_29_Perspective1_render_illum.hdr | pcompos -x 2 -y 2 - -816 -347 | pvalue -h -H -df | total -if3 -m | sed -r 's/[\t]+/1/g'", "pcomb -o /home/mss/MantaRay/UnnamedProject/images/2022_09_28_1341_29_Perspective1_render_illum.hdr | pcompos -x 2 -y 2 - -1305 -526 | pvalue -h -H -df | total -if3 -m | sed -r 's/[\t]+/1/g'", "pcomb -o /home/mss/MantaRay/UnnamedProject/images/2022_09_28_1341_29_Perspective1_render_illum.hdr | pcompos -x 2 -y 2 - -816 -302 | pvalue -h -H -df | total -if3 -m | sed -r 's/[\t]+/1/g'"])  # -> Stdout, Stderr_, Ran
python_13 = GhPythonScript(val=executessh_33.Stdout)  # -> x, y, z, ln
# ---------- python_13: Python ----------
__author__ = "mm1013"
__version__ = "2022.09.28"

import rhinoscriptsyntax as rs

length = int(len(val)/3.0)
x = val[0:length]
y = val[length:2*length]
z = val[2*length:3*length]
ln = length
# ---------- end python_13 ----------
panel_70 = Panel(executessh_33.Stdout)

# ----
# Remote Connect
# export PATH=$PATH:/usr/local/radiance/bin:/usr/local/accelerad/bin;export RAYPATH=.:/usr/local/accelerad/lib:/usr/local/radiance/lib;export DISPLAY=$(ip route list default | awk '{print $3}'):0;export LIBGL_ALWAYS_INDIRECT=1;export LD_LIBRARY_PATH=/usr/local/accelerad/bin:$LD_LIBRARY_PATH
# Be sure to check the above profile files if your EXPORT PATH=radiance stuff is included
panel_71 = Panel(". /etc/profile;. ~/.profile")

connect_2 = ConnectSSHFTP(
    User="lio",
    Ip="10.71.5.181",
    ProjectName="Andrei",
    Password="_prompt",
    _port="2222",
    Connect=Toggle(True),
    Prefixes=panel_71)  # -> Status, Prefixes, Run

panel_72 = Panel(connect_2.Status)

# ----
# Overview of all running tasks in linux
panel_73 = Panel("ps -aux | grep '<AllRadProgs>'")
logviewer_2 = LogViewer(Number=10)  # -> CurrentTasks, Logs
default = DefaultMSS(data=flatten(panel_73), default_value_flattened=flatten(logviewer_2.CurrentTasks))
panel_74 = Panel(logviewer_2.Logs)

executessh_34 = ExecuteSSH(
    _SSHCommands_=default,
    Run=Toggle(True),
    addPrefix=True,
    fireLogs=False,
    lastRunTime=62.9668,
    suppressWarnings=False,
    results="""root           6  0.0  0.0      0     0 ?        I<   Mar03   0:00 [kworker/0:0H-events_highpri]
root          26  0.0  0.0      0     0 ?        I<   Mar03   0:00 [kworker/2:0H-events_highpri]
root          32  0.0  0.0      0     0 ?        I<   Mar03   0:00 [kworker/3:0H-events_highpri]
root          38  0.0  0.0      0     0 ?        I<   Mar03   0:00 [kworker/4:0H-events_highpri]
root          50  0.0  0.0      0     0 ?        I<   Mar03   0:00 [kworker/6:0H-events_highpri]
root          62  0.0  0.0      0     0 ?        I<   Mar03   0:00 [kworker/8:0H-events_highpri]
root          74  0.0  0.0      0     0 ?        I<   Mar03   0:00 [kworker/10:0H-events_highpri]
root          79  0.0  0.0      0     0 ?        I    Mar03   0:00 [kworker/11:0-events]
root          80  0.0  0.0      0     0 ?        I<   Mar03   0:00 [kworker/11:0H-events_highpri]
root          92  0.0  0.0      0     0 ?        I<   Mar03   0:00 [kworker/13:0H-events_highpri]
root         104  0.0  0.0      0     0 ?        I<   Mar03   0:00 [kworker/15:0H-events_highpri]
root         110  0.0  0.0      0     0 ?        I<   Mar03   0:00 [kworker/16:0H-events_highpri]
root         140  0.0  0.0      0     0 ?        I<   Mar03   0:00 [kworker/21:0H-events_highpri]
root         164  0.0  0.0      0     0 ?        I<   Mar03   0:00 [kworker/25:0H-events_highpri]
root         188  0.0  0.0      0     0 ?        I<   Mar03   0:00 [kworker/29:0H-events_highpri]
root         194  0.0  0.0      0     0 ?        I<   Mar03   0:00 [kworker/30:0H-events_highpri]
root         200  0.0  0.0      0     0 ?        I<   Mar03   0:00 [kworker/31:0H-events_highpri]
root         218  0.0  0.0      0     0 ?        I<   Mar03   0:00 [kworker/34:0H-events_highpri]
root         224  0.0  0.0      0     0 ?        I<   Mar03   0:00 [kworker/35:0H-events_highpri]
root         230  0.0  0.0      0     0 ?        I<   Mar03   0:00 [kworker/36:0H-events_highpri]
root         242  0.0  0.0      0     0 ?        I<   Mar03   0:00 [kworker/38:0H-events_highpri]
root         248  0.0  0.0      0     0 ?        I<   Mar03   0:00 [kworker/39:0H-events_highpri]
root         254  0.0  0.0      0     0 ?        I<   Mar03   0:00 [kworker/40:0H-events_highpri]
root         266  0.0  0.0      0     0 ?        I<   Mar03   0:00 [kworker/42:0H-events_highpri]
root         272  0.0  0.0      0     0 ?        I<   Mar03   0:00 [kworker/43:0H-events_highpri]
root         284  0.0  0.0      0     0 ?        I<   Mar03   0:00 [kworker/45:0H-events_highpri]
root         290  0.0  0.0      0     0 ?        I<   Mar03   0:00 [kworker/46:0H-events_highpri]
root         296  0.0  0.0      0     0 ?        I<   Mar03   0:00 [kworker/47:0H-events_highpri]
root         302  0.0  0.0      0     0 ?        I<   Mar03   0:00 [kworker/48:0H-events_highpri]
root         308  0.0  0.0      0     0 ?        I<   Mar03   0:00 [kworker/49:0H-events_highpri]
root         314  0.0  0.0      0     0 ?        I<   Mar03   0:00 [kworker/50:0H-events_highpri]
root         320  0.0  0.0      0     0 ?        I<   Mar03   0:00 [kworker/51:0H-events_highpri]
root         344  0.0  0.0      0     0 ?        I<   Mar03   0:00 [kworker/55:0H-events_highpri]
root         350  0.0  0.0      0     0 ?        I<   Mar03   0:00 [kworker/56:0H-events_highpri]
root         362  0.0  0.0      0     0 ?        I<   Mar03   0:00 [kworker/58:0H-events_highpri]
root         392  0.0  0.0      0     0 ?        I<   Mar03   0:00 [kworker/63:0H-events_highpri]
root         393  0.0  0.0      0     0 ?        S    Mar03   0:00 [kdevtmpfs]
root         458  0.0  0.0      0     0 ?        I<   Mar03   0:00 [tpm_dev_wq]
root         462  0.0  0.0      0     0 ?        I<   Mar03   0:00 [devfreq_wq]
root         620  0.0  0.0      0     0 ?        I    Mar03   0:00 [kworker/19:1-events]
root        1162  0.0  0.0      0     0 ?        I    Mar03   0:00 [kworker/17:2-events]
root        1361  0.0  0.1 107920  8744 ?        Ssl  Mar03   0:00 /usr/bin/python3 /usr/share/unattended-upgrades/unattended-upgrade-shutdown --wait-for-signal
root       27020  0.0  0.0      0     0 ?        I    Mar03   0:00 [kworker/3:2-events]
root       27102  0.0  0.0      0     0 ?        I    Mar03   0:00 [kworker/7:0-events]
root       52256  0.0  0.0      0     0 ?        I    Mar04   0:00 [kworker/61:0-events]
root       55313  0.0  0.0      0     0 ?        I    Mar05   0:00 [kworker/6:2-events]
root       55972  0.0  0.0      0     0 ?        I    Mar05   0:00 [kworker/53:0-events]
root       57517  0.0  0.0      0     0 ?        I    Mar06   0:04 [kworker/52:3-events]
root       58586  0.0  0.0      0     0 ?        I    Mar06   0:00 [kworker/5:1-events]
root       62795  0.0  0.0      0     0 ?        I    Mar08   0:00 [kworker/38:0-events]
root       63203  0.0  0.0      0     0 ?        I    Mar08   0:00 [kworker/47:0-events]
root       63211  0.0  0.0      0     0 ?        I    Mar08   0:00 [kworker/18:2-events]
root       64307  0.0  0.0  22628  4932 ?        Ss   Mar08   0:01 /lib/systemd/systemd-udevd
root       77179  0.0  0.0      0     0 ?        I    Mar09   0:04 [kworker/28:1-events]
root       78850  0.0  0.0      0     0 ?        I    Mar10   0:00 [kworker/4:0-events]
root       80208  0.0  0.0      0     0 ?        I    Mar11   0:00 [kworker/62:2-events]
root       80863  0.0  0.0      0     0 ?        I    Mar11   0:00 [kworker/8:2-events]
root       82442  0.0  0.0      0     0 ?        I    Mar11   0:01 [kworker/28:2-events]
root       82652  0.0  0.0      0     0 ?        I    00:00   0:00 [kworker/39:1-events]
root       82668  0.0  0.0      0     0 ?        I    00:00   0:00 [kworker/45:0-events]
root       82669  0.0  0.0      0     0 ?        I    00:00   0:00 [kworker/42:1-events]
root       83460  0.0  0.0      0     0 ?        I    05:53   0:00 [kworker/10:2-events]
root       83879  0.0  0.0      0     0 ?        I    11:14   0:00 [kworker/34:1-events]
root       83988  0.0  0.0      0     0 ?        I    13:09   0:00 [kworker/14:1-events]
root       84382  0.0  0.0      0     0 ?        I    19:22   0:00 [kworker/20:0-events]
root       87922  0.0  0.0      0     0 ?        I    21:22   0:00 [kworker/u128:2-events_power_efficient]
root       87982  0.0  0.0      0     0 ?        I    21:26   0:00 [kworker/4:3-events]
root       87985  0.0  0.0      0     0 ?        I    21:28   0:00 [kworker/u128:0-events_power_efficient]
root       88351  0.0  0.0      0     0 ?        I    21:34   0:00 [kworker/u128:1-events_power_efficient]
lio        88381  0.0  0.0   7024  3500 ?        Ss   21:35   0:00 bash -c . /etc/profile;. ~/.profile;mkdir -p ~/MantaRay/Andrei/images/ rm -r ~/MantaRay/Andrei/images/2023_03_12_2232_rtpict_rendering_aa0_5000_sunny_ad32_0 rtpict -n 63 -w -ov ~/MantaRay/Andrei/images/2023_03_12_2232_rtpict_rendering_aa0_5000_sunny_ad32_0 -vf /home/lio/MantaRay/Andrei/views/Perspective3.vf -x 20000 -y 10000 -ab 3 -ad 8 -aa 0 /home/lio/MantaRay/Andrei/octrees/Scene_Overcast10klux.oct;echo ~/MantaRay/Andrei/images/2023_03_12_2232_rtpict_rendering_aa0_5000_sunny_ad32_0
lio        88387  0.0  0.0   2616   604 ?        S    21:35   0:00 sh -c vwrays -pj .67 -vf /home/lio/MantaRay/Andrei/views/Perspective3.vf -x 20000 -y 10000 -ff | rtrace -u- -dt .05 -dc .5 -ds .25 -dr 1 -aa .2 -ar 64 -ad 512 -as 128 -lr 7 -lw 1e-03 -w -ov -ab 3 -ad 8 -aa 0 -n 63 -fff -x 20000 -y 7357 '/home/lio/MantaRay/Andrei/octrees/Scene_Overcast10klux.oct' | getinfo -a 'VIEW= -vtv -vp 76.211 16.4301 1.83585 -vd -0.349681 0.927361 0.133136 -vu 0.0469732 -0.124574 0.991098 -vh 103.466 -vv 50 -vo 0 -va 0 -vs 0 -vl 0' | rsplit '-t?' -ih -iH -oh -oH -of3 '!pvalue -r -df -u > "/home/lio/MantaRay/Andrei/images/2023_03_12_2232_rtpict_rendering_aa0_5000_sunny_ad32_0/radiance.hdr"'
lio        88390  0.0  0.0   3888  1060 ?        S    21:35   0:00 vwrays -pj .67 -vf /home/lio/MantaRay/Andrei/views/Perspective3.vf -x 20000 -y 10000 -ff
lio        88391 16.0  0.3  31688 28568 ?        S    21:35   0:00 rtrace -u- -dt .05 -dc .5 -ds .25 -dr 1 -aa .2 -ar 64 -ad 512 -as 128 -lr 7 -lw 1e-03 -w -ov -ab 3 -ad 8 -aa 0 -n 63 -fff -x 20000 -y 7357 /home/lio/MantaRay/Andrei/octrees/Scene_Overcast10klux.oct
lio        88392  0.0  0.0   2504   724 ?        S    21:35   0:00 getinfo -a VIEW= -vtv -vp 76.211 16.4301 1.83585 -vd -0.349681 0.927361 0.133136 -vu 0.0469732 -0.124574 0.991098 -vh 103.466 -vv 50 -vo 0 -va 0 -vs 0 -vl 0
lio        88393  0.0  0.0   3884  1736 ?        S    21:35   0:00 rsplit -t? -ih -iH -oh -oH -of3 !pvalue -r -df -u > "/home/lio/MantaRay/Andrei/images/2023_03_12_2232_rtpict_rendering_aa0_5000_sunny_ad32_0/radiance.hdr"
lio        88394  0.0  0.0   2616   600 ?        S    21:35   0:00 sh -c pvalue -r -df -u > "/home/lio/MantaRay/Andrei/images/2023_03_12_2232_rtpict_rendering_aa0_5000_sunny_ad32_0/radiance.hdr"
lio        88395  0.0  0.0   4148  1028 ?        S    21:35   0:00 pvalue -r -df -u
lio        88396 13.0  0.3  31340 27068 ?        R    21:35   0:00 rtrace -u- -dt .05 -dc .5 -ds .25 -dr 1 -aa .2 -ar 64 -ad 512 -as 128 -lr 7 -lw 1e-03 -w -ov -ab 3 -ad 8 -aa 0 -n 63 -fff -x 20000 -y 7357 /home/lio/MantaRay/Andrei/octrees/Scene_Overcast10klux.oct
lio        88397 13.0  0.3  31340 27068 ?        R    21:35   0:00 rtrace -u- -dt .05 -dc .5 -ds .25 -dr 1 -aa .2 -ar 64 -ad 512 -as 128 -lr 7 -lw 1e-03 -w -ov -ab 3 -ad 8 -aa 0 -n 63 -fff -x 20000 -y 7357 /home/lio/MantaRay/Andrei/octrees/Scene_Overcast10klux.oct
lio        88398 13.0  0.3  31340 27068 ?        R    21:35   0:00 rtrace -u- -dt .05 -dc .5 -ds .25 -dr 1 -aa .2 -ar 64 -ad 512 -as 128 -lr 7 -lw 1e-03 -w -ov -ab 3 -ad 8 -aa 0 -n 63 -fff -x 20000 -y 7357 /home/lio/MantaRay/Andrei/octrees/Scene_Overcast10klux.oct
lio        88399 13.0  0.2  31340 25468 ?        R    21:35   0:00 rtrace -u- -dt .05 -dc .5 -ds .25 -dr 1 -aa .2 -ar 64 -ad 512 -as 128 -lr 7 -lw 1e-03 -w -ov -ab 3 -ad 8 -aa 0 -n 63 -fff -x 20000 -y 7357 /home/lio/MantaRay/Andrei/octrees/Scene_Overcast10klux.oct
lio        88400 13.0  0.2  31340 25468 ?        R    21:35   0:00 rtrace -u- -dt .05 -dc .5 -ds .25 -dr 1 -aa .2 -ar 64 -ad 512 -as 128 -lr 7 -lw 1e-03 -w -ov -ab 3 -ad 8 -aa 0 -n 63 -fff -x 20000 -y 7357 /home/lio/MantaRay/Andrei/octrees/Scene_Overcast10klux.oct
lio        88401 13.0  0.2  31344 25468 ?        R    21:35   0:00 rtrace -u- -dt .05 -dc .5 -ds .25 -dr 1 -aa .2 -ar 64 -ad 512 -as 128 -lr 7 -lw 1e-03 -w -ov -ab 3 -ad 8 -aa 0 -n 63 -fff -x 20000 -y 7357 /home/lio/MantaRay/Andrei/octrees/Scene_Overcast10klux.oct
lio        88402 13.0  0.2  31340 25468 ?        R    21:35   0:00 rtrace -u- -dt .05 -dc .5 -ds .25 -dr 1 -aa .2 -ar 64 -ad 512 -as 128 -lr 7 -lw 1e-03 -w -ov -ab 3 -ad 8 -aa 0 -n 63 -fff -x 20000 -y 7357 /home/lio/MantaRay/Andrei/octrees/Scene_Overcast10klux.oct
lio        88403 13.0  0.3  31340 27068 ?        R    21:35   0:00 rtrace -u- -dt .05 -dc .5 -ds .25 -dr 1 -aa .2 -ar 64 -ad 512 -as 128 -lr 7 -lw 1e-03 -w -ov -ab 3 -ad 8 -aa 0 -n 63 -fff -x 20000 -y 7357 /home/lio/MantaRay/Andrei/octrees/Scene_Overcast10klux.oct
lio        88404 13.0  0.2  31340 25468 ?        R    21:35   0:00 rtrace -u- -dt .05 -dc .5 -ds .25 -dr 1 -aa .2 -ar 64 -ad 512 -as 128 -lr 7 -lw 1e-03 -w -ov -ab 3 -ad 8 -aa 0 -n 63 -fff -x 20000 -y 7357 /home/lio/MantaRay/Andrei/octrees/Scene_Overcast10klux.oct
lio        88405 13.0  0.3  31340 27068 ?        R    21:35   0:00 rtrace -u- -dt .05 -dc .5 -ds .25 -dr 1 -aa .2 -ar 64 -ad 512 -as 128 -lr 7 -lw 1e-03 -w -ov -ab 3 -ad 8 -aa 0 -n 63 -fff -x 20000 -y 7357 /home/lio/MantaRay/Andrei/octrees/Scene_Overcast10klux.oct
lio        88406 13.0  0.2  31340 25468 ?        R    21:35   0:00 rtrace -u- -dt .05 -dc .5 -ds .25 -dr 1 -aa .2 -ar 64 -ad 512 -as 128 -lr 7 -lw 1e-03 -w -ov -ab 3 -ad 8 -aa 0 -n 63 -fff -x 20000 -y 7357 /home/lio/MantaRay/Andrei/octrees/Scene_Overcast10klux.oct
lio        88407 13.0  0.2  31340 25472 ?        R    21:35   0:00 rtrace -u- -dt .05 -dc .5 -ds .25 -dr 1 -aa .2 -ar 64 -ad 512 -as 128 -lr 7 -lw 1e-03 -w -ov -ab 3 -ad 8 -aa 0 -n 63 -fff -x 20000 -y 7357 /home/lio/MantaRay/Andrei/octrees/Scene_Overcast10klux.oct
lio        88408 13.0  0.2  31340 25472 ?        R    21:35   0:00 rtrace -u- -dt .05 -dc .5 -ds .25 -dr 1 -aa .2 -ar 64 -ad 512 -as 128 -lr 7 -lw 1e-03 -w -ov -ab 3 -ad 8 -aa 0 -n 63 -fff -x 20000 -y 7357 /home/lio/MantaRay/Andrei/octrees/Scene_Overcast10klux.oct
lio        88409 13.0  0.3  31340 27072 ?        R    21:35   0:00 rtrace -u- -dt .05 -dc .5 -ds .25 -dr 1 -aa .2 -ar 64 -ad 512 -as 128 -lr 7 -lw 1e-03 -w -ov -ab 3 -ad 8 -aa 0 -n 63 -fff -x 20000 -y 7357 /home/lio/MantaRay/Andrei/octrees/Scene_Overcast10klux.oct
lio        88410 13.0  0.2  31340 25472 ?        R    21:35   0:00 rtrace -u- -dt .05 -dc .5 -ds .25 -dr 1 -aa .2 -ar 64 -ad 512 -as 128 -lr 7 -lw 1e-03 -w -ov -ab 3 -ad 8 -aa 0 -n 63 -fff -x 20000 -y 7357 /home/lio/MantaRay/Andrei/octrees/Scene_Overcast10klux.oct
lio        88411 13.0  0.2  31340 25472 ?        R    21:35   0:00 rtrace -u- -dt .05 -dc .5 -ds .25 -dr 1 -aa .2 -ar 64 -ad 512 -as 128 -lr 7 -lw 1e-03 -w -ov -ab 3 -ad 8 -aa 0 -n 63 -fff -x 20000 -y 7357 /home/lio/MantaRay/Andrei/octrees/Scene_Overcast10klux.oct
lio        88412 13.0  0.3  31340 27072 ?        R    21:35   0:00 rtrace -u- -dt .05 -dc .5 -ds .25 -dr 1 -aa .2 -ar 64 -ad 512 -as 128 -lr 7 -lw 1e-03 -w -ov -ab 3 -ad 8 -aa 0 -n 63 -fff -x 20000 -y 7357 /home/lio/MantaRay/Andrei/octrees/Scene_Overcast10klux.oct
lio        88413 13.0  0.3  31340 27072 ?        R    21:35   0:00 rtrace -u- -dt .05 -dc .5 -ds .25 -dr 1 -aa .2 -ar 64 -ad 512 -as 128 -lr 7 -lw 1e-03 -w -ov -ab 3 -ad 8 -aa 0 -n 63 -fff -x 20000 -y 7357 /home/lio/MantaRay/Andrei/octrees/Scene_Overcast10klux.oct
lio        88414 13.0  0.3  31344 27088 ?        R    21:35   0:00 rtrace -u- -dt .05 -dc .5 -ds .25 -dr 1 -aa .2 -ar 64 -ad 512 -as 128 -lr 7 -lw 1e-03 -w -ov -ab 3 -ad 8 -aa 0 -n 63 -fff -x 20000 -y 7357 /home/lio/MantaRay/Andrei/octrees/Scene_Overcast10klux.oct
lio        88415 13.0  0.2  31340 25472 ?        R    21:35   0:00 rtrace -u- -dt .05 -dc .5 -ds .25 -dr 1 -aa .2 -ar 64 -ad 512 -as 128 -lr 7 -lw 1e-03 -w -ov -ab 3 -ad 8 -aa 0 -n 63 -fff -x 20000 -y 7357 /home/lio/MantaRay/Andrei/octrees/Scene_Overcast10klux.oct
lio        88416 13.0  0.3  31344 27072 ?        R    21:35   0:00 rtrace -u- -dt .05 -dc .5 -ds .25 -dr 1 -aa .2 -ar 64 -ad 512 -as 128 -lr 7 -lw 1e-03 -w -ov -ab 3 -ad 8 -aa 0 -n 63 -fff -x 20000 -y 7357 /home/lio/MantaRay/Andrei/octrees/Scene_Overcast10klux.oct
lio        88417 13.0  0.3  31344 27076 ?        R    21:35   0:00 rtrace -u- -dt .05 -dc .5 -ds .25 -dr 1 -aa .2 -ar 64 -ad 512 -as 128 -lr 7 -lw 1e-03 -w -ov -ab 3 -ad 8 -aa 0 -n 63 -fff -x 20000 -y 7357 /home/lio/MantaRay/Andrei/octrees/Scene_Overcast10klux.oct
lio        88418 13.0  0.3  31344 27088 ?        R    21:35   0:00 rtrace -u- -dt .05 -dc .5 -ds .25 -dr 1 -aa .2 -ar 64 -ad 512 -as 128 -lr 7 -lw 1e-03 -w -ov -ab 3 -ad 8 -aa 0 -n 63 -fff -x 20000 -y 7357 /home/lio/MantaRay/Andrei/octrees/Scene_Overcast10klux.oct
lio        88419 13.0  0.2  31340 25472 ?        R    21:35   0:00 rtrace -u- -dt .05 -dc .5 -ds .25 -dr 1 -aa .2 -ar 64 -ad 512 -as 128 -lr 7 -lw 1e-03 -w -ov -ab 3 -ad 8 -aa 0 -n 63 -fff -x 20000 -y 7357 /home/lio/MantaRay/Andrei/octrees/Scene_Overcast10klux.oct
lio        88420 13.0  0.2  31340 25472 ?        R    21:35   0:00 rtrace -u- -dt .05 -dc .5 -ds .25 -dr 1 -aa .2 -ar 64 -ad 512 -as 128 -lr 7 -lw 1e-03 -w -ov -ab 3 -ad 8 -aa 0 -n 63 -fff -x 20000 -y 7357 /home/lio/MantaRay/Andrei/octrees/Scene_Overcast10klux.oct
lio        88421 13.0  0.2  31340 25472 ?        R    21:35   0:00 rtrace -u- -dt .05 -dc .5 -ds .25 -dr 1 -aa .2 -ar 64 -ad 512 -as 128 -lr 7 -lw 1e-03 -w -ov -ab 3 -ad 8 -aa 0 -n 63 -fff -x 20000 -y 7357 /home/lio/MantaRay/Andrei/octrees/Scene_Overcast10klux.oct
lio        88422 13.0  0.2  31340 25472 ?        R    21:35   0:00 rtrace -u- -dt .05 -dc .5 -ds .25 -dr 1 -aa .2 -ar 64 -ad 512 -as 128 -lr 7 -lw 1e-03 -w -ov -ab 3 -ad 8 -aa 0 -n 63 -fff -x 20000 -y 7357 /home/lio/MantaRay/Andrei/octrees/Scene_Overcast10klux.oct
lio        88423 13.0  0.2  31340 25472 ?        R    21:35   0:00 rtrace -u- -dt .05 -dc .5 -ds .25 -dr 1 -aa .2 -ar 64 -ad 512 -as 128 -lr 7 -lw 1e-03 -w -ov -ab 3 -ad 8 -aa 0 -n 63 -fff -x 20000 -y 7357 /home/lio/MantaRay/Andrei/octrees/Scene_Overcast10klux.oct
lio        88424 13.0  0.3  31340 27072 ?        R    21:35   0:00 rtrace -u- -dt .05 -dc .5 -ds .25 -dr 1 -aa .2 -ar 64 -ad 512 -as 128 -lr 7 -lw 1e-03 -w -ov -ab 3 -ad 8 -aa 0 -n 63 -fff -x 20000 -y 7357 /home/lio/MantaRay/Andrei/octrees/Scene_Overcast10klux.oct
lio        88425 13.0  0.2  31340 25472 ?        R    21:35   0:00 rtrace -u- -dt .05 -dc .5 -ds .25 -dr 1 -aa .2 -ar 64 -ad 512 -as 128 -lr 7 -lw 1e-03 -w -ov -ab 3 -ad 8 -aa 0 -n 63 -fff -x 20000 -y 7357 /home/lio/MantaRay/Andrei/octrees/Scene_Overcast10klux.oct
lio        88426 13.0  0.2  31340 25472 ?        R    21:35   0:00 rtrace -u- -dt .05 -dc .5 -ds .25 -dr 1 -aa .2 -ar 64 -ad 512 -as 128 -lr 7 -lw 1e-03 -w -ov -ab 3 -ad 8 -aa 0 -n 63 -fff -x 20000 -y 7357 /home/lio/MantaRay/Andrei/octrees/Scene_Overcast10klux.oct
lio        88427 13.0  0.2  31344 25476 ?        R    21:35   0:00 rtrace -u- -dt .05 -dc .5 -ds .25 -dr 1 -aa .2 -ar 64 -ad 512 -as 128 -lr 7 -lw 1e-03 -w -ov -ab 3 -ad 8 -aa 0 -n 63 -fff -x 20000 -y 7357 /home/lio/MantaRay/Andrei/octrees/Scene_Overcast10klux.oct
lio        88428 13.0  0.2  31340 25476 ?        R    21:35   0:00 rtrace -u- -dt .05 -dc .5 -ds .25 -dr 1 -aa .2 -ar 64 -ad 512 -as 128 -lr 7 -lw 1e-03 -w -ov -ab 3 -ad 8 -aa 0 -n 63 -fff -x 20000 -y 7357 /home/lio/MantaRay/Andrei/octrees/Scene_Overcast10klux.oct
lio        88429 13.0  0.3  31340 27068 ?        R    21:35   0:00 rtrace -u- -dt .05 -dc .5 -ds .25 -dr 1 -aa .2 -ar 64 -ad 512 -as 128 -lr 7 -lw 1e-03 -w -ov -ab 3 -ad 8 -aa 0 -n 63 -fff -x 20000 -y 7357 /home/lio/MantaRay/Andrei/octrees/Scene_Overcast10klux.oct
lio        88430 13.0  0.2  31340 25476 ?        R    21:35   0:00 rtrace -u- -dt .05 -dc .5 -ds .25 -dr 1 -aa .2 -ar 64 -ad 512 -as 128 -lr 7 -lw 1e-03 -w -ov -ab 3 -ad 8 -aa 0 -n 63 -fff -x 20000 -y 7357 /home/lio/MantaRay/Andrei/octrees/Scene_Overcast10klux.oct
lio        88431 13.0  0.3  31340 27076 ?        R    21:35   0:00 rtrace -u- -dt .05 -dc .5 -ds .25 -dr 1 -aa .2 -ar 64 -ad 512 -as 128 -lr 7 -lw 1e-03 -w -ov -ab 3 -ad 8 -aa 0 -n 63 -fff -x 20000 -y 7357 /home/lio/MantaRay/Andrei/octrees/Scene_Overcast10klux.oct
lio        88432 13.0  0.2  31340 25476 ?        R    21:35   0:00 rtrace -u- -dt .05 -dc .5 -ds .25 -dr 1 -aa .2 -ar 64 -ad 512 -as 128 -lr 7 -lw 1e-03 -w -ov -ab 3 -ad 8 -aa 0 -n 63 -fff -x 20000 -y 7357 /home/lio/MantaRay/Andrei/octrees/Scene_Overcast10klux.oct
lio        88433 13.0  0.3  31340 27076 ?        R    21:35   0:00 rtrace -u- -dt .05 -dc .5 -ds .25 -dr 1 -aa .2 -ar 64 -ad 512 -as 128 -lr 7 -lw 1e-03 -w -ov -ab 3 -ad 8 -aa 0 -n 63 -fff -x 20000 -y 7357 /home/lio/MantaRay/Andrei/octrees/Scene_Overcast10klux.oct
lio        88434 13.0  0.2  31340 25476 ?        R    21:35   0:00 rtrace -u- -dt .05 -dc .5 -ds .25 -dr 1 -aa .2 -ar 64 -ad 512 -as 128 -lr 7 -lw 1e-03 -w -ov -ab 3 -ad 8 -aa 0 -n 63 -fff -x 20000 -y 7357 /home/lio/MantaRay/Andrei/octrees/Scene_Overcast10klux.oct
lio        88435 13.0  0.3  31340 26996 ?        R    21:35   0:00 rtrace -u- -dt .05 -dc .5 -ds .25 -dr 1 -aa .2 -ar 64 -ad 512 -as 128 -lr 7 -lw 1e-03 -w -ov -ab 3 -ad 8 -aa 0 -n 63 -fff -x 20000 -y 7357 /home/lio/MantaRay/Andrei/octrees/Scene_Overcast10klux.oct
lio        88436 13.0  0.3  31340 27076 ?        R    21:35   0:00 rtrace -u- -dt .05 -dc .5 -ds .25 -dr 1 -aa .2 -ar 64 -ad 512 -as 128 -lr 7 -lw 1e-03 -w -ov -ab 3 -ad 8 -aa 0 -n 63 -fff -x 20000 -y 7357 /home/lio/MantaRay/Andrei/octrees/Scene_Overcast10klux.oct
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""",
    commands="ps -aux | grep 'arch2rad\|bgraph\|bsdf2klems\|bsdf2rad\|bsdf2ttree\|bsdfview\|cnt\|compamb\|cv\|dayfact\|dcglare\|dctimestep\|dgraph\|epw2wea\|ev\|fieldcomb\|findglare\|gcomp\|genBSDF\|genblinds\|genbox\|genclock\|gendaymtx\|genklemsamp\|genprism\|genrev\|gensky\|genskyvec\|gensurf\|genworm\|getbbox\|getinfo\|glare\|glarendx\|glrad\|histo\|icalc\|igraph\|lampcolor\|libmeta.a\|lookamb\|macbethcal\|meta\|meta2bmp\|meta2tga\|metafile\|mgf2meta\|mgf2rad\|mkillum\|mkpmap\|mksource\|neaten\|normpat\|normtiff\|obj2mesh\|obj2rad\|objline\|objview\|oconv\|pabopto2bsdf\|pabopto2xyz\|pcomb\|pcompos\|pcond\|pdfblur\|pexpand\|pextrem\|pfilt\|pflip\|phisto\|pinterp\|pkgBSDF\|plotin\|pmapdump\|pmblur\|pmblur2\|pmdblur\|protate\|psign\|psketch\|psmeta\|psort\|pvalue\|ra_bmp\|ra_gif\|ra_pict\|ra_ppm\|ra_ps\|ra_rgbe\|ra_t16\|ra_t8\|ra_tiff\|ra_xyze\|rad\|rad2mgf\|raddepend\|ran2tiff\|ranimate\|ranimove\|rcalc\|rcode2bmp\|rcode_depth\|rcode_ident\|rcode_norm\|rcollate\|rcontrib\|rcrop\|replmarks\|rfluxmtx\|rhcopy\|rhinfo\|rholo\|rhoptimize\|rhpict\|rlam\|rmtxop\|robjutil\|rpict\|rpiece\|rsensor\|rsplit\|rtpict\|rtrace\|rvu\|tabfunc\|tmesh2rad\|total\|trad\|ttyimage\|vwrays\|vwright\|wrapBSDF\|x11meta\|xform\|xglaresrc\|ximage\|xshowtrace\|falsecolor'")  # -> Stdout, Stderr_, Ran

python_14 = GhPythonScript(x=executessh_34.Stdout)  # -> a
# ---------- python_14: Python ----------
__author__ = "mm1013"
__version__ = "2022.08.30"

import rhinoscriptsyntax as rs

a = [l for l in x.split("\n") if "grep" not in l]
# ---------- end python_14 ----------
panel_75 = Panel(python_14)

panel_76 = Panel("""mkdir -p <proj>/views/
echo "<vf>" > <proj>/views/<target>.vf
echo <proj>/views/<target>.vf""")
concat_5 = Concatenate(FragmentA="Perspective", FragmentB="1")

# ----
# Doubleclick Me To update view
view_3 = CreateView(Viewport="Perspective")  # -> ViewfileContent, ImageRatio

panel_77 = Panel(view_3.ViewfileContent)
vf_3 = Text(view_3.ViewfileContent)
overrides_36 = ApplyOverrides(Input=panel_76, Vf=graft(vf_3), Target=graft(concat_5))  # -> Output, DynamicOutput
executessh_35 = ExecuteSSH(
    _SSHCommands_=overrides_36.DynamicOutput,
    Run=Toggle(True),
    addPrefix=True,
    description="""mkdir -p ~/MantaRay/Andrei/views/
echo "rvu -vtv -vp 76.210958985352 16.4300937305602 1.83584927923156 -vd -0.349680913647465 0.927360836447747 0.133135786524922 -vu 0.0469732080515546 -0.124573895254805 0.991097806649975 -vh 103.466 -vv 50.000" > ~/MantaRay/Andrei/views/Perspective1.vf
echo ~/MantaRay/Andrei/views/Perspective1.vf""",
    fireLogs=False,
    lastRunTime=82.6831,
    suppressWarnings=False,
    results="/home/lio/MantaRay/Andrei/views/Perspective1.vf",
    commands="""mkdir -p ~/MantaRay/Andrei/views/
echo "rvu -vtv -vp 76.210958985352 16.4300937305602 1.83584927923156 -vd -0.349680913647465 0.927360836447747 0.133135786524922 -vu 0.0469732080515546 -0.124573895254805 0.991097806649975 -vh 103.466 -vv 50.000" > ~/MantaRay/Andrei/views/Perspective1.vf
echo ~/MantaRay/Andrei/views/Perspective1.vf""")  # -> Stdout, Stderr_, Ran

# ----
# VIEW
file_exists = Panel("[ -f <out> ] && echo \"1\" || echo \"0\"")
item_3 = ListItem(List=flatten(executessh_35.Stdout), Index=0, Wrap=True)
panel_78 = Panel(executessh_35.Stdout)
overrides_37 = ApplyOverrides(Input=file_exists, Out=graft(item_3))  # -> Output, DynamicOutput
executessh_36 = ExecuteSSH(
    _SSHCommands_=overrides_37.DynamicOutput,
    Run=executessh_17.Ran,
    addPrefix=True,
    description="[ -f /home/lio/MantaRay/Andrei/views/Perspective1.vf ] && echo \"1\" || echo \"0\"",
    fireLogs=False,
    lastRunTime=101.9638,
    suppressWarnings=False,
    results="1",
    commands="[ -f /home/lio/MantaRay/Andrei/views/Perspective1.vf ] && echo \"1\" || echo \"0\"")  # -> Stdout, Stderr_, Ran

# ----
# overture should now automatically be included in rtpict
# Parallel RTPICT render with ambient cache
viewfile_3 = Text(executessh_35.Stdout)
octree_3 = Text(executessh_19.Stdout)
modifierlist = Text(flatten(cluster.name_mod))
octree_overcast_2 = Text(octree_overcast)
entwine_9 = Entwine(Branch00=octree_overcast_2, Branch01=octree_3, FlattenInputs=True)  # -> flatten(Result)
division_2 = Division(A=resolution, B=1.5)
octree_4 = Text(graft(entwine_9))
list_2 = ItemSelector(
    octree_4,
    {"/home/lio/MantaRay/Andrei/octrees/Scene_Overcast10klux.oct", "/home/lio/MantaRay/Andrei/octrees/my_test_scene_0800.oct", "/home/lio/MantaRay/Andrei/octrees/my_test_scene_0900.oct", "/home/lio/MantaRay/Andrei/octrees/my_test_scene_1000.oct", "/home/lio/MantaRay/Andrei/octrees/my_test_scene_1100.oct", "/home/lio/MantaRay/Andrei/octrees/my_test_scene_1200.oct", "/home/lio/MantaRay/Andrei/octrees/my_test_scene_1300.oct", "/home/lio/MantaRay/Andrei/octrees/my_test_scene_1400.oct", "/home/lio/MantaRay/Andrei/octrees/my_test_scene_1500.oct", "/home/lio/MantaRay/Andrei/octrees/my_test_scene_1600.oct", "/home/lio/MantaRay/Andrei/octrees/my_test_scene_1700.oct"}, selected="/home/lio/MantaRay/Andrei/octrees/Scene_Overcast10klux.oct")
y_5 = Number(division_2)
eval = Evaluate(F="x=y", x=octree_4, y=list_2)
panel_79 = Panel("-ab 3 -ad 4096 -lw 0.0003 -aa 0.1 -ar 256 -as 1024")
panel_80 = Panel("""mkdir -p <proj>/images/
rtpict -n <cpus-1> -w -vf <vf> -x 400 -y 300 <radOptions> -af <ambFile> <oct> > /dev/null
rtpict -n <cpus-1> -w -vf <vf> -x <x> -y <y> <radOptions> -af <ambFile> <oct> | pfilt -x /2 -y /2 > <proj>/images/<target>;echo <proj>/images/<target>""")
x_7 = Number(x)
y_6 = Number(y_5)
run_4 = LBFalseStartToggle(False)
python_15 = GhPythonScript()  # -> time; inputs update: tree; same code as python_8

# ----
# exclude frames
panel_81 = Panel("frames")
python_16 = GhPythonScript(opaqueModifiers=modifierlist, search=panel_81)  # -> a; inputs opaqueModifiers: list, search: list
# ---------- python_16: Python ----------
__author__ = "mm1013"
__version__ = "2022.09.05"

import rhinoscriptsyntax as rs
#import Grasshopper.DataTree as dt
import ghpythonlib.treehelpers as th


o = []
for l in search:
    o.append([s for s in opaqueModifiers if l.lower() in s.lower()])
    

a = th.list_to_tree(o)
# ---------- end python_16 ----------
overrides_38 = ApplyOverrides(Input="-ae <modifier>", Modifier=graft(python_16))  # -> Output, DynamicOutput
join_6 = TextJoin(Text=flatten(overrides_38.Output), Join=" ")

hours_4 = Text(hours_2)
entwine_10 = Entwine(Branch00="ovc", Branch01=hours_4, FlattenInputs=True)  # -> flatten(Result)
cull_4 = CullPattern(List=graft(entwine_10), CullPattern=eval)  # -> flatten(List)
hours_5 = Text(cull_4)

merge = Merge(Data1=panel_79, Data2=list_2, Data3=join_6, Data4=Button())  # -> flatten(Result)
python_17 = GhPythonScript(update=merge)  # -> time; inputs update: tree; same code as python_8
overrides_39 = ApplyOverrides(Input="ambfile_<time>.af", Time=graft(python_17))  # -> Output, DynamicOutput
overrides_40 = ApplyOverrides(
    Input=panel_80,
    Vf=graft(viewfile_3),
    RadOptions=graft(panel_79),
    AmbFile=graft(overrides_39.DynamicOutput),
    Oct=graft(list_2),
    X=graft(x_7),
    Y=graft(y_6),
    Target=graft("<time>_rtpict_rendering_aa0.1_<x>_sunny_ad4096_<h>.hdr"),
    Time=graft("<time>"),
    H=graft(hours_5))  # -> Output, DynamicOutput
overrides_41 = ApplyOverrides(Input=overrides_40.DynamicOutput, Time=graft(python_15))  # -> Output, DynamicOutput
executessh_37 = ExecuteSSH(
    _SSHCommands_=overrides_41.DynamicOutput,
    Run=run_4,
    addPrefix=True,
    description="""mkdir -p ~/MantaRay/Andrei/images/
rtpict -n 62 -w -vf /home/lio/MantaRay/Andrei/views/Perspective1.vf -x 400 -y 300 -ab 3 -ad 4096 -lw 0.0003 -aa 0.1 -ar 256 -as 1024 -af ambfile_2023_03_12_2229_40.af

# This is a MantaRay Dictionary
# Globals will be updated in Execute component
# Locals will not!
# This tail is ignored by the Execute component /home/lio/MantaRay/Andrei/octrees/Scene_Overcast10klux.oct > /dev/null
rtpict -n 62 -w -vf /home/lio/MantaRay/Andrei/views/Perspective1.vf -x 5000 -y 3333.333333 -ab 3 -ad 4096 -lw 0.0003 -aa 0.1 -ar 256 -as 1024 -af ambfile_2023_03_12_2229_40.af

# This is a MantaRay Dictionary
# Globals will be updated in Execute component
# Locals will not!
# This tail is ignored by the Execute component /home/lio/MantaRay/Andrei/octrees/Scene_Overcast10klux.oct | pfilt -x /2 -y /2 > ~/MantaRay/Andrei/images/2023_03_12_2229_01_rtpict_rendering_aa0.1_5000_sunny_ad4096_ovc.hdr;echo ~/MantaRay/Andrei/images/2023_03_12_2229_01_rtpict_rendering_aa0.1_5000_sunny_ad4096_ovc.hdr""",
    fireLogs=False,
    lastRunTime=0,
    suppressWarnings=False)  # -> Stdout, Stderr_, Ran
download_8 = Download(LinuxFilePaths=executessh_37.Stdout, Run=executessh_37.Ran)  # -> FilePaths, Status, Ran
imageviewer_6 = LBImageViewer(ImagePath_=download_8.FilePaths, _scale_=2, DisableClickable=False, SaveImgWithCoords=False, scale=2)  # -> ImagePath, Values, GIF

# ----
# Parallel RTPICT render (luminance)
# without ambient cache
supersampling_2 = Panel("4")
viewfile_4 = Text(executessh_20.Stdout)
octree_5 = Text(octree_overcast)
x_8 = RemoteReceiver(x_2)
y_7 = RemoteReceiver(y)
panel_82 = Panel("""mkdir -p <proj>/images/
rm -r <proj>/images/<target>
rtpict -n <cpus> -w -ov <proj>/images/<target> -vf <vf> -x <x> -y <y> <radOptions> <oct>;echo <proj>/images/<target>""")
panel_83 = Panel("<time>_rtpict_rendering_aa0_<x>_sunny_ad32_<h>")
multiplication_3 = Multiplication(A=x_8, B=supersampling_2)
multiplication_4 = Multiplication(A=y_7, B=supersampling_2)
run_5 = LBFalseStartToggle(True)
y_8 = RemoteReceiver(y)
x_9 = RemoteReceiver(x_2)
python_18 = GhPythonScript(update=run_5)  # -> time; inputs update: tree
# ---------- python_18: Python ----------
__author__ = "mm1013"
__version__ = "2022.08.30"

import rhinoscriptsyntax as rs

from datetime import datetime
dt = datetime.now()

time = "%02d_%02d_%02d_%02d%02d" % (dt.year, dt.month, dt.day, dt.hour, dt.minute)
# ---------- end python_18 ----------
hours_6 = Number("0")

# ----
# raw render of material colors
panel_84 = Panel("""rpict -vf <vf> -x <x> -y <y> <radOptions> <oct> |
pfilt -x /<ss> -y /<ss> -1 -r 0.7 > <proj>/images/<target>_colors_filt.hdr
echo <proj>/images/<target>_colors_filt.hdr""")
viewfile_5 = Text(executessh_20.Stdout)
octree_6 = Text(octree_overcast)
supersampling_3 = Panel("4")
y_9 = RemoteReceiver(y)
x_10 = RemoteReceiver(x_2)
multiplication_5 = Multiplication(A=x_10, B=supersampling_3)
multiplication_6 = Multiplication(A=y_9, B=supersampling_3)
overrides_42 = ApplyOverrides(
    Input=panel_84,
    Vf=graft(viewfile_5),
    X=graft(multiplication_5),
    Y=graft(multiplication_6),
    Target=graft(panel_83),
    RadOptions=graft("-ab 0 -ad 1 -aa 1 -w -av 1 1 1"),
    Oct=graft(octree_6),
    Time=graft(python_18),
    H=graft(hours_6),
    Ss=graft(supersampling_3))  # -> Output, DynamicOutput
run_6 = LBFalseStartToggle(False)
panel_85 = Panel(overrides_42.DynamicOutput)
executessh_38 = ExecuteSSH(
    _SSHCommands=overrides_42.DynamicOutput,
    Run=run_6,
    addPrefix=True,
    description="""rpict -vf /home/lio/MantaRay/Andrei/views/Perspective3.vf -x 20000 -y 10000 -ab 0 -ad 1 -aa 1 -w -av 1 1 1 /home/lio/MantaRay/Andrei/octrees/Scene_Overcast10klux.oct |
pfilt -x /4 -y /4 -1 -r 0.7 > ~/MantaRay/Andrei/images/2023_03_12_2232_rtpict_rendering_aa0_20000_sunny_ad32_0_colors_filt.hdr
echo ~/MantaRay/Andrei/images/2023_03_12_2232_rtpict_rendering_aa0_20000_sunny_ad32_0_colors_filt.hdr""",
    fireLogs=True,
    lastRunTime=80956,
    name="rpict for colors (denoisr test)",
    suppressWarnings=True,
    results="/home/lio/simulation/Boston_Skylights/images/2023_01_09_1607_rtpict_rendering_aa0_20000_sunny_ad32_0_colors_filt.hdr",
    commands="""rpict -vf /home/lio/MantaRay/TestingRemote/views/Perspective1.vf -x 20000 -y 10000 -ab 0 -ad 1 -aa 1 -w -av 1 1 1 /home/lio/simulation/Boston_Skylights/octrees/my_test_scene.oct |
pfilt -x /4 -y /4 -1 -r 0.7 > ~/simulation/Boston_Skylights/images/2023_01_09_1607_rtpict_rendering_aa0_20000_sunny_ad32_0_colors_filt.hdr
echo ~/simulation/Boston_Skylights/images/2023_01_09_1607_rtpict_rendering_aa0_20000_sunny_ad32_0_colors_filt.hdr""")  # -> Stdout, Stderr, Ran
download_9 = Download(SftpPaths=flatten(executessh_38.Stdout), Run=executessh_38.Ran)  # -> FilePaths, Status, Ran
imageviewer_7 = LBImageViewer(ImagePath_=download_9.FilePaths, _scale_=1, DisableClickable=False, SaveImgWithCoords=False, scale=1)  # -> ImagePath, Values, GIF

overrides_43 = ApplyOverrides(Input=panel_83, X=graft(x_8), Time=graft("<time>"), H=graft("<h>"))  # -> Output, DynamicOutput

overrides_44 = ApplyOverrides(
    Input=panel_82,
    Vf=graft(viewfile_4),
    X=graft(multiplication_3),
    Y=graft(multiplication_4),
    Target=graft(overrides_43.Output),
    RadOptions=graft("-ab 3 -ad 8 -aa 0"),
    Oct=graft(octree_5),
    Time=graft(python_18),
    H=graft(hours_6))  # -> Output, DynamicOutput
executessh_39 = ExecuteSSH(
    _SSHCommands=overrides_44.DynamicOutput,
    Run=run_5,
    addPrefix=True,
    description="""mkdir -p ~/MantaRay/Andrei/images/
rm -r ~/MantaRay/Andrei/images/2023_03_12_2232_rtpict_rendering_aa0_5000_sunny_ad32_0
rtpict -n 63 -w -ov ~/MantaRay/Andrei/images/2023_03_12_2232_rtpict_rendering_aa0_5000_sunny_ad32_0 -vf /home/lio/MantaRay/Andrei/views/Perspective3.vf -x 20000 -y 10000 -ab 3 -ad 8 -aa 0 /home/lio/MantaRay/Andrei/octrees/Scene_Overcast10klux.oct;echo ~/MantaRay/Andrei/images/2023_03_12_2232_rtpict_rendering_aa0_5000_sunny_ad32_0""",
    fireLogs=True,
    lastRunTime=149008.5992,
    name="rtpict luminance (denoisr test)",
    suppressWarnings=True,
    commands="""mkdir -p ~/MantaRay/Andrei/images/
rm -r ~/MantaRay/Andrei/images/2023_03_12_2232_rtpict_rendering_aa0_5000_sunny_ad32_0
rtpict -n 63 -w -ov ~/MantaRay/Andrei/images/2023_03_12_2232_rtpict_rendering_aa0_5000_sunny_ad32_0 -vf /home/lio/MantaRay/Andrei/views/Perspective3.vf -x 20000 -y 10000 -ab 3 -ad 8 -aa 0 /home/lio/MantaRay/Andrei/octrees/Scene_Overcast10klux.oct;echo ~/MantaRay/Andrei/images/2023_03_12_2232_rtpict_rendering_aa0_5000_sunny_ad32_0""")  # -> Stdout, Stderr, Ran
panel_86 = Panel(executessh_39.Stderr)

# ----
# Get "radiance" path to radiance.hdr
# (rtpict generates a whole folder of other stuff..)
panel_87 = Panel("<proj>/images/<target>")
overrides_45 = ApplyOverrides(Input=panel_87, X=graft(x_8), Target=graft(panel_83), Time=graft(python_18), H=graft(hours_6))  # -> Output, DynamicOutput
overrides_46 = ApplyOverrides(Input="ls <target>", Target=graft(overrides_45.Output))  # -> Output, DynamicOutput
executessh_40 = ExecuteSSH(
    _SSHCommands_=overrides_46.DynamicOutput,
    Run=executessh_39.Ran,
    addPrefix=True,
    description="ls ~/MantaRay/Andrei/images/2023_03_12_2232_rtpict_rendering_aa0_5000_sunny_ad32_0",
    fireLogs=False,
    lastRunTime=76.4815,
    suppressWarnings=False,
    results="radiance.hdr",
    commands="ls ~/MantaRay/Andrei/images/2023_03_12_2232_rtpict_rendering_aa0_5000_sunny_ad32_0")  # -> Stdout, Stderr_, Ran
concat_6 = Concatenate(FragmentA=overrides_45.Output, FragmentB="radiance.hdr", JoinSeparator="/")
split = TextSplit(Text=executessh_40.Stdout)
concat_7 = Concatenate(FragmentA=overrides_45.Output, FragmentB=split, JoinSeparator="/")

# ----
# Using pfilt to downscale image
# radius per Mark Stock:
# http://markjstock.org/radmisc/aa0_test/final.html
panel_88 = Panel("pfilt -x /<ss> -y /<ss> -1 -r 0.7 <file> > <file-.>_filtered.hdr;echo <file-.>_filtered.hdr")
overrides_47 = ApplyOverrides(Input=panel_88, Ss=graft(supersampling_2), File=graft(concat_7))  # -> Output, DynamicOutput
executessh_41 = ExecuteSSH(
    _SSHCommands_=overrides_47.DynamicOutput,
    Run=executessh_39.Ran,
    addPrefix=True,
    description="pfilt -x /4 -y /4 -1 -r 0.7 ~/MantaRay/Andrei/images/2023_03_12_2232_rtpict_rendering_aa0_5000_sunny_ad32_0/radiance.hdr > ~/MantaRay/Andrei/images/2023_03_12_2232_rtpict_rendering_aa0_5000_sunny_ad32_0/radiance_filtered.hdr;echo ~/MantaRay/Andrei/images/2023_03_12_2232_rtpict_rendering_aa0_5000_sunny_ad32_0/radiance_filtered.hdr",
    fireLogs=False,
    lastRunTime=57.9429,
    suppressWarnings=False,
    results="/home/lio/MantaRay/Andrei/images/2023_03_12_2232_rtpict_rendering_aa0_5000_sunny_ad32_0/radiance_filtered.hdr",
    stderr="pfilt: truncated input (y=7317)",
    commands="pfilt -x /4 -y /4 -1 -r 0.7 ~/MantaRay/Andrei/images/2023_03_12_2232_rtpict_rendering_aa0_5000_sunny_ad32_0/radiance.hdr > ~/MantaRay/Andrei/images/2023_03_12_2232_rtpict_rendering_aa0_5000_sunny_ad32_0/radiance_filtered.hdr;echo ~/MantaRay/Andrei/images/2023_03_12_2232_rtpict_rendering_aa0_5000_sunny_ad32_0/radiance_filtered.hdr")  # -> Stdout, Stderr_, Ran
# ----
# This "was" a test where i combined for the denoiseer..
# -la for titel: pcompos -la -a 3 -s 10 -b 1 1 1 <hdrFiles> > <proj>/images/<target>
# echo <proj>/images/<target>
# pcompos -a 15 -b 1 1 1 -s 5 <proj>/mtxs/skyRenders/skyTregenza*.hdr > <proj>/mtxs/skyRenders/all.hdr
panel_89 = Panel("""ra_tiff <hdrFiles> <proj>/images/<target-.>.tif
convert <proj>/images/<target-.>.tif <proj>/images/<target-.>.png
echo <proj>/images/<target-.>.png""")
panel_90 = Panel("pcond -h <hdr> <hdr-.>_exposed.hdr;echo <hdr-.>_exposed.hdr")
overrides_48 = ApplyOverrides(Input=panel_89, HdrFiles=graft(concat_6), Target=graft("render_original.png"))  # -> Output, DynamicOutput
overrides_49 = ApplyOverrides(Input=panel_90, Hdr=graft(executessh_41.Stdout))  # -> Output, DynamicOutput
panel_91 = Panel("psign -h 15 <h> | pcompos <target> 0 0 - 570 20 > <target-.>_s.hdr;echo <target-.>_s.hdr")
executessh_42 = ExecuteSSH(
    _SSHCommands_=overrides_48.DynamicOutput,
    Run=executessh_41.Ran,
    addPrefix=True,
    description="""ra_tiff ~/MantaRay/Andrei/images/2023_03_12_2232_rtpict_rendering_aa0_5000_sunny_ad32_0/radiance.hdr ~/MantaRay/Andrei/images/render_original.tif
convert ~/MantaRay/Andrei/images/render_original.tif ~/MantaRay/Andrei/images/render_original.png
echo ~/MantaRay/Andrei/images/render_original.png""",
    fireLogs=False,
    lastRunTime=4214,
    suppressWarnings=False,
    results="/home/lio/simulation/Boston_Skylights/images/render_original.png",
    commands="""ra_tiff ~/simulation/Boston_Skylights/images/2023_01_09_1607_rtpict_rendering_aa0_5000_sunny_ad32_0/radiance.hdr ~/simulation/Boston_Skylights/images/render_original.tif
convert ~/simulation/Boston_Skylights/images/render_original.tif ~/simulation/Boston_Skylights/images/render_original.png
echo ~/simulation/Boston_Skylights/images/render_original.png""")  # -> Stdout, Stderr_, Ran
panel_92 = Panel(overrides_48.Output)
download_10 = Download(SftpPaths=flatten(executessh_42.Stdout), Run=executessh_41.Ran)  # -> FilePaths, Status, Ran
executessh_43 = ExecuteSSH(
    _SSHCommands_=overrides_49.DynamicOutput,
    Run=executessh_41.Ran,
    addPrefix=True,
    description="pcond -h /home/lio/MantaRay/Andrei/images/2023_03_12_2232_rtpict_rendering_aa0_5000_sunny_ad32_0/radiance_filtered.hdr /home/lio/MantaRay/Andrei/images/2023_03_12_2232_rtpict_rendering_aa0_5000_sunny_ad32_0/radiance_filtered_exposed.hdr;echo /home/lio/MantaRay/Andrei/images/2023_03_12_2232_rtpict_rendering_aa0_5000_sunny_ad32_0/radiance_filtered_exposed.hdr",
    fireLogs=False,
    lastRunTime=537,
    suppressWarnings=False,
    results="/home/lio/simulation/Boston_Skylights/images/2023_01_09_1607_rtpict_rendering_aa0_5000_sunny_ad32_0/radiance_filtered_exposed.hdr",
    commands="pcond -h /home/lio/simulation/Boston_Skylights/images/2023_01_09_1607_rtpict_rendering_aa0_5000_sunny_ad32_0/radiance_filtered.hdr /home/lio/simulation/Boston_Skylights/images/2023_01_09_1607_rtpict_rendering_aa0_5000_sunny_ad32_0/radiance_filtered_exposed.hdr;echo /home/lio/simulation/Boston_Skylights/images/2023_01_09_1607_rtpict_rendering_aa0_5000_sunny_ad32_0/radiance_filtered_exposed.hdr")  # -> Stdout, Stderr_, Ran
item_4 = ListItem(List=download_10.FilePaths, Index=0, Wrap=True)
hours_7 = Number(hours)
overrides_50 = ApplyOverrides(Input=panel_91, H=graft(hours_7), Target=graft(executessh_43.Stdout))  # -> Output, DynamicOutput
lng = ListLength(List=flatten(executessh_43.Stdout))
imageviewer_8 = LBImageViewer(ImagePath_=item_4, _scale_="1", DisableClickable=False, SaveImgWithCoords=False, scale=1)  # -> ImagePath, Values, GIF
python_19 = GhPythonScript(cnt=lng, run=executessh_43.Ran)  # -> out, ran; inputs cnt: Int32, run: Boolean
# ---------- python_19: Python ----------
__author__ = "mm1013"
__version__ = "2022.08.30"

import rhinoscriptsyntax as rs

ran = cnt > 1 and run
# ---------- end python_19 ----------
panel_93 = Panel("""pcompos -a 3 -s 10 -b 0.2 0.2 0.2 <hdrFiles> > <proj>/images/<target>
ra_tiff <proj>/images/<target> <proj>/images/<target-.>.tif
convert <proj>/images/<target-.>.tif <proj>/images/<target-.>.png
echo <proj>/images/<target-.>.png""")
executessh_44 = ExecuteSSH(
    _SSHCommands_=overrides_50.DynamicOutput,
    Run=python_19.ran,
    addPrefix=True,
    description="""psign -h 15 800 | pcompos /home/lio/simulation/Boston_Skylights/images/2023_01_09_1607_rtpict_rendering_aa0_5000_sunny_ad32_0/radiance_filtered_exposed.hdr 0 0 - 570 20 > /home/lio/simulation/Boston_Skylights/images/2023_01_09_1607_rtpict_rendering_aa0_5000_sunny_ad32_0/radiance_filtered_exposed_s.hdr;echo /home/lio/simulation/Boston_Skylights/images/2023_01_09_1607_rtpict_rendering_aa0_5000_sunny_ad32_0/radiance_filtered_exposed_s.hdr


- - -

psign -h 15 900 | pcompos /home/lio/simulation/Boston_Skylights/images/2023_01_09_1607_rtpict_rendering_aa0_5000_sunny_ad32_0/radiance_filtered_exposed.hdr 0 0 - 570 20 > /home/lio/simulation/Boston_Skylights/images/2023_01_09_1607_rtpict_rendering_aa0_5000_sunny_ad32_0/radiance_filtered_exposed_s.hdr;echo /home/lio/simulation/Boston_Skylights/images/2023_01_09_1607_rtpict_rendering_aa0_5000_sunny_ad32_0/radiance_filtered_exposed_s.hdr


- - -

psign -h 15 1000 | pcompos /home/lio/simulation/Boston_Skylights/images/2023_01_09_1607_rtpict_rendering_aa0_5000_sunny_ad32_0/radiance_filtered_exposed.hdr 0 0 - 570 20 > /home/lio/simulation/Boston_Skylights/images/2023_01_09_1607_rtpict_rendering_aa0_5000_sunny_ad32_0/radiance_filtered_exposed_s.hdr;echo /home/lio/simulation/Boston_Skylights/images/2023_01_09_1607_rtpict_rendering_aa0_5000_sunny_ad32_0/radiance_filtered_exposed_s.hdr


- - -

psign -h 15 1100 | pcompos /home/lio/simulation/Boston_Skylights/images/2023_01_09_1607_rtpict_rendering_aa0_5000_sunny_ad32_0/radiance_filtered_exposed.hdr 0 0 - 570 20 > /home/lio/simulation/Boston_Skylights/images/2023_01_09_1607_rtpict_rendering_aa0_5000_sunny_ad32_0/radiance_filtered_exposed_s.hdr;echo /home/lio/simulation/Boston_Skylights/images/2023_01_09_1607_rtpict_rendering_aa0_5000_sunny_ad32_0/radiance_filtered_exposed_s.hdr


- - -

psign -h 15 1200 | pcompos /home/lio/simulation/Boston_Skylights/images/2023_01_09_1607_rtpict_rendering_aa0_5000_sunny_ad32_0/radiance_filtered_exposed.hdr 0 0 - 570 20 > /home/lio/simulation/Boston_Skylights/images/2023_01_09_1607_rtpict_rendering_aa0_5000_sunny_ad32_0/radiance_filtered_exposed_s.hdr;echo /home/lio/simulation/Boston_Skylights/images/2023_01_09_1607_rtpict_rendering_aa0_5000_sunny_ad32_0/radiance_filtered_exposed_s.hdr


- - -

psign -h 15 1300 | pcompos /home/lio/simulation/Boston_Skylights/images/2023_01_09_1607_rtpict_rendering_aa0_5000_sunny_ad32_0/radiance_filtered_exposed.hdr 0 0 - 570 20 > /home/lio/simulation/Boston_Skylights/images/2023_01_09_1607_rtpict_rendering_aa0_5000_sunny_ad32_0/radiance_filtered_exposed_s.hdr;echo /home/lio/simulation/Boston_Skylights/images/2023_01_09_1607_rtpict_rendering_aa0_5000_sunny_ad32_0/radiance_filtered_exposed_s.hdr


- - -

psign -h 15 1400 | pcompos /home/lio/simulation/Boston_Skylights/images/2023_01_09_1607_rtpict_rendering_aa0_5000_sunny_ad32_0/radiance_filtered_exposed.hdr 0 0 - 570 20 > /home/lio/simulation/Boston_Skylights/images/2023_01_09_1607_rtpict_rendering_aa0_5000_sunny_ad32_0/radiance_filtered_exposed_s.hdr;echo /home/lio/simulation/Boston_Skylights/images/2023_01_09_1607_rtpict_rendering_aa0_5000_sunny_ad32_0/radiance_filtered_exposed_s.hdr


- - -

psign -h 15 1500 | pcompos /home/lio/simulation/Boston_Skylights/images/2023_01_09_1607_rtpict_rendering_aa0_5000_sunny_ad32_0/radiance_filtered_exposed.hdr 0 0 - 570 20 > /home/lio/simulation/Boston_Skylights/images/2023_01_09_1607_rtpict_rendering_aa0_5000_sunny_ad32_0/radiance_filtered_exposed_s.hdr;echo /home/lio/simulation/Boston_Skylights/images/2023_01_09_1607_rtpict_rendering_aa0_5000_sunny_ad32_0/radiance_filtered_exposed_s.hdr


- - -

psign -h 15 1600 | pcompos /home/lio/simulation/Boston_Skylights/images/2023_01_09_1607_rtpict_rendering_aa0_5000_sunny_ad32_0/radiance_filtered_exposed.hdr 0 0 - 570 20 > /home/lio/simulation/Boston_Skylights/images/2023_01_09_1607_rtpict_rendering_aa0_5000_sunny_ad32_0/radiance_filtered_exposed_s.hdr;echo /home/lio/simulation/Boston_Skylights/images/2023_01_09_1607_rtpict_rendering_aa0_5000_sunny_ad32_0/radiance_filtered_exposed_s.hdr


- - -

psign -h 15 1700 | pcompos /home/lio/simulation/Boston_Skylights/images/2023_01_09_1607_rtpict_rendering_aa0_5000_sunny_ad32_0/radiance_filtered_exposed.hdr 0 0 - 570 20 > /home/lio/simulation/Boston_Skylights/images/2023_01_09_1607_rtpict_rendering_aa0_5000_sunny_ad32_0/radiance_filtered_exposed_s.hdr;echo /home/lio/simulation/Boston_Skylights/images/2023_01_09_1607_rtpict_rendering_aa0_5000_sunny_ad32_0/radiance_filtered_exposed_s.hdr""",
    fireLogs=False,
    lastRunTime=166,
    suppressWarnings=False,
    results=["/home/lio/MantaRay/TestingRemote/images/2023_01_09_1225_rtpict_rendering_aa0_1500_sunny_ad32_0/radiance_filtered_exposed_s.hdr", "/home/lio/MantaRay/TestingRemote/images/2023_01_09_1225_rtpict_rendering_aa0_1500_sunny_ad32_0/radiance_filtered_exposed_filtered_exposed_s.hdr", "/home/lio/MantaRay/TestingRemote/images/2023_01_09_1225_rtpict_rendering_aa0_1500_sunny_ad32_0/radiance_filtered_exposed_s_filtered_exposed_s.hdr", "/home/lio/MantaRay/TestingRemote/images/2023_01_09_1225_rtpict_rendering_aa0_1500_sunny_ad32_0/radiance_filtered_filtered_exposed_filtered_exposed_s.hdr", "/home/lio/MantaRay/TestingRemote/images/2023_01_09_1225_rtpict_rendering_aa0_1500_sunny_ad32_0/radiance_filtered_filtered_exposed_s_filtered_exposed_s.hdr", "/home/lio/MantaRay/TestingRemote/images/2023_01_09_1225_rtpict_rendering_aa0_1500_sunny_ad32_0/radiance_filtered_filtered_filtered_exposed_s.hdr", "/home/lio/MantaRay/TestingRemote/images/2023_01_09_1225_rtpict_rendering_aa0_1500_sunny_ad32_0/radiance_filtered_filtered_exposed_s.hdr", "/home/lio/MantaRay/TestingRemote/images/2023_01_09_1225_rtpict_rendering_aa0_1500_sunny_ad32_0/radiance_filtered_exposed_s.hdr"],
    stderr=["/home/lio/MantaRay/TestingRemote/images/2023_01_09_1225_rtpict_rendering_aa0_1500_sunny_ad32_0/radiance_filtered_exposed_filtered_exposed.hdr: bad picture size", "/home/lio/MantaRay/TestingRemote/images/2023_01_09_1225_rtpict_rendering_aa0_1500_sunny_ad32_0/radiance_filtered_exposed_s_filtered_exposed.hdr: bad picture size", "/home/lio/MantaRay/TestingRemote/images/2023_01_09_1225_rtpict_rendering_aa0_1500_sunny_ad32_0/radiance_filtered_filtered_exposed_filtered_exposed.hdr: bad picture size", "/home/lio/MantaRay/TestingRemote/images/2023_01_09_1225_rtpict_rendering_aa0_1500_sunny_ad32_0/radiance_filtered_filtered_exposed_s_filtered_exposed.hdr: bad picture size", "/home/lio/MantaRay/TestingRemote/images/2023_01_09_1225_rtpict_rendering_aa0_1500_sunny_ad32_0/radiance_filtered_filtered_filtered_exposed.hdr: bad picture size", "/home/lio/MantaRay/TestingRemote/images/2023_01_09_1225_rtpict_rendering_aa0_1500_sunny_ad32_0/radiance_filtered_filtered_exposed.hdr: bad picture size"],
    commands=["psign -h 15 1000 | pcompos /home/lio/MantaRay/TestingRemote/images/2023_01_09_1225_rtpict_rendering_aa0_1500_sunny_ad32_0/radiance_filtered_exposed_s_filtered_exposed.hdr 0 0 - 570 20 > /home/lio/MantaRay/TestingRemote/images/2023_01_09_1225_rtpict_rendering_aa0_1500_sunny_ad32_0/radiance_filtered_exposed_s_filtered_exposed_s.hdr;echo /home/lio/MantaRay/TestingRemote/images/2023_01_09_1225_rtpict_rendering_aa0_1500_sunny_ad32_0/radiance_filtered_exposed_s_filtered_exposed_s.hdr", "psign -h 15 900 | pcompos /home/lio/MantaRay/TestingRemote/images/2023_01_09_1225_rtpict_rendering_aa0_1500_sunny_ad32_0/radiance_filtered_exposed_filtered_exposed.hdr 0 0 - 570 20 > /home/lio/MantaRay/TestingRemote/images/2023_01_09_1225_rtpict_rendering_aa0_1500_sunny_ad32_0/radiance_filtered_exposed_filtered_exposed_s.hdr;echo /home/lio/MantaRay/TestingRemote/images/2023_01_09_1225_rtpict_rendering_aa0_1500_sunny_ad32_0/radiance_filtered_exposed_filtered_exposed_s.hdr", "psign -h 15 1200 | pcompos /home/lio/MantaRay/TestingRemote/images/2023_01_09_1225_rtpict_rendering_aa0_1500_sunny_ad32_0/radiance_filtered_filtered_exposed_s_filtered_exposed.hdr 0 0 - 570 20 > /home/lio/MantaRay/TestingRemote/images/2023_01_09_1225_rtpict_rendering_aa0_1500_sunny_ad32_0/radiance_filtered_filtered_exposed_s_filtered_exposed_s.hdr;echo /home/lio/MantaRay/TestingRemote/images/2023_01_09_1225_rtpict_rendering_aa0_1500_sunny_ad32_0/radiance_filtered_filtered_exposed_s_filtered_exposed_s.hdr", "psign -h 15 1100 | pcompos /home/lio/MantaRay/TestingRemote/images/2023_01_09_1225_rtpict_rendering_aa0_1500_sunny_ad32_0/radiance_filtered_filtered_exposed_filtered_exposed.hdr 0 0 - 570 20 > /home/lio/MantaRay/TestingRemote/images/2023_01_09_1225_rtpict_rendering_aa0_1500_sunny_ad32_0/radiance_filtered_filtered_exposed_filtered_exposed_s.hdr;echo /home/lio/MantaRay/TestingRemote/images/2023_01_09_1225_rtpict_rendering_aa0_1500_sunny_ad32_0/radiance_filtered_filtered_exposed_filtered_exposed_s.hdr", "psign -h 15 1300 | pcompos /home/lio/MantaRay/TestingRemote/images/2023_01_09_1225_rtpict_rendering_aa0_1500_sunny_ad32_0/radiance_filtered_filtered_filtered_exposed.hdr 0 0 - 570 20 > /home/lio/MantaRay/TestingRemote/images/2023_01_09_1225_rtpict_rendering_aa0_1500_sunny_ad32_0/radiance_filtered_filtered_filtered_exposed_s.hdr;echo /home/lio/MantaRay/TestingRemote/images/2023_01_09_1225_rtpict_rendering_aa0_1500_sunny_ad32_0/radiance_filtered_filtered_filtered_exposed_s.hdr", "psign -h 15 1400 | pcompos /home/lio/MantaRay/TestingRemote/images/2023_01_09_1225_rtpict_rendering_aa0_1500_sunny_ad32_0/radiance_filtered_filtered_exposed.hdr 0 0 - 570 20 > /home/lio/MantaRay/TestingRemote/images/2023_01_09_1225_rtpict_rendering_aa0_1500_sunny_ad32_0/radiance_filtered_filtered_exposed_s.hdr;echo /home/lio/MantaRay/TestingRemote/images/2023_01_09_1225_rtpict_rendering_aa0_1500_sunny_ad32_0/radiance_filtered_filtered_exposed_s.hdr", "psign -h 15 1500 | pcompos /home/lio/MantaRay/TestingRemote/images/2023_01_09_1225_rtpict_rendering_aa0_1500_sunny_ad32_0/radiance_filtered_exposed.hdr 0 0 - 570 20 > /home/lio/MantaRay/TestingRemote/images/2023_01_09_1225_rtpict_rendering_aa0_1500_sunny_ad32_0/radiance_filtered_exposed_s.hdr;echo /home/lio/MantaRay/TestingRemote/images/2023_01_09_1225_rtpict_rendering_aa0_1500_sunny_ad32_0/radiance_filtered_exposed_s.hdr"])  # -> Stdout, Stderr_, Ran
panel_94 = Panel("""pcond -h <hdr> <hdr-.>_exposed.hdr
ra_tiff <hdr-.>_exposed.hdr <hdr-.>_exposed.tif
convert <hdr-.>_exposed.tif <hdr-.>_exposed.png
echo <hdr-.>_exposed.png""")
join_7 = TextJoin(Text=flatten(executessh_44.Stdout), Join=" ")
overrides_51 = ApplyOverrides(Input=panel_93, HdrFiles=graft(join_7), Target=graft("combined.hdr"))  # -> Output, DynamicOutput
executessh_45 = ExecuteSSH(
    _SSHCommands_=overrides_51.Output,
    Run=executessh_44.Ran,
    addPrefix=True,
    fireLogs=False,
    lastRunTime=13,
    suppressWarnings=False,
    results="/home/lio/simulation/Boston_Skylights/images/combined.png",
    stderr="""/home/lio/MantaRay/TestingRemote/images/2023_01_09_1225_rtpict_rendering_aa0_1500_sunny_ad32_0/radiance_filtered_exposed_filtered_exposed_s.hdr: bad picture size
ra_tiff: bad Radiance picture
convert-im6.q16: no images defined `/home/lio/simulation/Boston_Skylights/images/combined.png' @ error/convert.c/ConvertImageCommand/3258.""",
    commands="""pcompos -a 3 -s 10 -b 0.2 0.2 0.2 /home/lio/MantaRay/TestingRemote/images/2023_01_09_1225_rtpict_rendering_aa0_1500_sunny_ad32_0/radiance_filtered_exposed_s.hdr /home/lio/MantaRay/TestingRemote/images/2023_01_09_1225_rtpict_rendering_aa0_1500_sunny_ad32_0/radiance_filtered_exposed_filtered_exposed_s.hdr /home/lio/MantaRay/TestingRemote/images/2023_01_09_1225_rtpict_rendering_aa0_1500_sunny_ad32_0/radiance_filtered_exposed_s_filtered_exposed_s.hdr /home/lio/MantaRay/TestingRemote/images/2023_01_09_1225_rtpict_rendering_aa0_1500_sunny_ad32_0/radiance_filtered_filtered_exposed_filtered_exposed_s.hdr /home/lio/MantaRay/TestingRemote/images/2023_01_09_1225_rtpict_rendering_aa0_1500_sunny_ad32_0/radiance_filtered_filtered_exposed_s_filtered_exposed_s.hdr /home/lio/MantaRay/TestingRemote/images/2023_01_09_1225_rtpict_rendering_aa0_1500_sunny_ad32_0/radiance_filtered_filtered_filtered_exposed_s.hdr /home/lio/MantaRay/TestingRemote/images/2023_01_09_1225_rtpict_rendering_aa0_1500_sunny_ad32_0/radiance_filtered_filtered_exposed_s.hdr /home/lio/MantaRay/TestingRemote/images/2023_01_09_1225_rtpict_rendering_aa0_1500_sunny_ad32_0/radiance_filtered_exposed_s.hdr > ~/simulation/Boston_Skylights/images/combined.hdr
ra_tiff ~/simulation/Boston_Skylights/images/combined.hdr ~/simulation/Boston_Skylights/images/combined.tif
convert ~/simulation/Boston_Skylights/images/combined.tif ~/simulation/Boston_Skylights/images/combined.png
echo ~/simulation/Boston_Skylights/images/combined.png""")  # -> Stdout, Stderr_, Ran
overrides_52 = ApplyOverrides(Input=panel_94, Hdr=graft(executessh_44.Stdout))  # -> Output, DynamicOutput

# ----
# RENDER WITH RAD (rif files)
octree_7 = Data(octree_overcast)
panel_95 = Panel("""rtpict -w -n <cpus> @<options> -x 500 -y 400 -vf <vf> -af <target-.>.amb <oct> > <LinuxHome>/<target-.>_overture.hdr
rtpict -w -n <cpus> @<options> -vf <vf> -af <target-.>.amb <oct> > <LinuxHome>/<target>
echo <LinuxHome>/<target>""")
panel_96 = Panel("""pcond -h <hdr> <hdr-.>_exposed.hdr
ra_tiff <hdr-.>_exposed.hdr <hdr-.>_exposed.tif
convert <hdr-.>_exposed.tif <hdr-.>_exposed.png
echo <hdr-.>_exposed.png""")

# ----
# https://discourse.radiance-online.org/t/rad-program-for-generating-parameters/6026
panel_97 = Panel("scene.rif")
panel_98 = Panel("""rpict= rtpict -n <cpus>
RESOLUTION= 600
QUALITY=H
DETAIL= H
EXPOSURE= +0.1
UP= Z
INDIRECT= 0
VARIABILITY= M
REPORT= 1
<zone>
OCTREE=<oct>
view=<vn> -vf <v>""")
panel_99 = Panel("""echo "<RIF>" > <LinuxHome>/<target>
rad -n -s <LinuxHome>/<target> OPTFILE=<LinuxHome>/render.opt
echo <LinuxHome>/render.opt""")
overrides_53 = ApplyOverrides(
    Input=panel_99,
    RIF=graft(panel_98),
    Target=graft(panel_97),
    Oct=graft(octree_7),
    Zone=graft(zone_2.zone),
    Vn=graft(viewname_2),
    V=graft(executessh_21.Stdout))  # -> Output, DynamicOutput
falsestart_14 = LBFalseStartToggle(False)
executessh_46 = ExecuteSSH(
    _SSHCommands_=overrides_53.Output,
    Run=falsestart_14,
    addPrefix=True,
    fireLogs=False,
    lastRunTime=59,
    suppressWarnings=False,
    results="/home/lio/MantaRay/Andrei/render.opt",
    commands="""echo "rpict= rtpict -n 63
RESOLUTION= 600
QUALITY=H
DETAIL= H
EXPOSURE= +0.1
UP= Z
INDIRECT= 0
VARIABILITY= M
REPORT= 1
ZONE=I 0.00 14.49 0.00 18.21 0.00 13.53

OCTREE=/home/lio/MantaRay/Andrei/octrees/Scene_Overcast10klux.oct
view=Perspective2 -vf /home/lio/MantaRay/Andrei/views/Perspective2.vf" > ~/MantaRay/Andrei/scene.rif
rad -n -s ~/MantaRay/Andrei/scene.rif OPTFILE=~/MantaRay/Andrei/render.opt
echo ~/MantaRay/Andrei/render.opt""")  # -> Stdout, Stderr_, Ran
overrides_54 = ApplyOverrides(Input="cat <target>", Target=graft(executessh_46.Stdout))  # -> Output, DynamicOutput
executessh_47 = ExecuteSSH(
    _SSHCommands_=overrides_54.Output,
    Run=executessh_46.Ran,
    addPrefix=True,
    fireLogs=False,
    lastRunTime=65,
    suppressWarnings=False,
    results="""-dp 4096
-ar 400
-ms 0.096
-ds .2
-dt .05
-dc .75
-dr 3
-ss 16
-st .01
-ab 1
-aa .1
-ad 1536
-as 768
-av 0.17 0.17 0.17
-lr 12
-lw 1e-5""",
    commands="cat /home/lio/MantaRay/Andrei/render.opt")  # -> Stdout, Stderr_, Ran
panel_100 = Panel(executessh_47.Stdout)

overrides_55 = ApplyOverrides(
    Input=panel_95,
    Oct=graft(octree_7),
    Target=graft("myRender.hdr"),
    Options=graft(executessh_46.Stdout),
    Vf=graft(executessh_21.Stdout))  # -> Output, DynamicOutput
executessh_48 = ExecuteSSH(
    _SSHCommands=overrides_55.Output,
    Run=falsestart_12,
    addPrefix=True,
    fireLogs=False,
    lastRunTime=23941,
    suppressWarnings=False,
    results="/home/lio/MantaRay/Andrei/myRender.hdr",
    stderr="""rtrace: consistency - zero ambient radius in avinsert
rtrace: consistency - zero ambient radius in avinsert
rtrace: consistency - zero ambient radius in avinsert
rtrace: consistency - zero ambient radius in avinsert
rtrace: consistency - zero ambient radius in avinsert
rtrace: consistency - zero ambient radius in avinsert
rtrace: consistency - zero ambient radius in avinsert
rtrace: consistency - zero ambient radius in avinsert
rtrace: consistency - zero ambient radius in avinsert
rtrace: consistency - zero ambient radius in avinsert
rtrace: consistency - zero ambient radius in avinsert
rtrace: consistency - zero ambient radius in avinsert
rtrace: consistency - zero ambient radius in avinsert
rtrace: consistency - zero ambient radius in avinsert
rtrace: consistency - zero ambient radius in avinsert
rtrace: consistency - zero ambient radius in avinsert
rtrace: consistency - zero ambient radius in avinsert
rtrace: consistency - zero ambient radius in avinsert
rtrace: consistency - zero ambient radius in avinsert
rtrace: consistency - zero ambient radius in avinsert
rtrace: consistency - zero ambient radius in avinsert
rtrace: consistency - zero ambient radius in avinsert
rtrace: consistency - zero ambient radius in avinsert
rtrace: consistency - zero ambient radius in avinsert
rtrace: consistency - zero ambient radius in avinsert
rtrace: consistency - zero ambient radius in avinsert
rtrace: consistency - zero ambient radius in avinsert
rtrace: consistency - zero ambient radius in avinsert
rtrace: consistency - zero ambient radius in avinsert
rtrace: consistency - zero ambient radius in avinsert
rtrace: consistency - zero ambient radius in avinsert
rtrace: consistency - zero ambient radius in avinsert
rtrace: consistency - zero ambient radius in avinsert
rtrace: consistency - zero ambient radius in avinsert
rtrace: consistency - zero ambient radius in avinsert
rtrace: consistency - zero ambient radius in avinsert
rtrace: consistency - zero ambient radius in avinsert
rtrace: consistency - zero ambient radius in avinsert
rtrace: consistency - zero ambient radius in avinsert
rtrace: consistency - zero ambient radius in avinsert
rtrace: consistency - zero ambient radius in avinsert
rtrace: consistency - zero ambient radius in avinsert
rtrace: consistency - zero ambient radius in avinsert
rtrace: consistency - zero ambient radius in avinsert
rtrace: consistency - zero ambient radius in avinsert
rtrace: consistency - zero ambient radius in avinsert
rtrace: fatal - lost children
Error running rtrace""",
    commands="""rtpict -w -n 63 @/home/lio/MantaRay/Andrei/render.opt -x 500 -y 400 -vf /home/lio/MantaRay/Andrei/views/Perspective2.vf -af myRender.amb /home/lio/MantaRay/Andrei/octrees/Scene_Overcast10klux.oct > ~/MantaRay/Andrei/myRender_overture.hdr
rtpict -w -n 63 @/home/lio/MantaRay/Andrei/render.opt -vf /home/lio/MantaRay/Andrei/views/Perspective2.vf -af myRender.amb /home/lio/MantaRay/Andrei/octrees/Scene_Overcast10klux.oct > ~/MantaRay/Andrei/myRender.hdr
echo ~/MantaRay/Andrei/myRender.hdr""")  # -> Stdout, Stderr_, Ran
overrides_56 = ApplyOverrides(Input=panel_96, Hdr=graft(executessh_48.Stdout))  # -> Output, DynamicOutput
executessh_49 = ExecuteSSH(
    _SSHCommands_=overrides_56.DynamicOutput,
    Run=executessh_48.Ran,
    addPrefix=True,
    description="""pcond -h /home/lio/MantaRay/Andrei/myRender.hdr /home/lio/MantaRay/Andrei/myRender_exposed.hdr
ra_tiff /home/lio/MantaRay/Andrei/myRender_exposed.hdr /home/lio/MantaRay/Andrei/myRender_exposed.tif
convert /home/lio/MantaRay/Andrei/myRender_exposed.tif /home/lio/MantaRay/Andrei/myRender_exposed.png
echo /home/lio/MantaRay/Andrei/myRender_exposed.png""",
    fireLogs=False,
    lastRunTime=57,
    suppressWarnings=False,
    results="/home/lio/MantaRay/Andrei/myRender_exposed.png",
    stderr="""pcond: /home/lio/MantaRay/Andrei/myRender.hdr: not a Radiance picture
ra_tiff: bad Radiance picture
convert-im6.q16: no images defined `/home/lio/MantaRay/Andrei/myRender_exposed.png' @ error/convert.c/ConvertImageCommand/3258.""",
    commands="""pcond -h /home/lio/MantaRay/Andrei/myRender.hdr /home/lio/MantaRay/Andrei/myRender_exposed.hdr
ra_tiff /home/lio/MantaRay/Andrei/myRender_exposed.hdr /home/lio/MantaRay/Andrei/myRender_exposed.tif
convert /home/lio/MantaRay/Andrei/myRender_exposed.tif /home/lio/MantaRay/Andrei/myRender_exposed.png
echo /home/lio/MantaRay/Andrei/myRender_exposed.png""")  # -> Stdout, Stderr_, Ran
download_11 = Download(
    LinuxFilePaths=executessh_49.Stdout,
    Run=executessh_49.Ran,
    stdouts="C:\Users\mm1013\MantaRay\UnnamedProject\myRender_exposed.png")  # -> FilePaths, Status, Ran
imageviewer_9 = LBImageViewer(ImagePath_=download_11.FilePaths, _scale_="1", DisableClickable=False, SaveImgWithCoords=False, scale=1)  # -> ImagePath, Values, GIF

panel_101 = Panel(overrides_55.Output)

# ----
# Create a render of facade normals
panel_102 = Panel("xform -m normalshadermaterial <rad> > <rad-.>_black.rad;echo \"<rad-.>_black.rad\"")
scene_rads_3 = Text(entwine_3)
falsestart_15 = LBFalseStartToggle(False)
view_4 = Text(executessh_20.Stdout)
target = Text(panel_83)
overrides_57 = ApplyOverrides(Input=panel_102, Rad=graft(scene_rads_3))  # -> Output, DynamicOutput
python_20 = GhPythonScript(x=flatten(scene_rads_3))  # -> a; inputs x: list; same code as python_5
and_2 = GateAnd(A=python_20, B=falsestart_15)
executessh_50 = ExecuteSSH(
    _SSHCommands=overrides_57.Output,
    Run=and_2,
    addPrefix=True,
    description="""- - -



- - -



- - -



- - -



- - -



- - -



- - -



- - -



- - -



- - -



- - -



- - -



- - -



- - -



- - -""",
    fireLogs=False,
    lastRunTime=2494,
    suppressWarnings=False,
    results=["~/MantaRay/TestingRemote/radFiles/RevitJintInnerCW_Glass_80_mat_black.rad", "~/MantaRay/TestingRemote/radFiles/RevitJintInnerDoors_80_mat_black.rad", "~/MantaRay/TestingRemote/radFiles/Skylights_65_mat_black.rad", "~/MantaRay/TestingRemote/radFiles/GlassInt_74_mat_black.rad", "~/MantaRay/TestingRemote/radFiles/RevitJfacadeFacadesCWglass_74_mat_black.rad", "~/MantaRay/TestingRemote/radFiles/RevitJfacadeWindowGlass_74_mat_black.rad", "~/MantaRay/TestingRemote/radFiles/Skylights_55_mat_black.rad", "~/MantaRay/TestingRemote/radFiles/RevitJfacadeDoorPanel_70_mat_black.rad", "/home/lio/MantaRay/TestingRemote/radFiles/RevitJintInnerCW_Glass_80_black.rad", "/home/lio/MantaRay/TestingRemote/radFiles/RevitJintInnerDoors_80_black.rad", "/home/lio/MantaRay/TestingRemote/radFiles/Skylights_65_black.rad", "/home/lio/MantaRay/TestingRemote/radFiles/GlassInt_74_black.rad", "/home/lio/MantaRay/TestingRemote/radFiles/RevitJfacadeFacadesCWglass_74_black.rad", "/home/lio/MantaRay/TestingRemote/radFiles/RevitJfacadeWindowGlass_74_black.rad", "/home/lio/MantaRay/TestingRemote/radFiles/Skylights_55_black.rad", "/home/lio/MantaRay/TestingRemote/radFiles/RevitJfacadeDoorPanel_70_black.rad", "~/MantaRay/TestingRemote/radFiles/opaque_materials_black.rad", "/home/lio/MantaRay/TestingRemote/radFiles/RevitJintInnerCWs_50_black.rad", "/home/lio/MantaRay/TestingRemote/radFiles/RANSLUCENT_black.rad", "/home/lio/MantaRay/TestingRemote/radFiles/Ceilings_70_black.rad", "/home/lio/MantaRay/TestingRemote/radFiles/RevitJintInnerDoors_50_black.rad", "/home/lio/MantaRay/TestingRemote/radFiles/RevitJintInnerWalls_50_black.rad", "/home/lio/MantaRay/TestingRemote/radFiles/Roofs_20_black.rad", "/home/lio/MantaRay/TestingRemote/radFiles/RevitJfacadeFacadesCladding_50_black.rad", "/home/lio/MantaRay/TestingRemote/radFiles/RoofMullions_70_black.rad", "/home/lio/MantaRay/TestingRemote/radFiles/Frames_50_black.rad", "/home/lio/MantaRay/TestingRemote/radFiles/SlabWall_50_black.rad", "/home/lio/MantaRay/TestingRemote/radFiles/SlabFloor_30_black.rad", "/home/lio/MantaRay/TestingRemote/radFiles/WallInterior_70_black.rad", "/home/lio/MantaRay/TestingRemote/radFiles/Doors_50_black.rad", "/home/lio/MantaRay/TestingRemote/radFiles/RevitJfacadeFacadesWall_50_black.rad", "/home/lio/MantaRay/TestingRemote/radFiles/Floors_20_black.rad", "/home/lio/MantaRay/TestingRemote/radFiles/ByggD_30_black.rad", "/home/lio/MantaRay/TestingRemote/radFiles/Furniture_black.rad", "/home/lio/MantaRay/TestingRemote/radFiles/Curves_black.rad", "/home/lio/MantaRay/TestingRemote/radFiles/ByggE_30_black.rad", "/home/lio/MantaRay/TestingRemote/radFiles/ContextBright_70_black.rad", "/home/lio/MantaRay/TestingRemote/radFiles/RevitJfacadeDoors_55_black.rad", "/home/lio/MantaRay/TestingRemote/radFiles/RevitJfacadeWindowsFrames_70_black.rad", "/home/lio/MantaRay/TestingRemote/radFiles/RevitJfacadeFacadesFrames_70_black.rad"],
    commands=["xform -m normalshadermaterial ~/MantaRay/TestingRemote/radFiles/RevitJintInnerCW_Glass_80_mat.mat > ~/MantaRay/TestingRemote/radFiles/RevitJintInnerCW_Glass_80_mat_black.rad;echo \"~/MantaRay/TestingRemote/radFiles/RevitJintInnerCW_Glass_80_mat_black.rad\"", "xform -m normalshadermaterial ~/MantaRay/TestingRemote/radFiles/Skylights_65_mat.mat > ~/MantaRay/TestingRemote/radFiles/Skylights_65_mat_black.rad;echo \"~/MantaRay/TestingRemote/radFiles/Skylights_65_mat_black.rad\"", "xform -m normalshadermaterial ~/MantaRay/TestingRemote/radFiles/GlassInt_74_mat.mat > ~/MantaRay/TestingRemote/radFiles/GlassInt_74_mat_black.rad;echo \"~/MantaRay/TestingRemote/radFiles/GlassInt_74_mat_black.rad\"", "xform -m normalshadermaterial ~/MantaRay/TestingRemote/radFiles/RevitJfacadeWindowGlass_74_mat.mat > ~/MantaRay/TestingRemote/radFiles/RevitJfacadeWindowGlass_74_mat_black.rad;echo \"~/MantaRay/TestingRemote/radFiles/RevitJfacadeWindowGlass_74_mat_black.rad\"", "xform -m normalshadermaterial ~/MantaRay/TestingRemote/radFiles/RevitJintInnerDoors_80_mat.mat > ~/MantaRay/TestingRemote/radFiles/RevitJintInnerDoors_80_mat_black.rad;echo \"~/MantaRay/TestingRemote/radFiles/RevitJintInnerDoors_80_mat_black.rad\"", "xform -m normalshadermaterial ~/MantaRay/TestingRemote/radFiles/RevitJfacadeFacadesCWglass_74_mat.mat > ~/MantaRay/TestingRemote/radFiles/RevitJfacadeFacadesCWglass_74_mat_black.rad;echo \"~/MantaRay/TestingRemote/radFiles/RevitJfacadeFacadesCWglass_74_mat_black.rad\""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])  # -> flatten(Stdout), Stderr_, Ran
panel_103 = Panel(executessh_50.Stdout)
panel_104 = Panel("""mkdir -p <proj>/octrees/
oconv -r 2048 -w -f <rads> > <proj>/octrees/<target>
echo <proj>/octrees/<target>""")
python_21 = GhPythonScript(x=flatten(executessh_50.Stdout))  # -> a; inputs x: list; same code as python_5
and_3 = GateAnd(A=python_21, B=executessh_50.Ran)

# ----
# normalshader
panel_105 = Panel("""# Materials
void glow normalglow
0
0
4 1.0 1.0 1.0 -1

normalglow colorfunc normalshadermaterial
4 red green blue normalshader.cal
0
0""")
panel_106 = Panel("echo \"<mat>\" > <LinuxHome>/radFiles/mat_normalglow.mat;echo <LinuxHome>/radFiles/mat_normalglow.mat")
overrides_58 = ApplyOverrides(Input=panel_106, Mat=graft(panel_105))  # -> Output, DynamicOutput
executessh_51 = ExecuteSSH(
    _SSHCommands_=overrides_58.DynamicOutput,
    Run=falsestart_15,
    addPrefix=True,
    description="""echo "# Materials
void glow normalglow
0
0
4 1.0 1.0 1.0 -1

normalglow colorfunc normalshadermaterial
4 red green blue normalshader.cal
0
0" > ~/MantaRay/Andrei/radFiles/mat_normalglow.mat;echo ~/MantaRay/Andrei/radFiles/mat_normalglow.mat""",
    fireLogs=False,
    lastRunTime=12,
    suppressWarnings=False,
    results="/home/lio/MantaRay/TestingRemote/radFiles/mat_normalglow.mat",
    commands="""echo "# Materials
void glow normalglow
0
0
4 1.0 1.0 1.0 -1

normalglow colorfunc normalshadermaterial
4 red green blue normalshader.cal
0
0" > ~/MantaRay/TestingRemote/radFiles/mat_normalglow.mat;echo ~/MantaRay/TestingRemote/radFiles/mat_normalglow.mat""")  # -> Stdout, Stderr_, Ran
panel_107 = Panel(overrides_58.Output)
normalshadermat = Text(executessh_51.Stdout)

entwine_11 = Entwine(Branch00=normalshadermat, Branch01=executessh_50.Stdout, FlattenInputs=True)
join_8 = TextJoin(Text=flatten(entwine_11), Join=" ")
overrides_59 = ApplyOverrides(Input=panel_104, Rads=graft(join_8), Target=graft("myNormalsScene.oct"))  # -> Output, DynamicOutput
executessh_52 = ExecuteSSH(
    _SSHCommands=overrides_59.DynamicOutput,
    Run=and_3,
    addPrefix=True,
    description="""mkdir -p ~/MantaRay/Andrei/octrees/
oconv -r 2048 -w -f /home/lio/MantaRay/TestingRemote/radFiles/mat_normalglow.mat ~/MantaRay/TestingRemote/radFiles/RevitJintInnerCW_Glass_80_mat_black.rad ~/MantaRay/TestingRemote/radFiles/RevitJintInnerDoors_80_mat_black.rad ~/MantaRay/TestingRemote/radFiles/Skylights_65_mat_black.rad ~/MantaRay/TestingRemote/radFiles/GlassInt_74_mat_black.rad ~/MantaRay/TestingRemote/radFiles/RevitJfacadeFacadesCWglass_74_mat_black.rad ~/MantaRay/TestingRemote/radFiles/RevitJfacadeWindowGlass_74_mat_black.rad ~/MantaRay/TestingRemote/radFiles/Skylights_55_mat_black.rad ~/MantaRay/TestingRemote/radFiles/RevitJfacadeDoorPanel_70_mat_black.rad /home/lio/MantaRay/TestingRemote/radFiles/RevitJintInnerCW_Glass_80_black.rad /home/lio/MantaRay/TestingRemote/radFiles/RevitJintInnerDoors_80_black.rad /home/lio/MantaRay/TestingRemote/radFiles/Skylights_65_black.rad /home/lio/MantaRay/TestingRemote/radFiles/GlassInt_74_black.rad /home/lio/MantaRay/TestingRemote/radFiles/RevitJfacadeFacadesCWglass_74_black.rad /home/lio/MantaRay/TestingRemote/radFiles/RevitJfacadeWindowGlass_74_black.rad /home/lio/MantaRay/TestingRemote/radFiles/Skylights_55_black.rad /home/lio/MantaRay/TestingRemote/radFiles/RevitJfacadeDoorPanel_70_black.rad > ~/MantaRay/Andrei/octrees/myNormalsScene.oct
echo ~/MantaRay/Andrei/octrees/myNormalsScene.oct""",
    fireLogs=False,
    lastRunTime=65176,
    suppressWarnings=False,
    results="/home/lio/simulation/Boston_Skylights/octrees/myNormalsScene.oct",
    commands="""mkdir -p ~/simulation/Boston_Skylights/octrees/
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""")  # -> Stdout, Stderr_, Ran

panel_108 = Panel("""rpict -vf <vf> -x <x> -y <y> <radOptions> <oct> |
pfilt -x /<ss> -y /<ss> -1 -r 0.7 > <proj>/images/<target>_normals_filt.hdr
echo <proj>/images/<target>_normals_filt.hdr""")
supersampling_4 = Panel("4")
y_10 = RemoteReceiver(y)
x_11 = RemoteReceiver(x_2)
multiplication_7 = Multiplication(A=x_11, B=supersampling_4)
multiplication_8 = Multiplication(A=y_10, B=supersampling_4)
overrides_60 = ApplyOverrides(
    Input=panel_108,
    Vf=graft(view_4),
    X=graft(multiplication_7),
    Y=graft(multiplication_8),
    Target=graft(target),
    RadOptions=graft("-ab 0 -ad 1 -aa 1 -w -av 1 1 1"),
    Oct=graft(executessh_52.Stdout),
    Time=graft("0"),
    H=graft("0"),
    Ss=graft(supersampling_4))  # -> Output, DynamicOutput
panel_109 = Panel(overrides_60.Output)
executessh_53 = ExecuteSSH(
    _SSHCommands=overrides_60.DynamicOutput,
    Run=executessh_52.Ran,
    addPrefix=True,
    description="""rpict -vf /home/lio/MantaRay/Andrei/views/Perspective3.vf -x 20000 -y 10000 -ab 0 -ad 1 -aa 1 -w -av 1 1 1 /home/lio/simulation/Boston_Skylights/octrees/myNormalsScene.oct |
pfilt -x /4 -y /4 -1 -r 0.7 > ~/MantaRay/Andrei/images/0_rtpict_rendering_aa0_20000_sunny_ad32_0_normals_filt.hdr
echo ~/MantaRay/Andrei/images/0_rtpict_rendering_aa0_20000_sunny_ad32_0_normals_filt.hdr""",
    fireLogs=False,
    lastRunTime=32065,
    suppressWarnings=True,
    results="/home/lio/simulation/Boston_Skylights/images/2023_01_09_1607_rtpict_rendering_aa0_20000_sunny_ad32_0_normals_filt.hdr",
    commands="""rpict -vf /home/lio/MantaRay/TestingRemote/views/Perspective1.vf -x 20000 -y 10000 -ab 0 -ad 1 -aa 1 -w -av 1 1 1 /home/lio/simulation/Boston_Skylights/octrees/myNormalsScene.oct |
pfilt -x /4 -y /4 -1 -r 0.7 > ~/simulation/Boston_Skylights/images/2023_01_09_1607_rtpict_rendering_aa0_20000_sunny_ad32_0_normals_filt.hdr
echo ~/simulation/Boston_Skylights/images/2023_01_09_1607_rtpict_rendering_aa0_20000_sunny_ad32_0_normals_filt.hdr""")  # -> Stdout, Stderr, Ran
download_12 = Download(SftpPaths=flatten(executessh_53.Stdout), Run=executessh_53.Ran)  # -> FilePaths, Status, Ran
imageviewer_10 = LBImageViewer(ImagePath_=download_12.FilePaths, _scale_=1, DisableClickable=False, SaveImgWithCoords=False, scale=1)  # -> ImagePath, Values, GIF

# ----
# normalshader
# Save the shader. Remember to set your password.
# 
# source = https://discourse.radiance-online.org/t/rendering-of-normal-map/2471/3
panel_110 = Panel("echo <pw> | sudo -S echo \"<shader>\" > /usr/local/radiance/lib/normalshader.cal")
falsestart_16 = LBFalseStartToggle(False)
panel_111 = Panel("""{
  normalshader.cal

  Look in RADIANCE/lib/rayinit.cal for more info on builtin funcs and vars
}

red = (Nx + 1)/2;
green = (Ny + 1)/2;
blue = (Nz + 1)/2;""")

nickname_2 = GH_PromptInput(Prompt="ssh password?", Ask=falsestart_16)

overrides_61 = ApplyOverrides(Input=panel_110, Pw=graft(nickname_2), Shader=graft(panel_111))  # -> Output, DynamicOutput
executessh_54 = ExecuteSSH(
    _SSHCommands_=overrides_61.DynamicOutput,
    Run=falsestart_16,
    addPrefix=True,
    description="""echo  | sudo -S echo "{
  normalshader.cal

  Look in RADIANCE/lib/rayinit.cal for more info on builtin funcs and vars
}

red = (Nx + 1)/2;
green = (Ny + 1)/2;
blue = (Nz + 1)/2;" > /usr/local/radiance/lib/normalshader.cal""",
    fireLogs=False,
    lastRunTime=57,
    suppressWarnings=False,
    stderr="bash: /usr/local/radiance/lib/normalshader.cal: Permission denied",
    commands="""echo YYOURPASSWORD | sudo -S echo "{
  normalshader.cal

  Look in RADIANCE/lib/rayinit.cal for more info on builtin funcs and vars
}

red = (Nx + 1)/2;
green = (Ny + 1)/2;
blue = (Nz + 1)/2;" > /usr/local/radiance/lib/normalshader.cal""")  # -> Stdout, Stderr_, Ran
panel_112 = Panel(overrides_61.Output)
panel_113 = Panel(executessh_54.Stderr_)

# ----
# Parallel RTPICT render (luminance) no cache
viewfile_6 = Text(executessh_20.Stdout)
octree_8 = Text(executessh_19.Stdout)
octree_overcast_3 = Text(octree_overcast)
entwine_12 = Entwine(Branch00=octree_overcast_3, Branch01=octree_8, FlattenInputs=True)  # -> flatten(Result)
panel_114 = Panel("""mkdir -p <proj>/images/
rtpict -n <cpus-1> -w -vf <vf> -x <x> -y <y> <radOptions> <oct> | pfilt -x /<ss> -y /<ss> -r 0.7 > <proj>/images/<target>;echo <proj>/images/<target>""")
octree_9 = Text(graft(entwine_12))
list_3 = ItemSelector(
    octree_9,
    {"/home/lio/MantaRay/Andrei/octrees/Scene_Overcast10klux.oct", "/home/lio/MantaRay/Andrei/octrees/my_test_scene_0800.oct", "/home/lio/MantaRay/Andrei/octrees/my_test_scene_0900.oct", "/home/lio/MantaRay/Andrei/octrees/my_test_scene_1000.oct", "/home/lio/MantaRay/Andrei/octrees/my_test_scene_1100.oct", "/home/lio/MantaRay/Andrei/octrees/my_test_scene_1200.oct", "/home/lio/MantaRay/Andrei/octrees/my_test_scene_1300.oct", "/home/lio/MantaRay/Andrei/octrees/my_test_scene_1400.oct", "/home/lio/MantaRay/Andrei/octrees/my_test_scene_1500.oct", "/home/lio/MantaRay/Andrei/octrees/my_test_scene_1600.oct", "/home/lio/MantaRay/Andrei/octrees/my_test_scene_1700.oct"}, selected="/home/lio/MantaRay/Andrei/octrees/my_test_scene_1300.oct")
eval_2 = Evaluate(F="x=y", x=octree_9, y=list_3)
run_7 = LBFalseStartToggle(False)

hours_8 = Text(hours_2)
entwine_13 = Entwine(Branch00="ovc", Branch01=hours_8, FlattenInputs=True)  # -> flatten(Result)
cull_5 = CullPattern(List=graft(entwine_13), CullPattern=eval_2)  # -> flatten(List)
hours_9 = Text(cull_5)

overrides_62 = ApplyOverrides(
    Input=panel_114,
    Vf=graft(viewfile_6),
    X=graft(multiplication),
    Y=graft(multiplication_2),
    RadOptions=graft("-ab 3 -ad 16 -aa 0"),
    Oct=graft(list_3),
    Target=graft("<time>_rtpict_rendering_aa0_<x>_sunny_ad16_<h>.hdr"),
    Time=graft("<time>"),
    H=graft(hours_9),
    Text=graft(supersampling))  # -> Output, DynamicOutput
python_22 = GhPythonScript(update=flatten(overrides_62.Output))  # -> time; inputs update: tree; same code as python_8

# ----
# Parallel RTPICT render (Illuminance)
# (takes 2.5X longer than above...)
# mkdir -p <proj>/images/
# rtpict -i -w -n 30 -vf <vf> -x <x> -y <y> <radOptions> <oct> | pfilt -x /4 -y /4 -r 0.7 > <proj>/images/<target>;echo <proj>/images/<target>
viewfile_7 = Text(executessh_20.Stdout)
panel_115 = Panel("""mkdir -p <proj>/images/
rtpict -i -w -n <cpus-2> -vf <vf> -x <x> -y <y> <radOptions> <oct> | pfilt -x /<ss> -y /<ss> -r 0.7 > <proj>/images/<target>;echo <proj>/images/<target>""")
run_8 = LBFalseStartToggle(False)
x_12 = RemoteReceiver(x_2)
y_11 = RemoteReceiver(y)
overrides_63 = ApplyOverrides(
    Input=panel_115,
    Vf=graft(viewfile_7),
    X=graft(x_12),
    Y=graft(y_11),
    RadOptions=graft("-ab 3 -ad 16 -aa 0"),
    Oct=graft(list_3),
    Target=graft("<time>_rtpict_rendering_aa0_<x>_sunny_ad8_<h>_illum.hdr"),
    Time=graft(python_22),
    H=graft(hours_9),
    Text=graft(supersampling))  # -> Output, DynamicOutput
executessh_55 = ExecuteSSH(
    _SSHCommands_=flatten(overrides_63.DynamicOutput),
    Run=run_8,
    addPrefix=True,
    description="""mkdir -p ~/MantaRay/Andrei/images/
rtpict -i -w -n 61 -vf /home/lio/MantaRay/Andrei/views/Perspective3.vf -x 5000 -y 2500 -ab 3 -ad 16 -aa 0 /home/lio/MantaRay/Andrei/octrees/my_test_scene_1300.oct | pfilt -x /4 -y /4 -r 0.7 > ~/MantaRay/Andrei/images/2023_03_12_2232_04_rtpict_rendering_aa0_5000_sunny_ad8_1300_illum.hdr;echo ~/MantaRay/Andrei/images/2023_03_12_2232_04_rtpict_rendering_aa0_5000_sunny_ad8_1300_illum.hdr""",
    fireLogs=False,
    lastRunTime=0,
    suppressWarnings=False)  # -> Stdout, Stderr_, Ran

overrides_64 = ApplyOverrides(Input=overrides_62.DynamicOutput, Time=graft(python_22))  # -> Output, DynamicOutput
executessh_56 = ExecuteSSH(
    _SSHCommands_=flatten(overrides_64.DynamicOutput),
    Run=run_7,
    addPrefix=True,
    description="""mkdir -p ~/MantaRay/Andrei/images/
rtpict -n 62 -w -vf /home/lio/MantaRay/Andrei/views/Perspective3.vf -x 20000 -y 10000 -ab 3 -ad 16 -aa 0 /home/lio/MantaRay/Andrei/octrees/my_test_scene_1300.oct | pfilt -x /4 -y /4 -r 0.7 > ~/MantaRay/Andrei/images/2023_03_12_2232_04_rtpict_rendering_aa0_20000_sunny_ad16_1300.hdr;echo ~/MantaRay/Andrei/images/2023_03_12_2232_04_rtpict_rendering_aa0_20000_sunny_ad16_1300.hdr""",
    fireLogs=False,
    lastRunTime=0,
    suppressWarnings=False)  # -> Stdout, Stderr_, Ran

# ----
# orig dimensions
panel_116 = Panel("getinfo <f>")
overrides_65 = ApplyOverrides(Input=panel_116, F=graft(executessh_55.Stdout))  # -> Output, DynamicOutput
executessh_57 = ExecuteSSH(
    _SSHCommands_=overrides_65.DynamicOutput,
    Run=executessh_55.Ran,
    addPrefix=True,
    description="getinfo <f>",
    fireLogs=False,
    lastRunTime=0,
    suppressWarnings=False)  # -> Stdout, Stderr_, Ran
python_23 = GhPythonScript(x=executessh_57.Stdout)  # -> out, org_y
# ---------- python_23: Python ----------
__author__ = "mm1013"
__version__ = "2022.08.31"

import rhinoscriptsyntax as rs

lines = x.replace("\r","").split("\n")

for l in lines:
    line = l.strip()
    if line.startswith("rtrace"):
        print "RTRACE"
        li = line.split("-y")
        
        print li[1].strip().split(" ")[0]
        org_y = int(li[1].strip().split(" ")[0])
    elif line.startswith("pfilt"):
        print "PFIlT"
        li = line.split("-y")
        
        print li[1].strip().split(" ")[0]
        org_y = org_y / float(li[1].strip().split(" ")[0].replace("/",""))
# ---------- end python_23 ----------

panel_117 = Panel("""pcond -h <hdr> <hdr-.>_exposed.hdr
ra_tiff <hdr-.>_exposed.hdr <hdr-.>_exposed.tif
convert <hdr-.>_exposed.tif <hdr-.>_exposed.png
echo <hdr-.>_exposed.png""")
panel_118 = Panel("""ra_tiff <hdr-.>.hdr <hdr-.>.tif
convert <hdr-.>.tif <hdr-.>.png
echo <hdr-.>.png""")
entwine_14 = Entwine(Branch00=panel_117, Branch01=panel_118, FlattenInputs=True)
overrides_66 = ApplyOverrides(Input=entwine_14, Hdr=graft(executessh_56.Stdout))  # -> Output, DynamicOutput
executessh_58 = ExecuteSSH(
    _SSHCommands_=overrides_66.DynamicOutput,
    Run=executessh_56.Ran,
    addPrefix=True,
    description="""pcond -h <hdr> <hdr>_exposed.hdr
ra_tiff <hdr>_exposed.hdr <hdr>_exposed.tif
convert <hdr>_exposed.tif <hdr>_exposed.png
echo <hdr>_exposed.png


- - -

ra_tiff <hdr>.hdr <hdr>.tif
convert <hdr>.tif <hdr>.png
echo <hdr>.png""",
    fireLogs=False,
    lastRunTime=0,
    suppressWarnings=False)  # -> Stdout, Stderr_, Ran
download_13 = Download(LinuxFilePaths=executessh_58.Stdout, Run=executessh_58.Ran)  # -> flatten(FilePaths), Status, Ran
item_5 = ListItem(List=download_13.FilePaths, Index=0, Wrap=True)  # -> Item, Item1
imageviewer_11 = LBImageViewer(ImagePath_=item_5.Item, _scale_=3, DisableClickable=False, SaveImgWithCoords=False, scale=3)  # -> ImagePath, Values, GIF

# ----
# blurring the irrad
panel_119 = Panel("pfilt -x /3 -y /3 -r 1 <file> | pfilt -1 -x <x> -y <y> > <file-.>_filteredBlur.hdr;ra_tiff <file-.>_filteredBlur.hdr <file-.>_filteredBlur.tif;echo <file-.>_filteredBlur.hdr")
overrides_67 = ApplyOverrides(Input=panel_119, File=graft(executessh_55.Stdout), X=graft(x_6), Y=graft(python_23.org_y))  # -> Output, DynamicOutput
executessh_59 = ExecuteSSH(
    _SSHCommands_=overrides_67.DynamicOutput,
    Run=executessh_55.Ran,
    addPrefix=True,
    description="pfilt -x /3 -y /3 -r 1 <file> | pfilt -1 -x 5000 -y <y> > <file>_filteredBlur.hdr;ra_tiff <file>_filteredBlur.hdr <file>_filteredBlur.tif;echo <file>_filteredBlur.hdr",
    fireLogs=False,
    lastRunTime=0,
    suppressWarnings=False)  # -> Stdout, Stderr_, Ran

# ----
# overlay illuminance falsecolor on luminance picture
panel_120 = Panel("""pcond -h <rad> | pfilt -x /2 -y /2 -r 0.7 > <rad-.>exposed_sd.hdr
pfilt -x /2 -y /2 -r 0.7 <irrad> > <irrad-.>_sd.hdr
falsecolor -s 2000 -l lux -lw 200 -lh 300 -p <rad-.>exposed_sd.hdr -i <irrad-.>_sd.hdr -cl > <rad-.>_fc.hdr
ra_tiff <rad-.>_fc.hdr <rad-.>_fc.tif
convert <rad-.>_fc.tif <rad-.>_fc.png
echo <rad-.>_fc.hdr""")
panel_121 = Panel("-log 2")
overrides_68 = ApplyOverrides(Input=panel_120, Rad=graft(executessh_56.Stdout), Irrad=graft(executessh_59.Stdout))  # -> Output, DynamicOutput
executessh_60 = ExecuteSSH(
    _SSHCommands_=overrides_68.DynamicOutput,
    Run=[executessh_55.Ran, executessh_56.Ran],
    addPrefix=True,
    description="""pcond -h <rad> | pfilt -x /2 -y /2 -r 0.7 > <rad>exposed_sd.hdr
pfilt -x /2 -y /2 -r 0.7 <irrad> > <irrad>_sd.hdr
falsecolor -s 2000 -l lux -lw 200 -lh 300 -p <rad>exposed_sd.hdr -i <irrad>_sd.hdr -cl > <rad>_fc.hdr
ra_tiff <rad>_fc.hdr <rad>_fc.tif
convert <rad>_fc.tif <rad>_fc.png
echo <rad>_fc.hdr""",
    fireLogs=False,
    lastRunTime=0,
    suppressWarnings=False)  # -> Stdout, Stderr_, Ran
download_14 = Download(LinuxFilePaths=executessh_60.Stdout, Run=executessh_60.Ran)  # -> FilePaths, Status, Ran
imageviewer_12 = LBImageViewer(ImagePath_=download_14.FilePaths, _scale_=2, DisableClickable=False, SaveImgWithCoords=False, scale=2)  # -> ImagePath, Values, GIF

# ----
# save pngs exposed and raw
panel_122 = Panel("""ra_tiff <hdr-.>.hdr <hdr-.>.tif
convert <hdr-.>.tif <hdr-.>.png
rm <hdr-.>.tif
echo <hdr-.>.png""")
panel_123 = Panel("""pcond -h <hdr> <hdr-.>_exposed.hdr
ra_tiff <hdr-.>_exposed.hdr <hdr-.>_exposed.tif
convert <hdr-.>_exposed.tif <hdr-.>_exposed.png
rm <hdr-.>_exposed.tif
rm <hdr-.>_exposed.hdr
echo <hdr-.>_exposed.png""")
entwine_15 = Entwine(Branch00=panel_123, Branch01=panel_122, FlattenInputs=True)
overrides_69 = ApplyOverrides(Input=entwine_15, Hdr=graft(executessh_55.Stdout))  # -> Output, DynamicOutput
executessh_61 = ExecuteSSH(
    _SSHCommands_=overrides_69.DynamicOutput,
    Run=executessh_55.Ran,
    addPrefix=True,
    description="""pcond -h <hdr> <hdr>_exposed.hdr
ra_tiff <hdr>_exposed.hdr <hdr>_exposed.tif
convert <hdr>_exposed.tif <hdr>_exposed.png
rm <hdr>_exposed.tif
rm <hdr>_exposed.hdr
echo <hdr>_exposed.png


- - -

ra_tiff <hdr>.hdr <hdr>.tif
convert <hdr>.tif <hdr>.png
rm <hdr>.tif
echo <hdr>.png""",
    fireLogs=False,
    lastRunTime=0,
    suppressWarnings=False)  # -> Stdout, Stderr_, Ran
download_15 = Download(LinuxFilePaths=executessh_61.Stdout, Run=executessh_61.Ran)  # -> flatten(FilePaths), Status, Ran
item_6 = ListItem(List=download_15.FilePaths, Index=0, Wrap=True)  # -> Item, Item1
imageviewer_13 = LBImageViewer(ImagePath_=item_6.Item, _scale_=2, DisableClickable=False, SaveImgWithCoords=False, scale=2)  # -> ImagePath, Values, GIF
imageviewer_14 = LBImageViewer(ImagePath_=item_6.Item1, _scale_=2, DisableClickable=False, SaveImgWithCoords=False, scale=2)  # -> ImagePath, Values, GIF

# ----
# FalseColor
panel_124 = Panel("""pfilt -x /2 -y /2 -r 0.7 <irrad> | falsecolor -s 2000 -l lux -lw 200 -lh 300 > <irrad-.>_fc2.hdr
ra_tiff <irrad-.>_fc2.hdr <irrad-.>_fc2.tif
convert <irrad-.>_fc2.tif <irrad-.>_fc2.png
rm <irrad-.>_fc2.hdr
rm <irrad-.>_fc2.tif
echo <irrad-.>_fc2.png""")
overrides_70 = ApplyOverrides(Input=panel_124, Irrad=graft(executessh_55.Stdout))  # -> Output, DynamicOutput
executessh_62 = ExecuteSSH(
    _SSHCommands_=overrides_70.DynamicOutput,
    Run=executessh_55.Ran,
    addPrefix=True,
    description="""pfilt -x /2 -y /2 -r 0.7 <irrad> | falsecolor -s 2000 -l lux -lw 200 -lh 300 > <irrad>_fc2.hdr
ra_tiff <irrad>_fc2.hdr <irrad>_fc2.tif
convert <irrad>_fc2.tif <irrad>_fc2.png
rm <irrad>_fc2.hdr
rm <irrad>_fc2.tif
echo <irrad>_fc2.png""",
    fireLogs=False,
    lastRunTime=0,
    suppressWarnings=False)  # -> Stdout, Stderr_, Ran
download_16 = Download(LinuxFilePaths=executessh_62.Stdout, Run=executessh_62.Ran)  # -> FilePaths, Status, Ran
imageviewer_15 = LBImageViewer(ImagePath_=download_16.FilePaths, _scale_=2, DisableClickable=False, SaveImgWithCoords=False, scale=2)  # -> ImagePath, Values, GIF

panel_125 = Panel("""mkdir -p <proj>/views/
echo "<vf>" > <proj>/views/<target>.vf
echo <proj>/views/<target>.vf""")
concat_8 = Concatenate(FragmentA="Perspective", FragmentB="1")

# ----
# Doubleclick Me To update view
view_5 = CreateView(Viewport="Perspective")  # -> ViewfileContent, ImageRatio

panel_126 = Panel(view_5.ViewfileContent)
vf_4 = Text(view_5.ViewfileContent)
overrides_71 = ApplyOverrides(Input=panel_125, Vf=graft(vf_4), Target=graft(concat_8))  # -> Output, DynamicOutput
executessh_63 = ExecuteSSH(
    _SSHCommands_=overrides_71.DynamicOutput,
    Run=Toggle(True),
    addPrefix=True,
    description="""mkdir -p ~/MantaRay/Andrei/views/
echo "rvu -vtv -vp 76.210958985352 16.4300937305602 1.83584927923156 -vd -0.349680913647465 0.927360836447747 0.133135786524922 -vu 0.0469732080515546 -0.124573895254805 0.991097806649975 -vh 103.466 -vv 50.000" > ~/MantaRay/Andrei/views/Perspective1.vf
echo ~/MantaRay/Andrei/views/Perspective1.vf""",
    fireLogs=False,
    lastRunTime=80.9886,
    suppressWarnings=False,
    results="/home/lio/MantaRay/Andrei/views/Perspective1.vf",
    commands="""mkdir -p ~/MantaRay/Andrei/views/
echo "rvu -vtv -vp 76.210958985352 16.4300937305602 1.83584927923156 -vd -0.349680913647465 0.927360836447747 0.133135786524922 -vu 0.0469732080515546 -0.124573895254805 0.991097806649975 -vh 103.466 -vv 50.000" > ~/MantaRay/Andrei/views/Perspective1.vf
echo ~/MantaRay/Andrei/views/Perspective1.vf""")  # -> Stdout, Stderr_, Ran

# ----
# VIEW
file_exists_2 = Panel("[ -f <out> ] && echo \"1\" || echo \"0\"")
item_7 = ListItem(List=flatten(executessh_63.Stdout), Index=0, Wrap=True)
panel_127 = Panel(executessh_63.Stdout)
overrides_72 = ApplyOverrides(Input=file_exists_2, Out=graft(item_7))  # -> Output, DynamicOutput
executessh_64 = ExecuteSSH(
    _SSHCommands_=overrides_72.DynamicOutput,
    Run=executessh_17.Ran,
    addPrefix=True,
    description="[ -f /home/lio/MantaRay/Andrei/views/Perspective1.vf ] && echo \"1\" || echo \"0\"",
    fireLogs=False,
    lastRunTime=57.7387,
    suppressWarnings=False,
    results="1",
    commands="[ -f /home/lio/MantaRay/Andrei/views/Perspective1.vf ] && echo \"1\" || echo \"0\"")  # -> Stdout, Stderr_, Ran

# ----
# Parallel ACCELERAD RTRACE render
# echo "rvu -vtv -vp 0.5 4.5 1.6 -vd 0.830824 -1.13002 -0.181063 -vu 0 0 1 -vh 98.2132 -vv 79.2785 -vo 0 -va 0 -vs 0 -vl 0" > <proj>/views/myview.vf;echo <proj>/views/myview.vf
run_9 = LBFalseStartToggle(False)
octree_10 = Text(executessh_17.Stdout)
viewfile_8 = Text(executessh_63.Stdout)
panel_128 = Panel("""mkdir -p <proj>/images/
vwrays -ff -x <x> -y <y> -vf <vf> -pa 1 | accelerad_rtrace <radOptions> -w `vwrays -d -ff -x <x> -y <y> -vf <vf> -pa 1` -ffc <oct> > <proj>/images/<target-.>.hdr
echo <proj>/images/<target-.>.hdr""")
panel_129 = Panel("-ab 3 -ad 2048")
overrides_73 = ApplyOverrides(
    Input=panel_128,
    X=graft("600"),
    Y=graft("300"),
    Vf=graft(viewfile_8),
    RadOptions=graft("-as 0 -ab 3 -aa 0.2 -ad 128"),
    Oct=graft(octree_10),
    Target=graft("accelerad_rtrace_rendering.png"))  # -> Output, DynamicOutput
executessh_65 = ExecuteSSH(
    _SSHCommands_=overrides_73.DynamicOutput,
    Run=run_9,
    addPrefix=True,
    description="""mkdir -p ~/MantaRay/Andrei/images/
vwrays -ff -x 600 -y 300 -vf /home/lio/MantaRay/Andrei/views/Perspective1.vf -pa 1 | accelerad_rtrace -as 0 -ab 3 -aa 0.2 -ad 128 -w `vwrays -d -ff -x 600 -y 300 -vf /home/lio/MantaRay/Andrei/views/Perspective1.vf -pa 1` -ffc /home/lio/MantaRay/Andrei/octrees/Scene_Overcast10klux.oct > ~/MantaRay/Andrei/images/accelerad_rtrace_rendering.hdr
echo ~/MantaRay/Andrei/images/accelerad_rtrace_rendering.hdr""",
    fireLogs=False,
    lastRunTime=535,
    suppressWarnings=False,
    results="/home/mss/simulation/Boston_Skylights/images/accelerad_rtrace_rendering.hdr",
    stderr="""accelerad_rtrace: internal - A supported NVIDIA GPU could not be found
(/media/nathaniel/DATA/Accelerad/src/rt/optix_radiance.c:255)""",
    commands="""mkdir -p ~/simulation/Boston_Skylights/images/
vwrays -ff -x 600 -y 300 -vf /home/mss/MantaRay/UnnamedProject/views/Perspective1.vf -pa 1 | accelerad_rtrace -as 0 -ab 3 -aa 0.2 -ad 128 -w `vwrays -d -ff -x 600 -y 300 -vf /home/mss/MantaRay/UnnamedProject/views/Perspective1.vf -pa 1` -ffc /home/mss/MantaRay/UnnamedProject/octrees/my_test_scene.oct > ~/simulation/Boston_Skylights/images/accelerad_rtrace_rendering.hdr
echo ~/simulation/Boston_Skylights/images/accelerad_rtrace_rendering.hdr""")  # -> Stdout, Stderr_, Ran
panel_130 = Panel(executessh_65.Stderr_)

# ----
# Using PCOND to set automatic exposure
# and convert to PNG
panel_131 = Panel("""pcond -h <hdr> <hdr-.>_exposed.hdr
ra_tiff <hdr-.>_exposed.hdr <hdr-.>_exposed.tif
convert <hdr-.>_exposed.tif <hdr-.>_exposed.png
echo <hdr-.>_exposed.png""")
overrides_74 = ApplyOverrides(Input=panel_131, Hdr=graft(executessh_65.Stdout))  # -> Output, DynamicOutput
executessh_66 = ExecuteSSH(
    _SSHCommands_=overrides_74.DynamicOutput,
    Run=executessh_65.Ran,
    addPrefix=True,
    description="""pcond -h /home/mss/simulation/Boston_Skylights/images/accelerad_rtrace_rendering.hdr /home/mss/simulation/Boston_Skylights/images/accelerad_rtrace_rendering_exposed.hdr
ra_tiff /home/mss/simulation/Boston_Skylights/images/accelerad_rtrace_rendering_exposed.hdr /home/mss/simulation/Boston_Skylights/images/accelerad_rtrace_rendering_exposed.tif
convert /home/mss/simulation/Boston_Skylights/images/accelerad_rtrace_rendering_exposed.tif /home/mss/simulation/Boston_Skylights/images/accelerad_rtrace_rendering_exposed.png
echo /home/mss/simulation/Boston_Skylights/images/accelerad_rtrace_rendering_exposed.png""",
    fireLogs=False,
    lastRunTime=546,
    suppressWarnings=False,
    results="/home/mss/MantaRay/UnnamedProject/images/rtrace_rendering_exposed.png",
    commands="""pcond -h /home/mss/MantaRay/UnnamedProject/images/rtrace_rendering.hdr /home/mss/MantaRay/UnnamedProject/images/rtrace_rendering_exposed.hdr
ra_tiff /home/mss/MantaRay/UnnamedProject/images/rtrace_rendering_exposed.hdr /home/mss/MantaRay/UnnamedProject/images/rtrace_rendering_exposed.tif
convert /home/mss/MantaRay/UnnamedProject/images/rtrace_rendering_exposed.tif /home/mss/MantaRay/UnnamedProject/images/rtrace_rendering_exposed.png
echo /home/mss/MantaRay/UnnamedProject/images/rtrace_rendering_exposed.png""")  # -> Stdout, Stderr_, Ran
download_17 = Download(LinuxFilePaths=executessh_66.Stdout, Run=executessh_66.Ran)  # -> FilePaths, Status, Ran
imageviewer_16 = LBImageViewer(ImagePath_=download_17.FilePaths, _scale_="1.5", DisableClickable=False, SaveImgWithCoords=False, scale=1.5)  # -> ImagePath, Values, GIF

# ==== cluster DefaultMSS
default_value_flattened = ClusterInput()
data = ClusterInput()
data_2 = Data(data)
merge = Merge(Data1=flatten(data_2), Data2="0")  # -> flatten(Result)
default_value_flattened_2 = Data(flatten(default_value_flattened))
lng = ListLength(List=merge)
equals = Equality(FirstNumber=lng, SecondNumber="1")  # -> Equality, Inequality
cull = CullPattern(List=data_2, CullPattern=invert(equals.Equality))
panel = Panel(equals.Equality)
cull_2 = CullPattern(List=default_value_flattened_2, CullPattern=equals.Equality)
data_3 = Data([cull, cull_2])
data_4 = ClusterOutput(data_3)

# ==== cluster LargestBREP
window_breps = ClusterInput()
window_breps_2 = Brep(window_breps)
debrep = DeconstructBrep(Brep=window_breps_2)  # -> Faces, Edges, Vertices
area = Area(Geometry=debrep.Faces)  # -> Area, Centroid
sort = SortList(Keys=area.Area, ValuesA=debrep.Faces)  # -> Keys, ValuesA
item = ListItem(List=sort.ValuesA, Index=-1, Wrap=True)
group = Group(Objects=flatten(item))
grouped = ClusterOutput(group)

# ==== cluster Cluster
mod = ClusterInput()
python = GhPythonScript(mod=mod)  # -> name_geo, name_mod; inputs mod: list
# ---------- python: Python ----------
__author__ = "mm1013"
__version__ = "2023.03.11"

import re

regex = re.compile('[^a-zA-Z0-9_.]')

import rhinoscriptsyntax as rs



name_geo = [regex.sub('_',m.split("\n")[0].split(" ")[2]) + "_geo" for m in mod]
name_mod = [regex.sub('_',m.split("\n")[0].split(" ")[2]) for m in mod]
# ---------- end python ----------
name_mod = ClusterOutput(python.name_mod)
name_geo = ClusterOutput(python.name_geo)

# ==== cluster Cluster_2
L = ClusterInput()
lng = ListLength(List=L)
default = DefaultMSS(data=flatten(lng), default_value_flattened=flatten("0"))
bool = Boolean(default)
bool_2 = ClusterOutput(bool)
